# Grasshopper definition zoning.gh (Grasshopper 1.0.7)

# 사용방법!!
# 1. "spacename 실면적"
# 과 같은 방식으로 입력해야함 실이름은 띄어쓰기가 없어야함.
# 
# 2. 맨끝에 입력에 엔터, 즉 개행문자가 들어가면안됨.
# 
# 3. 가로길이가 세로길이의 4배가 넘어가는 경우는 배제했음. 필요하면 코드수정하면됨
# 
# 4. 글씨는 바로 바로 지워지니 라이노창에서 드래그해서 지우면됨
# 
# 5. 쓰리디 프린터로 뽑거나, 우드락으로 대고 잘라서 사용하면 편해보여서 만들었는데 저작권은
# 내가 만들어서 없으니까. 걍 공유해도 가능함.
# 
# (by in_chanchan)
panel = Panel("""촬영스튜디오 75
대극장 1000
소극장 600
소품실 70
기계실 150
회의실 250
화장실 34""")
c_script = CSharpScript(x=panel, fontsize=Slider(1000, range=0..10000))  # -> out, rectangles; inputs x: String, fontsize: Double
# ---------- c_script: C# ----------
    string[] parts = x.Split('\n');
    List<List<Rectangle3d>> rectList2D = new List<List<Rectangle3d>>();
    List<string> nameSpace = new List<string>();
    foreach(var i in parts)
    {
      string[] j = i.Split(' ');
      string a = j[0];
      int b = 0;
      int u;
      if(int.TryParse(j[1], out u))
      {
        b = u * 1000000;
      }

      List<Tuple<int, int>> lists = divideNum(b);
      if(lists.Count > 0) // Ensure we have some factors
      {
        List<Rectangle3d> innerList = new List<Rectangle3d>();
        for(int k = 0; k < lists.Count; k++){
          var tuple = lists[k];
          Rectangle3d rect = new Rectangle3d(Plane.WorldXY, tuple.Item1, tuple.Item2);
          innerList.Add(rect);
          nameSpace.Add(a);
        }
        rectList2D.Add(innerList);
      }
    }
    List<Rectangle3d> arrangedRects = ArrangeRectangles(rectList2D, 10000.0, 20000.0);
    rectangles = arrangedRects;
    DisplayAreaOnCenter(arrangedRects, nameSpace, fontsize);
    double textHeight = fontsize;  // 텍스트 높이 설정
    foreach (var rect in arrangedRects)
    {
      DisplayRectangleDimensions(rect, textHeight);
    }
# ---------- c_script: C# additional code ----------
  //가로 세로 뽑아내는 함수.
  private List<Tuple<int, int>> divideNum(int n)
  {
    List<Tuple<int, int>> factors = new List<Tuple<int, int>>();
    for(int i = 3000; i * i <= n; i += 50)
    {
      if(n % i == 0){
        if(i * 4 < n / i) continue;
        factors.Add(new Tuple<int, int>(i, n / i));
      }
    }
    return factors;
  }
  //2차원 평면을 1차원으로 바꾸고 정렬하기.
  private List<Rectangle3d> ArrangeRectangles(List<List<Rectangle3d>> rectList2D, double xSpacing, double ySpacing)
  {
    List<Rectangle3d> result = new List<Rectangle3d>();
    double yOffset = -rectList2D[0][0].Height + ySpacing;
    for (int i = 0; i < rectList2D.Count; i++)
    {
      double xOffset = 0.0;
      for (int j = 0; j < rectList2D[i].Count; j++)
      {
        Rectangle3d rect = rectList2D[i][j];
        Transform translation = Transform.Translation(xOffset, yOffset, 0);
        rect.Transform(translation);
        result.Add(rect);
        xOffset += rect.Width + xSpacing;
      }
      if( i + 1 < rectList2D.Count)
      {
        yOffset -= rectList2D[i + 1][0].Height + ySpacing;
      }
    }
    return result;
  }
  //면적을 적어보자.
  private void DisplayAreaOnCenter(List<Rectangle3d> rectangles, List<string> name, double fontsize)
  {
    int id = 0;
    foreach (var rect in rectangles)
    {
      double area = rect.Area / 1000000;
      string name1 = name[id] + "\n" + area.ToString() + "m2";
      Plane rectPlane = rect.Plane;
      Plane centerPlane = new Plane(rect.Center, rectPlane.Normal);
      Rhino.RhinoDoc.ActiveDoc.Objects.AddText(name1, centerPlane, fontsize, "Arial", true, false);
      id += 1;
    }
  }
  private void AddDimensionText(Point3d location, string text, double height, double rotationDegree = 0.0)
  {
    Plane textPlane = new Plane(location, Vector3d.ZAxis);

    if (Math.Abs(rotationDegree) > 0.01)
    {
      Transform rotation = Transform.Rotation(Rhino.RhinoMath.ToRadians(rotationDegree), textPlane.Normal, textPlane.Origin);
      textPlane.Transform(rotation);
    }

    Rhino.RhinoDoc.ActiveDoc.Objects.AddText(text, textPlane, height, "Arial", true, true);
  }

  private void DisplayRectangleDimensions(Rectangle3d rect, double textHeight)
  {

    Point3d midPointBottom = (rect.Corner(0) + rect.Corner(3)) * 0.5;
    Point3d midPointLeft = (rect.Corner(0) + rect.Corner(1)) * 0.5;

    AddDimensionText(midPointBottom, rect.Height.ToString(), textHeight, -90.0);
    AddDimensionText(midPointLeft, rect.Width.ToString(), textHeight);

  }
# ---------- end c_script ----------
panel_2 = Panel(c_script.out)
