# Grasshopper definition plan_generator.gh (Grasshopper 1.0.7)
# plug-ins: Kangaroo2 Components

panel = Panel("C:\Users\BaekInchan\Documents\AI-based-Architectural-Design-Automation\02_plan_generator\room.py")
series = Series(Start=0, Step=1, Count=Slider(6, range=0..6))
panel_2 = Panel("""livingroom
master_bedroom
guest_bedroom
kitchen
master_bath
guest_bath""")
width = Panel("""30
20
20
15
15
10""")
depth = Panel("""40
30
25
20
15
15""")
panel_3 = Panel("""livingroom
master_bedroom
guest_bedroom
kitchen
master_bath
guest_bath
room1
room2
room3""")
width_2 = Panel("""30
20
20
15
15
10
12
15
18""")
depth_2 = Panel("""40
30
25
20
15
15
20
25
15""")
ltv = LinkToVscode(RunVSCode=Toggle(True), file=panel)  # -> out, Code; inputs RunVSCode: Boolean
# ---------- ltv: Python ----------
import rhinoscriptsyntax as rs
import os
import subprocess
VSCode = 'C:\Users\BaekInchan\AppData\Roaming\Microsoft\Windows\Start Menu\Programs\Visual Studio Code\Visual Studio Code.lnk'
vscode_path = VSCode.replace('\\', '\\\\')
file_path = file.replace('\\', '\\\\')
command = [file_path]
process_name = 'Code'

def save_file(file_path):
    subprocess.Popen([vscode_path, '--command', 'workbench.action.files.save'], shell=True)
    
def run_vscode():
    subprocess.Popen(command, shell=True)
    
def close_vscode():
    save_file(file_path)
    subprocess.Popen(['taskkill', '/F', '/IM', process_name + '.exe'], shell=True)
    
def copy_content(file_path):
    with open(file_path, 'r') as file:
        file_content = file.read()
    return file_content
    
if(RunVSCode):
    if os.path.exists(file):
        run_vscode()
        content = copy_content(file_path)
        Code = content
# ---------- end ltv ----------
python = GhPythonScript()  # -> out, room
# ---------- python: Python ----------
import rhinoscriptsyntax as rs
import Rhino.Geometry as rg
import ghpythonlib.componentbase
import math
import time
import System.Drawing as sd
import random
import json



class Room:
    def __init__ (self, room_name, depth, width, location):
        self.room_name = room_name
        self.depth = depth
        self.width = width
        self.location = location

    def area(self):
        return self.depth * self.width
    
    def visual_3d(self):
        crv = rg.Rectangle3d(self.location,rg.Interval(-self.width/2, self.width/2), rg.Interval(-self.depth/2, self.depth/2))
        crv = crv.ToNurbsCurve()
        height = 12
        result = rg.Extrusion.Create(crv, height, True)
        return result, crv
       

room = Room
# ---------- end python ----------
item = ListItem(List=depth, Index=series, Wrap=True)
item_2 = ListItem(List=width, Index=series, Wrap=True)
item_3 = ListItem(List=panel_2, Index=series, Wrap=True)
pt = Point(Point(-9.812949736, -48.40960034, 0))
python_2 = GhPythonScript(room=python.room, seed=Slider(73, range=0..100), rooms=panel_3, widths=width_2, depths=depth_2, origin=pt)  # -> out, rooms_3d, initial_rooms, rooms_areas, floor_network; inputs rooms: list, widths: list of Int32, depths: list of Int32, origin: Point3d
# ---------- python_2: Python ----------
import rhinoscriptsyntax as rs
import Rhino.Geometry as rg
import ghpythonlib.componentbase
import random
import math
import time

random.seed(seed)

class Floorplan:
    def __init__ (self, room_names, widths, depths, origin):
        self.room_names = room_names
        self.widths = widths
        self.depths = depths
        self.origin = origin
        self.rooms = []
        self.areas = []
    
    def initialize(self):
        self.initialize_rooms()
        
    def initialize_rooms(self):
        initial_room_names = self.room_names
        initial_widths = self.widths
        initial_depths = self.depths
        self.network, initial_locations = self.distribution_network()
        for i in range(len(initial_room_names)):
            cur_room = room(initial_room_names[i], initial_depths[i], initial_widths[i], initial_locations[i])
            self.rooms.append(cur_room)

    
    def distribution_network(self):
        cnt = self.origin
        print(cnt)
        k = len(self.room_names)
        nums = list(range(k))
        random.shuffle(nums)
        lines = []
        locations = []
        rotation = 2 * math.pi / k;
        for num in nums:
            r = k * 15
            pt = rg.Point3d(cnt.X + random.uniform(r/2, r) * math.cos(rotation*num), cnt.Y + random.uniform(r/2, r) * math.sin(rotation*num),0)
            pt_plane = rg.Plane(pt, rg.Vector3d.ZAxis)
            pt_plane.Rotate(0, rg.Vector3d.ZAxis, pt_plane.Origin)
            locations.append(pt_plane)
            line = rg.Line(cnt, pt)
            lines.append(line)
        return lines, locations
        



floor = Floorplan(rooms, widths, depths,origin)
floor.initialize()
initial_rooms = []
rooms_3d = []
rooms_areas = []
floor_network = floor.network

for room in floor.rooms:
    room_3d,room_2d = room.visual_3d()
    initial_rooms.append(room_2d)
    rooms_3d.append(room_3d)
    rooms_areas.append(room.area())
# ---------- end python_2 ----------
crv = Curve(python_2.initial_rooms)
cc = CurveCollide(Curves=crv, BasePlane=PlaneXY(0, 0, 0), Strength=1)  # -> Goal, Frames
pt_2 = Point(cc.Frames)
inter = InterconnectPoints(Pts=pt_2)
length_line = LengthLine(Line=inter, Length=0, Strength=1e-05)
onplane = OnPlane(Points=pt_2, Plane=PlaneXY(0, 0, 0), Strength=10)
show = Show(G=cc.Frames)
merge = Merge(Data1=cc.Goal, Data2=length_line, Data3=onplane)
entwine = Entwine(Branch00=merge, Branch01=show, FlattenInputs=True)
zombiesolver = ZombieSolver(GoalObjects=entwine, Threshold=1e-10, Tolerance=0.01, MaxIterations=500)  # -> I, V, O
unflatten = UnflattenTree(Tree=zombiesolver.O, Guide=entwine)
bang = ExplodeTree(Data=unflatten)  # -> Branch0, Branch1
orient = Orient(Geometry=crv, Source=cc.Frames, Target=bang.Branch1)  # -> Geometry, Transform
