# Grasshopper definition plan_generator_solver.gh (Grasshopper 1.0.7)
# plug-ins: Kangaroo2 Components

panel = Panel("""livingroom
master_bedroom
guest_bedroom
kitchen
master_bath
guest_bath
room1
room2
room3""")
width = Panel("""30
20
20
15
15
10
12
15
18""")
depth = Panel("""40
30
25
20
15
15
20
25
15""")
python = GhPythonScript()  # -> out, room
# ---------- python: Python ----------
import rhinoscriptsyntax as rs
import Rhino.Geometry as rg
import ghpythonlib.componentbase
import math
import time
import System.Drawing as sd
import random
import json



class Room:
    def __init__ (self, room_name, depth, width, location):
        self.room_name = room_name
        self.depth = depth
        self.width = width
        self.location = location

    def area(self):
        return self.depth * self.width
    
    def visual_3d(self):
        crv = rg.Rectangle3d(self.location,rg.Interval(-self.width/2, self.width/2), rg.Interval(-self.depth/2, self.depth/2))
        crv = crv.ToNurbsCurve()
        height = 12
        result = rg.Extrusion.Create(crv, height, True)
        return result, crv
       

room = Room
# ---------- end python ----------
pt = Point(Point(-9.812949736, -48.40960034, 0))
python_2 = GhPythonScript(room=python.room, seed=Slider(27, range=0..100), rooms=panel, widths=width, depths=depth, origin=pt)  # -> out, rooms_3d, initial_rooms, rooms_areas, floor_network; inputs rooms: list, widths: list of Int32, depths: list of Int32, origin: Point3d
# ---------- python_2: Python ----------
import rhinoscriptsyntax as rs
import Rhino.Geometry as rg
import ghpythonlib.componentbase
import random
import math
import time

random.seed(seed)

class Floorplan:
    def __init__ (self, room_names, widths, depths, origin):
        self.room_names = room_names
        self.widths = widths
        self.depths = depths
        self.origin = origin
        self.rooms = []
        self.areas = []
    
    def initialize(self):
        self.initialize_rooms()
        
    def initialize_rooms(self):
        initial_room_names = self.room_names
        initial_widths = self.widths
        initial_depths = self.depths
        self.network, initial_locations = self.distribution_network()
        for i in range(len(initial_room_names)):
            cur_room = room(initial_room_names[i], initial_depths[i], initial_widths[i], initial_locations[i])
            self.rooms.append(cur_room)

    
    def distribution_network(self):
        cnt = self.origin
        print(cnt)
        k = len(self.room_names)
        nums = list(range(k))
        random.shuffle(nums)
        lines = []
        locations = []
        rotation = 2 * math.pi / k;
        for num in nums:
            r = k * 15
            pt = rg.Point3d(cnt.X + random.uniform(0, r) * math.cos(rotation*num), cnt.Y + random.uniform(0, r) * math.sin(rotation*num),0)
            pt_plane = rg.Plane(pt, rg.Vector3d.ZAxis)
            pt_plane.Rotate(random.uniform(0, 2), rg.Vector3d.ZAxis, pt_plane.Origin)
            locations.append(pt_plane)
            line = rg.Line(cnt, pt)
            lines.append(line)
        return lines, locations
        



floor = Floorplan(rooms, widths, depths,origin)
floor.initialize()
initial_rooms = []
rooms_3d = []
rooms_areas = []
floor_network = floor.network

for room in floor.rooms:
    room_3d,room_2d = room.visual_3d()
    initial_rooms.append(room_2d)
    rooms_3d.append(room_3d)
    rooms_areas.append(room.area())
# ---------- end python_2 ----------
crv = Curve(python_2.initial_rooms)
explode = Explode(Curve=crv, Recursive=True)  # -> Segments, Vertices
disc = Discontinuity(Curve=crv, Level=1)  # -> Points, Parameters
area = Area(Geometry=crv)  # -> Area, graft(Centroid)
pt_2 = Point(flatten(area.Centroid))
merge = Merge(Data1=disc.Points, Data2=area.Centroid)
line = Line(explode.Segments)
con = DelaunayEdges(Points=pt_2, Plane=PlaneXY(0, 0, 0))  # -> Connectivity, Edges
inter = InterconnectPoints(Pts=merge)
show = Show(G=crv)
collider = Collider(Objects=flatten(line), Radii=1, Strength=1000)
length_line = LengthLine(Line=inter, Strength=10)
length_line_2 = LengthLine(Line=con.Edges, Length=0, Strength=0.05)
merge_2 = Merge(Data1=collider, Data2=length_line_2, Data3=length_line)
entwine = Entwine(Branch00=show, Branch01=merge_2, FlattenInputs=True)
reset = Button()
on = BooleanToggle(False)
solver = Solver(GoalObjects=entwine, Reset=reset, Threshold=1e-10, Tolerance=0.01, On=on)  # -> I, V, O
bang = ExplodeTree(Data=solver.O)  # -> Branch0, Branch1
crv_2 = Curve(bang.Branch0)
lng = ListLength(List=crv_2)
dom = ConstructDomain(DomainStart=Slider(15, range=0..100), DomainEnd=Slider(7, range=0..100))
random = Random(Range=dom, Number=lng, Seed=Slider(65, range=0..100))  # -> graft(Random)
offset = Offset(Curve=crv_2, Distance=1, Plane=PlaneXY(0, 0, 0), Corners=1)
Z = UnitZ(Factor=random)
boundary = BoundarySurfaces(Edges=offset)
extr = Extrude(Base=boundary, Direction=Z)
preview = CustomPreview(Geometry=extr, Material=ColourSwatch(SwatchColor=RGB(55, 116, 255)))
