# Grasshopper definition Squarify.gh (Grasshopper 1.0.7)
# plug-ins: Magnetizing_FPG

panel = Panel("C:\Users\BaekInchan\Documents\AI-based-Architectural-Design-Automation\03_space_generator\Squarify.py")
magnetizingrooms = MagnetizingRooms(RoomAreas="20, 50, 40, 30, 40", Iterations=3, MaxAdjDistance=3, Adjacencies="0 - 0")  # -> Grid, XGridDim, RoomOrder
houseinstance = HouseInstance()
panel_2 = Panel("""7.27
7.77
11.87
11.87
6.21
7.77
5""")
houseinstance_2 = HouseInstance()
# living room-bedroom1
# living room-bedroom2
# living room-dinning room
# dinning room-kitchen
# washroom-living room
# washroom-bedroom1
panel_4 = Panel("""guestroom
kitchen
dinning room
living room
bedroom1
bedroom2
washroom""")
pt = Point(Point(4.759631755, -7.085213608, 0))
generatecorridorsinbetween = GenerateCorridorsInBetween(CellSize=1)  # -> Corridors, XGridDim, NumberGrid
springsystem_es = SpringSystem_ES(Adjacencies=" - ", ProportionThreshold=2, FFBalance=0, SpringCollAllGenes=True, AdjustArea=False)  # -> Rooms, Adjacencies
roominstance = RoomInstance()
squarifytreemap = PythonScript(location=pt, width=Slider(7, range=0..10), V=panel_2, t=Slider(34, range=0..100))  # -> out, R; inputs location: Point3d, width: Int32, V: list
# ---------- squarifytreemap: Python ----------
import rhinoscriptsyntax as rs
import Rhino.Geometry as rg
import ghpythonlib.componentbase
import math
import time
import System.Drawing as sd
import random
import json
from Rhino.Geometry import *
import rhinoscriptsyntax as rs
import scriptcontext as sc

# START Squarify code by Uri Laserson
def normalize_sizes(sizes, dx, dy):
    total_size = sum(sizes)
    total_area = dx * dy
    sizes = map(float, sizes)
    sizes = map(lambda size: size * total_area / total_size, sizes)
    return list(sizes)

def pad_rectangle(rect):
    if rect['dx'] > 2:
        rect['x'] += 1
        rect['dx'] -= 2
    if rect['dy'] > 2:
        rect['y'] += 1
        rect['dy'] -= 2

def layoutrow(sizes, x, y, dx, dy):
    # generate rects for each size in sizes
    # dx >= dy
    # they will fill up height dy, and width will be determined by their area
    # sizes should be pre-normalized wrt dx * dy (i.e., they should be same units)
    covered_area = sum(sizes)
    width = covered_area / dy
    rects = []
    for size in sizes:
        rects.append({'x': x, 'y': y, 'dx': width, 'dy': size / width})
        y += size / width
    return rects

def layoutcol(sizes, x, y, dx, dy):
    # generate rects for each size in sizes
    # dx < dy
    # they will fill up width dx, and height will be determined by their area
    # sizes should be pre-normalized wrt dx * dy (i.e., they should be same units)
    covered_area = sum(sizes)
    height = covered_area / dx
    rects = []
    for size in sizes:
        rects.append({'x': x, 'y': y, 'dx': size / height, 'dy': height})
        x += size / height
    return rects

def layout(sizes, x, y, dx, dy):
    return layoutrow(sizes, x, y, dx, dy) if dx >= dy else layoutcol(sizes, x, y, dx, dy)

def leftoverrow(sizes, x, y, dx, dy):
    # compute remaining area when dx >= dy
    covered_area = sum(sizes)
    width = covered_area / dy
    leftover_x = x + width
    leftover_y = y
    leftover_dx = dx - width
    leftover_dy = dy
    return (leftover_x, leftover_y, leftover_dx, leftover_dy)

def leftovercol(sizes, x, y, dx, dy):
    # compute remaining area when dx >= dy
    covered_area = sum(sizes)
    height = covered_area / dx
    leftover_x = x
    leftover_y = y + height
    leftover_dx = dx
    leftover_dy = dy - height
    return (leftover_x, leftover_y, leftover_dx, leftover_dy)

def leftover(sizes, x, y, dx, dy):
    return leftoverrow(sizes, x, y, dx, dy) if dx >= dy else leftovercol(sizes, x, y, dx, dy)

def worst_ratio(sizes, x, y, dx, dy):
    return max([max(rect['dx'] / rect['dy'], rect['dy'] / rect['dx']) for rect in layout(sizes, x, y, dx, dy)])

def squarify(sizes, x, y, dx, dy):
    # sizes should be pre-normalized wrt dx * dy (i.e., they should be same units)
    # or dx * dy == sum(sizes)
    # sizes should be sorted biggest to smallest
    sizes = list(map(float, sizes))
    
    if len(sizes) == 0:
        return []
    
    if len(sizes) == 1:
        return layout(sizes, x, y, dx, dy)
    
    # figure out where 'split' should be
    i = 1
    while i < len(sizes) and worst_ratio(sizes[:i], x, y, dx, dy) >= worst_ratio(sizes[:(i+1)], x, y, dx, dy):
        i += 1
    current = sizes[:i]
    remaining = sizes[i:]
    
    (leftover_x, leftover_y, leftover_dx, leftover_dy) = leftover(current, x, y, dx, dy)
    return layout(current, x, y, dx, dy) + \
            squarify(remaining, leftover_x, leftover_y, leftover_dx, leftover_dy)
# END Squarify code by Uri Laserson

random.seed(t)
random.shuffle(V)
pt_plane = rg.Plane(location, rg.Vector3d.ZAxis)
R = rg.Rectangle3d(pt_plane, width, sum(V) / width)

if not R:
    raise ValueError("Input R failed to collect data")

if type(R) == Rectangle3d:
    rectangles = []
    
    sizes_normalized = normalize_sizes(V, R.X.Length, R.Y.Length)
    #print normalized
    
    squarified = squarify(sizes_normalized, R.X.Min, R.Y.Min, R.X.Length, R.Y.Length)
    #print squarified
    
    for square in squarified:
#        print square['x']
        origin = Point3d(square['x'], square['y'], 0)
        rectangle_plane = Plane(origin, Vector3d(1,0,0), Vector3d(0,1,0))
        rectangle = Rectangle3d(rectangle_plane, square['dx'], square['dy'])
        rectangles.append(rectangle)
    
    transform = Transform.ChangeBasis(R.Plane, Plane(Point3d(0,0,0), Vector3d(1,0,0), Vector3d(0,1,0)))
    [a.Transform(transform) for a in rectangles]
    
    R = rectangles
    
else:
    raise TypeError("Input R must be a rectangle")
# ---------- end squarifytreemap ----------
ltv = LinkToVscode(RunVSCode=Toggle(True), file=panel)  # -> out, Code; inputs RunVSCode: Boolean
# ---------- ltv: Python ----------
import rhinoscriptsyntax as rs
import os
import subprocess
VSCode = 'C:\Users\BaekInchan\AppData\Roaming\Microsoft\Windows\Start Menu\Programs\Visual Studio Code\Visual Studio Code.lnk'
vscode_path = VSCode.replace('\\', '\\\\')
file_path = file.replace('\\', '\\\\')
command = [file_path]
process_name = 'Code'

def save_file(file_path):
    subprocess.Popen([vscode_path, '--command', 'workbench.action.files.save'], shell=True)
    
def run_vscode():
    subprocess.Popen(command, shell=True)
    
def close_vscode():
    save_file(file_path)
    subprocess.Popen(['taskkill', '/F', '/IM', process_name + '.exe'], shell=True)
    
def copy_content(file_path):
    with open(file_path, 'r') as file:
        file_content = file.read()
    return file_content
    
if(RunVSCode):
    if os.path.exists(file):
        run_vscode()
        content = copy_content(file_path)
        Code = content
# ---------- end ltv ----------
number_slider = Slider(7, range=0..10)
aspi = SpringSystem(Adjacences=" - ", ProportionThreshold=2)  # -> Rooms, Adjacences
roominstance_2 = RoomInstance()
roominstance_3 = RoomInstance()
crv = Curve(squarifytreemap.R)
crv_2 = Curve(graft(squarifytreemap.R))
colom = CollisionOneMany(Collider=crv, Obstacles=crv_2)  # -> Collision, Index
rectangle = Rectangle(Plane=PlaneXY(0, 0, 0), XSize=number_slider, YSize=number_slider, Radius=0)  # -> Rectangle, Length
pt_2 = Point(Point(7.952420273, -9.643557446, 0))
python = GhPythonScript(C=colom.Collision)  # -> out, listEdges, treeEdges; inputs C: tree
# ---------- python: Python ----------
__author__ = "BaekInchan"
__version__ = "2024.02.04"

import rhinoscriptsyntax as rs
import ghpythonlib.treehelpers as th

listEdges = []
treeEdges = []
dict = {}

    
for i in range(C.BranchCount):
    branchList = C.Branch(i)
    tmp= []
    for j in range(branchList.Count):
        if branchList[j] == True : 
            if i == j : continue
            edge1 = '{0} - {1}'.format(i, j)
            edge2 = '{0} - {1}'.format(j, i)
            if(edge1 not in dict and edge2 not in dict) : 
                listEdges.append(edge1)
                tmp.append(j)
                dict[edge1] = 1
                dict[edge2] = 1
    treeEdges.append(tmp)

treeEdges = th.list_to_tree(treeEdges, none_and_holes = True)
# ---------- end python ----------
houseinstance_3 = HouseInstance(Boundary=rectangle.Rectangle, EntrancePoint=pt_2)
item = ListItem(List=crv, Index=python.treeEdges, Wrap=True)
panel_5 = Panel(houseinstance_3)
panel_6 = Panel(item)
area = Area(Geometry=item)  # -> Area, Centroid
area_2 = Area(Geometry=crv_2)  # -> Area, Centroid
ln = Line(StartPoint=area.Centroid, EndPoint=area_2.Centroid)  # -> flatten(Line)
