# Grasshopper definition massPlan.gh (Grasshopper 1.0.7)

# space module (m2)
number_slider = Slider(6, range=0..100)
# 건물 width
# 복도폭
number_slider_2 = Slider(7800, range=0..100000)
number_slider_3 = Slider(1200, range=0..10000)
# core count
number_slider_4 = Slider(3, range=0..10)
# 커브 선택
crv = Curve(<curve referenced from the Rhino model>)
neg = Negative(Value=number_slider_2)
neg_2 = Negative(Value=number_slider_3)
subtraction = Subtraction(A=number_slider_2, B=number_slider_3)
multiplication = Multiplication(A=number_slider, B="1e6")
offset = OffsetCurve(Curve=crv, Distance=expr("x / 2", [number_slider_2, neg]), Corners=1)
offset_2 = OffsetCurve(Curve=crv, Distance=expr("x / 2", [number_slider_3, neg_2]), Corners=1)  # -> flatten(Curve)
division = Division(A=subtraction, B="2")
division_2 = Division(A=multiplication, B=division)
end = EndPoints(Curve=offset)  # -> flatten(Start), flatten(End)
item = ListItem(List=end.Start, Index=0, Wrap=True)  # -> Item, Item1
item_2 = ListItem(List=end.End, Index=0, Wrap=True)  # -> Item, Item1
len = Length(Curve=offset_2)
rectangle = Rectangle(Plane=PlaneXY(0, 0, 0), XSize=division_2, YSize=division, Radius=0)  # -> Rectangle, Length
ln = Line(StartPoint=item.Item, EndPoint=item.Item1)
ln_2 = Line(StartPoint=item_2.Item, EndPoint=item_2.Item1)
sort = SortList(Keys=len, ValuesA=offset_2)  # -> Keys, ValuesA
disc = Discontinuity(Curve=rectangle.Rectangle, Level=1)  # -> Points, Parameters
item_3 = ListItem(List=disc.Points, Index=Slider(1, range=0..4), Wrap=True)
item_4 = ListItem(List=sort.ValuesA, Index=0, Wrap=True)
divide = DivideCurve(Curve=item_4, Count=expr("x * 2", number_slider_4), Kinks=False)  # -> Points, Tangents, Parameters
dispatch = Dispatch(List=divide.Points, DispatchPattern=[True, False])  # -> ListA, ListB
join = JoinCurves(Curves=flatten([ln, ln_2, offset]), Preserve=False)
offset_3 = OffsetCurve(Curve=join, Distance="75", Corners=1)
pl_origin = PlaneOrigin(Base=rectangle.Rectangle, Origin=item_3)
merge = Merge(Data1=flatten(offset), Data2=offset_2)
explode = Explode(Curve=merge, Recursive=True)  # -> Segments, flatten(Vertices)
flip = FlipMatrix(Data=explode.Segments)
partition = PartitionList(List=flip, Size="4")
end_2 = EndPoints(Curve=partition)  # -> Start, End
midpt = CurveMiddle(Curve=partition)
pdecon = Deconstruct(Point=midpt)  # -> XComponent, YComponent, ZComponent
panel = Panel("""0
2""")
sort_2 = SortList(Keys=pdecon.YComponent, ValuesA=partition)  # -> Keys, ValuesA
item_5 = ListItem(List=sort_2.ValuesA, Index=panel, Wrap=True)
flip_2 = FlipMatrix(Data=item_5)
tstat = TreeStatistics(Tree=flip_2)  # -> Paths, Length, Count
item_6 = ListItem(List=tstat.Paths, Index="-1", Wrap=True)
cull_i = CullIndex(List=tstat.Paths, Indices="-1", Wrap=True)
branch = TreeBranch(Tree=flip_2, Path=item_6, MaintainPaths=True)
branch_2 = TreeBranch(Tree=flip_2, Path=cull_i, MaintainPaths=True)
flip_3 = FlipCurve(Curve=branch)  # -> Curve, Flag
divlength = DivideLength(Curve=[flip_3.Curve, branch_2], Length=division_2)  # -> Points, Tangents, Parameters
cull_i_2 = CullIndex(List=divlength.Points, Indices="-1", Wrap=True)
rectangle_2 = Rectangle(Plane=divlength.Points, XSize=division_2, YSize=division, Radius=0)  # -> Rectangle, Length
pl = ConstructPlane(Origin=cull_i_2, XAxis=divlength.Tangents, YAxis=Vector(0, 1, 0))
orient = Orient(Geometry=rectangle_2.Rectangle, Source=divlength.Points, Target=pl)  # -> flatten(Geometry), Transform
area = Area(Geometry=<missing>)  # -> Area, Centroid
area_2 = Area(Geometry=orient.Geometry)  # -> Area, Centroid
cp = ClosestPoint(Point=dispatch.ListB, Cloud=area_2.Centroid)  # -> ClosestPoint, CPIndex, Distance
number_slider_5 = Slider(75, range=0..1000)
cull_i_3 = CullIndex(List=orient.Geometry, Indices=cp.CPIndex, Wrap=True)
item_7 = ListItem(List=orient.Geometry, Index=cp.CPIndex, Wrap=True)
neg_3 = Negative(Value=number_slider_5)
boundary = BoundarySurfaces(Edges=item_7)
merge_2 = Merge(Data1=number_slider_5, Data2=neg_3)  # -> graft(Result)
preview = CustomPreview(Geometry=boundary, Material=ColourSwatch(SwatchColor=RGB(20, 199, 118)))
offset_4 = OffsetCurve(Curve=cull_i_3, Distance=merge_2, Corners=1)
