# Grasshopper definition SquareTile.gh (Grasshopper 1.0.7)

crv = Curve(<curve referenced from the Rhino model>)
c_script = CSharpScript(x=crv)  # -> out, crvesL, crvesR, gcd; inputs x: Curve
# ---------- c_script: C# usings ----------
using System.Linq;
using System.Runtime.InteropServices;
# ---------- c_script: C# ----------
    var seg = x.DuplicateSegments();
    Curve reference = seg[0];
    Vector3d refV = reference.PointAtEnd - reference.PointAtStart; 
    List<Curve> L = new List<Curve>{reference};
    List<Curve> R = new List<Curve>();
    for (int i = 1; i < seg.Length; i++)
    {
      var now = seg[i];
      var nowV = now.PointAtEnd - now.PointAtStart;
      double dotProduct = Math.Abs(Vector3d.Multiply(refV, nowV));
      if (dotProduct < 0.01) R.Add(now);
      else L.Add(now); 
    }
    int w, h;
    w = (int)Math.Round(L[0].GetLength());
    Print(w.ToString());
    for (int i = 1; i < L.Count; i++)
    {
      w = Gcd(w, (int)Math.Round(L[i].GetLength()));
      Print((w.ToString())); 
    }
    h = (int)R[0].GetLength();
    Print(h.ToString()); 
    for (int i = 1; i < R.Count; i++)
    {
      h = Gcd(h, (int)Math.Round(R[i].GetLength()));
      Print(h.ToString());
    }
    gcd = Gcd(w, h); 
    
    crvesL = L;
    crvesR = R;
# ---------- c_script: C# additional code ----------
  
  public int Gcd(int a, int b)
  {
    while (b != 0)
    {
      int temp = b;
      b = a % b;
      a = temp;
    }

    return Math.Abs(a); 
  }
# ---------- end c_script ----------
planar = IsPlanar(Surface=crv, Interior=True)  # -> Planar, Plane
boundary = BoundarySurfaces(Edges=crv)
disc = Discontinuity(Curve=crv, Level=1)  # -> Points, Parameters
bbox = BoundingBox(Content=crv, Plane=planar.Plane)  # -> Box, Box_2
srf = Surface(bbox.Box)
srf_cp = SurfaceClosestPoint(Point=disc.Points, Surface=srf)  # -> Point, UVPoint, Distance
iso = IsoCurve(Surface=srf, UVPoint=srf_cp.UVPoint)  # -> UIsocurve, VIsocurve
crv_2 = Curve(flatten([iso.VIsocurve, iso.UIsocurve]))
srfsplit = SurfaceSplit(Surface=boundary, Curves=crv_2)
disc_2 = Discontinuity(Curve=srfsplit, Level=1)  # -> Points, Parameters
item = ListItem(List=disc_2.Points, Index=0, Wrap=True)  # -> Item, Item1, Item2, Item3
int = Integer(c_script.gcd)
srf4pt = _4PointSurface(CornerA=item.Item, CornerB=item.Item1, CornerC=item.Item2, CornerD=item.Item3)  # -> flatten(Surface)
c_script_2 = CSharpScript(x=int, y=Slider(1, range=0..10))  # -> out, A; inputs x: Int32, y: Int32
# ---------- c_script_2: C# ----------
    var li = GetDivisors(x);
    A = li[y % li.Count];
# ---------- c_script_2: C# additional code ----------
  public List<int> GetDivisors(int n)
  {
    List<int> divisors = new List<int>();

    for (int i = 1; i <= Math.Sqrt(n); i++)
    {
      if (n % i == 0)
      {
        divisors.Add(i);
        if (i != n / i) // 중복 약수를 방지 (i * i = n인 경우 제외)
        {
          divisors.Add(n / i);
        }
      }
    }

    divisors.Sort(); // 약수를 정렬

    return divisors;
  }
# ---------- end c_script_2 ----------
dim = Dimensions(Surface=srf4pt)  # -> UDimension, VDimension
int_2 = Integer(dim.UDimension)
int_3 = Integer(dim.VDimension)
integer_division = IntegerDivision(A=int_2, B=c_script_2.A)
integer_division_2 = IntegerDivision(A=int_3, B=c_script_2.A)
divide = DivideDomain²(Domain=srf4pt, UCount=integer_division, VCount=integer_division_2)
subsrf = Isotrim(Surface=graft(srf4pt), Domain=divide)
area = Area(Geometry=subsrf)  # -> Area, Centroid
scale = Scale(Geometry=subsrf, Center=area.Centroid, Factor=Slider(0.93, range=0..1))  # -> Geometry, Transform
Z = UnitZ(Factor=Slider(0.1, range=0..0.1))
extr = Extrude(Base=scale.Geometry, Direction=Z)
