# Grasshopper definition 11_automated_facade.gh (Grasshopper 1.0.7)

number_slider = Slider(23, range=0..100)
trigrid = Triangular(Plane=PlaneXY(0, 0, 0), Size=number_slider, ExtentX=number_slider, ExtentY=Slider(15, range=0..100))  # -> flatten(Cells), Points
runion = RegionUnion(Curves=trigrid.Cells)
area = Area(Geometry=runion)  # -> Area, Centroid
arc = Arc(Plane=area.Centroid, Radius=Slider(220, range=0..1000), Angle=Domain(0, 3.141592654))  # -> Arc, Length
# author : inchan baek
# e-mail : bic7885@gmailcom
yz = YZPlane(Origin=area.Centroid)
rotate = Rotate(Geometry=arc.Arc, Angle=degrees(Slider(46, range=0..100)), Plane=yz)  # -> Geometry, Transform
area_2 = Area(Geometry=trigrid.Cells)  # -> Area, Centroid
eval = EvaluateCurve(Curve=reparameterize(rotate.Geometry), Parameter=Slider(0.68, range=0..1))  # -> Point, Tangent, Angle
pull = PullPoint(Point=eval.Point, Geometry=area_2.Centroid, ClosestOnly=False)  # -> ClosestPoint, Distance
sph = Sphere(Base=eval.Point, Radius=Slider(13, range=0..100))
sort = SortList(Keys=pull.Distance, ValuesA=pull.ClosestPoint, ValuesB=trigrid.Cells)  # -> Keys, graft(ValuesA), ValuesB
lng = ListLength(List=sort.ValuesB)
explode = Explode(Curve=sort.ValuesB, Recursive=True)  # -> Segments, flatten(Vertices)
preview = CustomPreview(Geometry=sph, Material=ColourSwatch(SwatchColor=RGB(240, 188, 88)))
Z = UnitZ(Factor=Slider(2, range=0..10))
range = Range(Domain=Domain(0, 1), Steps=expr("x - 1", lng))
cullpt = CullDuplicates(Points=explode.Vertices, Tolerance=0.1, CullMode=3)  # -> Points, Indices, Valence
midpt = CurveMiddle(Curve=explode.Segments)
rev = Reverse(Vector=Z)
graph = GraphMapper(
    range,
    x0=0,
    x1=1,
    y0=0,
    y1=1,
    A=1,
    B=0,
    container_name="Linear",
    Graph_x0=0.25,
    Graph_x1=0.75,
    Graph_y0=0.25,
    Graph_y1=0.75)
move = Move(Geometry=midpt, Motion=rev)  # -> Geometry, Transform
vec2pt = Vector2Pt(PointA=move.Geometry, PointB=sort.ValuesA, Unitize=False)  # -> Vector, Length
bnd = Bounds(Numbers=graph)
dom = ConstructDomain(DomainStart=Slider(0.9, range=0..1), DomainEnd=Slider(0.3, range=0..1))
remap = RemapNumbers(Value=graph, Source=bnd, Target=dom)  # -> graft(Mapped), Clipped
multiplication = Multiplication(A=vec2pt.Length, B=remap.Mapped)
amp = Amplitude(Vector=vec2pt.Vector, Amplitude=multiplication)
move_2 = Move(Geometry=midpt, Motion=amp)  # -> graft(Geometry), Transform
cps = ClosestPoints(Point=move_2.Geometry, Cloud=cullpt.Points, Count="2")  # -> ClosestPoint, CPIndex, Distance
merge = Merge(Data1=simplify(move_2.Geometry), Data2=simplify(cps.ClosestPoint))
pline = PolyLine(Vertices=merge, Closed=invert(False))
boundary = BoundarySurfaces(Edges=pline)
preview_2 = CustomPreview(Geometry=boundary, Material=ColourSwatch(SwatchColor=RGB(196, 65, 88)))
