# Grasshopper definition getCoor.gh (Grasshopper 1.0.7)
# plug-ins: SelectLayerfromGeoJSON

panel = Panel("C:\Users\BaekInchan\Documents\AI-based-Architectural-Design-Automation\08_Automatic Generation of Floor Plans Using GAN\lib\")
panel_2 = Panel("C:\Users\BaekInchan\Documents\AI-based-Architectural-Design-Automation\08_Automatic Generation of Floor Plans Using GAN\lib\")
python = GhPythonScript(Run=Toggle(True), input_address="경기 수원시 팔달구 효원로308번길 16", vworld_key="C492AE9A-1701-393D-913A-D080B66D18CC")  # -> out, x_coord, y_coord
# ---------- python: Python ----------
__author__ = "BaekInchan"
__version__ = "2024.02.08"

import rhinoscriptsyntax as rs
from System.Net import HttpWebRequest, WebRequest
from System.IO import StreamReader
import json

def AddressToCoord(input_address, vworld_key):
    apiurl = "https://api.vworld.kr/req/address?service=address&request=getcoord&crs=EPSG:900913&address={0}&format=json&type=road&key={1}".format(input_address, vworld_key)
    request = WebRequest.Create(apiurl)
    request.Method = "GET"
    response = request.GetResponse()
    stream = response.GetResponseStream()
    reader = StreamReader(stream)
    responseText = reader.ReadToEnd()
    response_data = json.loads(responseText)
    x_coord = response_data['response']['result']['point']['x']
    y_coord = response_data['response']['result']['point']['y']
    return x_coord, y_coord

if Run : 
    x_coord, y_coord = AddressToCoord(input_address, vworld_key)
# ---------- end python ----------
python_2 = GhPythonScript(Run=Toggle(True), input_address="경기 수원시 팔달구 동수원로 403", vworld_key="C492AE9A-1701-393D-913A-D080B66D18CC")  # -> out, x_coord, y_coord; same code as python
panel_3 = Panel(python.x_coord)
panel_4 = Panel(python.y_coord)
panel_5 = Panel(python_2.x_coord)
panel_6 = Panel(python_2.y_coord)
int = Integer(panel_3)
int_2 = Integer(panel_4)
panel_7 = Panel(python_2.x_coord)
panel_8 = Panel(python_2.y_coord)
int_3 = Integer(panel_6)
int_4 = Integer(panel_5)
panel_9 = Panel(python_2.x_coord)
panel_10 = Panel(python_2.y_coord)
panel_11 = Panel("lt_c_uq111")
panel_12 = Panel("lt_l_sprd")
panel_13 = Panel("lt_c_spbd")
path = FilePath(panel)
python_3 = GhPythonScript(lib=path, latitude=panel_7, longitude=panel_8)  # -> out, utmX, utmY; inputs latitude: Int32, longitude: Int32
# ---------- python_3: Python ----------
__author__ = "BaekInchan"
__version__ = "2024.02.08"

import rhinoscriptsyntax as rs
import sys
if lib not in sys.path:
    sys.path.append(lib)
import clr
# ProjNet 라이브러리 참조 추가
clr.AddReference('ProjNet.dll')
from ProjNet.CoordinateSystems import CoordinateSystemFactory
from ProjNet.CoordinateSystems.Transformations import CoordinateTransformationFactory
from ProjNet.CoordinateSystems import GeographicCoordinateSystem, HorizontalDatum, PrimeMeridian, AngularUnit, AxisInfo, AxisOrientationEnum

def ConvertLatLonToUTM(latitude, longitude, utmZone, isNorthHemisphere):
    """
    Convert latitude and longitude to UTM coordinates.

    Parameters:
    - latitude (float): Latitude in degrees.
    - longitude (float): Longitude in degrees.
    - utmZone (int): UTM zone number.
    - isNorthHemisphere (bool): True if the location is in the North Hemisphere; False otherwise.

    Returns:
    - (float, float): Tuple containing UTM X and Y coordinates.
    """
    # 좌표계 변환을 위한 팩토리 객체 생성
    csFactory = CoordinateSystemFactory()
    ctFactory = CoordinateTransformationFactory()

    # 원본 좌표계 (WGS84) 생성
    geoCS = csFactory.CreateGeographicCoordinateSystem("WGS 84", AngularUnit.Degrees, HorizontalDatum.WGS84, PrimeMeridian.Greenwich, [AxisInfo("Lon", AxisOrientationEnum.East), AxisInfo("Lat", AxisOrientationEnum.North)])

    # 목표 UTM 좌표계 생성
    utmCS = csFactory.CreateProjectedCoordinateSystem("WGS 84 / UTM zone {0}{1}".format(utmZone, "N" if isNorthHemisphere else "S"), geoCS, None, None, None)

    # 좌표 변환 객체 생성
    transform = ctFactory.CreateFromCoordinateSystems(geoCS, utmCS)

    # 좌표 변환 실행
    utmCoordinates = transform.MathTransform.Transform([longitude, latitude])

    return utmCoordinates[0], utmCoordinates[1]

# 함수 사용 예시
latitude = 52.5200  # 예: 베를린
longitude = 13.4050

utmX, utmY = ConvertLatLonToUTM(latitude, longitude, 33, True)
print("UTM Coordinates: X = {}, Y = {}".format(utmX, utmY))
# ---------- end python_3 ----------
python_4 = GhPythonScript(latitude=panel_9, longitude=panel_10)  # -> out, result
# ---------- python_4: Python ----------
__author__ = "BaekInchan"
__version__ = "2024.02.08"

import rhinoscriptsyntax as rs
from math import sin, cos, tan, pi, sqrt

RADIANS_PER_DEGREE = pi/180.0
DEGREES_PER_RADIAN = 180.0/pi

WGS84_A =  6378137.0
WGS84_B =  6356752.31424518
WGS84_F =  0.0033528107
WGS84_E =  0.0818191908
WGS84_EP = 0.0820944379

UTM_K0 =   0.9996
UTM_FE =   500000.0
UTM_FN_N = 0.0
UTM_FN_S = 10000000.0
UTM_E2 =   (WGS84_E*WGS84_E)
UTM_E4 =   (UTM_E2*UTM_E2)
UTM_E6 =   (UTM_E4*UTM_E2)
UTM_EP2 =  (UTM_E2/(1-UTM_E2))

class GPStoUTM(object):
    def __init__(self, **kwargs):
        pass

    def UTM(self, lat, lon):
        '''
        Gets the UTM coordinate without the letter and number.
        '''
        self.m0 = (1 - UTM_E2/4 - 3*UTM_E4/64 - 5*UTM_E6/256)
        self.m1 = -(3*UTM_E2/8 + 3*UTM_E4/32 + 45*UTM_E6/1024)
        self.m2 = (15*UTM_E4/256 + 45*UTM_E6/1024)
        self.m3 = -(35*UTM_E6/3072)

        if lon > 0:
            self.cm = int(lon) - (int(lon) % 6) + 3
        else:
            self.cm = int(lon) - (int(lon) % 6) - 3

        self.rlat = lat * RADIANS_PER_DEGREE
        self.rlon = lon * RADIANS_PER_DEGREE
        self.rlon0 = self.cm * RADIANS_PER_DEGREE

        self.slat = sin(self.rlat)
        self.clat = cos(self.rlat)
        self.tlat = tan(self.rlat)

        if lat > 0:
            self.fn = UTM_FN_N
        else:
            self.fn = UTM_FN_S

        self.T = self.tlat*self.tlat
        self.C = UTM_EP2 * self.clat * self.clat
        self.A = (self.rlon - self.rlon0) * self.clat
        self.M = WGS84_A * (self.m0*self.rlat + self.m1*sin(2*self.rlat) + \
            self.m2*sin(4*self.rlat) + self.m3*sin(6*self.rlat))
        self.V = WGS84_A / sqrt(1 - UTM_E2 * self.slat * self.slat)

        self.x = UTM_FE + UTM_K0 * self.V * (self.A + (1-self.T+self.C)\
            *pow(self.A, 3)/6 +(5-18*self.T+self.T*self.T+72*self.C-58*UTM_EP2)\
            *pow(self.A, 5)/120)

        self.y = self.fn + UTM_K0 * (self.M + self.V * self.tlat * \
            (self.A*self.A/2 + (5-self.T+9*self.C+4*self.C*self.C)* \
            pow(self.A, 4)/24 + ((61-58*self.T+self.T*self.T+600*self.C-\
            330*UTM_EP2) * pow(self.A, 6)/720)))

        return (self.x, self.y)

    def UTMLetterDesignator(self, Lat):
        '''
        Gets the UTM letter only.
        '''
        self.LetterDesignator = 'Z'
        if ((84 >= Lat) and (Lat >= 72)):
            self.LetterDesignator = 'X'
        elif ((72 > Lat) and (Lat >= 64)):
            self.LetterDesignator = 'W'
        elif ((64 > Lat) and (Lat >= 56)):
            self.LetterDesignator = 'V'
        elif ((56 > Lat) and (Lat >= 48)):
            self.LetterDesignator = 'U'
        elif ((48 > Lat) and (Lat >= 40)):
            self.LetterDesignator = 'T'
        elif ((40 > Lat) and (Lat >= 32)):
            self.LetterDesignator = 'S'
        elif ((32 > Lat) and (Lat >= 24)):
            self.LetterDesignator = 'R'
        elif ((24 > Lat) and (Lat >= 16)):
            self.LetterDesignator = 'Q'
        elif ((16 > Lat) and (Lat >= 8)):
            self.LetterDesignator = 'P'
        elif (( 8 > Lat) and (Lat >= 0)):
            self.LetterDesignator = 'N'
        elif (( 0 > Lat) and (Lat >= -8)):
            self.LetterDesignator = 'M'
        elif ((-8 > Lat) and (Lat >= -16)):
            self.LetterDesignator = 'L'
        elif ((-16 > Lat) and (Lat >= -24)):
            self.LetterDesignator = 'K'
        elif ((-24 > Lat) and (Lat >= -32)):
            self.LetterDesignator = 'J'
        elif ((-32 > Lat) and (Lat >= -40)):
            self.LetterDesignator = 'H'
        elif ((-40 > Lat) and (Lat >= -48)):
            self.LetterDesignator = 'G'
        elif ((-48 > Lat) and (Lat >= -56)):
            self.LetterDesignator = 'F'
        elif ((-56 > Lat) and (Lat >= -64)):
            self.LetterDesignator = 'E'
        elif ((-64 > Lat) and (Lat >= -72)):
            self.LetterDesignator = 'D'
        elif ((-72 > Lat) and (Lat >= -80)):
            self.LetterDesignator = 'C'
        return self.LetterDesignator

    def LLtoUTM(self, Lat, Long):
        '''
        Gets the UTM coordinate with the letter and number as inputs also.
        '''
        self.a = WGS84_A;
        self.eccSquared = UTM_E2;
        self.k0 = UTM_K0;

        self.LongTemp = (Long+180)-int((Long+180)/360)*360-180

        self.LatRad = Lat * RADIANS_PER_DEGREE
        self.LongRad = self.LongTemp * RADIANS_PER_DEGREE

        self.ZoneNumber = int((self.LongTemp+180)/6) + 1

        self.LongOrigin = (self.ZoneNumber-1)*6 - 180 + 3
        self.LongOriginRad = self.LongOrigin * RADIANS_PER_DEGREE

        self.eccPrimeSquared = (self.eccSquared)/(1-self.eccSquared);

        self.N = self.a/sqrt(1-self.eccSquared*sin(self.LatRad)*\
            sin(self.LatRad));
        self.T = tan(self.LatRad)*tan(self.LatRad);
        self.C = self.eccPrimeSquared*cos(self.LatRad)*cos(self.LatRad);
        self.A = cos(self.LatRad)*(self.LongRad-self.LongOriginRad);

        self.M = self.a*((1 - self.eccSquared/4 -\
            3*self.eccSquared*self.eccSquared/64 -\
            5*self.eccSquared*self.eccSquared*self.eccSquared/256) * \
            self.LatRad - (3*self.eccSquared/8 + 3*self.eccSquared*\
            self.eccSquared/32 +45*self.eccSquared*self.eccSquared*\
            self.eccSquared/1024)*sin(2*self.LatRad) + (15*self.eccSquared*\
            self.eccSquared/256 + 45*self.eccSquared*self.eccSquared*\
            self.eccSquared/1024)*sin(4*self.LatRad) - (35*self.eccSquared*\
            self.eccSquared*self.eccSquared/3072)*sin(6*self.LatRad))

        self.UTMEasting = float(self.k0*self.N*(self.A+(1-self.T+self.C)*\
            self.A**3/6 + (5-18*self.T+self.T*self.T+72*self.C-58*\
            self.eccPrimeSquared)*self.A**4/120) + 500000.0)

        self.UTMNorthing = float(self.k0*(self.M+self.N*tan(self.LatRad)\
            *(self.A**2/2+(5-self.T+9*self.C+4*self.C**2)*self.A**4/24 + (61-58\
            *self.T+self.T**2+600*self.C-330*self.eccPrimeSquared)\
            *self.A**6/720)))

        if (Lat < 0):
            self.UTMNorthing += 10000000.0

        return (self.UTMEasting, self.UTMNorthing)

    def UTMtoLL(self, UTMNorthing, UTMEasting, UTMNumber, UTMLetter):
        '''
        Gets the latitude and longitude with the UTM letter and number.
        '''
        self.ZoneNumber = int(UTMNumber)
        self.ZoneLetter = UTMLetter

        self.k0 = UTM_K0
        self.a = WGS84_A
        self.eccSquared = UTM_E2
        self.e1 = (1-sqrt(1-self.eccSquared))/(1+sqrt(1-self.eccSquared))

        self.x = UTMEasting - 500000.0
        self.y = UTMNorthing

        if self.ZoneLetter < 'N':
            self.y -= 10000000.0

        self.LongOrigin = (self.ZoneNumber - 1)*6 - 180 + 3
        self.eccPrimeSquared = (self.eccSquared)/(1-self.eccSquared)

        self.M = self.y/self.k0;
        self.mu = self.M/(self.a*(1-self.eccSquared/4-3*self.eccSquared**2/64\
            -5*self.eccSquared**3/256))

        self.phi1Rad = self.mu + ((3*self.e1/2-27*self.e1**3/32)*sin(2*self.mu)\
            + (21*self.e1**2/16-55*self.e1**4/32)*sin(4*self.mu)\
            + (151*self.e1**3/96)*sin(6*self.mu))

        self.N1 = self.a/sqrt(1-self.eccSquared*sin(self.phi1Rad)**2)
        self.T1 = tan(self.phi1Rad)**2
        self.C1 = self.eccPrimeSquared*cos(self.phi1Rad)**2
        self.R1 = self.a*(1-self.eccSquared)/pow(1-self.eccSquared*sin(self.phi1Rad)**2, 1.5)
        self.D = self.x/(self.N1*self.k0)

        self.Lat = self.phi1Rad - ((self.N1*tan(self.phi1Rad)/self.R1)\
            *(self.D**2/2-(5+3*self.T1+10*self.C1-4*self.C1**2-9\
            *self.eccPrimeSquared)*self.D**4/24+(61+90*self.T1+298*self.C1\
            +45*self.T1**2-252*self.eccPrimeSquared-3*self.C1**2)\
            *self.D**6/720))

        self.Lat = self.Lat * DEGREES_PER_RADIAN

        self.Long = ((self.D-(1+2*self.T1+self.C1)*self.D**3/6+(5-2*self.C1\
            +28*self.T1-3*self.C1**2+8*self.eccPrimeSquared+24*self.T1**2)\
            *self.D**5/120)/cos(self.phi1Rad))

        self.Long = self.LongOrigin + self.Long * DEGREES_PER_RADIAN

        return (self.Lat, self.Long)
        
gps = GPStoUTM()
latitude = 52.5200  # 예: 베를린
longitude = 13.4050

result = gps.LLtoUTM(latitude, longitude)
# ---------- end python_4 ----------
python_5 = GhPythonScript(Run=Toggle(True), input_address1="경기 수원시 권선구 권선로 669", input_address2="경기 수원시 팔달구 인계로 178 경기문화재단")  # -> out, info
# ---------- python_5: Python ----------
__author__ = "BaekInchan"
__version__ = "2024.02.08"

import rhinoscriptsyntax as rs
from System.Net import HttpWebRequest, WebRequest
from System.IO import StreamReader
import json
import clr
clr.AddReference('System.Web.Extensions')
from System.Web.Script.Serialization import JavaScriptSerializer
vworld_key = "C492AE9A-1701-393D-913A-D080B66D18CC"

def read(apiurl) : 
    request = WebRequest.Create(apiurl)
    request.Method = "GET"
    response = request.GetResponse()
    stream = response.GetResponseStream()
    reader = StreamReader(stream)
    responseText = reader.ReadToEnd()
    return json.loads(responseText)

def terrain(ymin,xmin,ymax,xmax, typeCol, vworld_key) :
    params = {
        "SERVICE": "WFS",
        "REQUEST": "GetFeature",
        "TYPENAME": typeCol,
        "BBOX": "{0:.10f},{1:.10f},{2:.10f},{3:.10f}".format(ymin, xmin, ymax, xmax),
        "VERSION": "1.1.0",
        "MAXFEATURES": "1000",
        "SRSNAME": "EPSG:900913",
        "OUTPUT": "application/json",
        "EXCEPTIONS": "text/xml",
        "KEY": vworld_key
    }

    apiurl = "https://api.vworld.kr/req/wfs"

    # params 딕셔너리를 URL 쿼리 스트링으로 변환
    query_string = "&".join(["{0}={1}".format(key, value) for key, value in params.items()])
    full_url = "{0}?{1}".format(apiurl,query_string)
    data = read(full_url)
    return data


def AddressToCoord(input_address, vworld_key):
    apiurl = "https://api.vworld.kr/req/address?service=address&request=getcoord&crs=EPSG:900913&address={0}&format=json&type=road&key={1}".format(input_address, vworld_key)
    request = WebRequest.Create(apiurl)
    request.Method = "GET"
    response = request.GetResponse()
    stream = response.GetResponseStream()
    reader = StreamReader(stream)
    responseText = reader.ReadToEnd()
    response_data = json.loads(responseText)
    x_coord = response_data['response']['result']['point']['x']
    y_coord = response_data['response']['result']['point']['y']
    return float(x_coord), float(y_coord)

info = []
if Run : 
    ymin, xmin = AddressToCoord(input_address1, vworld_key)
    ymax, xmax = AddressToCoord(input_address2, vworld_key)
    if(ymin > ymax) : ymin, ymax = ymax, ymin
    if(xmin > xmax) : xmin, xmax = xmax, xmin
    print(xmin, xmax)
    typeM = ["lt_c_upisuq151", "lt_c_spbd"]
    for s in typeM : 
        result = JavaScriptSerializer().Serialize(terrain(ymin,xmin,ymax,xmax, s, vworld_key))
        info.append(result)
    info
# ---------- end python_5 ----------
python_6 = GhPythonScript(Run=Toggle(True), input_address1="경기 수원시 권선구 권선로 669", input_address2="경기 수원시 팔달구 인계로 178 경기문화재단")  # -> out, info
# ---------- python_6: Python ----------
__author__ = "BaekInchan"
__version__ = "2024.02.08"

import rhinoscriptsyntax as rs
from System.Net import HttpWebRequest, WebRequest
from System.IO import StreamReader
import json
import clr
clr.AddReference('System.Web.Extensions')
from System.Web.Script.Serialization import JavaScriptSerializer
vworld_key = "C492AE9A-1701-393D-913A-D080B66D18CC"

def read(apiurl) : 
    request = WebRequest.Create(apiurl)
    request.Method = "GET"
    response = request.GetResponse()
    stream = response.GetResponseStream()
    reader = StreamReader(stream)
    responseText = reader.ReadToEnd()
    return json.loads(responseText)

def terrain(ymin,xmin,ymax,xmax, typeCol, vworld_key) :
    params = {
        "SERVICE": "WFS",
        "REQUEST": "GetFeature",
        "TYPENAME": typeCol,
        "BBOX": "{0:.10f},{1:.10f},{2:.10f},{3:.10f}".format(ymin, xmin, ymax, xmax),
        "VERSION": "2.0.0",
        "MAXFEATURES": "100",
        "SRSNAME": "EPSG:4326",
        "OUTPUT": "application/json",
        "EXCEPTIONS": "text/xml",
        "KEY": vworld_key
    }

    apiurl = "https://api.vworld.kr/req/wfs"

    # params 딕셔너리를 URL 쿼리 스트링으로 변환
    query_string = "&".join(["{0}={1}".format(key, value) for key, value in params.items()])
    full_url = "{0}?{1}".format(apiurl,query_string)
    data = read(full_url)
    return data


def AddressToCoord(input_address, vworld_key):
    apiurl = "https://api.vworld.kr/req/address?service=address&request=getcoord&crs=EPSG:4326&address={0}&format=json&type=road&key={1}".format(input_address, vworld_key)
    request = WebRequest.Create(apiurl)
    request.Method = "GET"
    response = request.GetResponse()
    stream = response.GetResponseStream()
    reader = StreamReader(stream)
    responseText = reader.ReadToEnd()
    response_data = json.loads(responseText)
    x_coord = response_data['response']['result']['point']['x']
    y_coord = response_data['response']['result']['point']['y']
    return float(x_coord), float(y_coord)

info = []
if Run : 
    xmin, ymin = AddressToCoord(input_address1, vworld_key)
    xmax, ymax = AddressToCoord(input_address2, vworld_key)
    #if(ymin > ymax) : ymin, ymax = ymax, ymin
    #if(xmin > xmax) : xmin, xmax = xmax, xmin
    print(xmin, xmax)
    typeM = ["lt_c_upisuq151", "lt_c_spbd"]
    for s in typeM : 
        result = JavaScriptSerializer().Serialize(terrain(ymin,xmin,ymax,xmax, s, vworld_key))
        print(result)
        info.append(result)
    print(info[0])
    info
# ---------- end python_6 ----------
python_7 = GhPythonScript(
    Run=Toggle(True),
    ymin=int,
    xmin=int_2,
    ymax=int_4,
    xmax=int_3,
    typeCol="lt_c_spbd",
    vworld_key="C492AE9A-1701-393D-913A-D080B66D18CC")  # -> out, result
# ---------- python_7: Python ----------
__author__ = "BaekInchan"
__version__ = "2024.02.08"

import rhinoscriptsyntax as rs
from System.Net import HttpWebRequest, WebRequest
from System.IO import StreamReader
import json
import clr
clr.AddReference('System.Web.Extensions')
from System.Web.Script.Serialization import JavaScriptSerializer


def read(apiurl) : 
    request = WebRequest.Create(apiurl)
    request.Method = "GET"
    response = request.GetResponse()
    stream = response.GetResponseStream()
    reader = StreamReader(stream)
    responseText = reader.ReadToEnd()
    return json.loads(responseText)

def terrain(ymin,xmin,ymax,xmax, typeCol, vworld_key) :
    params = {
        "SERVICE": "WFS",
        "REQUEST": "GetFeature",
        "TYPENAME": typeCol,
        "BBOX": "{0},{1},{2},{3}".format(ymin, xmin, ymax, xmax),
        "VERSION": "1.1.0",
        "MAXFEATURES": "40",
        "SRSNAME": "EPSG:900913",
        "OUTPUT": "application/json",
        "EXCEPTIONS": "text/xml",
        "KEY": vworld_key
    }

    apiurl = "https://api.vworld.kr/req/wfs"

    # params 딕셔너리를 URL 쿼리 스트링으로 변환
    query_string = "&".join(["{0}={1}".format(key, value) for key, value in params.items()])
    full_url = "{0}?{1}".format(apiurl,query_string)
    data = read(full_url)
    return data

if Run : 
    result = terrain(ymin,xmin,ymax,xmax, typeCol, vworld_key)
    result = JavaScriptSerializer().Serialize(result)
    print(result)
# ---------- end python_7 ----------
python_8 = GhPythonScript(
    ymin="13987670",
    xmin="3912271",
    ymax="14359383",
    xmax="4642932",
    typeCol="lt_c_uq111",
    vworld_key="C492AE9A-1701-393D-913A-D080B66D18CC")  # -> out, result
# ---------- python_8: Python ----------
__author__ = "BaekInchan"
__version__ = "2024.02.08"

import rhinoscriptsyntax as rs
from System.Net import HttpWebRequest, WebRequest
from System.IO import StreamReader
import json


def read(apiurl) : 
    request = WebRequest.Create(apiurl)
    request.Method = "GET"
    response = request.GetResponse()
    stream = response.GetResponseStream()
    reader = StreamReader(stream)
    responseText = reader.ReadToEnd()
    return json.loads(responseText)

def terrain(ymin,xmin,ymax,xmax, typeCol, vworld_key) :
    params = {
        "SERVICE": "WFS",
        "REQUEST": "GetFeature",
        "TYPENAME": typeCol,
        "BBOX": "{0},{1},{2},{3}".format(ymin, xmin, ymax, xmax),
        "PROPERTYNAME": "mnum,sido_cd,sigungu_cd,dyear,dnum,ucode,bon_bun,bu_bun,uname,sido_name,sigg_name,ag_geom",
        "VERSION": "1.1.0",
        "MAXFEATURES": "40",
        "SRSNAME": "EPSG:900913",
        "OUTPUT": "application/json",
        "EXCEPTIONS": "text/xml",
        "KEY": vworld_key
    }

    apiurl = "https://api.vworld.kr/req/wfs"

    # params 딕셔너리를 URL 쿼리 스트링으로 변환
    query_string = "&".join(["{0}={1}".format(key, value) for key, value in params.items()])
    full_url = "{0}?{1}".format(apiurl,query_string)
    data = read(full_url)
    return data

result = terrain(ymin,xmin,ymax,xmax, typeCol, vworld_key)
print(result)
# ---------- end python_8 ----------
python_9 = GhPythonScript(
    Run=Toggle(True),
    input_address="경기도 수원시 팔달구 효원로308번길 16 (인계동, 한화 꿈에그린 파크)",
    vworld_key="C492AE9A-1701-393D-913A-D080B66D18CC")  # -> out, x_coord, y_coord
# ---------- python_9: Python ----------
__author__ = "BaekInchan"
__version__ = "2024.02.08"

import rhinoscriptsyntax as rs
from System.Net import HttpWebRequest, WebRequest
from System.IO import StreamReader
import json

def AddressToCoord(input_address, vworld_key):
    apiurl = "https://api.vworld.kr/req/address?service=address&request=getcoord&crs=epsg:4326&address={0}&format=json&type=road&key={1}".format(input_address, vworld_key)
    request = WebRequest.Create(apiurl)
    request.Method = "GET"
    response = request.GetResponse()
    stream = response.GetResponseStream()
    reader = StreamReader(stream)
    responseText = reader.ReadToEnd()
    response_data = json.loads(responseText)
    x_coord = response_data['response']['result']['point']['x']
    y_coord = response_data['response']['result']['point']['y']
    return x_coord, y_coord

if Run : 
    x_coord, y_coord = AddressToCoord(input_address, vworld_key)
# ---------- end python_9 ----------
path_2 = FilePath(panel_2)
python_10 = GhPythonScript(lib=path_2, result=python_7.result)  # -> out, bld
# ---------- python_10: Python ----------
__author__ = "BaekInchan"
__version__ = "2024.02.08"

import rhinoscriptsyntax as rs
import Rhino.Geometry as geo
import sys
if lib not in sys.path:
    sys.path.append(lib)
import clr
clr.AddReference('ProjNET.dll')
clr.AddReference('GeoAPI.CoordinateSystems.dll')
clr.AddReference('System.Web.Extensions')
from System.Web.Script.Serialization import JavaScriptSerializer
from ProjNet import *
from ProjNet.CoordinateSystems import *
from ProjNet.CoordinateSystems.Transformations import *
from GeoAPI.CoordinateSystems import *
from GeoAPI.CoordinateSystems.Transformations import *

def zone(coordinates):
    if 56 <= coordinates[1] < 64 and 3 <= coordinates[0] < 12:
        return 32
    if 72 <= coordinates[1] < 84 and 0 <= coordinates[0] < 42:
        if coordinates[0] < 9:
            return 31
        elif coordinates[0] < 21:
            return 33
        elif coordinates[0] < 33:
            return 35
        return 37
    return int((coordinates[0] + 180) / 6) + 1
    
def letter(coordinates):
    return 'CDEFGHJKLMNPQRSTUVWXX'[int((coordinates[1] + 80) / 8)]
    
def LLtoUTM(coordinates):
    z = zone(coordinates)
    l = letter(coordinates)
    ctfac = CoordinateTransformationFactory()

    wgs84 = CoordinateSystems.GeographicCoordinateSystem.WGS84
    utm = CoordinateSystems.ProjectedCoordinateSystem.WGS84_UTM(z, coordinates[1] > 0)
    trans = ctfac.CreateFromCoordinateSystems(wgs84, utm)

    result = trans.MathTransform.Transform(coordinates);
    x = result[0]
    y = result[1]
    return z, l, x, y

if result is not None:
    bldPolylines = []

    js = JavaScriptSerializer()
    dataDict = js.DeserializeObject(result)
   
    features = dataDict["features"]
    for feature in features:

        coords = feature["geometry"]["coordinates"]

        points = []
        for polygon in coords:
            for ring in polygon:
                for coord in ring:
                    try:
                        coordarray = (float(coord[0]), float(coord[1]))
                        
                        z, l, x, y = LLtoUTM(coordarray)
                        print(z, l, x, y)
                        pt = geo.Point3d(x, y, 0)
                        points.append(pt)
                    except:
                        pass
        print(points)
        if(len(points)) : 
            polyline = rs.AddPolyline(points)

            bldPolylines.append(polyline)
    
            bld = bldPolylines
# ---------- end python_10 ----------
panel_14 = Panel(python_4.result)
python_11 = GhPythonScript()  # -> out, gps
# ---------- python_11: Python ----------
__author__ = "BaekInchan"
__version__ = "2024.02.08"

import rhinoscriptsyntax as rs
from math import sin, cos, tan, pi, sqrt

RADIANS_PER_DEGREE = pi/180.0
DEGREES_PER_RADIAN = 180.0/pi

WGS84_A =  6378137.0
WGS84_B =  6356752.31424518
WGS84_F =  0.0033528107
WGS84_E =  0.0818191908
WGS84_EP = 0.0820944379

UTM_K0 =   0.9996
UTM_FE =   500000.0
UTM_FN_N = 0.0
UTM_FN_S = 10000000.0
UTM_E2 =   (WGS84_E*WGS84_E)
UTM_E4 =   (UTM_E2*UTM_E2)
UTM_E6 =   (UTM_E4*UTM_E2)
UTM_EP2 =  (UTM_E2/(1-UTM_E2))

class GPStoUTM(object):
    def __init__(self, **kwargs):
        pass

    def UTM(self, lat, lon):
        '''
        Gets the UTM coordinate without the letter and number.
        '''
        self.m0 = (1 - UTM_E2/4 - 3*UTM_E4/64 - 5*UTM_E6/256)
        self.m1 = -(3*UTM_E2/8 + 3*UTM_E4/32 + 45*UTM_E6/1024)
        self.m2 = (15*UTM_E4/256 + 45*UTM_E6/1024)
        self.m3 = -(35*UTM_E6/3072)

        if lon > 0:
            self.cm = int(lon) - (int(lon) % 6) + 3
        else:
            self.cm = int(lon) - (int(lon) % 6) - 3

        self.rlat = lat * RADIANS_PER_DEGREE
        self.rlon = lon * RADIANS_PER_DEGREE
        self.rlon0 = self.cm * RADIANS_PER_DEGREE

        self.slat = sin(self.rlat)
        self.clat = cos(self.rlat)
        self.tlat = tan(self.rlat)

        if lat > 0:
            self.fn = UTM_FN_N
        else:
            self.fn = UTM_FN_S

        self.T = self.tlat*self.tlat
        self.C = UTM_EP2 * self.clat * self.clat
        self.A = (self.rlon - self.rlon0) * self.clat
        self.M = WGS84_A * (self.m0*self.rlat + self.m1*sin(2*self.rlat) + \
            self.m2*sin(4*self.rlat) + self.m3*sin(6*self.rlat))
        self.V = WGS84_A / sqrt(1 - UTM_E2 * self.slat * self.slat)

        self.x = UTM_FE + UTM_K0 * self.V * (self.A + (1-self.T+self.C)\
            *pow(self.A, 3)/6 +(5-18*self.T+self.T*self.T+72*self.C-58*UTM_EP2)\
            *pow(self.A, 5)/120)

        self.y = self.fn + UTM_K0 * (self.M + self.V * self.tlat * \
            (self.A*self.A/2 + (5-self.T+9*self.C+4*self.C*self.C)* \
            pow(self.A, 4)/24 + ((61-58*self.T+self.T*self.T+600*self.C-\
            330*UTM_EP2) * pow(self.A, 6)/720)))

        return (self.x, self.y)

    def UTMLetterDesignator(self, Lat):
        '''
        Gets the UTM letter only.
        '''
        self.LetterDesignator = 'Z'
        if ((84 >= Lat) and (Lat >= 72)):
            self.LetterDesignator = 'X'
        elif ((72 > Lat) and (Lat >= 64)):
            self.LetterDesignator = 'W'
        elif ((64 > Lat) and (Lat >= 56)):
            self.LetterDesignator = 'V'
        elif ((56 > Lat) and (Lat >= 48)):
            self.LetterDesignator = 'U'
        elif ((48 > Lat) and (Lat >= 40)):
            self.LetterDesignator = 'T'
        elif ((40 > Lat) and (Lat >= 32)):
            self.LetterDesignator = 'S'
        elif ((32 > Lat) and (Lat >= 24)):
            self.LetterDesignator = 'R'
        elif ((24 > Lat) and (Lat >= 16)):
            self.LetterDesignator = 'Q'
        elif ((16 > Lat) and (Lat >= 8)):
            self.LetterDesignator = 'P'
        elif (( 8 > Lat) and (Lat >= 0)):
            self.LetterDesignator = 'N'
        elif (( 0 > Lat) and (Lat >= -8)):
            self.LetterDesignator = 'M'
        elif ((-8 > Lat) and (Lat >= -16)):
            self.LetterDesignator = 'L'
        elif ((-16 > Lat) and (Lat >= -24)):
            self.LetterDesignator = 'K'
        elif ((-24 > Lat) and (Lat >= -32)):
            self.LetterDesignator = 'J'
        elif ((-32 > Lat) and (Lat >= -40)):
            self.LetterDesignator = 'H'
        elif ((-40 > Lat) and (Lat >= -48)):
            self.LetterDesignator = 'G'
        elif ((-48 > Lat) and (Lat >= -56)):
            self.LetterDesignator = 'F'
        elif ((-56 > Lat) and (Lat >= -64)):
            self.LetterDesignator = 'E'
        elif ((-64 > Lat) and (Lat >= -72)):
            self.LetterDesignator = 'D'
        elif ((-72 > Lat) and (Lat >= -80)):
            self.LetterDesignator = 'C'
        return self.LetterDesignator

    def LLtoUTM(self, Lat, Long):
        '''
        Gets the UTM coordinate with the letter and number as inputs also.
        '''
        self.a = WGS84_A;
        self.eccSquared = UTM_E2;
        self.k0 = UTM_K0;

        self.LongTemp = (Long+180)-int((Long+180)/360)*360-180

        self.LatRad = Lat * RADIANS_PER_DEGREE
        self.LongRad = self.LongTemp * RADIANS_PER_DEGREE

        self.ZoneNumber = int((self.LongTemp+180)/6) + 1

        self.LongOrigin = (self.ZoneNumber-1)*6 - 180 + 3
        self.LongOriginRad = self.LongOrigin * RADIANS_PER_DEGREE

        self.eccPrimeSquared = (self.eccSquared)/(1-self.eccSquared);

        self.N = self.a/sqrt(1-self.eccSquared*sin(self.LatRad)*\
            sin(self.LatRad));
        self.T = tan(self.LatRad)*tan(self.LatRad);
        self.C = self.eccPrimeSquared*cos(self.LatRad)*cos(self.LatRad);
        self.A = cos(self.LatRad)*(self.LongRad-self.LongOriginRad);

        self.M = self.a*((1 - self.eccSquared/4 -\
            3*self.eccSquared*self.eccSquared/64 -\
            5*self.eccSquared*self.eccSquared*self.eccSquared/256) * \
            self.LatRad - (3*self.eccSquared/8 + 3*self.eccSquared*\
            self.eccSquared/32 +45*self.eccSquared*self.eccSquared*\
            self.eccSquared/1024)*sin(2*self.LatRad) + (15*self.eccSquared*\
            self.eccSquared/256 + 45*self.eccSquared*self.eccSquared*\
            self.eccSquared/1024)*sin(4*self.LatRad) - (35*self.eccSquared*\
            self.eccSquared*self.eccSquared/3072)*sin(6*self.LatRad))

        self.UTMEasting = float(self.k0*self.N*(self.A+(1-self.T+self.C)*\
            self.A**3/6 + (5-18*self.T+self.T*self.T+72*self.C-58*\
            self.eccPrimeSquared)*self.A**4/120) + 500000.0)

        self.UTMNorthing = float(self.k0*(self.M+self.N*tan(self.LatRad)\
            *(self.A**2/2+(5-self.T+9*self.C+4*self.C**2)*self.A**4/24 + (61-58\
            *self.T+self.T**2+600*self.C-330*self.eccPrimeSquared)\
            *self.A**6/720)))

        if (Lat < 0):
            self.UTMNorthing += 10000000.0

        return (self.UTMEasting, self.UTMNorthing)

    def UTMtoLL(self, UTMNorthing, UTMEasting, UTMNumber, UTMLetter):
        '''
        Gets the latitude and longitude with the UTM letter and number.
        '''
        self.ZoneNumber = int(UTMNumber)
        self.ZoneLetter = UTMLetter

        self.k0 = UTM_K0
        self.a = WGS84_A
        self.eccSquared = UTM_E2
        self.e1 = (1-sqrt(1-self.eccSquared))/(1+sqrt(1-self.eccSquared))

        self.x = UTMEasting - 500000.0
        self.y = UTMNorthing

        if self.ZoneLetter < 'N':
            self.y -= 10000000.0

        self.LongOrigin = (self.ZoneNumber - 1)*6 - 180 + 3
        self.eccPrimeSquared = (self.eccSquared)/(1-self.eccSquared)

        self.M = self.y/self.k0;
        self.mu = self.M/(self.a*(1-self.eccSquared/4-3*self.eccSquared**2/64\
            -5*self.eccSquared**3/256))

        self.phi1Rad = self.mu + ((3*self.e1/2-27*self.e1**3/32)*sin(2*self.mu)\
            + (21*self.e1**2/16-55*self.e1**4/32)*sin(4*self.mu)\
            + (151*self.e1**3/96)*sin(6*self.mu))

        self.N1 = self.a/sqrt(1-self.eccSquared*sin(self.phi1Rad)**2)
        self.T1 = tan(self.phi1Rad)**2
        self.C1 = self.eccPrimeSquared*cos(self.phi1Rad)**2
        self.R1 = self.a*(1-self.eccSquared)/pow(1-self.eccSquared*sin(self.phi1Rad)**2, 1.5)
        self.D = self.x/(self.N1*self.k0)

        self.Lat = self.phi1Rad - ((self.N1*tan(self.phi1Rad)/self.R1)\
            *(self.D**2/2-(5+3*self.T1+10*self.C1-4*self.C1**2-9\
            *self.eccPrimeSquared)*self.D**4/24+(61+90*self.T1+298*self.C1\
            +45*self.T1**2-252*self.eccPrimeSquared-3*self.C1**2)\
            *self.D**6/720))

        self.Lat = self.Lat * DEGREES_PER_RADIAN

        self.Long = ((self.D-(1+2*self.T1+self.C1)*self.D**3/6+(5-2*self.C1\
            +28*self.T1-3*self.C1**2+8*self.eccPrimeSquared+24*self.T1**2)\
            *self.D**5/120)/cos(self.phi1Rad))

        self.Long = self.LongOrigin + self.Long * DEGREES_PER_RADIAN

        return (self.Lat, self.Long)
        
gps = GPStoUTM()
# ---------- end python_11 ----------
python_12 = GhPythonScript()  # -> out, gps; same code as python_11
python_13 = GhPythonScript()  # -> out, gps; same code as python_11
crv = Curve(python_10.bld)
python_14 = GhPythonScript(lib=path_2, result=python_7.result)  # -> out, bld; same code as python_10
python_15 = GhPythonScript(gps=python_12.gps, info=python_5.info)  # -> out, building, street; inputs info: list
# ---------- python_15: Python ----------
__author__ = "BaekInchan"
__version__ = "2024.02.08"

import rhinoscriptsyntax as rs
import Rhino.Geometry as rg
import clr
clr.AddReference('System.Web.Extensions')
from System.Web.Script.Serialization import JavaScriptSerializer


bldPolylines = []
strPolylines = []

bucket = [bldPolylines, strPolylines]

for id, result in enumerate(info) : 
    if result is not None:
        dataDict = JavaScriptSerializer().DeserializeObject(result)
        features = dataDict["features"]
        for feature in features:
            coords = feature["geometry"]["coordinates"]
            points = []
            for coord in coords[0][0]:
                try:
                    x, y = gps.LLtoUTM(float(coord[1]) / 1e5, float(coord[0]) / 1e5)
                    pt = rg.Point3d(x, y, 0)
                    points.append(pt)
                except: continue
            polyline = rs.AddPolyline(points)
            bucket[id].append(polyline)

building = bucket[0]
street = bucket[1]
# ---------- end python_15 ----------
python_16 = GhPythonScript(gps=python_13.gps, info=python_6.info)  # -> out, building, street; inputs info: list
# ---------- python_16: Python ----------
__author__ = "BaekInchan"
__version__ = "2024.02.08"

import rhinoscriptsyntax as rs
import Rhino.Geometry as rg
import clr
clr.AddReference('System.Web.Extensions')
from System.Web.Script.Serialization import JavaScriptSerializer


bldPolylines = []
strPolylines = []

bucket = [bldPolylines, strPolylines]

for id, result in enumerate(info) : 
    if result is not None:
        dataDict = JavaScriptSerializer().DeserializeObject(result)
        features = dataDict["features"]
        for feature in features:
            coords = feature["geometry"]["coordinates"]
            points = []
            for coord in coords[0][0]:
                try:
                    x, y = gps.LLtoUTM(coord[1], float(coord[0]))
                    pt = rg.Point3d(x, y, 0)
                    points.append(pt)
                except: continue
            polyline = rs.AddPolyline(points)
            bucket[id].append(polyline)

building = bucket[0]
street = bucket[1]
# ---------- end python_16 ----------
panel_15 = Panel("C492AE9A-1701-393D-913A-D080B66D18CC")
importgeojson = ImportGeoJSON()  # -> Geometry, Attributes, Values, LayerNames
crv_2 = Curve(python_14.bld)
crv_3 = Curve(python_15.building)
crv_4 = Curve(python_15.street)
crv_5 = Curve(python_16.building)
crv_6 = Curve(python_16.street)
panel_17 = Panel(python_14.out)
join = JoinCurves(Curves=crv_3, Preserve=False)
join_2 = JoinCurves(Curves=crv_4, Preserve=False)
join_3 = JoinCurves(Curves=crv_5, Preserve=False)
join_4 = JoinCurves(Curves=crv_6, Preserve=False)
panel_18 = Panel("lt_c_landinfobasemap")
panel_19 = Panel("lt_c_upisuq151")
panel_20 = Panel("lp_pa_cbnd_bubun")
panel_21 = Panel("도시계획시설도_도시계획(도로)")
