# Grasshopper definition mapMaker.gh (Grasshopper 1.0.7)

python = GhPythonScript(Run=Toggle(True), input_address1="강원 춘천시 동부시장길 8", input_address2="강원 춘천시 삭주로 77")  # -> out, info, groundModel
# ---------- python: Python ----------
__author__ = "BaekInchan"
__version__ = "2024.02.08"

import rhinoscriptsyntax as rs
from System.Net import HttpWebRequest, WebRequest
from System.IO import StreamReader
import json
import clr
clr.AddReference('System.Web.Extensions')
from System.Web.Script.Serialization import JavaScriptSerializer
vworld_key = "C492AE9A-1701-393D-913A-D080B66D18CC"

def read(apiurl) : 
    request = WebRequest.Create(apiurl)
    request.Method = "GET"
    response = request.GetResponse()
    stream = response.GetResponseStream()
    reader = StreamReader(stream)
    responseText = reader.ReadToEnd()
    return json.loads(responseText)

def terrain(ymin,xmin,ymax,xmax, typeCol, vworld_key) :
    params = {
        "SERVICE": "WFS",
        "REQUEST": "GetFeature",
        "TYPENAME": typeCol,
        "BBOX": "{0:.10f},{1:.10f},{2:.10f},{3:.10f}".format(ymin, xmin, ymax, xmax),
        "VERSION": "2.0.0",
        "MAXFEATURES": "1000",
        "SRSNAME": "EPSG:4326",
        "OUTPUT": "application/json",
        "EXCEPTIONS": "text/xml",
        "KEY": vworld_key
    }

    apiurl = "https://api.vworld.kr/req/wfs"

    # params 딕셔너리를 URL 쿼리 스트링으로 변환
    query_string = "&".join(["{0}={1}".format(key, value) for key, value in params.items()])
    full_url = "{0}?{1}".format(apiurl,query_string)
    data = read(full_url)
    return data
    

def ground(ymin,xmin,ymax,xmax, typeCol, vworld_key) :
    params = {
        "TYPENAME": typeCol,
        "BBOX": "{0:.10f},{1:.10f},{2:.10f},{3:.10f}".format(ymin, xmin, ymax, xmax),
        "MAXFEATURES": "1000",
        "SRSNAME": "EPSG:4326",
        "OUTPUT": "application/json",
        "KEY": vworld_key
    }

    apiurl = "https://api.vworld.kr/ned/wfs/getLandCharacteristicsWFS"

    # params 딕셔너리를 URL 쿼리 스트링으로 변환
    query_string = "&".join(["{0}={1}".format(key, value) for key, value in params.items()])
    full_url = "{0}?{1}".format(apiurl,query_string)
    data = read(full_url)
    return data


def AddressToCoord(input_address, vworld_key):
    apiurl = "https://api.vworld.kr/req/address?service=address&request=getcoord&crs=EPSG:4326&address={0}&format=json&type=road&key={1}".format(input_address, vworld_key)
    request = WebRequest.Create(apiurl)
    request.Method = "GET"
    response = request.GetResponse()
    stream = response.GetResponseStream()
    reader = StreamReader(stream)
    responseText = reader.ReadToEnd()
    response_data = json.loads(responseText)
    x_coord = response_data['response']['result']['point']['x']
    y_coord = response_data['response']['result']['point']['y']
    return float(x_coord), float(y_coord)

info = []

if Run : 
    xmin, ymin = AddressToCoord(input_address1, vworld_key)
    xmax, ymax = AddressToCoord(input_address2, vworld_key)
    if(ymin > ymax) : ymin, ymax = ymax, ymin
    if(xmin > xmax) : xmin, xmax = xmax, xmin
    typeM = ["lt_c_spbd", "lt_c_upisuq151", "lt_c_upisuq161", "lt_c_uq111"]
    for s in typeM : 
        result = JavaScriptSerializer().Serialize(terrain(ymin,xmin,ymax,xmax, s, vworld_key))
        info.append(result)
    info
    groundModel = JavaScriptSerializer().Serialize(ground(ymin,xmin,ymax,xmax, "dt_d194", vworld_key))
# ---------- end python ----------
python_2 = GhPythonScript(Run=Toggle(True), input_address1="강원 춘천시 터미널길14번길 15", input_address2="강원 춘천시 공지로 316 춘천교육대학교부설초등학교")  # -> out, info
# ---------- python_2: Python ----------
__author__ = "BaekInchan"
__version__ = "2024.02.08"

import rhinoscriptsyntax as rs
from System.Net import HttpWebRequest, WebRequest
from System.IO import StreamReader
import json
import clr
clr.AddReference('System.Web.Extensions')
from System.Web.Script.Serialization import JavaScriptSerializer
vworld_key = "C492AE9A-1701-393D-913A-D080B66D18CC"

def read(apiurl) : 
    request = WebRequest.Create(apiurl)
    request.Method = "GET"
    response = request.GetResponse()
    stream = response.GetResponseStream()
    reader = StreamReader(stream)
    responseText = reader.ReadToEnd()
    return json.loads(responseText)

def terrain(ymin,xmin,ymax,xmax, typeCol, vworld_key) :
    params = {
        "SERVICE": "WFS",
        "REQUEST": "GetFeature",
        "TYPENAME": typeCol,
        "BBOX": "{0:.10f},{1:.10f},{2:.10f},{3:.10f}".format(ymin, xmin, ymax, xmax),
        "VERSION": "2.0.0",
        "MAXFEATURES": "1000",
        "SRSNAME": "EPSG:4326",
        "OUTPUT": "application/json",
        "EXCEPTIONS": "text/xml",
        "KEY": vworld_key
    }

    apiurl = "https://api.vworld.kr/req/wfs"

    # params 딕셔너리를 URL 쿼리 스트링으로 변환
    query_string = "&".join(["{0}={1}".format(key, value) for key, value in params.items()])
    full_url = "{0}?{1}".format(apiurl,query_string)
    data = read(full_url)
    return data


def AddressToCoord(input_address, vworld_key):
    apiurl = "https://api.vworld.kr/req/address?service=address&request=getcoord&crs=EPSG:4326&address={0}&format=json&type=road&key={1}".format(input_address, vworld_key)
    request = WebRequest.Create(apiurl)
    request.Method = "GET"
    response = request.GetResponse()
    stream = response.GetResponseStream()
    reader = StreamReader(stream)
    responseText = reader.ReadToEnd()
    response_data = json.loads(responseText)
    x_coord = response_data['response']['result']['point']['x']
    y_coord = response_data['response']['result']['point']['y']
    return float(x_coord), float(y_coord)

info = []
if Run : 
    xmin, ymin = AddressToCoord(input_address1, vworld_key)
    xmax, ymax = AddressToCoord(input_address2, vworld_key)
    if(ymin > ymax) : ymin, ymax = ymax, ymin
    if(xmin > xmax) : xmin, xmax = xmax, xmin
    typeM = ["lt_c_spbd", "lt_c_upisuq151", "lt_c_wkmstrm", "lp_pa_cbnd_bubun", "lt_c_upisuq161", "lt_c_uq111"]
    for s in typeM : 
        result = JavaScriptSerializer().Serialize(terrain(ymin,xmin,ymax,xmax, s, vworld_key))
        info.append(result)
    info
# ---------- end python_2 ----------
python_3 = GhPythonScript()  # -> out, gps
# ---------- python_3: Python ----------
__author__ = "BaekInchan"
__version__ = "2024.02.08"

import rhinoscriptsyntax as rs
from math import sin, cos, tan, pi, sqrt

RADIANS_PER_DEGREE = pi/180.0
DEGREES_PER_RADIAN = 180.0/pi

WGS84_A =  6378137.0
WGS84_B =  6356752.31424518
WGS84_F =  0.0033528107
WGS84_E =  0.0818191908
WGS84_EP = 0.0820944379

UTM_K0 =   0.9996
UTM_FE =   500000.0
UTM_FN_N = 0.0
UTM_FN_S = 10000000.0
UTM_E2 =   (WGS84_E*WGS84_E)
UTM_E4 =   (UTM_E2*UTM_E2)
UTM_E6 =   (UTM_E4*UTM_E2)
UTM_EP2 =  (UTM_E2/(1-UTM_E2))

class GPStoUTM(object):
    def __init__(self, **kwargs):
        pass

    def UTM(self, lat, lon):
        '''
        Gets the UTM coordinate without the letter and number.
        '''
        self.m0 = (1 - UTM_E2/4 - 3*UTM_E4/64 - 5*UTM_E6/256)
        self.m1 = -(3*UTM_E2/8 + 3*UTM_E4/32 + 45*UTM_E6/1024)
        self.m2 = (15*UTM_E4/256 + 45*UTM_E6/1024)
        self.m3 = -(35*UTM_E6/3072)

        if lon > 0:
            self.cm = int(lon) - (int(lon) % 6) + 3
        else:
            self.cm = int(lon) - (int(lon) % 6) - 3

        self.rlat = lat * RADIANS_PER_DEGREE
        self.rlon = lon * RADIANS_PER_DEGREE
        self.rlon0 = self.cm * RADIANS_PER_DEGREE

        self.slat = sin(self.rlat)
        self.clat = cos(self.rlat)
        self.tlat = tan(self.rlat)

        if lat > 0:
            self.fn = UTM_FN_N
        else:
            self.fn = UTM_FN_S

        self.T = self.tlat*self.tlat
        self.C = UTM_EP2 * self.clat * self.clat
        self.A = (self.rlon - self.rlon0) * self.clat
        self.M = WGS84_A * (self.m0*self.rlat + self.m1*sin(2*self.rlat) + \
            self.m2*sin(4*self.rlat) + self.m3*sin(6*self.rlat))
        self.V = WGS84_A / sqrt(1 - UTM_E2 * self.slat * self.slat)

        self.x = UTM_FE + UTM_K0 * self.V * (self.A + (1-self.T+self.C)\
            *pow(self.A, 3)/6 +(5-18*self.T+self.T*self.T+72*self.C-58*UTM_EP2)\
            *pow(self.A, 5)/120)

        self.y = self.fn + UTM_K0 * (self.M + self.V * self.tlat * \
            (self.A*self.A/2 + (5-self.T+9*self.C+4*self.C*self.C)* \
            pow(self.A, 4)/24 + ((61-58*self.T+self.T*self.T+600*self.C-\
            330*UTM_EP2) * pow(self.A, 6)/720)))

        return (self.x, self.y)

    def UTMLetterDesignator(self, Lat):
        '''
        Gets the UTM letter only.
        '''
        self.LetterDesignator = 'Z'
        if ((84 >= Lat) and (Lat >= 72)):
            self.LetterDesignator = 'X'
        elif ((72 > Lat) and (Lat >= 64)):
            self.LetterDesignator = 'W'
        elif ((64 > Lat) and (Lat >= 56)):
            self.LetterDesignator = 'V'
        elif ((56 > Lat) and (Lat >= 48)):
            self.LetterDesignator = 'U'
        elif ((48 > Lat) and (Lat >= 40)):
            self.LetterDesignator = 'T'
        elif ((40 > Lat) and (Lat >= 32)):
            self.LetterDesignator = 'S'
        elif ((32 > Lat) and (Lat >= 24)):
            self.LetterDesignator = 'R'
        elif ((24 > Lat) and (Lat >= 16)):
            self.LetterDesignator = 'Q'
        elif ((16 > Lat) and (Lat >= 8)):
            self.LetterDesignator = 'P'
        elif (( 8 > Lat) and (Lat >= 0)):
            self.LetterDesignator = 'N'
        elif (( 0 > Lat) and (Lat >= -8)):
            self.LetterDesignator = 'M'
        elif ((-8 > Lat) and (Lat >= -16)):
            self.LetterDesignator = 'L'
        elif ((-16 > Lat) and (Lat >= -24)):
            self.LetterDesignator = 'K'
        elif ((-24 > Lat) and (Lat >= -32)):
            self.LetterDesignator = 'J'
        elif ((-32 > Lat) and (Lat >= -40)):
            self.LetterDesignator = 'H'
        elif ((-40 > Lat) and (Lat >= -48)):
            self.LetterDesignator = 'G'
        elif ((-48 > Lat) and (Lat >= -56)):
            self.LetterDesignator = 'F'
        elif ((-56 > Lat) and (Lat >= -64)):
            self.LetterDesignator = 'E'
        elif ((-64 > Lat) and (Lat >= -72)):
            self.LetterDesignator = 'D'
        elif ((-72 > Lat) and (Lat >= -80)):
            self.LetterDesignator = 'C'
        return self.LetterDesignator

    def LLtoUTM(self, Lat, Long):
        '''
        Gets the UTM coordinate with the letter and number as inputs also.
        '''
        self.a = WGS84_A;
        self.eccSquared = UTM_E2;
        self.k0 = UTM_K0;

        self.LongTemp = (Long+180)-int((Long+180)/360)*360-180

        self.LatRad = Lat * RADIANS_PER_DEGREE
        self.LongRad = self.LongTemp * RADIANS_PER_DEGREE

        self.ZoneNumber = int((self.LongTemp+180)/6) + 1

        self.LongOrigin = (self.ZoneNumber-1)*6 - 180 + 3
        self.LongOriginRad = self.LongOrigin * RADIANS_PER_DEGREE

        self.eccPrimeSquared = (self.eccSquared)/(1-self.eccSquared);

        self.N = self.a/sqrt(1-self.eccSquared*sin(self.LatRad)*\
            sin(self.LatRad));
        self.T = tan(self.LatRad)*tan(self.LatRad);
        self.C = self.eccPrimeSquared*cos(self.LatRad)*cos(self.LatRad);
        self.A = cos(self.LatRad)*(self.LongRad-self.LongOriginRad);

        self.M = self.a*((1 - self.eccSquared/4 -\
            3*self.eccSquared*self.eccSquared/64 -\
            5*self.eccSquared*self.eccSquared*self.eccSquared/256) * \
            self.LatRad - (3*self.eccSquared/8 + 3*self.eccSquared*\
            self.eccSquared/32 +45*self.eccSquared*self.eccSquared*\
            self.eccSquared/1024)*sin(2*self.LatRad) + (15*self.eccSquared*\
            self.eccSquared/256 + 45*self.eccSquared*self.eccSquared*\
            self.eccSquared/1024)*sin(4*self.LatRad) - (35*self.eccSquared*\
            self.eccSquared*self.eccSquared/3072)*sin(6*self.LatRad))

        self.UTMEasting = float(self.k0*self.N*(self.A+(1-self.T+self.C)*\
            self.A**3/6 + (5-18*self.T+self.T*self.T+72*self.C-58*\
            self.eccPrimeSquared)*self.A**4/120) + 500000.0)

        self.UTMNorthing = float(self.k0*(self.M+self.N*tan(self.LatRad)\
            *(self.A**2/2+(5-self.T+9*self.C+4*self.C**2)*self.A**4/24 + (61-58\
            *self.T+self.T**2+600*self.C-330*self.eccPrimeSquared)\
            *self.A**6/720)))

        if (Lat < 0):
            self.UTMNorthing += 10000000.0

        return (self.UTMEasting, self.UTMNorthing)

    def UTMtoLL(self, UTMNorthing, UTMEasting, UTMNumber, UTMLetter):
        '''
        Gets the latitude and longitude with the UTM letter and number.
        '''
        self.ZoneNumber = int(UTMNumber)
        self.ZoneLetter = UTMLetter

        self.k0 = UTM_K0
        self.a = WGS84_A
        self.eccSquared = UTM_E2
        self.e1 = (1-sqrt(1-self.eccSquared))/(1+sqrt(1-self.eccSquared))

        self.x = UTMEasting - 500000.0
        self.y = UTMNorthing

        if self.ZoneLetter < 'N':
            self.y -= 10000000.0

        self.LongOrigin = (self.ZoneNumber - 1)*6 - 180 + 3
        self.eccPrimeSquared = (self.eccSquared)/(1-self.eccSquared)

        self.M = self.y/self.k0;
        self.mu = self.M/(self.a*(1-self.eccSquared/4-3*self.eccSquared**2/64\
            -5*self.eccSquared**3/256))

        self.phi1Rad = self.mu + ((3*self.e1/2-27*self.e1**3/32)*sin(2*self.mu)\
            + (21*self.e1**2/16-55*self.e1**4/32)*sin(4*self.mu)\
            + (151*self.e1**3/96)*sin(6*self.mu))

        self.N1 = self.a/sqrt(1-self.eccSquared*sin(self.phi1Rad)**2)
        self.T1 = tan(self.phi1Rad)**2
        self.C1 = self.eccPrimeSquared*cos(self.phi1Rad)**2
        self.R1 = self.a*(1-self.eccSquared)/pow(1-self.eccSquared*sin(self.phi1Rad)**2, 1.5)
        self.D = self.x/(self.N1*self.k0)

        self.Lat = self.phi1Rad - ((self.N1*tan(self.phi1Rad)/self.R1)\
            *(self.D**2/2-(5+3*self.T1+10*self.C1-4*self.C1**2-9\
            *self.eccPrimeSquared)*self.D**4/24+(61+90*self.T1+298*self.C1\
            +45*self.T1**2-252*self.eccPrimeSquared-3*self.C1**2)\
            *self.D**6/720))

        self.Lat = self.Lat * DEGREES_PER_RADIAN

        self.Long = ((self.D-(1+2*self.T1+self.C1)*self.D**3/6+(5-2*self.C1\
            +28*self.T1-3*self.C1**2+8*self.eccPrimeSquared+24*self.T1**2)\
            *self.D**5/120)/cos(self.phi1Rad))

        self.Long = self.LongOrigin + self.Long * DEGREES_PER_RADIAN

        return (self.Lat, self.Long)
        
gps = GPStoUTM()
# ---------- end python_3 ----------
python_4 = GhPythonScript()  # -> out, gps; same code as python_3
python_5 = GhPythonScript(gps=python_3.gps, info=python.info, groundModel=python.groundModel)  # -> out, building, building_height, street, ground, gound_height; inputs info: list
# ---------- python_5: Python ----------
__author__ = "BaekInchan"
__version__ = "2024.02.08"

import rhinoscriptsyntax as rs
import Rhino.Geometry as rg
import random
import clr
clr.AddReference('System.Web.Extensions')
from System.Web.Script.Serialization import JavaScriptSerializer


bldPolylines = []
buildingHeight = []
strPolylines = []
strNamePolylines = []
cadastralMap = []
driveWay = []
subsidiarysection = []

bucket = [bldPolylines, strPolylines, strNamePolylines, cadastralMap, driveWay, subsidiarysection]

for id, result in enumerate(info) : 
    if result is not None:
        dataDict = JavaScriptSerializer().DeserializeObject(result)
        features = dataDict["features"]
        for feature in features:
            coords = feature["geometry"]["coordinates"]
            points = []
            for coord in coords[0][0]:
                try:
                    x, y = gps.LLtoUTM(coord[1], coord[0])
                    pt = rg.Point3d(x, y, 0)
                    points.append(pt)
                except: continue
            if(len(points) == 0) : continue
            try : 
                polyline = rs.AddPolyline(points)
                bucket[id].append(polyline)
                if id == 0 : 
                    height = feature["properties"]["gro_flo_co"]
                    if(height == 0) : 
                        height = random.randint(1, 3)
                    buildingHeight.append(height)
            except : pass

ground = []
ground_height = []

if groundModel is not None:
    dataDict = JavaScriptSerializer().DeserializeObject(groundModel)
    features = dataDict["features"]
    for feature in features:
        coords = feature["geometry"]["coordinates"]
        points = []
        for coord in coords[0][0]:
            try:
                x, y = gps.LLtoUTM(coord[1], coord[0])
                pt = rg.Point3d(x, y, 0)
                points.append(pt)
            except: continue
        if(len(points) == 0) : continue
        try : 
            polyline = rs.AddPolyline(points)
            ground.append(polyline)
            height = int(feature["properties"]["tpgrph_hg_code"])
            if(height == 0) : 
                height = random.randint(1, 3)
            buildingHeight.append(height)
            tpgrph_hg_code
        except : pass
            
            
building = bucket[0]
building_height = buildingHeight
street = bucket[1]
ground = ground
ground_height = ground_height
# ---------- end python_5 ----------
python_6 = GhPythonScript(gps=python_4.gps, info=python_2.info)  # -> out, building, building_height, street, cadastral, water; inputs info: list
# ---------- python_6: Python ----------
__author__ = "BaekInchan"
__version__ = "2024.02.08"

import rhinoscriptsyntax as rs
import Rhino.Geometry as rg
import random
import clr
clr.AddReference('System.Web.Extensions')
from System.Web.Script.Serialization import JavaScriptSerializer


bldPolylines = []
buildingHeight = []
strPolylines = []
strNamePolylines = []
cadastralMap = []
driveWay = []
subsidiarysection = []

bucket = [bldPolylines, strPolylines, strNamePolylines, cadastralMap, driveWay, subsidiarysection]

for id, result in enumerate(info) : 
    if result is not None:
        dataDict = JavaScriptSerializer().DeserializeObject(result)
        features = dataDict["features"]
        for feature in features:
            coords = feature["geometry"]["coordinates"]
            points = []
            for coord in coords[0][0]:
                try:
                    x, y = gps.LLtoUTM(coord[1], coord[0])
                    pt = rg.Point3d(x, y, 0)
                    points.append(pt)
                except: continue
            if(len(points) == 0) : continue
            try : 
                polyline = rs.AddPolyline(points)
                bucket[id].append(polyline)
                if id == 0 : 
                    height = feature["properties"]["gro_flo_co"]
                    if(height == 0) : 
                        height = random.randint(1, 3)
                    buildingHeight.append(height * 3)
            except : pass
            
building = bucket[0]
building_height = buildingHeight
street = bucket[1]
water = bucket[2]
cadastral = bucket[3]
# ---------- end python_6 ----------
crv = Curve(python_6.building)
crv_2 = Curve(python_6.street)
crv_3 = Curve(python_6.cadastral)
crv_4 = Curve(python_6.water)
crv_5 = Curve(python_5.building)
crv_6 = Curve(python_5.street)
crv_7 = Curve(python_5.ground)
join = JoinCurves(Curves=crv, Preserve=False)
Z = UnitZ(Factor=python_6.building_height)
boundary = BoundarySurfaces(Edges=crv_2)
boundary_2 = BoundarySurfaces(Edges=crv_4)
join_2 = JoinCurves(Curves=crv_6, Preserve=False)
join_3 = JoinCurves(Preserve=False)
Z_2 = UnitZ(Factor=1)
join_4 = JoinCurves(Curves=crv_7, Preserve=False)
extr = Extrude(Base=join, Direction=Z)
preview = CustomPreview(Geometry=join_2, Material=ColourSwatch(SwatchColor=RGB(46, 40, 40)))
preview_2 = CustomPreview(Geometry=join_4, Material=ColourSwatch(SwatchColor=RGB(207, 196, 40)))
cap = CapHoles(Brep=extr)
extr_2 = Extrude(Base=join_3, Direction=Z_2)
preview_3 = CustomPreview(Geometry=cap, Material=ColourSwatch(SwatchColor=RGB(209, 74, 132)))
preview_4 = CustomPreview(Geometry=boundary, Material=ColourSwatch(SwatchColor=RGB(153, 153, 153)))
preview_5 = CustomPreview(Geometry=boundary_2, Material=ColourSwatch(SwatchColor=RGB(36, 107, 225)))
cap_2 = CapHoles(Brep=extr_2)
preview_6 = CustomPreview(Geometry=cap_2, Material=ColourSwatch(SwatchColor=RGB(212, 51, 51)))
