# Grasshopper definition mapMakerV2.gh (Grasshopper 1.0.7)

python = GhPythonScript(
    Run=Toggle(True),
    input_address1="서울 강남구 남부순환로 2744",
    input_address2="서울 송파구 한가람로 65 한강사업본부 잠실안내센터",
    typeCol="lt_c_b3surfacemark")  # -> out, info
# ---------- python: Python ----------
__author__ = "BaekInchan"
__version__ = "2024.02.08"

import rhinoscriptsyntax as rs
from System.Net import HttpWebRequest, WebRequest
from System.IO import StreamReader
import json
import clr
clr.AddReference('System.Web.Extensions')
from System.Web.Script.Serialization import JavaScriptSerializer
vworld_key = "2E83D8C0-6737-36FA-8A59-919ED2F15065"

def read(apiurl) : 
    request = WebRequest.Create(apiurl)
    request.Method = "GET"
    response = request.GetResponse()
    stream = response.GetResponseStream()
    reader = StreamReader(stream)
    responseText = reader.ReadToEnd()
    return json.loads(responseText)

def terrain(ymin,xmin,ymax,xmax, typeCol, vworld_key) :
    params = {
        "SERVICE": "WFS",
        "REQUEST": "GetFeature",
        "TYPENAME": typeCol,
        "BBOX": "{0},{1},{2},{3}".format(ymin, xmin, ymax, xmax),
        "VERSION": "2.0.0",
        "MAXFEATURES": "1000",
        "SRSNAME": "EPSG:4326",
        "OUTPUT": "application/json",
        "EXCEPTIONS": "text/xml",
        "KEY": vworld_key
    }

    apiurl = "https://api.vworld.kr/req/wfs"

    # params 딕셔너리를 URL 쿼리 스트링으로 변환
    query_string = "&".join(["{0}={1}".format(key, value) for key, value in params.items()])
    full_url = "{0}?{1}".format(apiurl,query_string)
    data = read(full_url)
    return data


def AddressToCoord(input_address, vworld_key):
    apiurl = "https://api.vworld.kr/req/address?service=address&request=getcoord&crs=EPSG:4326&address={0}&format=json&type=road&key={1}".format(input_address, vworld_key)
    request = WebRequest.Create(apiurl)
    request.Method = "GET"
    response = request.GetResponse()
    stream = response.GetResponseStream()
    reader = StreamReader(stream)
    responseText = reader.ReadToEnd()
    response_data = json.loads(responseText)
    x_coord = response_data['response']['result']['point']['x']
    y_coord = response_data['response']['result']['point']['y']
    return float(x_coord), float(y_coord)

def divideMap(t, ymin, xmin, ymax, xmax) : 
    rectangles = []
    current_x = xmin
    while current_x < xmax:
        next_x = min(current_x + t, xmax)
        current_y = ymin
        while current_y < ymax:
            next_y = min(current_y + t, ymax)
            rectangles.append((current_y, current_x, next_y, next_x))
            current_y += t
        current_x += t
    return rectangles
    
    
info = []
typeM = ["lt_c_spbd", "lt_c_upisuq151", "lt_c_wkmstrm", "lp_pa_cbnd_bubun", "lt_c_uq162"]
typeM.append(typeCol)

if Run : 
    xmin, ymin = AddressToCoord(input_address1, vworld_key)
    xmax, ymax = AddressToCoord(input_address2, vworld_key)
    if(ymin > ymax) : ymin, ymax = ymax, ymin
    if(xmin > xmax) : xmin, xmax = xmax, xmin
    dm = divideMap(0.005, ymin,xmin, ymax, xmax)
    print(len(dm))
    print(dm)
    if(len(dm) <= 300) : 
        for i in dm : 
            obj = []
            for s in typeM : 
                try : 
                    result = JavaScriptSerializer().Serialize(terrain(i[0],i[1],i[2],i[3], s, vworld_key))
                    obj.append(result)
                except : continue
            info.append(obj)


info
# ---------- end python ----------
python_2 = GhPythonScript()  # -> out, gps
# ---------- python_2: Python ----------
__author__ = "BaekInchan"
__version__ = "2024.02.08"

import rhinoscriptsyntax as rs
from math import sin, cos, tan, pi, sqrt

RADIANS_PER_DEGREE = pi/180.0
DEGREES_PER_RADIAN = 180.0/pi

WGS84_A =  6378137.0
WGS84_B =  6356752.31424518
WGS84_F =  0.0033528107
WGS84_E =  0.0818191908
WGS84_EP = 0.0820944379

UTM_K0 =   0.9996
UTM_FE =   500000.0
UTM_FN_N = 0.0
UTM_FN_S = 10000000.0
UTM_E2 =   (WGS84_E*WGS84_E)
UTM_E4 =   (UTM_E2*UTM_E2)
UTM_E6 =   (UTM_E4*UTM_E2)
UTM_EP2 =  (UTM_E2/(1-UTM_E2))

class GPStoUTM(object):
    def __init__(self, **kwargs):
        pass

    def UTM(self, lat, lon):
        '''
        Gets the UTM coordinate without the letter and number.
        '''
        self.m0 = (1 - UTM_E2/4 - 3*UTM_E4/64 - 5*UTM_E6/256)
        self.m1 = -(3*UTM_E2/8 + 3*UTM_E4/32 + 45*UTM_E6/1024)
        self.m2 = (15*UTM_E4/256 + 45*UTM_E6/1024)
        self.m3 = -(35*UTM_E6/3072)

        if lon > 0:
            self.cm = int(lon) - (int(lon) % 6) + 3
        else:
            self.cm = int(lon) - (int(lon) % 6) - 3

        self.rlat = lat * RADIANS_PER_DEGREE
        self.rlon = lon * RADIANS_PER_DEGREE
        self.rlon0 = self.cm * RADIANS_PER_DEGREE

        self.slat = sin(self.rlat)
        self.clat = cos(self.rlat)
        self.tlat = tan(self.rlat)

        if lat > 0:
            self.fn = UTM_FN_N
        else:
            self.fn = UTM_FN_S

        self.T = self.tlat*self.tlat
        self.C = UTM_EP2 * self.clat * self.clat
        self.A = (self.rlon - self.rlon0) * self.clat
        self.M = WGS84_A * (self.m0*self.rlat + self.m1*sin(2*self.rlat) + \
            self.m2*sin(4*self.rlat) + self.m3*sin(6*self.rlat))
        self.V = WGS84_A / sqrt(1 - UTM_E2 * self.slat * self.slat)

        self.x = UTM_FE + UTM_K0 * self.V * (self.A + (1-self.T+self.C)\
            *pow(self.A, 3)/6 +(5-18*self.T+self.T*self.T+72*self.C-58*UTM_EP2)\
            *pow(self.A, 5)/120)

        self.y = self.fn + UTM_K0 * (self.M + self.V * self.tlat * \
            (self.A*self.A/2 + (5-self.T+9*self.C+4*self.C*self.C)* \
            pow(self.A, 4)/24 + ((61-58*self.T+self.T*self.T+600*self.C-\
            330*UTM_EP2) * pow(self.A, 6)/720)))

        return (self.x, self.y)

    def UTMLetterDesignator(self, Lat):
        '''
        Gets the UTM letter only.
        '''
        self.LetterDesignator = 'Z'
        if ((84 >= Lat) and (Lat >= 72)):
            self.LetterDesignator = 'X'
        elif ((72 > Lat) and (Lat >= 64)):
            self.LetterDesignator = 'W'
        elif ((64 > Lat) and (Lat >= 56)):
            self.LetterDesignator = 'V'
        elif ((56 > Lat) and (Lat >= 48)):
            self.LetterDesignator = 'U'
        elif ((48 > Lat) and (Lat >= 40)):
            self.LetterDesignator = 'T'
        elif ((40 > Lat) and (Lat >= 32)):
            self.LetterDesignator = 'S'
        elif ((32 > Lat) and (Lat >= 24)):
            self.LetterDesignator = 'R'
        elif ((24 > Lat) and (Lat >= 16)):
            self.LetterDesignator = 'Q'
        elif ((16 > Lat) and (Lat >= 8)):
            self.LetterDesignator = 'P'
        elif (( 8 > Lat) and (Lat >= 0)):
            self.LetterDesignator = 'N'
        elif (( 0 > Lat) and (Lat >= -8)):
            self.LetterDesignator = 'M'
        elif ((-8 > Lat) and (Lat >= -16)):
            self.LetterDesignator = 'L'
        elif ((-16 > Lat) and (Lat >= -24)):
            self.LetterDesignator = 'K'
        elif ((-24 > Lat) and (Lat >= -32)):
            self.LetterDesignator = 'J'
        elif ((-32 > Lat) and (Lat >= -40)):
            self.LetterDesignator = 'H'
        elif ((-40 > Lat) and (Lat >= -48)):
            self.LetterDesignator = 'G'
        elif ((-48 > Lat) and (Lat >= -56)):
            self.LetterDesignator = 'F'
        elif ((-56 > Lat) and (Lat >= -64)):
            self.LetterDesignator = 'E'
        elif ((-64 > Lat) and (Lat >= -72)):
            self.LetterDesignator = 'D'
        elif ((-72 > Lat) and (Lat >= -80)):
            self.LetterDesignator = 'C'
        return self.LetterDesignator

    def LLtoUTM(self, Lat, Long):
        '''
        Gets the UTM coordinate with the letter and number as inputs also.
        '''
        self.a = WGS84_A;
        self.eccSquared = UTM_E2;
        self.k0 = UTM_K0;

        self.LongTemp = (Long+180)-int((Long+180)/360)*360-180

        self.LatRad = Lat * RADIANS_PER_DEGREE
        self.LongRad = self.LongTemp * RADIANS_PER_DEGREE

        self.ZoneNumber = int((self.LongTemp+180)/6) + 1

        self.LongOrigin = (self.ZoneNumber-1)*6 - 180 + 3
        self.LongOriginRad = self.LongOrigin * RADIANS_PER_DEGREE

        self.eccPrimeSquared = (self.eccSquared)/(1-self.eccSquared);

        self.N = self.a/sqrt(1-self.eccSquared*sin(self.LatRad)*\
            sin(self.LatRad));
        self.T = tan(self.LatRad)*tan(self.LatRad);
        self.C = self.eccPrimeSquared*cos(self.LatRad)*cos(self.LatRad);
        self.A = cos(self.LatRad)*(self.LongRad-self.LongOriginRad);

        self.M = self.a*((1 - self.eccSquared/4 -\
            3*self.eccSquared*self.eccSquared/64 -\
            5*self.eccSquared*self.eccSquared*self.eccSquared/256) * \
            self.LatRad - (3*self.eccSquared/8 + 3*self.eccSquared*\
            self.eccSquared/32 +45*self.eccSquared*self.eccSquared*\
            self.eccSquared/1024)*sin(2*self.LatRad) + (15*self.eccSquared*\
            self.eccSquared/256 + 45*self.eccSquared*self.eccSquared*\
            self.eccSquared/1024)*sin(4*self.LatRad) - (35*self.eccSquared*\
            self.eccSquared*self.eccSquared/3072)*sin(6*self.LatRad))

        self.UTMEasting = float(self.k0*self.N*(self.A+(1-self.T+self.C)*\
            self.A**3/6 + (5-18*self.T+self.T*self.T+72*self.C-58*\
            self.eccPrimeSquared)*self.A**4/120) + 500000.0)

        self.UTMNorthing = float(self.k0*(self.M+self.N*tan(self.LatRad)\
            *(self.A**2/2+(5-self.T+9*self.C+4*self.C**2)*self.A**4/24 + (61-58\
            *self.T+self.T**2+600*self.C-330*self.eccPrimeSquared)\
            *self.A**6/720)))

        if (Lat < 0):
            self.UTMNorthing += 10000000.0

        return (self.UTMEasting, self.UTMNorthing)

    def UTMtoLL(self, UTMNorthing, UTMEasting, UTMNumber, UTMLetter):
        '''
        Gets the latitude and longitude with the UTM letter and number.
        '''
        self.ZoneNumber = int(UTMNumber)
        self.ZoneLetter = UTMLetter

        self.k0 = UTM_K0
        self.a = WGS84_A
        self.eccSquared = UTM_E2
        self.e1 = (1-sqrt(1-self.eccSquared))/(1+sqrt(1-self.eccSquared))

        self.x = UTMEasting - 500000.0
        self.y = UTMNorthing

        if self.ZoneLetter < 'N':
            self.y -= 10000000.0

        self.LongOrigin = (self.ZoneNumber - 1)*6 - 180 + 3
        self.eccPrimeSquared = (self.eccSquared)/(1-self.eccSquared)

        self.M = self.y/self.k0;
        self.mu = self.M/(self.a*(1-self.eccSquared/4-3*self.eccSquared**2/64\
            -5*self.eccSquared**3/256))

        self.phi1Rad = self.mu + ((3*self.e1/2-27*self.e1**3/32)*sin(2*self.mu)\
            + (21*self.e1**2/16-55*self.e1**4/32)*sin(4*self.mu)\
            + (151*self.e1**3/96)*sin(6*self.mu))

        self.N1 = self.a/sqrt(1-self.eccSquared*sin(self.phi1Rad)**2)
        self.T1 = tan(self.phi1Rad)**2
        self.C1 = self.eccPrimeSquared*cos(self.phi1Rad)**2
        self.R1 = self.a*(1-self.eccSquared)/pow(1-self.eccSquared*sin(self.phi1Rad)**2, 1.5)
        self.D = self.x/(self.N1*self.k0)

        self.Lat = self.phi1Rad - ((self.N1*tan(self.phi1Rad)/self.R1)\
            *(self.D**2/2-(5+3*self.T1+10*self.C1-4*self.C1**2-9\
            *self.eccPrimeSquared)*self.D**4/24+(61+90*self.T1+298*self.C1\
            +45*self.T1**2-252*self.eccPrimeSquared-3*self.C1**2)\
            *self.D**6/720))

        self.Lat = self.Lat * DEGREES_PER_RADIAN

        self.Long = ((self.D-(1+2*self.T1+self.C1)*self.D**3/6+(5-2*self.C1\
            +28*self.T1-3*self.C1**2+8*self.eccPrimeSquared+24*self.T1**2)\
            *self.D**5/120)/cos(self.phi1Rad))

        self.Long = self.LongOrigin + self.Long * DEGREES_PER_RADIAN

        return (self.Lat, self.Long)
        
gps = GPStoUTM()
# ---------- end python_2 ----------
python_3 = GhPythonScript(gps=python_2.gps, info=python.info)  # -> out, building, building_height, street, cadastral, water, green, detail_street; inputs info: list
# ---------- python_3: Python ----------
__author__ = "BaekInchan"
__version__ = "2024.02.08"

import rhinoscriptsyntax as rs
import Rhino.Geometry as rg
import random
import clr
clr.AddReference('System.Web.Extensions')
from System.Web.Script.Serialization import JavaScriptSerializer


bldPolylines = {}
buildingHeight = {}
strPolylines = {}
waterPolylines = {}
cadastralMap = {}
greenPolylines = {}
detailstr = {}

bucket = [bldPolylines, strPolylines, waterPolylines, cadastralMap, greenPolylines, detailstr]

for i in info : 
    for id, result in enumerate(i) : 
        if result is not None:
            dataDict = JavaScriptSerializer().DeserializeObject(result)
            features = dataDict["features"]
            for feature in features:
                coords = feature["geometry"]["coordinates"]
                points = []
                for coord in coords[0][0]:
                    try:
                        x, y = gps.LLtoUTM(coord[1], coord[0])
                        pt = rg.Point3d(x, y, 0)
                        points.append(pt)
                    except: continue
                if(len(points) == 0) : continue
                try : 
                    polyline = rs.AddPolyline(points)
                    bucket[id][polyline] = 1
                    if id == 0 : 
                        height = feature["properties"]["gro_flo_co"]
                        if(height == 0) : 
                            height = random.randint(1, 4)
                        buildingHeight[polyline] = height * 4
                        
                except : pass


building = bucket[0].keys()
building_height = buildingHeight.values()
street = bucket[1].keys()
water = bucket[2].keys()
cadastral = bucket[3].keys()
green = bucket[4].keys()
detail_street = bucket[5].keys()
# ---------- end python_3 ----------
crv = Curve(python_3.building)
Z = UnitZ(Factor=python_3.building_height)
crv_2 = Curve(python_3.street)
crv_3 = Curve(python_3.cadastral)
crv_4 = Curve(python_3.water)
crv_5 = Curve(python_3.green)
crv_6 = Curve(python_3.detail_street)
boundary = BoundarySurfaces(Edges=crv_4)
boundary_2 = BoundarySurfaces(Edges=crv_5)
boundary_3 = BoundarySurfaces(Edges=crv)
area = Area(Geometry=boundary)  # -> Area, Centroid
area_2 = Area(Geometry=boundary_2)  # -> Area, Centroid
extr = Extrude(Base=boundary_3, Direction=Z)
cullpt = CullDuplicates(Points=area.Centroid, Tolerance=0.1, CullMode=1)  # -> Points, Indices, Valence
cullpt_2 = CullDuplicates(Points=area_2.Centroid, Tolerance=0.1, CullMode=1)  # -> Points, Indices, Valence
area_3 = Area(Geometry=extr)  # -> Area, Centroid
item = ListItem(List=boundary, Index=cullpt.Indices, Wrap=True)
item_2 = ListItem(List=boundary_2, Index=cullpt_2.Indices, Wrap=True)
cullpt_3 = CullDuplicates(Points=area_3.Centroid, Tolerance=0.1, CullMode=1)  # -> Points, Indices, Valence
preview = CustomPreview(Geometry=item, Material=ColourSwatch(SwatchColor=RGB(0, 85, 255)))
preview_2 = CustomPreview(Geometry=item_2, Material=ColourSwatch(SwatchColor=RGB(0, 255, 34)))
item_3 = ListItem(List=extr, Index=cullpt_3.Indices, Wrap=True)
cap = CapHoles(Brep=item_3)
preview_3 = CustomPreview(Geometry=cap, Material=ColourSwatch(SwatchColor=RGB(209, 74, 132)))
