# Grasshopper definition flatten_mass.gh (Grasshopper 1.0.7)

brep = Brep([<brep referenced from the Rhino model> x3590])
debrep = DeconstructBrep(Brep=brep)  # -> Faces, Edges, Vertices
area = Area(Geometry=debrep.Faces)  # -> Area, Centroid
pdecon = Deconstruct(Point=area.Centroid)  # -> XComponent, YComponent, ZComponent
sort = SortList(Keys=pdecon.ZComponent, ValuesA=debrep.Faces)  # -> Keys, ValuesA
item = ListItem(List=sort.ValuesA, Index=0, Wrap=True)
Z = UnitZ(Factor=1)
srf = Surface(<surface referenced from the Rhino model>)
area_2 = Area(Geometry=item)  # -> Area, Centroid
rev = Reverse(Vector=Z)
project = ProjectPoint(Point=area_2.Centroid, Direction=rev, Geometry=srf)  # -> Point, Index
vec2pt = Vector2Pt(PointA=area_2.Centroid, PointB=project.Point, Unitize=False)  # -> Vector, Length
move = Move(Geometry=graft(brep), Motion=vec2pt.Vector)  # -> Geometry, Transform
