# Grasshopper definition mapmodeling.gh (Grasshopper 1.0.7)
# plug-ins: atit, NGon

panel = Panel(""""C:\Users\BaekInchan\Desktop\설계스튜디오9_졸업설계\맵모델링\압구정\N3A_A0010000.shp"
"C:\Users\BaekInchan\Desktop\설계스튜디오9_졸업설계\맵모델링\압구정\N3A_A0033320.shp"
"C:\Users\BaekInchan\Desktop\설계스튜디오9_졸업설계\맵모델링\압구정\N3A_A0053326.shp"
"C:\Users\BaekInchan\Desktop\설계스튜디오9_졸업설계\맵모델링\압구정\N3A_A0063321.shp"
"C:\Users\BaekInchan\Desktop\설계스튜디오9_졸업설계\맵모델링\압구정\N3A_A0070000.shp"
"C:\Users\BaekInchan\Desktop\설계스튜디오9_졸업설계\맵모델링\압구정\N3A_A0080000.shp"
"C:\Users\BaekInchan\Desktop\설계스튜디오9_졸업설계\맵모델링\압구정\N3A_A0090000.shp"
"C:\Users\BaekInchan\Desktop\설계스튜디오9_졸업설계\맵모델링\압구정\N3A_A0100000.shp"
"C:\Users\BaekInchan\Desktop\설계스튜디오9_졸업설계\맵모델링\압구정\N3A_A0110020.shp"
"C:\Users\BaekInchan\Desktop\설계스튜디오9_졸업설계\맵모델링\압구정\N3A_A0160024.shp"
"C:\Users\BaekInchan\Desktop\설계스튜디오9_졸업설계\맵모델링\압구정\N3A_A0191221.shp"
"C:\Users\BaekInchan\Desktop\설계스튜디오9_졸업설계\맵모델링\압구정\N3A_A0201222.shp"
"C:\Users\BaekInchan\Desktop\설계스튜디오9_졸업설계\맵모델링\압구정\N3A_B0010000.shp"
"C:\Users\BaekInchan\Desktop\설계스튜디오9_졸업설계\맵모델링\압구정\N3A_C0186115.shp"
"C:\Users\BaekInchan\Desktop\설계스튜디오9_졸업설계\맵모델링\압구정\N3A_C0390000.shp"
"C:\Users\BaekInchan\Desktop\설계스튜디오9_졸업설계\맵모델링\압구정\N3A_C0423365.shp"
"C:\Users\BaekInchan\Desktop\설계스튜디오9_졸업설계\맵모델링\압구정\N3A_C0430000.shp"
"C:\Users\BaekInchan\Desktop\설계스튜디오9_졸업설계\맵모델링\압구정\N3A_D0010000.shp"
"C:\Users\BaekInchan\Desktop\설계스튜디오9_졸업설계\맵모델링\압구정\N3A_E0010001.shp"
"C:\Users\BaekInchan\Desktop\설계스튜디오9_졸업설계\맵모델링\압구정\N3A_E0032111.shp"
"C:\Users\BaekInchan\Desktop\설계스튜디오9_졸업설계\맵모델링\압구정\N3A_E0052114.shp"
"C:\Users\BaekInchan\Desktop\설계스튜디오9_졸업설계\맵모델링\압구정\N3A_G0010000.shp"
"C:\Users\BaekInchan\Desktop\설계스튜디오9_졸업설계\맵모델링\압구정\N3A_G0020000.shp"
"C:\Users\BaekInchan\Desktop\설계스튜디오9_졸업설계\맵모델링\압구정\N3L_A0010000.shp"
"C:\Users\BaekInchan\Desktop\설계스튜디오9_졸업설계\맵모델링\압구정\N3L_A0020000.shp"
"C:\Users\BaekInchan\Desktop\설계스튜디오9_졸업설계\맵모델링\압구정\N3L_A0033330.shp"
"C:\Users\BaekInchan\Desktop\설계스튜디오9_졸업설계\맵모델링\압구정\N3L_A0123373.shp"
"C:\Users\BaekInchan\Desktop\설계스튜디오9_졸업설계\맵모델링\압구정\N3L_A0150000.shp"
"C:\Users\BaekInchan\Desktop\설계스튜디오9_졸업설계\맵모델링\압구정\N3L_A0171119.shp"
"C:\Users\BaekInchan\Desktop\설계스튜디오9_졸업설계\맵모델링\압구정\N3L_B0020000.shp"
"C:\Users\BaekInchan\Desktop\설계스튜디오9_졸업설계\맵모델링\압구정\N3L_C0050000.shp"
"C:\Users\BaekInchan\Desktop\설계스튜디오9_졸업설계\맵모델링\압구정\N3L_C0060000.shp"
"C:\Users\BaekInchan\Desktop\설계스튜디오9_졸업설계\맵모델링\압구정\N3L_C0070000.shp"
"C:\Users\BaekInchan\Desktop\설계스튜디오9_졸업설계\맵모델링\압구정\N3L_C0520000.shp"
"C:\Users\BaekInchan\Desktop\설계스튜디오9_졸업설계\맵모델링\압구정\N3L_E0020000.shp"
"C:\Users\BaekInchan\Desktop\설계스튜디오9_졸업설계\맵모델링\압구정\N3L_F0010000.shp"
"C:\Users\BaekInchan\Desktop\설계스튜디오9_졸업설계\맵모델링\압구정\N3L_F0030000.shp"
"C:\Users\BaekInchan\Desktop\설계스튜디오9_졸업설계\맵모델링\압구정\N3L_F0040000.shp"
"C:\Users\BaekInchan\Desktop\설계스튜디오9_졸업설계\맵모델링\압구정\N3L_G0030000.shp"
"C:\Users\BaekInchan\Desktop\설계스튜디오9_졸업설계\맵모델링\압구정\N3L_H0010000.shp"
"C:\Users\BaekInchan\Desktop\설계스튜디오9_졸업설계\맵모델링\압구정\N3P_A0131122.shp"
"C:\Users\BaekInchan\Desktop\설계스튜디오9_졸업설계\맵모델링\압구정\N3P_C0210000.shp"
"C:\Users\BaekInchan\Desktop\설계스튜디오9_졸업설계\맵모델링\압구정\N3P_C0380000.shp"
"C:\Users\BaekInchan\Desktop\설계스튜디오9_졸업설계\맵모델링\압구정\N3P_D0030000.shp"
"C:\Users\BaekInchan\Desktop\설계스튜디오9_졸업설계\맵모델링\압구정\N3P_E0042326.shp"
"C:\Users\BaekInchan\Desktop\설계스튜디오9_졸업설계\맵모델링\압구정\N3P_F0020000.shp"
"C:\Users\BaekInchan\Desktop\설계스튜디오9_졸업설계\맵모델링\압구정\N3P_H0020000.shp"
"C:\Users\BaekInchan\Desktop\설계스튜디오9_졸업설계\맵모델링\압구정\N3P_H0040000.shp"
"C:\Users\BaekInchan\Desktop\설계스튜디오9_졸업설계\맵모델링\압구정\N3P_H0059153.shp"
""")
panel_2 = Panel(""""C:\Users\BaekInchan\Desktop\설계스튜디오9_졸업설계\맵모델링\강남구청\(B010)수치지도_37705092_2022_00000597055733\N3P_H0040000.shp"
"C:\Users\BaekInchan\Desktop\설계스튜디오9_졸업설계\맵모델링\강남구청\(B010)수치지도_37705092_2022_00000597055733\N3A_A0010000.shp"
"C:\Users\BaekInchan\Desktop\설계스튜디오9_졸업설계\맵모델링\강남구청\(B010)수치지도_37705092_2022_00000597055733\N3A_A0033320.shp"
"C:\Users\BaekInchan\Desktop\설계스튜디오9_졸업설계\맵모델링\강남구청\(B010)수치지도_37705092_2022_00000597055733\N3A_A0053326.shp"
"C:\Users\BaekInchan\Desktop\설계스튜디오9_졸업설계\맵모델링\강남구청\(B010)수치지도_37705092_2022_00000597055733\N3A_A0080000.shp"
"C:\Users\BaekInchan\Desktop\설계스튜디오9_졸업설계\맵모델링\강남구청\(B010)수치지도_37705092_2022_00000597055733\N3A_B0010000.shp"
"C:\Users\BaekInchan\Desktop\설계스튜디오9_졸업설계\맵모델링\강남구청\(B010)수치지도_37705092_2022_00000597055733\N3A_C0186115.shp"
"C:\Users\BaekInchan\Desktop\설계스튜디오9_졸업설계\맵모델링\강남구청\(B010)수치지도_37705092_2022_00000597055733\N3A_C0305316.shp"
"C:\Users\BaekInchan\Desktop\설계스튜디오9_졸업설계\맵모델링\강남구청\(B010)수치지도_37705092_2022_00000597055733\N3A_C0390000.shp"
"C:\Users\BaekInchan\Desktop\설계스튜디오9_졸업설계\맵모델링\강남구청\(B010)수치지도_37705092_2022_00000597055733\N3A_C0423365.shp"
"C:\Users\BaekInchan\Desktop\설계스튜디오9_졸업설계\맵모델링\강남구청\(B010)수치지도_37705092_2022_00000597055733\N3A_C0430000.shp"
"C:\Users\BaekInchan\Desktop\설계스튜디오9_졸업설계\맵모델링\강남구청\(B010)수치지도_37705092_2022_00000597055733\N3A_G0010000.shp"
"C:\Users\BaekInchan\Desktop\설계스튜디오9_졸업설계\맵모델링\강남구청\(B010)수치지도_37705092_2022_00000597055733\N3L_A0010000.shp"
"C:\Users\BaekInchan\Desktop\설계스튜디오9_졸업설계\맵모델링\강남구청\(B010)수치지도_37705092_2022_00000597055733\N3L_A0020000.shp"
"C:\Users\BaekInchan\Desktop\설계스튜디오9_졸업설계\맵모델링\강남구청\(B010)수치지도_37705092_2022_00000597055733\N3L_A0033330.shp"
"C:\Users\BaekInchan\Desktop\설계스튜디오9_졸업설계\맵모델링\강남구청\(B010)수치지도_37705092_2022_00000597055733\N3L_B0020000.shp"
"C:\Users\BaekInchan\Desktop\설계스튜디오9_졸업설계\맵모델링\강남구청\(B010)수치지도_37705092_2022_00000597055733\N3L_C0070000.shp"
"C:\Users\BaekInchan\Desktop\설계스튜디오9_졸업설계\맵모델링\강남구청\(B010)수치지도_37705092_2022_00000597055733\N3L_C0520000.shp"
"C:\Users\BaekInchan\Desktop\설계스튜디오9_졸업설계\맵모델링\강남구청\(B010)수치지도_37705092_2022_00000597055733\N3L_E0020000.shp"
"C:\Users\BaekInchan\Desktop\설계스튜디오9_졸업설계\맵모델링\강남구청\(B010)수치지도_37705092_2022_00000597055733\N3L_F0010000.shp"
"C:\Users\BaekInchan\Desktop\설계스튜디오9_졸업설계\맵모델링\강남구청\(B010)수치지도_37705092_2022_00000597055733\N3L_F0040000.shp"
"C:\Users\BaekInchan\Desktop\설계스튜디오9_졸업설계\맵모델링\강남구청\(B010)수치지도_37705092_2022_00000597055733\N3L_G0030000.shp"
"C:\Users\BaekInchan\Desktop\설계스튜디오9_졸업설계\맵모델링\강남구청\(B010)수치지도_37705092_2022_00000597055733\N3L_H0010000.shp"
"C:\Users\BaekInchan\Desktop\설계스튜디오9_졸업설계\맵모델링\강남구청\(B010)수치지도_37705092_2022_00000597055733\N3P_A0131122.shp"
"C:\Users\BaekInchan\Desktop\설계스튜디오9_졸업설계\맵모델링\강남구청\(B010)수치지도_37705092_2022_00000597055733\N3P_C0285311.shp"
"C:\Users\BaekInchan\Desktop\설계스튜디오9_졸업설계\맵모델링\강남구청\(B010)수치지도_37705092_2022_00000597055733\N3P_C0310000.shp"
"C:\Users\BaekInchan\Desktop\설계스튜디오9_졸업설계\맵모델링\강남구청\(B010)수치지도_37705092_2022_00000597055733\N3P_C0380000.shp"
"C:\Users\BaekInchan\Desktop\설계스튜디오9_졸업설계\맵모델링\강남구청\(B010)수치지도_37705092_2022_00000597055733\N3P_F0020000.shp"
""")
panel_3 = Panel(""""C:\Users\BaekInchan\Desktop\설계스튜디오9_졸업설계\맵모델링\압구정\N3A_A0010000.shp"
"C:\Users\BaekInchan\Desktop\설계스튜디오9_졸업설계\맵모델링\압구정\N3A_A0033320.shp"
"C:\Users\BaekInchan\Desktop\설계스튜디오9_졸업설계\맵모델링\압구정\N3A_A0053326.shp"
"C:\Users\BaekInchan\Desktop\설계스튜디오9_졸업설계\맵모델링\압구정\N3A_A0063321.shp"
"C:\Users\BaekInchan\Desktop\설계스튜디오9_졸업설계\맵모델링\압구정\N3A_A0070000.shp"
"C:\Users\BaekInchan\Desktop\설계스튜디오9_졸업설계\맵모델링\압구정\N3A_A0080000.shp"
"C:\Users\BaekInchan\Desktop\설계스튜디오9_졸업설계\맵모델링\압구정\N3A_A0090000.shp"
"C:\Users\BaekInchan\Desktop\설계스튜디오9_졸업설계\맵모델링\압구정\N3A_A0100000.shp"
"C:\Users\BaekInchan\Desktop\설계스튜디오9_졸업설계\맵모델링\압구정\N3A_A0110020.shp"
"C:\Users\BaekInchan\Desktop\설계스튜디오9_졸업설계\맵모델링\압구정\N3A_A0160024.shp"
"C:\Users\BaekInchan\Desktop\설계스튜디오9_졸업설계\맵모델링\압구정\N3A_A0191221.shp"
"C:\Users\BaekInchan\Desktop\설계스튜디오9_졸업설계\맵모델링\압구정\N3A_A0201222.shp"
"C:\Users\BaekInchan\Desktop\설계스튜디오9_졸업설계\맵모델링\압구정\N3A_B0010000.shp"
"C:\Users\BaekInchan\Desktop\설계스튜디오9_졸업설계\맵모델링\압구정\N3A_C0186115.shp"
"C:\Users\BaekInchan\Desktop\설계스튜디오9_졸업설계\맵모델링\압구정\N3A_C0390000.shp"
"C:\Users\BaekInchan\Desktop\설계스튜디오9_졸업설계\맵모델링\압구정\N3A_C0423365.shp"
"C:\Users\BaekInchan\Desktop\설계스튜디오9_졸업설계\맵모델링\압구정\N3A_C0430000.shp"
"C:\Users\BaekInchan\Desktop\설계스튜디오9_졸업설계\맵모델링\압구정\N3A_D0010000.shp"
"C:\Users\BaekInchan\Desktop\설계스튜디오9_졸업설계\맵모델링\압구정\N3A_E0010001.shp"
"C:\Users\BaekInchan\Desktop\설계스튜디오9_졸업설계\맵모델링\압구정\N3A_E0032111.shp"
"C:\Users\BaekInchan\Desktop\설계스튜디오9_졸업설계\맵모델링\압구정\N3A_E0052114.shp"
"C:\Users\BaekInchan\Desktop\설계스튜디오9_졸업설계\맵모델링\압구정\N3A_G0010000.shp"
"C:\Users\BaekInchan\Desktop\설계스튜디오9_졸업설계\맵모델링\압구정\N3A_G0020000.shp"
"C:\Users\BaekInchan\Desktop\설계스튜디오9_졸업설계\맵모델링\압구정\N3L_A0010000.shp"
"C:\Users\BaekInchan\Desktop\설계스튜디오9_졸업설계\맵모델링\압구정\N3L_A0020000.shp"
"C:\Users\BaekInchan\Desktop\설계스튜디오9_졸업설계\맵모델링\압구정\N3L_A0033330.shp"
"C:\Users\BaekInchan\Desktop\설계스튜디오9_졸업설계\맵모델링\압구정\N3L_A0123373.shp"
"C:\Users\BaekInchan\Desktop\설계스튜디오9_졸업설계\맵모델링\압구정\N3L_A0150000.shp"
"C:\Users\BaekInchan\Desktop\설계스튜디오9_졸업설계\맵모델링\압구정\N3L_A0171119.shp"
"C:\Users\BaekInchan\Desktop\설계스튜디오9_졸업설계\맵모델링\압구정\N3L_B0020000.shp"
"C:\Users\BaekInchan\Desktop\설계스튜디오9_졸업설계\맵모델링\압구정\N3L_C0050000.shp"
"C:\Users\BaekInchan\Desktop\설계스튜디오9_졸업설계\맵모델링\압구정\N3L_C0060000.shp"
"C:\Users\BaekInchan\Desktop\설계스튜디오9_졸업설계\맵모델링\압구정\N3L_C0070000.shp"
"C:\Users\BaekInchan\Desktop\설계스튜디오9_졸업설계\맵모델링\압구정\N3L_C0520000.shp"
"C:\Users\BaekInchan\Desktop\설계스튜디오9_졸업설계\맵모델링\압구정\N3L_E0020000.shp"
"C:\Users\BaekInchan\Desktop\설계스튜디오9_졸업설계\맵모델링\압구정\N3L_F0010000.shp"
"C:\Users\BaekInchan\Desktop\설계스튜디오9_졸업설계\맵모델링\압구정\N3L_F0030000.shp"
"C:\Users\BaekInchan\Desktop\설계스튜디오9_졸업설계\맵모델링\압구정\N3L_F0040000.shp"
"C:\Users\BaekInchan\Desktop\설계스튜디오9_졸업설계\맵모델링\압구정\N3L_G0030000.shp"
"C:\Users\BaekInchan\Desktop\설계스튜디오9_졸업설계\맵모델링\압구정\N3L_H0010000.shp"
"C:\Users\BaekInchan\Desktop\설계스튜디오9_졸업설계\맵모델링\압구정\N3P_A0131122.shp"
"C:\Users\BaekInchan\Desktop\설계스튜디오9_졸업설계\맵모델링\압구정\N3P_C0210000.shp"
"C:\Users\BaekInchan\Desktop\설계스튜디오9_졸업설계\맵모델링\압구정\N3P_C0380000.shp"
"C:\Users\BaekInchan\Desktop\설계스튜디오9_졸업설계\맵모델링\압구정\N3P_D0030000.shp"
"C:\Users\BaekInchan\Desktop\설계스튜디오9_졸업설계\맵모델링\압구정\N3P_E0042326.shp"
"C:\Users\BaekInchan\Desktop\설계스튜디오9_졸업설계\맵모델링\압구정\N3P_F0020000.shp"
"C:\Users\BaekInchan\Desktop\설계스튜디오9_졸업설계\맵모델링\압구정\N3P_H0020000.shp"
"C:\Users\BaekInchan\Desktop\설계스튜디오9_졸업설계\맵모델링\압구정\N3P_H0040000.shp"
"C:\Users\BaekInchan\Desktop\설계스튜디오9_졸업설계\맵모델링\압구정\N3P_H0059153.shp"
""")
panel_4 = Panel(""""C:\Users\BaekInchan\Desktop\설계스튜디오9_졸업설계\맵모델링\강남구청\(B010)수치지도_37705092_2022_00000597055733\N3P_H0040000.shp"
"C:\Users\BaekInchan\Desktop\설계스튜디오9_졸업설계\맵모델링\강남구청\(B010)수치지도_37705092_2022_00000597055733\N3A_A0010000.shp"
"C:\Users\BaekInchan\Desktop\설계스튜디오9_졸업설계\맵모델링\강남구청\(B010)수치지도_37705092_2022_00000597055733\N3A_A0033320.shp"
"C:\Users\BaekInchan\Desktop\설계스튜디오9_졸업설계\맵모델링\강남구청\(B010)수치지도_37705092_2022_00000597055733\N3A_A0053326.shp"
"C:\Users\BaekInchan\Desktop\설계스튜디오9_졸업설계\맵모델링\강남구청\(B010)수치지도_37705092_2022_00000597055733\N3A_A0080000.shp"
"C:\Users\BaekInchan\Desktop\설계스튜디오9_졸업설계\맵모델링\강남구청\(B010)수치지도_37705092_2022_00000597055733\N3A_B0010000.shp"
"C:\Users\BaekInchan\Desktop\설계스튜디오9_졸업설계\맵모델링\강남구청\(B010)수치지도_37705092_2022_00000597055733\N3A_C0186115.shp"
"C:\Users\BaekInchan\Desktop\설계스튜디오9_졸업설계\맵모델링\강남구청\(B010)수치지도_37705092_2022_00000597055733\N3A_C0305316.shp"
"C:\Users\BaekInchan\Desktop\설계스튜디오9_졸업설계\맵모델링\강남구청\(B010)수치지도_37705092_2022_00000597055733\N3A_C0390000.shp"
"C:\Users\BaekInchan\Desktop\설계스튜디오9_졸업설계\맵모델링\강남구청\(B010)수치지도_37705092_2022_00000597055733\N3A_C0423365.shp"
"C:\Users\BaekInchan\Desktop\설계스튜디오9_졸업설계\맵모델링\강남구청\(B010)수치지도_37705092_2022_00000597055733\N3A_C0430000.shp"
"C:\Users\BaekInchan\Desktop\설계스튜디오9_졸업설계\맵모델링\강남구청\(B010)수치지도_37705092_2022_00000597055733\N3A_G0010000.shp"
"C:\Users\BaekInchan\Desktop\설계스튜디오9_졸업설계\맵모델링\강남구청\(B010)수치지도_37705092_2022_00000597055733\N3L_A0010000.shp"
"C:\Users\BaekInchan\Desktop\설계스튜디오9_졸업설계\맵모델링\강남구청\(B010)수치지도_37705092_2022_00000597055733\N3L_A0020000.shp"
"C:\Users\BaekInchan\Desktop\설계스튜디오9_졸업설계\맵모델링\강남구청\(B010)수치지도_37705092_2022_00000597055733\N3L_A0033330.shp"
"C:\Users\BaekInchan\Desktop\설계스튜디오9_졸업설계\맵모델링\강남구청\(B010)수치지도_37705092_2022_00000597055733\N3L_B0020000.shp"
"C:\Users\BaekInchan\Desktop\설계스튜디오9_졸업설계\맵모델링\강남구청\(B010)수치지도_37705092_2022_00000597055733\N3L_C0070000.shp"
"C:\Users\BaekInchan\Desktop\설계스튜디오9_졸업설계\맵모델링\강남구청\(B010)수치지도_37705092_2022_00000597055733\N3L_C0520000.shp"
"C:\Users\BaekInchan\Desktop\설계스튜디오9_졸업설계\맵모델링\강남구청\(B010)수치지도_37705092_2022_00000597055733\N3L_E0020000.shp"
"C:\Users\BaekInchan\Desktop\설계스튜디오9_졸업설계\맵모델링\강남구청\(B010)수치지도_37705092_2022_00000597055733\N3L_F0010000.shp"
"C:\Users\BaekInchan\Desktop\설계스튜디오9_졸업설계\맵모델링\강남구청\(B010)수치지도_37705092_2022_00000597055733\N3L_F0040000.shp"
"C:\Users\BaekInchan\Desktop\설계스튜디오9_졸업설계\맵모델링\강남구청\(B010)수치지도_37705092_2022_00000597055733\N3L_G0030000.shp"
"C:\Users\BaekInchan\Desktop\설계스튜디오9_졸업설계\맵모델링\강남구청\(B010)수치지도_37705092_2022_00000597055733\N3L_H0010000.shp"
"C:\Users\BaekInchan\Desktop\설계스튜디오9_졸업설계\맵모델링\강남구청\(B010)수치지도_37705092_2022_00000597055733\N3P_A0131122.shp"
"C:\Users\BaekInchan\Desktop\설계스튜디오9_졸업설계\맵모델링\강남구청\(B010)수치지도_37705092_2022_00000597055733\N3P_C0285311.shp"
"C:\Users\BaekInchan\Desktop\설계스튜디오9_졸업설계\맵모델링\강남구청\(B010)수치지도_37705092_2022_00000597055733\N3P_C0310000.shp"
"C:\Users\BaekInchan\Desktop\설계스튜디오9_졸업설계\맵모델링\강남구청\(B010)수치지도_37705092_2022_00000597055733\N3P_C0380000.shp"
"C:\Users\BaekInchan\Desktop\설계스튜디오9_졸업설계\맵모델링\강남구청\(B010)수치지도_37705092_2022_00000597055733\N3P_F0020000.shp"
""")
panel_5 = Panel(""""C:\Users\BaekInchan\Desktop\설계스튜디오9_졸업설계\맵모델링\신사\N3P_H0059153.shp"
"C:\Users\BaekInchan\Desktop\설계스튜디오9_졸업설계\맵모델링\신사\N3A_A0010000.shp"
"C:\Users\BaekInchan\Desktop\설계스튜디오9_졸업설계\맵모델링\신사\N3A_A0033320.shp"
"C:\Users\BaekInchan\Desktop\설계스튜디오9_졸업설계\맵모델링\신사\N3A_A0053326.shp"
"C:\Users\BaekInchan\Desktop\설계스튜디오9_졸업설계\맵모델링\신사\N3A_A0063321.shp"
"C:\Users\BaekInchan\Desktop\설계스튜디오9_졸업설계\맵모델링\신사\N3A_A0070000.shp"
"C:\Users\BaekInchan\Desktop\설계스튜디오9_졸업설계\맵모델링\신사\N3A_A0080000.shp"
"C:\Users\BaekInchan\Desktop\설계스튜디오9_졸업설계\맵모델링\신사\N3A_A0090000.shp"
"C:\Users\BaekInchan\Desktop\설계스튜디오9_졸업설계\맵모델링\신사\N3A_A0100000.shp"
"C:\Users\BaekInchan\Desktop\설계스튜디오9_졸업설계\맵모델링\신사\N3A_A0110020.shp"
"C:\Users\BaekInchan\Desktop\설계스튜디오9_졸업설계\맵모델링\신사\N3A_A0160024.shp"
"C:\Users\BaekInchan\Desktop\설계스튜디오9_졸업설계\맵모델링\신사\N3A_A0191221.shp"
"C:\Users\BaekInchan\Desktop\설계스튜디오9_졸업설계\맵모델링\신사\N3A_A0201222.shp"
"C:\Users\BaekInchan\Desktop\설계스튜디오9_졸업설계\맵모델링\신사\N3A_B0010000.shp"
"C:\Users\BaekInchan\Desktop\설계스튜디오9_졸업설계\맵모델링\신사\N3A_C0186115.shp"
"C:\Users\BaekInchan\Desktop\설계스튜디오9_졸업설계\맵모델링\신사\N3A_C0390000.shp"
"C:\Users\BaekInchan\Desktop\설계스튜디오9_졸업설계\맵모델링\신사\N3A_C0423365.shp"
"C:\Users\BaekInchan\Desktop\설계스튜디오9_졸업설계\맵모델링\신사\N3A_C0430000.shp"
"C:\Users\BaekInchan\Desktop\설계스튜디오9_졸업설계\맵모델링\신사\N3A_D0010000.shp"
"C:\Users\BaekInchan\Desktop\설계스튜디오9_졸업설계\맵모델링\신사\N3A_E0010001.shp"
"C:\Users\BaekInchan\Desktop\설계스튜디오9_졸업설계\맵모델링\신사\N3A_E0032111.shp"
"C:\Users\BaekInchan\Desktop\설계스튜디오9_졸업설계\맵모델링\신사\N3A_E0052114.shp"
"C:\Users\BaekInchan\Desktop\설계스튜디오9_졸업설계\맵모델링\신사\N3A_G0010000.shp"
"C:\Users\BaekInchan\Desktop\설계스튜디오9_졸업설계\맵모델링\신사\N3A_G0020000.shp"
"C:\Users\BaekInchan\Desktop\설계스튜디오9_졸업설계\맵모델링\신사\N3L_A0010000.shp"
"C:\Users\BaekInchan\Desktop\설계스튜디오9_졸업설계\맵모델링\신사\N3L_A0020000.shp"
"C:\Users\BaekInchan\Desktop\설계스튜디오9_졸업설계\맵모델링\신사\N3L_A0033320.shp"
"C:\Users\BaekInchan\Desktop\설계스튜디오9_졸업설계\맵모델링\신사\N3L_A0123373.shp"
"C:\Users\BaekInchan\Desktop\설계스튜디오9_졸업설계\맵모델링\신사\N3L_A0150000.shp"
"C:\Users\BaekInchan\Desktop\설계스튜디오9_졸업설계\맵모델링\신사\N3L_A0171119.shp"
"C:\Users\BaekInchan\Desktop\설계스튜디오9_졸업설계\맵모델링\신사\N3L_B0020000.shp"
"C:\Users\BaekInchan\Desktop\설계스튜디오9_졸업설계\맵모델링\신사\N3L_C0050000.shp"
"C:\Users\BaekInchan\Desktop\설계스튜디오9_졸업설계\맵모델링\신사\N3L_C0060000.shp"
"C:\Users\BaekInchan\Desktop\설계스튜디오9_졸업설계\맵모델링\신사\N3L_C0520000.shp"
"C:\Users\BaekInchan\Desktop\설계스튜디오9_졸업설계\맵모델링\신사\N3L_E0020000.shp"
"C:\Users\BaekInchan\Desktop\설계스튜디오9_졸업설계\맵모델링\신사\N3L_F0010000.shp"
"C:\Users\BaekInchan\Desktop\설계스튜디오9_졸업설계\맵모델링\신사\N3L_F0030000.shp"
"C:\Users\BaekInchan\Desktop\설계스튜디오9_졸업설계\맵모델링\신사\N3L_F0040000.shp"
"C:\Users\BaekInchan\Desktop\설계스튜디오9_졸업설계\맵모델링\신사\N3L_G0030000.shp"
"C:\Users\BaekInchan\Desktop\설계스튜디오9_졸업설계\맵모델링\신사\N3L_H0010000.shp"
"C:\Users\BaekInchan\Desktop\설계스튜디오9_졸업설계\맵모델링\신사\N3P_A0131122.shp"
"C:\Users\BaekInchan\Desktop\설계스튜디오9_졸업설계\맵모델링\신사\N3P_C0380000.shp"
"C:\Users\BaekInchan\Desktop\설계스튜디오9_졸업설계\맵모델링\신사\N3P_E0042326.shp"
"C:\Users\BaekInchan\Desktop\설계스튜디오9_졸업설계\맵모델링\신사\N3P_F0020000.shp"
"C:\Users\BaekInchan\Desktop\설계스튜디오9_졸업설계\맵모델링\신사\N3P_H0020000.shp"
"C:\Users\BaekInchan\Desktop\설계스튜디오9_졸업설계\맵모델링\신사\N3P_H0040000.shp"
""")
panel_6 = Panel(""""C:\Users\BaekInchan\Desktop\설계스튜디오9_졸업설계\맵모델링\논현역\(B010)수치지도_37705091_2022_00000452529185\N3P_H0040000.shp"
"C:\Users\BaekInchan\Desktop\설계스튜디오9_졸업설계\맵모델링\논현역\(B010)수치지도_37705091_2022_00000452529185\N3A_A0010000.shp"
"C:\Users\BaekInchan\Desktop\설계스튜디오9_졸업설계\맵모델링\논현역\(B010)수치지도_37705091_2022_00000452529185\N3A_A0033320.shp"
"C:\Users\BaekInchan\Desktop\설계스튜디오9_졸업설계\맵모델링\논현역\(B010)수치지도_37705091_2022_00000452529185\N3A_A0053326.shp"
"C:\Users\BaekInchan\Desktop\설계스튜디오9_졸업설계\맵모델링\논현역\(B010)수치지도_37705091_2022_00000452529185\N3A_A0063321.shp"
"C:\Users\BaekInchan\Desktop\설계스튜디오9_졸업설계\맵모델링\논현역\(B010)수치지도_37705091_2022_00000452529185\N3A_A0070000.shp"
"C:\Users\BaekInchan\Desktop\설계스튜디오9_졸업설계\맵모델링\논현역\(B010)수치지도_37705091_2022_00000452529185\N3A_A0080000.shp"
"C:\Users\BaekInchan\Desktop\설계스튜디오9_졸업설계\맵모델링\논현역\(B010)수치지도_37705091_2022_00000452529185\N3A_A0090000.shp"
"C:\Users\BaekInchan\Desktop\설계스튜디오9_졸업설계\맵모델링\논현역\(B010)수치지도_37705091_2022_00000452529185\N3A_A0100000.shp"
"C:\Users\BaekInchan\Desktop\설계스튜디오9_졸업설계\맵모델링\논현역\(B010)수치지도_37705091_2022_00000452529185\N3A_A0160024.shp"
"C:\Users\BaekInchan\Desktop\설계스튜디오9_졸업설계\맵모델링\논현역\(B010)수치지도_37705091_2022_00000452529185\N3A_B0010000.shp"
"C:\Users\BaekInchan\Desktop\설계스튜디오9_졸업설계\맵모델링\논현역\(B010)수치지도_37705091_2022_00000452529185\N3A_C0186115.shp"
"C:\Users\BaekInchan\Desktop\설계스튜디오9_졸업설계\맵모델링\논현역\(B010)수치지도_37705091_2022_00000452529185\N3A_C0390000.shp"
"C:\Users\BaekInchan\Desktop\설계스튜디오9_졸업설계\맵모델링\논현역\(B010)수치지도_37705091_2022_00000452529185\N3A_C0423365.shp"
"C:\Users\BaekInchan\Desktop\설계스튜디오9_졸업설계\맵모델링\논현역\(B010)수치지도_37705091_2022_00000452529185\N3A_C0430000.shp"
"C:\Users\BaekInchan\Desktop\설계스튜디오9_졸업설계\맵모델링\논현역\(B010)수치지도_37705091_2022_00000452529185\N3A_D0010000.shp"
"C:\Users\BaekInchan\Desktop\설계스튜디오9_졸업설계\맵모델링\논현역\(B010)수치지도_37705091_2022_00000452529185\N3A_E0010001.shp"
"C:\Users\BaekInchan\Desktop\설계스튜디오9_졸업설계\맵모델링\논현역\(B010)수치지도_37705091_2022_00000452529185\N3A_E0032111.shp"
"C:\Users\BaekInchan\Desktop\설계스튜디오9_졸업설계\맵모델링\논현역\(B010)수치지도_37705091_2022_00000452529185\N3A_E0052114.shp"
"C:\Users\BaekInchan\Desktop\설계스튜디오9_졸업설계\맵모델링\논현역\(B010)수치지도_37705091_2022_00000452529185\N3A_G0010000.shp"
"C:\Users\BaekInchan\Desktop\설계스튜디오9_졸업설계\맵모델링\논현역\(B010)수치지도_37705091_2022_00000452529185\N3A_G0020000.shp"
"C:\Users\BaekInchan\Desktop\설계스튜디오9_졸업설계\맵모델링\논현역\(B010)수치지도_37705091_2022_00000452529185\N3L_A0010000.shp"
"C:\Users\BaekInchan\Desktop\설계스튜디오9_졸업설계\맵모델링\논현역\(B010)수치지도_37705091_2022_00000452529185\N3L_A0020000.shp"
"C:\Users\BaekInchan\Desktop\설계스튜디오9_졸업설계\맵모델링\논현역\(B010)수치지도_37705091_2022_00000452529185\N3L_A0033330.shp"
"C:\Users\BaekInchan\Desktop\설계스튜디오9_졸업설계\맵모델링\논현역\(B010)수치지도_37705091_2022_00000452529185\N3L_A0150000.shp"
"C:\Users\BaekInchan\Desktop\설계스튜디오9_졸업설계\맵모델링\논현역\(B010)수치지도_37705091_2022_00000452529185\N3L_A0171119.shp"
"C:\Users\BaekInchan\Desktop\설계스튜디오9_졸업설계\맵모델링\논현역\(B010)수치지도_37705091_2022_00000452529185\N3L_B0020000.shp"
"C:\Users\BaekInchan\Desktop\설계스튜디오9_졸업설계\맵모델링\논현역\(B010)수치지도_37705091_2022_00000452529185\N3L_C0050000.shp"
"C:\Users\BaekInchan\Desktop\설계스튜디오9_졸업설계\맵모델링\논현역\(B010)수치지도_37705091_2022_00000452529185\N3L_C0060000.shp"
"C:\Users\BaekInchan\Desktop\설계스튜디오9_졸업설계\맵모델링\논현역\(B010)수치지도_37705091_2022_00000452529185\N3L_C0070000.shp"
"C:\Users\BaekInchan\Desktop\설계스튜디오9_졸업설계\맵모델링\논현역\(B010)수치지도_37705091_2022_00000452529185\N3L_C0520000.shp"
"C:\Users\BaekInchan\Desktop\설계스튜디오9_졸업설계\맵모델링\논현역\(B010)수치지도_37705091_2022_00000452529185\N3L_E0020000.shp"
"C:\Users\BaekInchan\Desktop\설계스튜디오9_졸업설계\맵모델링\논현역\(B010)수치지도_37705091_2022_00000452529185\N3L_F0010000.shp"
"C:\Users\BaekInchan\Desktop\설계스튜디오9_졸업설계\맵모델링\논현역\(B010)수치지도_37705091_2022_00000452529185\N3L_F0030000.shp"
"C:\Users\BaekInchan\Desktop\설계스튜디오9_졸업설계\맵모델링\논현역\(B010)수치지도_37705091_2022_00000452529185\N3L_F0040000.shp"
"C:\Users\BaekInchan\Desktop\설계스튜디오9_졸업설계\맵모델링\논현역\(B010)수치지도_37705091_2022_00000452529185\N3L_G0030000.shp"
"C:\Users\BaekInchan\Desktop\설계스튜디오9_졸업설계\맵모델링\논현역\(B010)수치지도_37705091_2022_00000452529185\N3L_H0010000.shp"
"C:\Users\BaekInchan\Desktop\설계스튜디오9_졸업설계\맵모델링\논현역\(B010)수치지도_37705091_2022_00000452529185\N3P_A0131122.shp"
"C:\Users\BaekInchan\Desktop\설계스튜디오9_졸업설계\맵모델링\논현역\(B010)수치지도_37705091_2022_00000452529185\N3P_C0380000.shp"
"C:\Users\BaekInchan\Desktop\설계스튜디오9_졸업설계\맵모델링\논현역\(B010)수치지도_37705091_2022_00000452529185\N3P_D0030000.shp"
"C:\Users\BaekInchan\Desktop\설계스튜디오9_졸업설계\맵모델링\논현역\(B010)수치지도_37705091_2022_00000452529185\N3P_E0042326.shp"
"C:\Users\BaekInchan\Desktop\설계스튜디오9_졸업설계\맵모델링\논현역\(B010)수치지도_37705091_2022_00000452529185\N3P_F0020000.shp"
"C:\Users\BaekInchan\Desktop\설계스튜디오9_졸업설계\맵모델링\논현역\(B010)수치지도_37705091_2022_00000452529185\N3P_H0020000.shp"
""")
panel_7 = Panel(""""C:\Users\BaekInchan\Desktop\설계스튜디오9_졸업설계\맵모델링\신사\N3P_H0059153.shp"
"C:\Users\BaekInchan\Desktop\설계스튜디오9_졸업설계\맵모델링\신사\N3A_A0010000.shp"
"C:\Users\BaekInchan\Desktop\설계스튜디오9_졸업설계\맵모델링\신사\N3A_A0033320.shp"
"C:\Users\BaekInchan\Desktop\설계스튜디오9_졸업설계\맵모델링\신사\N3A_A0053326.shp"
"C:\Users\BaekInchan\Desktop\설계스튜디오9_졸업설계\맵모델링\신사\N3A_A0063321.shp"
"C:\Users\BaekInchan\Desktop\설계스튜디오9_졸업설계\맵모델링\신사\N3A_A0070000.shp"
"C:\Users\BaekInchan\Desktop\설계스튜디오9_졸업설계\맵모델링\신사\N3A_A0080000.shp"
"C:\Users\BaekInchan\Desktop\설계스튜디오9_졸업설계\맵모델링\신사\N3A_A0090000.shp"
"C:\Users\BaekInchan\Desktop\설계스튜디오9_졸업설계\맵모델링\신사\N3A_A0100000.shp"
"C:\Users\BaekInchan\Desktop\설계스튜디오9_졸업설계\맵모델링\신사\N3A_A0110020.shp"
"C:\Users\BaekInchan\Desktop\설계스튜디오9_졸업설계\맵모델링\신사\N3A_A0160024.shp"
"C:\Users\BaekInchan\Desktop\설계스튜디오9_졸업설계\맵모델링\신사\N3A_A0191221.shp"
"C:\Users\BaekInchan\Desktop\설계스튜디오9_졸업설계\맵모델링\신사\N3A_A0201222.shp"
"C:\Users\BaekInchan\Desktop\설계스튜디오9_졸업설계\맵모델링\신사\N3A_B0010000.shp"
"C:\Users\BaekInchan\Desktop\설계스튜디오9_졸업설계\맵모델링\신사\N3A_C0186115.shp"
"C:\Users\BaekInchan\Desktop\설계스튜디오9_졸업설계\맵모델링\신사\N3A_C0390000.shp"
"C:\Users\BaekInchan\Desktop\설계스튜디오9_졸업설계\맵모델링\신사\N3A_C0423365.shp"
"C:\Users\BaekInchan\Desktop\설계스튜디오9_졸업설계\맵모델링\신사\N3A_C0430000.shp"
"C:\Users\BaekInchan\Desktop\설계스튜디오9_졸업설계\맵모델링\신사\N3A_D0010000.shp"
"C:\Users\BaekInchan\Desktop\설계스튜디오9_졸업설계\맵모델링\신사\N3A_E0010001.shp"
"C:\Users\BaekInchan\Desktop\설계스튜디오9_졸업설계\맵모델링\신사\N3A_E0032111.shp"
"C:\Users\BaekInchan\Desktop\설계스튜디오9_졸업설계\맵모델링\신사\N3A_E0052114.shp"
"C:\Users\BaekInchan\Desktop\설계스튜디오9_졸업설계\맵모델링\신사\N3A_G0010000.shp"
"C:\Users\BaekInchan\Desktop\설계스튜디오9_졸업설계\맵모델링\신사\N3A_G0020000.shp"
"C:\Users\BaekInchan\Desktop\설계스튜디오9_졸업설계\맵모델링\신사\N3L_A0010000.shp"
"C:\Users\BaekInchan\Desktop\설계스튜디오9_졸업설계\맵모델링\신사\N3L_A0020000.shp"
"C:\Users\BaekInchan\Desktop\설계스튜디오9_졸업설계\맵모델링\신사\N3L_A0033320.shp"
"C:\Users\BaekInchan\Desktop\설계스튜디오9_졸업설계\맵모델링\신사\N3L_A0123373.shp"
"C:\Users\BaekInchan\Desktop\설계스튜디오9_졸업설계\맵모델링\신사\N3L_A0150000.shp"
"C:\Users\BaekInchan\Desktop\설계스튜디오9_졸업설계\맵모델링\신사\N3L_A0171119.shp"
"C:\Users\BaekInchan\Desktop\설계스튜디오9_졸업설계\맵모델링\신사\N3L_B0020000.shp"
"C:\Users\BaekInchan\Desktop\설계스튜디오9_졸업설계\맵모델링\신사\N3L_C0050000.shp"
"C:\Users\BaekInchan\Desktop\설계스튜디오9_졸업설계\맵모델링\신사\N3L_C0060000.shp"
"C:\Users\BaekInchan\Desktop\설계스튜디오9_졸업설계\맵모델링\신사\N3L_C0520000.shp"
"C:\Users\BaekInchan\Desktop\설계스튜디오9_졸업설계\맵모델링\신사\N3L_E0020000.shp"
"C:\Users\BaekInchan\Desktop\설계스튜디오9_졸업설계\맵모델링\신사\N3L_F0010000.shp"
"C:\Users\BaekInchan\Desktop\설계스튜디오9_졸업설계\맵모델링\신사\N3L_F0030000.shp"
"C:\Users\BaekInchan\Desktop\설계스튜디오9_졸업설계\맵모델링\신사\N3L_F0040000.shp"
"C:\Users\BaekInchan\Desktop\설계스튜디오9_졸업설계\맵모델링\신사\N3L_G0030000.shp"
"C:\Users\BaekInchan\Desktop\설계스튜디오9_졸업설계\맵모델링\신사\N3L_H0010000.shp"
"C:\Users\BaekInchan\Desktop\설계스튜디오9_졸업설계\맵모델링\신사\N3P_A0131122.shp"
"C:\Users\BaekInchan\Desktop\설계스튜디오9_졸업설계\맵모델링\신사\N3P_C0380000.shp"
"C:\Users\BaekInchan\Desktop\설계스튜디오9_졸업설계\맵모델링\신사\N3P_E0042326.shp"
"C:\Users\BaekInchan\Desktop\설계스튜디오9_졸업설계\맵모델링\신사\N3P_F0020000.shp"
"C:\Users\BaekInchan\Desktop\설계스튜디오9_졸업설계\맵모델링\신사\N3P_H0020000.shp"
"C:\Users\BaekInchan\Desktop\설계스튜디오9_졸업설계\맵모델링\신사\N3P_H0040000.shp"
""")
panel_8 = Panel(""""C:\Users\BaekInchan\Desktop\설계스튜디오9_졸업설계\맵모델링\논현역\(B010)수치지도_37705091_2022_00000452529185\N3P_H0040000.shp"
"C:\Users\BaekInchan\Desktop\설계스튜디오9_졸업설계\맵모델링\논현역\(B010)수치지도_37705091_2022_00000452529185\N3A_A0010000.shp"
"C:\Users\BaekInchan\Desktop\설계스튜디오9_졸업설계\맵모델링\논현역\(B010)수치지도_37705091_2022_00000452529185\N3A_A0033320.shp"
"C:\Users\BaekInchan\Desktop\설계스튜디오9_졸업설계\맵모델링\논현역\(B010)수치지도_37705091_2022_00000452529185\N3A_A0053326.shp"
"C:\Users\BaekInchan\Desktop\설계스튜디오9_졸업설계\맵모델링\논현역\(B010)수치지도_37705091_2022_00000452529185\N3A_A0063321.shp"
"C:\Users\BaekInchan\Desktop\설계스튜디오9_졸업설계\맵모델링\논현역\(B010)수치지도_37705091_2022_00000452529185\N3A_A0070000.shp"
"C:\Users\BaekInchan\Desktop\설계스튜디오9_졸업설계\맵모델링\논현역\(B010)수치지도_37705091_2022_00000452529185\N3A_A0080000.shp"
"C:\Users\BaekInchan\Desktop\설계스튜디오9_졸업설계\맵모델링\논현역\(B010)수치지도_37705091_2022_00000452529185\N3A_A0090000.shp"
"C:\Users\BaekInchan\Desktop\설계스튜디오9_졸업설계\맵모델링\논현역\(B010)수치지도_37705091_2022_00000452529185\N3A_A0100000.shp"
"C:\Users\BaekInchan\Desktop\설계스튜디오9_졸업설계\맵모델링\논현역\(B010)수치지도_37705091_2022_00000452529185\N3A_A0160024.shp"
"C:\Users\BaekInchan\Desktop\설계스튜디오9_졸업설계\맵모델링\논현역\(B010)수치지도_37705091_2022_00000452529185\N3A_B0010000.shp"
"C:\Users\BaekInchan\Desktop\설계스튜디오9_졸업설계\맵모델링\논현역\(B010)수치지도_37705091_2022_00000452529185\N3A_C0186115.shp"
"C:\Users\BaekInchan\Desktop\설계스튜디오9_졸업설계\맵모델링\논현역\(B010)수치지도_37705091_2022_00000452529185\N3A_C0390000.shp"
"C:\Users\BaekInchan\Desktop\설계스튜디오9_졸업설계\맵모델링\논현역\(B010)수치지도_37705091_2022_00000452529185\N3A_C0423365.shp"
"C:\Users\BaekInchan\Desktop\설계스튜디오9_졸업설계\맵모델링\논현역\(B010)수치지도_37705091_2022_00000452529185\N3A_C0430000.shp"
"C:\Users\BaekInchan\Desktop\설계스튜디오9_졸업설계\맵모델링\논현역\(B010)수치지도_37705091_2022_00000452529185\N3A_D0010000.shp"
"C:\Users\BaekInchan\Desktop\설계스튜디오9_졸업설계\맵모델링\논현역\(B010)수치지도_37705091_2022_00000452529185\N3A_E0010001.shp"
"C:\Users\BaekInchan\Desktop\설계스튜디오9_졸업설계\맵모델링\논현역\(B010)수치지도_37705091_2022_00000452529185\N3A_E0032111.shp"
"C:\Users\BaekInchan\Desktop\설계스튜디오9_졸업설계\맵모델링\논현역\(B010)수치지도_37705091_2022_00000452529185\N3A_E0052114.shp"
"C:\Users\BaekInchan\Desktop\설계스튜디오9_졸업설계\맵모델링\논현역\(B010)수치지도_37705091_2022_00000452529185\N3A_G0010000.shp"
"C:\Users\BaekInchan\Desktop\설계스튜디오9_졸업설계\맵모델링\논현역\(B010)수치지도_37705091_2022_00000452529185\N3A_G0020000.shp"
"C:\Users\BaekInchan\Desktop\설계스튜디오9_졸업설계\맵모델링\논현역\(B010)수치지도_37705091_2022_00000452529185\N3L_A0010000.shp"
"C:\Users\BaekInchan\Desktop\설계스튜디오9_졸업설계\맵모델링\논현역\(B010)수치지도_37705091_2022_00000452529185\N3L_A0020000.shp"
"C:\Users\BaekInchan\Desktop\설계스튜디오9_졸업설계\맵모델링\논현역\(B010)수치지도_37705091_2022_00000452529185\N3L_A0033330.shp"
"C:\Users\BaekInchan\Desktop\설계스튜디오9_졸업설계\맵모델링\논현역\(B010)수치지도_37705091_2022_00000452529185\N3L_A0150000.shp"
"C:\Users\BaekInchan\Desktop\설계스튜디오9_졸업설계\맵모델링\논현역\(B010)수치지도_37705091_2022_00000452529185\N3L_A0171119.shp"
"C:\Users\BaekInchan\Desktop\설계스튜디오9_졸업설계\맵모델링\논현역\(B010)수치지도_37705091_2022_00000452529185\N3L_B0020000.shp"
"C:\Users\BaekInchan\Desktop\설계스튜디오9_졸업설계\맵모델링\논현역\(B010)수치지도_37705091_2022_00000452529185\N3L_C0050000.shp"
"C:\Users\BaekInchan\Desktop\설계스튜디오9_졸업설계\맵모델링\논현역\(B010)수치지도_37705091_2022_00000452529185\N3L_C0060000.shp"
"C:\Users\BaekInchan\Desktop\설계스튜디오9_졸업설계\맵모델링\논현역\(B010)수치지도_37705091_2022_00000452529185\N3L_C0070000.shp"
"C:\Users\BaekInchan\Desktop\설계스튜디오9_졸업설계\맵모델링\논현역\(B010)수치지도_37705091_2022_00000452529185\N3L_C0520000.shp"
"C:\Users\BaekInchan\Desktop\설계스튜디오9_졸업설계\맵모델링\논현역\(B010)수치지도_37705091_2022_00000452529185\N3L_E0020000.shp"
"C:\Users\BaekInchan\Desktop\설계스튜디오9_졸업설계\맵모델링\논현역\(B010)수치지도_37705091_2022_00000452529185\N3L_F0010000.shp"
"C:\Users\BaekInchan\Desktop\설계스튜디오9_졸업설계\맵모델링\논현역\(B010)수치지도_37705091_2022_00000452529185\N3L_F0030000.shp"
"C:\Users\BaekInchan\Desktop\설계스튜디오9_졸업설계\맵모델링\논현역\(B010)수치지도_37705091_2022_00000452529185\N3L_F0040000.shp"
"C:\Users\BaekInchan\Desktop\설계스튜디오9_졸업설계\맵모델링\논현역\(B010)수치지도_37705091_2022_00000452529185\N3L_G0030000.shp"
"C:\Users\BaekInchan\Desktop\설계스튜디오9_졸업설계\맵모델링\논현역\(B010)수치지도_37705091_2022_00000452529185\N3L_H0010000.shp"
"C:\Users\BaekInchan\Desktop\설계스튜디오9_졸업설계\맵모델링\논현역\(B010)수치지도_37705091_2022_00000452529185\N3P_A0131122.shp"
"C:\Users\BaekInchan\Desktop\설계스튜디오9_졸업설계\맵모델링\논현역\(B010)수치지도_37705091_2022_00000452529185\N3P_C0380000.shp"
"C:\Users\BaekInchan\Desktop\설계스튜디오9_졸업설계\맵모델링\논현역\(B010)수치지도_37705091_2022_00000452529185\N3P_D0030000.shp"
"C:\Users\BaekInchan\Desktop\설계스튜디오9_졸업설계\맵모델링\논현역\(B010)수치지도_37705091_2022_00000452529185\N3P_E0042326.shp"
"C:\Users\BaekInchan\Desktop\설계스튜디오9_졸업설계\맵모델링\논현역\(B010)수치지도_37705091_2022_00000452529185\N3P_F0020000.shp"
"C:\Users\BaekInchan\Desktop\설계스튜디오9_졸업설계\맵모델링\논현역\(B010)수치지도_37705091_2022_00000452529185\N3P_H0020000.shp"
""")
# 하천
panel_9 = Panel(""""C:\Users\BaekInchan\Desktop\설계스튜디오9_졸업설계\맵모델링\압구정\N3A_A0010000.shp"
"C:\Users\BaekInchan\Desktop\설계스튜디오9_졸업설계\맵모델링\압구정\N3A_A0033320.shp"
"C:\Users\BaekInchan\Desktop\설계스튜디오9_졸업설계\맵모델링\압구정\N3A_A0053326.shp"
"C:\Users\BaekInchan\Desktop\설계스튜디오9_졸업설계\맵모델링\압구정\N3A_A0063321.shp"
"C:\Users\BaekInchan\Desktop\설계스튜디오9_졸업설계\맵모델링\압구정\N3A_A0070000.shp"
"C:\Users\BaekInchan\Desktop\설계스튜디오9_졸업설계\맵모델링\압구정\N3A_A0080000.shp"
"C:\Users\BaekInchan\Desktop\설계스튜디오9_졸업설계\맵모델링\압구정\N3A_A0090000.shp"
"C:\Users\BaekInchan\Desktop\설계스튜디오9_졸업설계\맵모델링\압구정\N3A_A0100000.shp"
"C:\Users\BaekInchan\Desktop\설계스튜디오9_졸업설계\맵모델링\압구정\N3A_A0110020.shp"
"C:\Users\BaekInchan\Desktop\설계스튜디오9_졸업설계\맵모델링\압구정\N3A_A0160024.shp"
"C:\Users\BaekInchan\Desktop\설계스튜디오9_졸업설계\맵모델링\압구정\N3A_A0191221.shp"
"C:\Users\BaekInchan\Desktop\설계스튜디오9_졸업설계\맵모델링\압구정\N3A_A0201222.shp"
"C:\Users\BaekInchan\Desktop\설계스튜디오9_졸업설계\맵모델링\압구정\N3A_B0010000.shp"
"C:\Users\BaekInchan\Desktop\설계스튜디오9_졸업설계\맵모델링\압구정\N3A_C0186115.shp"
"C:\Users\BaekInchan\Desktop\설계스튜디오9_졸업설계\맵모델링\압구정\N3A_C0390000.shp"
"C:\Users\BaekInchan\Desktop\설계스튜디오9_졸업설계\맵모델링\압구정\N3A_C0423365.shp"
"C:\Users\BaekInchan\Desktop\설계스튜디오9_졸업설계\맵모델링\압구정\N3A_C0430000.shp"
"C:\Users\BaekInchan\Desktop\설계스튜디오9_졸업설계\맵모델링\압구정\N3A_D0010000.shp"
"C:\Users\BaekInchan\Desktop\설계스튜디오9_졸업설계\맵모델링\압구정\N3A_E0010001.shp"
"C:\Users\BaekInchan\Desktop\설계스튜디오9_졸업설계\맵모델링\압구정\N3A_E0032111.shp"
"C:\Users\BaekInchan\Desktop\설계스튜디오9_졸업설계\맵모델링\압구정\N3A_E0052114.shp"
"C:\Users\BaekInchan\Desktop\설계스튜디오9_졸업설계\맵모델링\압구정\N3A_G0010000.shp"
"C:\Users\BaekInchan\Desktop\설계스튜디오9_졸업설계\맵모델링\압구정\N3A_G0020000.shp"
"C:\Users\BaekInchan\Desktop\설계스튜디오9_졸업설계\맵모델링\압구정\N3L_A0010000.shp"
"C:\Users\BaekInchan\Desktop\설계스튜디오9_졸업설계\맵모델링\압구정\N3L_A0020000.shp"
"C:\Users\BaekInchan\Desktop\설계스튜디오9_졸업설계\맵모델링\압구정\N3L_A0033330.shp"
"C:\Users\BaekInchan\Desktop\설계스튜디오9_졸업설계\맵모델링\압구정\N3L_A0123373.shp"
"C:\Users\BaekInchan\Desktop\설계스튜디오9_졸업설계\맵모델링\압구정\N3L_A0150000.shp"
"C:\Users\BaekInchan\Desktop\설계스튜디오9_졸업설계\맵모델링\압구정\N3L_A0171119.shp"
"C:\Users\BaekInchan\Desktop\설계스튜디오9_졸업설계\맵모델링\압구정\N3L_B0020000.shp"
"C:\Users\BaekInchan\Desktop\설계스튜디오9_졸업설계\맵모델링\압구정\N3L_C0050000.shp"
"C:\Users\BaekInchan\Desktop\설계스튜디오9_졸업설계\맵모델링\압구정\N3L_C0060000.shp"
"C:\Users\BaekInchan\Desktop\설계스튜디오9_졸업설계\맵모델링\압구정\N3L_C0070000.shp"
"C:\Users\BaekInchan\Desktop\설계스튜디오9_졸업설계\맵모델링\압구정\N3L_C0520000.shp"
"C:\Users\BaekInchan\Desktop\설계스튜디오9_졸업설계\맵모델링\압구정\N3L_E0020000.shp"
"C:\Users\BaekInchan\Desktop\설계스튜디오9_졸업설계\맵모델링\압구정\N3L_F0010000.shp"
"C:\Users\BaekInchan\Desktop\설계스튜디오9_졸업설계\맵모델링\압구정\N3L_F0030000.shp"
"C:\Users\BaekInchan\Desktop\설계스튜디오9_졸업설계\맵모델링\압구정\N3L_F0040000.shp"
"C:\Users\BaekInchan\Desktop\설계스튜디오9_졸업설계\맵모델링\압구정\N3L_G0030000.shp"
"C:\Users\BaekInchan\Desktop\설계스튜디오9_졸업설계\맵모델링\압구정\N3L_H0010000.shp"
"C:\Users\BaekInchan\Desktop\설계스튜디오9_졸업설계\맵모델링\압구정\N3P_A0131122.shp"
"C:\Users\BaekInchan\Desktop\설계스튜디오9_졸업설계\맵모델링\압구정\N3P_C0210000.shp"
"C:\Users\BaekInchan\Desktop\설계스튜디오9_졸업설계\맵모델링\압구정\N3P_C0380000.shp"
"C:\Users\BaekInchan\Desktop\설계스튜디오9_졸업설계\맵모델링\압구정\N3P_D0030000.shp"
"C:\Users\BaekInchan\Desktop\설계스튜디오9_졸업설계\맵모델링\압구정\N3P_E0042326.shp"
"C:\Users\BaekInchan\Desktop\설계스튜디오9_졸업설계\맵모델링\압구정\N3P_F0020000.shp"
"C:\Users\BaekInchan\Desktop\설계스튜디오9_졸업설계\맵모델링\압구정\N3P_H0020000.shp"
"C:\Users\BaekInchan\Desktop\설계스튜디오9_졸업설계\맵모델링\압구정\N3P_H0040000.shp"
"C:\Users\BaekInchan\Desktop\설계스튜디오9_졸업설계\맵모델링\압구정\N3P_H0059153.shp"
""")
panel_10 = Panel(""""C:\Users\BaekInchan\Desktop\설계스튜디오9_졸업설계\맵모델링\강남구청\(B010)수치지도_37705092_2022_00000597055733\N3P_H0040000.shp"
"C:\Users\BaekInchan\Desktop\설계스튜디오9_졸업설계\맵모델링\강남구청\(B010)수치지도_37705092_2022_00000597055733\N3A_A0010000.shp"
"C:\Users\BaekInchan\Desktop\설계스튜디오9_졸업설계\맵모델링\강남구청\(B010)수치지도_37705092_2022_00000597055733\N3A_A0033320.shp"
"C:\Users\BaekInchan\Desktop\설계스튜디오9_졸업설계\맵모델링\강남구청\(B010)수치지도_37705092_2022_00000597055733\N3A_A0053326.shp"
"C:\Users\BaekInchan\Desktop\설계스튜디오9_졸업설계\맵모델링\강남구청\(B010)수치지도_37705092_2022_00000597055733\N3A_A0080000.shp"
"C:\Users\BaekInchan\Desktop\설계스튜디오9_졸업설계\맵모델링\강남구청\(B010)수치지도_37705092_2022_00000597055733\N3A_B0010000.shp"
"C:\Users\BaekInchan\Desktop\설계스튜디오9_졸업설계\맵모델링\강남구청\(B010)수치지도_37705092_2022_00000597055733\N3A_C0186115.shp"
"C:\Users\BaekInchan\Desktop\설계스튜디오9_졸업설계\맵모델링\강남구청\(B010)수치지도_37705092_2022_00000597055733\N3A_C0305316.shp"
"C:\Users\BaekInchan\Desktop\설계스튜디오9_졸업설계\맵모델링\강남구청\(B010)수치지도_37705092_2022_00000597055733\N3A_C0390000.shp"
"C:\Users\BaekInchan\Desktop\설계스튜디오9_졸업설계\맵모델링\강남구청\(B010)수치지도_37705092_2022_00000597055733\N3A_C0423365.shp"
"C:\Users\BaekInchan\Desktop\설계스튜디오9_졸업설계\맵모델링\강남구청\(B010)수치지도_37705092_2022_00000597055733\N3A_C0430000.shp"
"C:\Users\BaekInchan\Desktop\설계스튜디오9_졸업설계\맵모델링\강남구청\(B010)수치지도_37705092_2022_00000597055733\N3A_G0010000.shp"
"C:\Users\BaekInchan\Desktop\설계스튜디오9_졸업설계\맵모델링\강남구청\(B010)수치지도_37705092_2022_00000597055733\N3L_A0010000.shp"
"C:\Users\BaekInchan\Desktop\설계스튜디오9_졸업설계\맵모델링\강남구청\(B010)수치지도_37705092_2022_00000597055733\N3L_A0020000.shp"
"C:\Users\BaekInchan\Desktop\설계스튜디오9_졸업설계\맵모델링\강남구청\(B010)수치지도_37705092_2022_00000597055733\N3L_A0033330.shp"
"C:\Users\BaekInchan\Desktop\설계스튜디오9_졸업설계\맵모델링\강남구청\(B010)수치지도_37705092_2022_00000597055733\N3L_B0020000.shp"
"C:\Users\BaekInchan\Desktop\설계스튜디오9_졸업설계\맵모델링\강남구청\(B010)수치지도_37705092_2022_00000597055733\N3L_C0070000.shp"
"C:\Users\BaekInchan\Desktop\설계스튜디오9_졸업설계\맵모델링\강남구청\(B010)수치지도_37705092_2022_00000597055733\N3L_C0520000.shp"
"C:\Users\BaekInchan\Desktop\설계스튜디오9_졸업설계\맵모델링\강남구청\(B010)수치지도_37705092_2022_00000597055733\N3L_E0020000.shp"
"C:\Users\BaekInchan\Desktop\설계스튜디오9_졸업설계\맵모델링\강남구청\(B010)수치지도_37705092_2022_00000597055733\N3L_F0010000.shp"
"C:\Users\BaekInchan\Desktop\설계스튜디오9_졸업설계\맵모델링\강남구청\(B010)수치지도_37705092_2022_00000597055733\N3L_F0040000.shp"
"C:\Users\BaekInchan\Desktop\설계스튜디오9_졸업설계\맵모델링\강남구청\(B010)수치지도_37705092_2022_00000597055733\N3L_G0030000.shp"
"C:\Users\BaekInchan\Desktop\설계스튜디오9_졸업설계\맵모델링\강남구청\(B010)수치지도_37705092_2022_00000597055733\N3L_H0010000.shp"
"C:\Users\BaekInchan\Desktop\설계스튜디오9_졸업설계\맵모델링\강남구청\(B010)수치지도_37705092_2022_00000597055733\N3P_A0131122.shp"
"C:\Users\BaekInchan\Desktop\설계스튜디오9_졸업설계\맵모델링\강남구청\(B010)수치지도_37705092_2022_00000597055733\N3P_C0285311.shp"
"C:\Users\BaekInchan\Desktop\설계스튜디오9_졸업설계\맵모델링\강남구청\(B010)수치지도_37705092_2022_00000597055733\N3P_C0310000.shp"
"C:\Users\BaekInchan\Desktop\설계스튜디오9_졸업설계\맵모델링\강남구청\(B010)수치지도_37705092_2022_00000597055733\N3P_C0380000.shp"
"C:\Users\BaekInchan\Desktop\설계스튜디오9_졸업설계\맵모델링\강남구청\(B010)수치지도_37705092_2022_00000597055733\N3P_F0020000.shp"
""")
panel_11 = Panel(""""C:\Users\BaekInchan\Desktop\설계스튜디오9_졸업설계\맵모델링\논현역\(B010)수치지도_37705091_2022_00000452529185\N3P_H0040000.shp"
"C:\Users\BaekInchan\Desktop\설계스튜디오9_졸업설계\맵모델링\논현역\(B010)수치지도_37705091_2022_00000452529185\N3A_A0010000.shp"
"C:\Users\BaekInchan\Desktop\설계스튜디오9_졸업설계\맵모델링\논현역\(B010)수치지도_37705091_2022_00000452529185\N3A_A0033320.shp"
"C:\Users\BaekInchan\Desktop\설계스튜디오9_졸업설계\맵모델링\논현역\(B010)수치지도_37705091_2022_00000452529185\N3A_A0053326.shp"
"C:\Users\BaekInchan\Desktop\설계스튜디오9_졸업설계\맵모델링\논현역\(B010)수치지도_37705091_2022_00000452529185\N3A_A0063321.shp"
"C:\Users\BaekInchan\Desktop\설계스튜디오9_졸업설계\맵모델링\논현역\(B010)수치지도_37705091_2022_00000452529185\N3A_A0070000.shp"
"C:\Users\BaekInchan\Desktop\설계스튜디오9_졸업설계\맵모델링\논현역\(B010)수치지도_37705091_2022_00000452529185\N3A_A0080000.shp"
"C:\Users\BaekInchan\Desktop\설계스튜디오9_졸업설계\맵모델링\논현역\(B010)수치지도_37705091_2022_00000452529185\N3A_A0090000.shp"
"C:\Users\BaekInchan\Desktop\설계스튜디오9_졸업설계\맵모델링\논현역\(B010)수치지도_37705091_2022_00000452529185\N3A_A0100000.shp"
"C:\Users\BaekInchan\Desktop\설계스튜디오9_졸업설계\맵모델링\논현역\(B010)수치지도_37705091_2022_00000452529185\N3A_A0160024.shp"
"C:\Users\BaekInchan\Desktop\설계스튜디오9_졸업설계\맵모델링\논현역\(B010)수치지도_37705091_2022_00000452529185\N3A_B0010000.shp"
"C:\Users\BaekInchan\Desktop\설계스튜디오9_졸업설계\맵모델링\논현역\(B010)수치지도_37705091_2022_00000452529185\N3A_C0186115.shp"
"C:\Users\BaekInchan\Desktop\설계스튜디오9_졸업설계\맵모델링\논현역\(B010)수치지도_37705091_2022_00000452529185\N3A_C0390000.shp"
"C:\Users\BaekInchan\Desktop\설계스튜디오9_졸업설계\맵모델링\논현역\(B010)수치지도_37705091_2022_00000452529185\N3A_C0423365.shp"
"C:\Users\BaekInchan\Desktop\설계스튜디오9_졸업설계\맵모델링\논현역\(B010)수치지도_37705091_2022_00000452529185\N3A_C0430000.shp"
"C:\Users\BaekInchan\Desktop\설계스튜디오9_졸업설계\맵모델링\논현역\(B010)수치지도_37705091_2022_00000452529185\N3A_D0010000.shp"
"C:\Users\BaekInchan\Desktop\설계스튜디오9_졸업설계\맵모델링\논현역\(B010)수치지도_37705091_2022_00000452529185\N3A_E0010001.shp"
"C:\Users\BaekInchan\Desktop\설계스튜디오9_졸업설계\맵모델링\논현역\(B010)수치지도_37705091_2022_00000452529185\N3A_E0032111.shp"
"C:\Users\BaekInchan\Desktop\설계스튜디오9_졸업설계\맵모델링\논현역\(B010)수치지도_37705091_2022_00000452529185\N3A_E0052114.shp"
"C:\Users\BaekInchan\Desktop\설계스튜디오9_졸업설계\맵모델링\논현역\(B010)수치지도_37705091_2022_00000452529185\N3A_G0010000.shp"
"C:\Users\BaekInchan\Desktop\설계스튜디오9_졸업설계\맵모델링\논현역\(B010)수치지도_37705091_2022_00000452529185\N3A_G0020000.shp"
"C:\Users\BaekInchan\Desktop\설계스튜디오9_졸업설계\맵모델링\논현역\(B010)수치지도_37705091_2022_00000452529185\N3L_A0010000.shp"
"C:\Users\BaekInchan\Desktop\설계스튜디오9_졸업설계\맵모델링\논현역\(B010)수치지도_37705091_2022_00000452529185\N3L_A0020000.shp"
"C:\Users\BaekInchan\Desktop\설계스튜디오9_졸업설계\맵모델링\논현역\(B010)수치지도_37705091_2022_00000452529185\N3L_A0033330.shp"
"C:\Users\BaekInchan\Desktop\설계스튜디오9_졸업설계\맵모델링\논현역\(B010)수치지도_37705091_2022_00000452529185\N3L_A0150000.shp"
"C:\Users\BaekInchan\Desktop\설계스튜디오9_졸업설계\맵모델링\논현역\(B010)수치지도_37705091_2022_00000452529185\N3L_A0171119.shp"
"C:\Users\BaekInchan\Desktop\설계스튜디오9_졸업설계\맵모델링\논현역\(B010)수치지도_37705091_2022_00000452529185\N3L_B0020000.shp"
"C:\Users\BaekInchan\Desktop\설계스튜디오9_졸업설계\맵모델링\논현역\(B010)수치지도_37705091_2022_00000452529185\N3L_C0050000.shp"
"C:\Users\BaekInchan\Desktop\설계스튜디오9_졸업설계\맵모델링\논현역\(B010)수치지도_37705091_2022_00000452529185\N3L_C0060000.shp"
"C:\Users\BaekInchan\Desktop\설계스튜디오9_졸업설계\맵모델링\논현역\(B010)수치지도_37705091_2022_00000452529185\N3L_C0070000.shp"
"C:\Users\BaekInchan\Desktop\설계스튜디오9_졸업설계\맵모델링\논현역\(B010)수치지도_37705091_2022_00000452529185\N3L_C0520000.shp"
"C:\Users\BaekInchan\Desktop\설계스튜디오9_졸업설계\맵모델링\논현역\(B010)수치지도_37705091_2022_00000452529185\N3L_E0020000.shp"
"C:\Users\BaekInchan\Desktop\설계스튜디오9_졸업설계\맵모델링\논현역\(B010)수치지도_37705091_2022_00000452529185\N3L_F0010000.shp"
"C:\Users\BaekInchan\Desktop\설계스튜디오9_졸업설계\맵모델링\논현역\(B010)수치지도_37705091_2022_00000452529185\N3L_F0030000.shp"
"C:\Users\BaekInchan\Desktop\설계스튜디오9_졸업설계\맵모델링\논현역\(B010)수치지도_37705091_2022_00000452529185\N3L_F0040000.shp"
"C:\Users\BaekInchan\Desktop\설계스튜디오9_졸업설계\맵모델링\논현역\(B010)수치지도_37705091_2022_00000452529185\N3L_G0030000.shp"
"C:\Users\BaekInchan\Desktop\설계스튜디오9_졸업설계\맵모델링\논현역\(B010)수치지도_37705091_2022_00000452529185\N3L_H0010000.shp"
"C:\Users\BaekInchan\Desktop\설계스튜디오9_졸업설계\맵모델링\논현역\(B010)수치지도_37705091_2022_00000452529185\N3P_A0131122.shp"
"C:\Users\BaekInchan\Desktop\설계스튜디오9_졸업설계\맵모델링\논현역\(B010)수치지도_37705091_2022_00000452529185\N3P_C0380000.shp"
"C:\Users\BaekInchan\Desktop\설계스튜디오9_졸업설계\맵모델링\논현역\(B010)수치지도_37705091_2022_00000452529185\N3P_D0030000.shp"
"C:\Users\BaekInchan\Desktop\설계스튜디오9_졸업설계\맵모델링\논현역\(B010)수치지도_37705091_2022_00000452529185\N3P_E0042326.shp"
"C:\Users\BaekInchan\Desktop\설계스튜디오9_졸업설계\맵모델링\논현역\(B010)수치지도_37705091_2022_00000452529185\N3P_F0020000.shp"
"C:\Users\BaekInchan\Desktop\설계스튜디오9_졸업설계\맵모델링\논현역\(B010)수치지도_37705091_2022_00000452529185\N3P_H0020000.shp"
""")
panel_12 = Panel(""""C:\Users\BaekInchan\Desktop\설계스튜디오9_졸업설계\맵모델링\신사\N3P_H0059153.shp"
"C:\Users\BaekInchan\Desktop\설계스튜디오9_졸업설계\맵모델링\신사\N3A_A0010000.shp"
"C:\Users\BaekInchan\Desktop\설계스튜디오9_졸업설계\맵모델링\신사\N3A_A0033320.shp"
"C:\Users\BaekInchan\Desktop\설계스튜디오9_졸업설계\맵모델링\신사\N3A_A0053326.shp"
"C:\Users\BaekInchan\Desktop\설계스튜디오9_졸업설계\맵모델링\신사\N3A_A0063321.shp"
"C:\Users\BaekInchan\Desktop\설계스튜디오9_졸업설계\맵모델링\신사\N3A_A0070000.shp"
"C:\Users\BaekInchan\Desktop\설계스튜디오9_졸업설계\맵모델링\신사\N3A_A0080000.shp"
"C:\Users\BaekInchan\Desktop\설계스튜디오9_졸업설계\맵모델링\신사\N3A_A0090000.shp"
"C:\Users\BaekInchan\Desktop\설계스튜디오9_졸업설계\맵모델링\신사\N3A_A0100000.shp"
"C:\Users\BaekInchan\Desktop\설계스튜디오9_졸업설계\맵모델링\신사\N3A_A0110020.shp"
"C:\Users\BaekInchan\Desktop\설계스튜디오9_졸업설계\맵모델링\신사\N3A_A0160024.shp"
"C:\Users\BaekInchan\Desktop\설계스튜디오9_졸업설계\맵모델링\신사\N3A_A0191221.shp"
"C:\Users\BaekInchan\Desktop\설계스튜디오9_졸업설계\맵모델링\신사\N3A_A0201222.shp"
"C:\Users\BaekInchan\Desktop\설계스튜디오9_졸업설계\맵모델링\신사\N3A_B0010000.shp"
"C:\Users\BaekInchan\Desktop\설계스튜디오9_졸업설계\맵모델링\신사\N3A_C0186115.shp"
"C:\Users\BaekInchan\Desktop\설계스튜디오9_졸업설계\맵모델링\신사\N3A_C0390000.shp"
"C:\Users\BaekInchan\Desktop\설계스튜디오9_졸업설계\맵모델링\신사\N3A_C0423365.shp"
"C:\Users\BaekInchan\Desktop\설계스튜디오9_졸업설계\맵모델링\신사\N3A_C0430000.shp"
"C:\Users\BaekInchan\Desktop\설계스튜디오9_졸업설계\맵모델링\신사\N3A_D0010000.shp"
"C:\Users\BaekInchan\Desktop\설계스튜디오9_졸업설계\맵모델링\신사\N3A_E0010001.shp"
"C:\Users\BaekInchan\Desktop\설계스튜디오9_졸업설계\맵모델링\신사\N3A_E0032111.shp"
"C:\Users\BaekInchan\Desktop\설계스튜디오9_졸업설계\맵모델링\신사\N3A_E0052114.shp"
"C:\Users\BaekInchan\Desktop\설계스튜디오9_졸업설계\맵모델링\신사\N3A_G0010000.shp"
"C:\Users\BaekInchan\Desktop\설계스튜디오9_졸업설계\맵모델링\신사\N3A_G0020000.shp"
"C:\Users\BaekInchan\Desktop\설계스튜디오9_졸업설계\맵모델링\신사\N3L_A0010000.shp"
"C:\Users\BaekInchan\Desktop\설계스튜디오9_졸업설계\맵모델링\신사\N3L_A0020000.shp"
"C:\Users\BaekInchan\Desktop\설계스튜디오9_졸업설계\맵모델링\신사\N3L_A0033320.shp"
"C:\Users\BaekInchan\Desktop\설계스튜디오9_졸업설계\맵모델링\신사\N3L_A0123373.shp"
"C:\Users\BaekInchan\Desktop\설계스튜디오9_졸업설계\맵모델링\신사\N3L_A0150000.shp"
"C:\Users\BaekInchan\Desktop\설계스튜디오9_졸업설계\맵모델링\신사\N3L_A0171119.shp"
"C:\Users\BaekInchan\Desktop\설계스튜디오9_졸업설계\맵모델링\신사\N3L_B0020000.shp"
"C:\Users\BaekInchan\Desktop\설계스튜디오9_졸업설계\맵모델링\신사\N3L_C0050000.shp"
"C:\Users\BaekInchan\Desktop\설계스튜디오9_졸업설계\맵모델링\신사\N3L_C0060000.shp"
"C:\Users\BaekInchan\Desktop\설계스튜디오9_졸업설계\맵모델링\신사\N3L_C0520000.shp"
"C:\Users\BaekInchan\Desktop\설계스튜디오9_졸업설계\맵모델링\신사\N3L_E0020000.shp"
"C:\Users\BaekInchan\Desktop\설계스튜디오9_졸업설계\맵모델링\신사\N3L_F0010000.shp"
"C:\Users\BaekInchan\Desktop\설계스튜디오9_졸업설계\맵모델링\신사\N3L_F0030000.shp"
"C:\Users\BaekInchan\Desktop\설계스튜디오9_졸업설계\맵모델링\신사\N3L_F0040000.shp"
"C:\Users\BaekInchan\Desktop\설계스튜디오9_졸업설계\맵모델링\신사\N3L_G0030000.shp"
"C:\Users\BaekInchan\Desktop\설계스튜디오9_졸업설계\맵모델링\신사\N3L_H0010000.shp"
"C:\Users\BaekInchan\Desktop\설계스튜디오9_졸업설계\맵모델링\신사\N3P_A0131122.shp"
"C:\Users\BaekInchan\Desktop\설계스튜디오9_졸업설계\맵모델링\신사\N3P_C0380000.shp"
"C:\Users\BaekInchan\Desktop\설계스튜디오9_졸업설계\맵모델링\신사\N3P_E0042326.shp"
"C:\Users\BaekInchan\Desktop\설계스튜디오9_졸업설계\맵모델링\신사\N3P_F0020000.shp"
"C:\Users\BaekInchan\Desktop\설계스튜디오9_졸업설계\맵모델링\신사\N3P_H0020000.shp"
"C:\Users\BaekInchan\Desktop\설계스튜디오9_졸업설계\맵모델링\신사\N3P_H0040000.shp"
""")
panel_13 = Panel(""""C:\Users\user\OneDrive\바탕 화면\설계\설계 스튜디오\5학년\맵모델링\1사분면\N3A_A0010000.shp"
"C:\Users\user\OneDrive\바탕 화면\설계\설계 스튜디오\5학년\맵모델링\1사분면\N3A_A0033320.shp"
"C:\Users\user\OneDrive\바탕 화면\설계\설계 스튜디오\5학년\맵모델링\1사분면\N3A_A0053326.shp"
"C:\Users\user\OneDrive\바탕 화면\설계\설계 스튜디오\5학년\맵모델링\1사분면\N3A_A0063321.shp"
"C:\Users\user\OneDrive\바탕 화면\설계\설계 스튜디오\5학년\맵모델링\1사분면\N3A_A0070000.shp"
"C:\Users\user\OneDrive\바탕 화면\설계\설계 스튜디오\5학년\맵모델링\1사분면\N3A_A0080000.shp"
"C:\Users\user\OneDrive\바탕 화면\설계\설계 스튜디오\5학년\맵모델링\1사분면\N3A_A0090000.shp"
"C:\Users\user\OneDrive\바탕 화면\설계\설계 스튜디오\5학년\맵모델링\1사분면\N3A_A0100000.shp"
"C:\Users\user\OneDrive\바탕 화면\설계\설계 스튜디오\5학년\맵모델링\1사분면\N3A_B0010000.shp"
"C:\Users\user\OneDrive\바탕 화면\설계\설계 스튜디오\5학년\맵모델링\1사분면\N3A_C0186115.shp"
"C:\Users\user\OneDrive\바탕 화면\설계\설계 스튜디오\5학년\맵모델링\1사분면\N3A_C0390000.shp"
"C:\Users\user\OneDrive\바탕 화면\설계\설계 스튜디오\5학년\맵모델링\1사분면\N3A_C0423365.shp"
"C:\Users\user\OneDrive\바탕 화면\설계\설계 스튜디오\5학년\맵모델링\1사분면\N3A_C0430000.shp"
"C:\Users\user\OneDrive\바탕 화면\설계\설계 스튜디오\5학년\맵모델링\1사분면\N3A_D0010000.shp"
"C:\Users\user\OneDrive\바탕 화면\설계\설계 스튜디오\5학년\맵모델링\1사분면\N3A_E0010001.shp"
"C:\Users\user\OneDrive\바탕 화면\설계\설계 스튜디오\5학년\맵모델링\1사분면\N3A_E0032111.shp"
"C:\Users\user\OneDrive\바탕 화면\설계\설계 스튜디오\5학년\맵모델링\1사분면\N3A_E0052114.shp"
"C:\Users\user\OneDrive\바탕 화면\설계\설계 스튜디오\5학년\맵모델링\1사분면\N3A_G0010000.shp"
"C:\Users\user\OneDrive\바탕 화면\설계\설계 스튜디오\5학년\맵모델링\1사분면\N3A_G0020000.shp"
"C:\Users\user\OneDrive\바탕 화면\설계\설계 스튜디오\5학년\맵모델링\1사분면\N3L_A0010000.shp"
"C:\Users\user\OneDrive\바탕 화면\설계\설계 스튜디오\5학년\맵모델링\1사분면\N3L_A0020000.shp"
"C:\Users\user\OneDrive\바탕 화면\설계\설계 스튜디오\5학년\맵모델링\1사분면\N3L_A0033330.shp"
"C:\Users\user\OneDrive\바탕 화면\설계\설계 스튜디오\5학년\맵모델링\1사분면\N3L_B0020000.shp"
"C:\Users\user\OneDrive\바탕 화면\설계\설계 스튜디오\5학년\맵모델링\1사분면\N3L_C0050000.shp"
"C:\Users\user\OneDrive\바탕 화면\설계\설계 스튜디오\5학년\맵모델링\1사분면\N3L_C0070000.shp"
"C:\Users\user\OneDrive\바탕 화면\설계\설계 스튜디오\5학년\맵모델링\1사분면\N3L_C0520000.shp"
"C:\Users\user\OneDrive\바탕 화면\설계\설계 스튜디오\5학년\맵모델링\1사분면\N3L_E0020000.shp"
"C:\Users\user\OneDrive\바탕 화면\설계\설계 스튜디오\5학년\맵모델링\1사분면\N3L_F0010000.shp"
"C:\Users\user\OneDrive\바탕 화면\설계\설계 스튜디오\5학년\맵모델링\1사분면\N3L_F0030000.shp"
"C:\Users\user\OneDrive\바탕 화면\설계\설계 스튜디오\5학년\맵모델링\1사분면\N3L_F0040000.shp"
"C:\Users\user\OneDrive\바탕 화면\설계\설계 스튜디오\5학년\맵모델링\1사분면\N3L_G0030000.shp"
"C:\Users\user\OneDrive\바탕 화면\설계\설계 스튜디오\5학년\맵모델링\1사분면\N3L_H0010000.shp"
"C:\Users\user\OneDrive\바탕 화면\설계\설계 스튜디오\5학년\맵모델링\1사분면\N3P_A0131122.shp"
"C:\Users\user\OneDrive\바탕 화면\설계\설계 스튜디오\5학년\맵모델링\1사분면\N3P_C0310000.shp"
"C:\Users\user\OneDrive\바탕 화면\설계\설계 스튜디오\5학년\맵모델링\1사분면\N3P_C0380000.shp"
"C:\Users\user\OneDrive\바탕 화면\설계\설계 스튜디오\5학년\맵모델링\1사분면\N3P_D0030000.shp"
"C:\Users\user\OneDrive\바탕 화면\설계\설계 스튜디오\5학년\맵모델링\1사분면\N3P_E0042326.shp"
"C:\Users\user\OneDrive\바탕 화면\설계\설계 스튜디오\5학년\맵모델링\1사분면\N3P_F0020000.shp"
"C:\Users\user\OneDrive\바탕 화면\설계\설계 스튜디오\5학년\맵모델링\1사분면\N3P_H0040000.shp"
""")  # disabled
panel_14 = Panel(""""C:\Users\user\OneDrive\바탕 화면\설계\설계 스튜디오\5학년\맵모델링\2사분면\N3A_A0010000.shp"
"C:\Users\user\OneDrive\바탕 화면\설계\설계 스튜디오\5학년\맵모델링\2사분면\N3A_A0033320.shp"
"C:\Users\user\OneDrive\바탕 화면\설계\설계 스튜디오\5학년\맵모델링\2사분면\N3A_A0053326.shp"
"C:\Users\user\OneDrive\바탕 화면\설계\설계 스튜디오\5학년\맵모델링\2사분면\N3A_A0063321.shp"
"C:\Users\user\OneDrive\바탕 화면\설계\설계 스튜디오\5학년\맵모델링\2사분면\N3A_A0070000.shp"
"C:\Users\user\OneDrive\바탕 화면\설계\설계 스튜디오\5학년\맵모델링\2사분면\N3A_A0080000.shp"
"C:\Users\user\OneDrive\바탕 화면\설계\설계 스튜디오\5학년\맵모델링\2사분면\N3A_A0090000.shp"
"C:\Users\user\OneDrive\바탕 화면\설계\설계 스튜디오\5학년\맵모델링\2사분면\N3A_A0100000.shp"
"C:\Users\user\OneDrive\바탕 화면\설계\설계 스튜디오\5학년\맵모델링\2사분면\N3A_A0160024.shp"
"C:\Users\user\OneDrive\바탕 화면\설계\설계 스튜디오\5학년\맵모델링\2사분면\N3A_A0201222.shp"
"C:\Users\user\OneDrive\바탕 화면\설계\설계 스튜디오\5학년\맵모델링\2사분면\N3A_B0010000.shp"
"C:\Users\user\OneDrive\바탕 화면\설계\설계 스튜디오\5학년\맵모델링\2사분면\N3A_C0032254.shp"
"C:\Users\user\OneDrive\바탕 화면\설계\설계 스튜디오\5학년\맵모델링\2사분면\N3A_C0186115.shp"
"C:\Users\user\OneDrive\바탕 화면\설계\설계 스튜디오\5학년\맵모델링\2사분면\N3A_C0390000.shp"
"C:\Users\user\OneDrive\바탕 화면\설계\설계 스튜디오\5학년\맵모델링\2사분면\N3A_C0423365.shp"
"C:\Users\user\OneDrive\바탕 화면\설계\설계 스튜디오\5학년\맵모델링\2사분면\N3A_C0430000.shp"
"C:\Users\user\OneDrive\바탕 화면\설계\설계 스튜디오\5학년\맵모델링\2사분면\N3A_D0010000.shp"
"C:\Users\user\OneDrive\바탕 화면\설계\설계 스튜디오\5학년\맵모델링\2사분면\N3A_E0010001.shp"
"C:\Users\user\OneDrive\바탕 화면\설계\설계 스튜디오\5학년\맵모델링\2사분면\N3A_E0032111.shp"
"C:\Users\user\OneDrive\바탕 화면\설계\설계 스튜디오\5학년\맵모델링\2사분면\N3A_E0052114.shp"
"C:\Users\user\OneDrive\바탕 화면\설계\설계 스튜디오\5학년\맵모델링\2사분면\N3A_G0010000.shp"
"C:\Users\user\OneDrive\바탕 화면\설계\설계 스튜디오\5학년\맵모델링\2사분면\N3A_G0020000.shp"
"C:\Users\user\OneDrive\바탕 화면\설계\설계 스튜디오\5학년\맵모델링\2사분면\N3L_A0010000.shp"
"C:\Users\user\OneDrive\바탕 화면\설계\설계 스튜디오\5학년\맵모델링\2사분면\N3L_A0020000.shp"
"C:\Users\user\OneDrive\바탕 화면\설계\설계 스튜디오\5학년\맵모델링\2사분면\N3L_A0033330.shp"
"C:\Users\user\OneDrive\바탕 화면\설계\설계 스튜디오\5학년\맵모델링\2사분면\N3L_A0150000.shp"
"C:\Users\user\OneDrive\바탕 화면\설계\설계 스튜디오\5학년\맵모델링\2사분면\N3L_A0171119.shp"
"C:\Users\user\OneDrive\바탕 화면\설계\설계 스튜디오\5학년\맵모델링\2사분면\N3L_B0020000.shp"
"C:\Users\user\OneDrive\바탕 화면\설계\설계 스튜디오\5학년\맵모델링\2사분면\N3L_C0050000.shp"
"C:\Users\user\OneDrive\바탕 화면\설계\설계 스튜디오\5학년\맵모델링\2사분면\N3L_C0070000.shp"
"C:\Users\user\OneDrive\바탕 화면\설계\설계 스튜디오\5학년\맵모델링\2사분면\N3L_C0520000.shp"
"C:\Users\user\OneDrive\바탕 화면\설계\설계 스튜디오\5학년\맵모델링\2사분면\N3L_E0020000.shp"
"C:\Users\user\OneDrive\바탕 화면\설계\설계 스튜디오\5학년\맵모델링\2사분면\N3L_F0010000.shp"
"C:\Users\user\OneDrive\바탕 화면\설계\설계 스튜디오\5학년\맵모델링\2사분면\N3L_F0030000.shp"
"C:\Users\user\OneDrive\바탕 화면\설계\설계 스튜디오\5학년\맵모델링\2사분면\N3L_F0040000.shp"
"C:\Users\user\OneDrive\바탕 화면\설계\설계 스튜디오\5학년\맵모델링\2사분면\N3L_G0030000.shp"
"C:\Users\user\OneDrive\바탕 화면\설계\설계 스튜디오\5학년\맵모델링\2사분면\N3L_H0010000.shp"
"C:\Users\user\OneDrive\바탕 화면\설계\설계 스튜디오\5학년\맵모델링\2사분면\N3P_A0131122.shp"
"C:\Users\user\OneDrive\바탕 화면\설계\설계 스튜디오\5학년\맵모델링\2사분면\N3P_C0310000.shp"
"C:\Users\user\OneDrive\바탕 화면\설계\설계 스튜디오\5학년\맵모델링\2사분면\N3P_C0330000.shp"
"C:\Users\user\OneDrive\바탕 화면\설계\설계 스튜디오\5학년\맵모델링\2사분면\N3P_C0380000.shp"
"C:\Users\user\OneDrive\바탕 화면\설계\설계 스튜디오\5학년\맵모델링\2사분면\N3P_D0030000.shp"
"C:\Users\user\OneDrive\바탕 화면\설계\설계 스튜디오\5학년\맵모델링\2사분면\N3P_E0042326.shp"
"C:\Users\user\OneDrive\바탕 화면\설계\설계 스튜디오\5학년\맵모델링\2사분면\N3P_F0020000.shp"
"C:\Users\user\OneDrive\바탕 화면\설계\설계 스튜디오\5학년\맵모델링\2사분면\N3P_H0020000.shp"
"C:\Users\user\OneDrive\바탕 화면\설계\설계 스튜디오\5학년\맵모델링\2사분면\N3P_H0040000.shp"
""")  # disabled
panel_15 = Panel(""""C:\Users\user\OneDrive\바탕 화면\설계\설계 스튜디오\5학년\맵모델링\1사분면\N3A_A0010000.shp"
"C:\Users\user\OneDrive\바탕 화면\설계\설계 스튜디오\5학년\맵모델링\1사분면\N3A_A0033320.shp"
"C:\Users\user\OneDrive\바탕 화면\설계\설계 스튜디오\5학년\맵모델링\1사분면\N3A_A0053326.shp"
"C:\Users\user\OneDrive\바탕 화면\설계\설계 스튜디오\5학년\맵모델링\1사분면\N3A_A0063321.shp"
"C:\Users\user\OneDrive\바탕 화면\설계\설계 스튜디오\5학년\맵모델링\1사분면\N3A_A0070000.shp"
"C:\Users\user\OneDrive\바탕 화면\설계\설계 스튜디오\5학년\맵모델링\1사분면\N3A_A0080000.shp"
"C:\Users\user\OneDrive\바탕 화면\설계\설계 스튜디오\5학년\맵모델링\1사분면\N3A_A0090000.shp"
"C:\Users\user\OneDrive\바탕 화면\설계\설계 스튜디오\5학년\맵모델링\1사분면\N3A_A0100000.shp"
"C:\Users\user\OneDrive\바탕 화면\설계\설계 스튜디오\5학년\맵모델링\1사분면\N3A_B0010000.shp"
"C:\Users\user\OneDrive\바탕 화면\설계\설계 스튜디오\5학년\맵모델링\1사분면\N3A_C0186115.shp"
"C:\Users\user\OneDrive\바탕 화면\설계\설계 스튜디오\5학년\맵모델링\1사분면\N3A_C0390000.shp"
"C:\Users\user\OneDrive\바탕 화면\설계\설계 스튜디오\5학년\맵모델링\1사분면\N3A_C0423365.shp"
"C:\Users\user\OneDrive\바탕 화면\설계\설계 스튜디오\5학년\맵모델링\1사분면\N3A_C0430000.shp"
"C:\Users\user\OneDrive\바탕 화면\설계\설계 스튜디오\5학년\맵모델링\1사분면\N3A_D0010000.shp"
"C:\Users\user\OneDrive\바탕 화면\설계\설계 스튜디오\5학년\맵모델링\1사분면\N3A_E0010001.shp"
"C:\Users\user\OneDrive\바탕 화면\설계\설계 스튜디오\5학년\맵모델링\1사분면\N3A_E0032111.shp"
"C:\Users\user\OneDrive\바탕 화면\설계\설계 스튜디오\5학년\맵모델링\1사분면\N3A_E0052114.shp"
"C:\Users\user\OneDrive\바탕 화면\설계\설계 스튜디오\5학년\맵모델링\1사분면\N3A_G0010000.shp"
"C:\Users\user\OneDrive\바탕 화면\설계\설계 스튜디오\5학년\맵모델링\1사분면\N3A_G0020000.shp"
"C:\Users\user\OneDrive\바탕 화면\설계\설계 스튜디오\5학년\맵모델링\1사분면\N3L_A0010000.shp"
"C:\Users\user\OneDrive\바탕 화면\설계\설계 스튜디오\5학년\맵모델링\1사분면\N3L_A0020000.shp"
"C:\Users\user\OneDrive\바탕 화면\설계\설계 스튜디오\5학년\맵모델링\1사분면\N3L_A0033330.shp"
"C:\Users\user\OneDrive\바탕 화면\설계\설계 스튜디오\5학년\맵모델링\1사분면\N3L_B0020000.shp"
"C:\Users\user\OneDrive\바탕 화면\설계\설계 스튜디오\5학년\맵모델링\1사분면\N3L_C0050000.shp"
"C:\Users\user\OneDrive\바탕 화면\설계\설계 스튜디오\5학년\맵모델링\1사분면\N3L_C0070000.shp"
"C:\Users\user\OneDrive\바탕 화면\설계\설계 스튜디오\5학년\맵모델링\1사분면\N3L_C0520000.shp"
"C:\Users\user\OneDrive\바탕 화면\설계\설계 스튜디오\5학년\맵모델링\1사분면\N3L_E0020000.shp"
"C:\Users\user\OneDrive\바탕 화면\설계\설계 스튜디오\5학년\맵모델링\1사분면\N3L_F0010000.shp"
"C:\Users\user\OneDrive\바탕 화면\설계\설계 스튜디오\5학년\맵모델링\1사분면\N3L_F0030000.shp"
"C:\Users\user\OneDrive\바탕 화면\설계\설계 스튜디오\5학년\맵모델링\1사분면\N3L_F0040000.shp"
"C:\Users\user\OneDrive\바탕 화면\설계\설계 스튜디오\5학년\맵모델링\1사분면\N3L_G0030000.shp"
"C:\Users\user\OneDrive\바탕 화면\설계\설계 스튜디오\5학년\맵모델링\1사분면\N3L_H0010000.shp"
"C:\Users\user\OneDrive\바탕 화면\설계\설계 스튜디오\5학년\맵모델링\1사분면\N3P_A0131122.shp"
"C:\Users\user\OneDrive\바탕 화면\설계\설계 스튜디오\5학년\맵모델링\1사분면\N3P_C0310000.shp"
"C:\Users\user\OneDrive\바탕 화면\설계\설계 스튜디오\5학년\맵모델링\1사분면\N3P_C0380000.shp"
"C:\Users\user\OneDrive\바탕 화면\설계\설계 스튜디오\5학년\맵모델링\1사분면\N3P_D0030000.shp"
"C:\Users\user\OneDrive\바탕 화면\설계\설계 스튜디오\5학년\맵모델링\1사분면\N3P_E0042326.shp"
"C:\Users\user\OneDrive\바탕 화면\설계\설계 스튜디오\5학년\맵모델링\1사분면\N3P_F0020000.shp"
"C:\Users\user\OneDrive\바탕 화면\설계\설계 스튜디오\5학년\맵모델링\1사분면\N3P_H0040000.shp"
""")  # disabled
panel_16 = Panel(""""C:\Users\user\OneDrive\바탕 화면\설계\설계 스튜디오\5학년\맵모델링\2사분면\N3A_A0010000.shp"
"C:\Users\user\OneDrive\바탕 화면\설계\설계 스튜디오\5학년\맵모델링\2사분면\N3A_A0033320.shp"
"C:\Users\user\OneDrive\바탕 화면\설계\설계 스튜디오\5학년\맵모델링\2사분면\N3A_A0053326.shp"
"C:\Users\user\OneDrive\바탕 화면\설계\설계 스튜디오\5학년\맵모델링\2사분면\N3A_A0063321.shp"
"C:\Users\user\OneDrive\바탕 화면\설계\설계 스튜디오\5학년\맵모델링\2사분면\N3A_A0070000.shp"
"C:\Users\user\OneDrive\바탕 화면\설계\설계 스튜디오\5학년\맵모델링\2사분면\N3A_A0080000.shp"
"C:\Users\user\OneDrive\바탕 화면\설계\설계 스튜디오\5학년\맵모델링\2사분면\N3A_A0090000.shp"
"C:\Users\user\OneDrive\바탕 화면\설계\설계 스튜디오\5학년\맵모델링\2사분면\N3A_A0100000.shp"
"C:\Users\user\OneDrive\바탕 화면\설계\설계 스튜디오\5학년\맵모델링\2사분면\N3A_A0160024.shp"
"C:\Users\user\OneDrive\바탕 화면\설계\설계 스튜디오\5학년\맵모델링\2사분면\N3A_A0201222.shp"
"C:\Users\user\OneDrive\바탕 화면\설계\설계 스튜디오\5학년\맵모델링\2사분면\N3A_B0010000.shp"
"C:\Users\user\OneDrive\바탕 화면\설계\설계 스튜디오\5학년\맵모델링\2사분면\N3A_C0032254.shp"
"C:\Users\user\OneDrive\바탕 화면\설계\설계 스튜디오\5학년\맵모델링\2사분면\N3A_C0186115.shp"
"C:\Users\user\OneDrive\바탕 화면\설계\설계 스튜디오\5학년\맵모델링\2사분면\N3A_C0390000.shp"
"C:\Users\user\OneDrive\바탕 화면\설계\설계 스튜디오\5학년\맵모델링\2사분면\N3A_C0423365.shp"
"C:\Users\user\OneDrive\바탕 화면\설계\설계 스튜디오\5학년\맵모델링\2사분면\N3A_C0430000.shp"
"C:\Users\user\OneDrive\바탕 화면\설계\설계 스튜디오\5학년\맵모델링\2사분면\N3A_D0010000.shp"
"C:\Users\user\OneDrive\바탕 화면\설계\설계 스튜디오\5학년\맵모델링\2사분면\N3A_E0010001.shp"
"C:\Users\user\OneDrive\바탕 화면\설계\설계 스튜디오\5학년\맵모델링\2사분면\N3A_E0032111.shp"
"C:\Users\user\OneDrive\바탕 화면\설계\설계 스튜디오\5학년\맵모델링\2사분면\N3A_E0052114.shp"
"C:\Users\user\OneDrive\바탕 화면\설계\설계 스튜디오\5학년\맵모델링\2사분면\N3A_G0010000.shp"
"C:\Users\user\OneDrive\바탕 화면\설계\설계 스튜디오\5학년\맵모델링\2사분면\N3A_G0020000.shp"
"C:\Users\user\OneDrive\바탕 화면\설계\설계 스튜디오\5학년\맵모델링\2사분면\N3L_A0010000.shp"
"C:\Users\user\OneDrive\바탕 화면\설계\설계 스튜디오\5학년\맵모델링\2사분면\N3L_A0020000.shp"
"C:\Users\user\OneDrive\바탕 화면\설계\설계 스튜디오\5학년\맵모델링\2사분면\N3L_A0033330.shp"
"C:\Users\user\OneDrive\바탕 화면\설계\설계 스튜디오\5학년\맵모델링\2사분면\N3L_A0150000.shp"
"C:\Users\user\OneDrive\바탕 화면\설계\설계 스튜디오\5학년\맵모델링\2사분면\N3L_A0171119.shp"
"C:\Users\user\OneDrive\바탕 화면\설계\설계 스튜디오\5학년\맵모델링\2사분면\N3L_B0020000.shp"
"C:\Users\user\OneDrive\바탕 화면\설계\설계 스튜디오\5학년\맵모델링\2사분면\N3L_C0050000.shp"
"C:\Users\user\OneDrive\바탕 화면\설계\설계 스튜디오\5학년\맵모델링\2사분면\N3L_C0070000.shp"
"C:\Users\user\OneDrive\바탕 화면\설계\설계 스튜디오\5학년\맵모델링\2사분면\N3L_C0520000.shp"
"C:\Users\user\OneDrive\바탕 화면\설계\설계 스튜디오\5학년\맵모델링\2사분면\N3L_E0020000.shp"
"C:\Users\user\OneDrive\바탕 화면\설계\설계 스튜디오\5학년\맵모델링\2사분면\N3L_F0010000.shp"
"C:\Users\user\OneDrive\바탕 화면\설계\설계 스튜디오\5학년\맵모델링\2사분면\N3L_F0030000.shp"
"C:\Users\user\OneDrive\바탕 화면\설계\설계 스튜디오\5학년\맵모델링\2사분면\N3L_F0040000.shp"
"C:\Users\user\OneDrive\바탕 화면\설계\설계 스튜디오\5학년\맵모델링\2사분면\N3L_G0030000.shp"
"C:\Users\user\OneDrive\바탕 화면\설계\설계 스튜디오\5학년\맵모델링\2사분면\N3L_H0010000.shp"
"C:\Users\user\OneDrive\바탕 화면\설계\설계 스튜디오\5학년\맵모델링\2사분면\N3P_A0131122.shp"
"C:\Users\user\OneDrive\바탕 화면\설계\설계 스튜디오\5학년\맵모델링\2사분면\N3P_C0310000.shp"
"C:\Users\user\OneDrive\바탕 화면\설계\설계 스튜디오\5학년\맵모델링\2사분면\N3P_C0330000.shp"
"C:\Users\user\OneDrive\바탕 화면\설계\설계 스튜디오\5학년\맵모델링\2사분면\N3P_C0380000.shp"
"C:\Users\user\OneDrive\바탕 화면\설계\설계 스튜디오\5학년\맵모델링\2사분면\N3P_D0030000.shp"
"C:\Users\user\OneDrive\바탕 화면\설계\설계 스튜디오\5학년\맵모델링\2사분면\N3P_E0042326.shp"
"C:\Users\user\OneDrive\바탕 화면\설계\설계 스튜디오\5학년\맵모델링\2사분면\N3P_F0020000.shp"
"C:\Users\user\OneDrive\바탕 화면\설계\설계 스튜디오\5학년\맵모델링\2사분면\N3P_H0020000.shp"
"C:\Users\user\OneDrive\바탕 화면\설계\설계 스튜디오\5학년\맵모델링\2사분면\N3P_H0040000.shp"
""")  # disabled
panel_17 = Panel(""""C:\Users\user\OneDrive\바탕 화면\설계\설계 스튜디오\5학년\맵모델링\3사분면\N3A_A0010000.shp"
"C:\Users\user\OneDrive\바탕 화면\설계\설계 스튜디오\5학년\맵모델링\3사분면\N3A_A0033320.shp"
"C:\Users\user\OneDrive\바탕 화면\설계\설계 스튜디오\5학년\맵모델링\3사분면\N3A_A0053326.shp"
"C:\Users\user\OneDrive\바탕 화면\설계\설계 스튜디오\5학년\맵모델링\3사분면\N3A_A0063321.shp"
"C:\Users\user\OneDrive\바탕 화면\설계\설계 스튜디오\5학년\맵모델링\3사분면\N3A_A0070000.shp"
"C:\Users\user\OneDrive\바탕 화면\설계\설계 스튜디오\5학년\맵모델링\3사분면\N3A_A0080000.shp"
"C:\Users\user\OneDrive\바탕 화면\설계\설계 스튜디오\5학년\맵모델링\3사분면\N3A_A0090000.shp"
"C:\Users\user\OneDrive\바탕 화면\설계\설계 스튜디오\5학년\맵모델링\3사분면\N3A_A0160024.shp"
"C:\Users\user\OneDrive\바탕 화면\설계\설계 스튜디오\5학년\맵모델링\3사분면\N3A_A0191221.shp"
"C:\Users\user\OneDrive\바탕 화면\설계\설계 스튜디오\5학년\맵모델링\3사분면\N3A_A0201222.shp"
"C:\Users\user\OneDrive\바탕 화면\설계\설계 스튜디오\5학년\맵모델링\3사분면\N3A_B0010000.shp"
"C:\Users\user\OneDrive\바탕 화면\설계\설계 스튜디오\5학년\맵모델링\3사분면\N3A_C0186115.shp"
"C:\Users\user\OneDrive\바탕 화면\설계\설계 스튜디오\5학년\맵모델링\3사분면\N3A_C0390000.shp"
"C:\Users\user\OneDrive\바탕 화면\설계\설계 스튜디오\5학년\맵모델링\3사분면\N3A_C0423365.shp"
"C:\Users\user\OneDrive\바탕 화면\설계\설계 스튜디오\5학년\맵모델링\3사분면\N3A_C0430000.shp"
"C:\Users\user\OneDrive\바탕 화면\설계\설계 스튜디오\5학년\맵모델링\3사분면\N3A_D0010000.shp"
"C:\Users\user\OneDrive\바탕 화면\설계\설계 스튜디오\5학년\맵모델링\3사분면\N3A_E0010001.shp"
"C:\Users\user\OneDrive\바탕 화면\설계\설계 스튜디오\5학년\맵모델링\3사분면\N3A_E0032111.shp"
"C:\Users\user\OneDrive\바탕 화면\설계\설계 스튜디오\5학년\맵모델링\3사분면\N3A_E0052114.shp"
"C:\Users\user\OneDrive\바탕 화면\설계\설계 스튜디오\5학년\맵모델링\3사분면\N3A_G0010000.shp"
"C:\Users\user\OneDrive\바탕 화면\설계\설계 스튜디오\5학년\맵모델링\3사분면\N3L_A0010000.shp"
"C:\Users\user\OneDrive\바탕 화면\설계\설계 스튜디오\5학년\맵모델링\3사분면\N3L_A0020000.shp"
"C:\Users\user\OneDrive\바탕 화면\설계\설계 스튜디오\5학년\맵모델링\3사분면\N3L_A0033330.shp"
"C:\Users\user\OneDrive\바탕 화면\설계\설계 스튜디오\5학년\맵모델링\3사분면\N3L_A0123373.shp"
"C:\Users\user\OneDrive\바탕 화면\설계\설계 스튜디오\5학년\맵모델링\3사분면\N3L_A0150000.shp"
"C:\Users\user\OneDrive\바탕 화면\설계\설계 스튜디오\5학년\맵모델링\3사분면\N3L_A0171119.shp"
"C:\Users\user\OneDrive\바탕 화면\설계\설계 스튜디오\5학년\맵모델링\3사분면\N3L_B0020000.shp"
"C:\Users\user\OneDrive\바탕 화면\설계\설계 스튜디오\5학년\맵모델링\3사분면\N3L_C0050000.shp"
"C:\Users\user\OneDrive\바탕 화면\설계\설계 스튜디오\5학년\맵모델링\3사분면\N3L_C0070000.shp"
"C:\Users\user\OneDrive\바탕 화면\설계\설계 스튜디오\5학년\맵모델링\3사분면\N3L_C0520000.shp"
"C:\Users\user\OneDrive\바탕 화면\설계\설계 스튜디오\5학년\맵모델링\3사분면\N3L_E0020000.shp"
"C:\Users\user\OneDrive\바탕 화면\설계\설계 스튜디오\5학년\맵모델링\3사분면\N3L_F0010000.shp"
"C:\Users\user\OneDrive\바탕 화면\설계\설계 스튜디오\5학년\맵모델링\3사분면\N3L_F0030000.shp"
"C:\Users\user\OneDrive\바탕 화면\설계\설계 스튜디오\5학년\맵모델링\3사분면\N3L_F0040000.shp"
"C:\Users\user\OneDrive\바탕 화면\설계\설계 스튜디오\5학년\맵모델링\3사분면\N3L_G0030000.shp"
"C:\Users\user\OneDrive\바탕 화면\설계\설계 스튜디오\5학년\맵모델링\3사분면\N3L_H0010000.shp"
"C:\Users\user\OneDrive\바탕 화면\설계\설계 스튜디오\5학년\맵모델링\3사분면\N3P_A0131122.shp"
"C:\Users\user\OneDrive\바탕 화면\설계\설계 스튜디오\5학년\맵모델링\3사분면\N3P_C0340000.shp"
"C:\Users\user\OneDrive\바탕 화면\설계\설계 스튜디오\5학년\맵모델링\3사분면\N3P_C0380000.shp"
"C:\Users\user\OneDrive\바탕 화면\설계\설계 스튜디오\5학년\맵모델링\3사분면\N3P_E0042326.shp"
"C:\Users\user\OneDrive\바탕 화면\설계\설계 스튜디오\5학년\맵모델링\3사분면\N3P_F0020000.shp"
"C:\Users\user\OneDrive\바탕 화면\설계\설계 스튜디오\5학년\맵모델링\3사분면\N3P_H0020000.shp"
"C:\Users\user\OneDrive\바탕 화면\설계\설계 스튜디오\5학년\맵모델링\3사분면\N3P_H0040000.shp"
""")  # disabled
panel_18 = Panel(""""C:\Users\user\OneDrive\바탕 화면\설계\설계 스튜디오\5학년\맵모델링\3사분면\N3A_A0010000.shp"
"C:\Users\user\OneDrive\바탕 화면\설계\설계 스튜디오\5학년\맵모델링\3사분면\N3A_A0033320.shp"
"C:\Users\user\OneDrive\바탕 화면\설계\설계 스튜디오\5학년\맵모델링\3사분면\N3A_A0053326.shp"
"C:\Users\user\OneDrive\바탕 화면\설계\설계 스튜디오\5학년\맵모델링\3사분면\N3A_A0063321.shp"
"C:\Users\user\OneDrive\바탕 화면\설계\설계 스튜디오\5학년\맵모델링\3사분면\N3A_A0070000.shp"
"C:\Users\user\OneDrive\바탕 화면\설계\설계 스튜디오\5학년\맵모델링\3사분면\N3A_A0080000.shp"
"C:\Users\user\OneDrive\바탕 화면\설계\설계 스튜디오\5학년\맵모델링\3사분면\N3A_A0090000.shp"
"C:\Users\user\OneDrive\바탕 화면\설계\설계 스튜디오\5학년\맵모델링\3사분면\N3A_A0160024.shp"
"C:\Users\user\OneDrive\바탕 화면\설계\설계 스튜디오\5학년\맵모델링\3사분면\N3A_A0191221.shp"
"C:\Users\user\OneDrive\바탕 화면\설계\설계 스튜디오\5학년\맵모델링\3사분면\N3A_A0201222.shp"
"C:\Users\user\OneDrive\바탕 화면\설계\설계 스튜디오\5학년\맵모델링\3사분면\N3A_B0010000.shp"
"C:\Users\user\OneDrive\바탕 화면\설계\설계 스튜디오\5학년\맵모델링\3사분면\N3A_C0186115.shp"
"C:\Users\user\OneDrive\바탕 화면\설계\설계 스튜디오\5학년\맵모델링\3사분면\N3A_C0390000.shp"
"C:\Users\user\OneDrive\바탕 화면\설계\설계 스튜디오\5학년\맵모델링\3사분면\N3A_C0423365.shp"
"C:\Users\user\OneDrive\바탕 화면\설계\설계 스튜디오\5학년\맵모델링\3사분면\N3A_C0430000.shp"
"C:\Users\user\OneDrive\바탕 화면\설계\설계 스튜디오\5학년\맵모델링\3사분면\N3A_D0010000.shp"
"C:\Users\user\OneDrive\바탕 화면\설계\설계 스튜디오\5학년\맵모델링\3사분면\N3A_E0010001.shp"
"C:\Users\user\OneDrive\바탕 화면\설계\설계 스튜디오\5학년\맵모델링\3사분면\N3A_E0032111.shp"
"C:\Users\user\OneDrive\바탕 화면\설계\설계 스튜디오\5학년\맵모델링\3사분면\N3A_E0052114.shp"
"C:\Users\user\OneDrive\바탕 화면\설계\설계 스튜디오\5학년\맵모델링\3사분면\N3A_G0010000.shp"
"C:\Users\user\OneDrive\바탕 화면\설계\설계 스튜디오\5학년\맵모델링\3사분면\N3L_A0010000.shp"
"C:\Users\user\OneDrive\바탕 화면\설계\설계 스튜디오\5학년\맵모델링\3사분면\N3L_A0020000.shp"
"C:\Users\user\OneDrive\바탕 화면\설계\설계 스튜디오\5학년\맵모델링\3사분면\N3L_A0033330.shp"
"C:\Users\user\OneDrive\바탕 화면\설계\설계 스튜디오\5학년\맵모델링\3사분면\N3L_A0123373.shp"
"C:\Users\user\OneDrive\바탕 화면\설계\설계 스튜디오\5학년\맵모델링\3사분면\N3L_A0150000.shp"
"C:\Users\user\OneDrive\바탕 화면\설계\설계 스튜디오\5학년\맵모델링\3사분면\N3L_A0171119.shp"
"C:\Users\user\OneDrive\바탕 화면\설계\설계 스튜디오\5학년\맵모델링\3사분면\N3L_B0020000.shp"
"C:\Users\user\OneDrive\바탕 화면\설계\설계 스튜디오\5학년\맵모델링\3사분면\N3L_C0050000.shp"
"C:\Users\user\OneDrive\바탕 화면\설계\설계 스튜디오\5학년\맵모델링\3사분면\N3L_C0070000.shp"
"C:\Users\user\OneDrive\바탕 화면\설계\설계 스튜디오\5학년\맵모델링\3사분면\N3L_C0520000.shp"
"C:\Users\user\OneDrive\바탕 화면\설계\설계 스튜디오\5학년\맵모델링\3사분면\N3L_E0020000.shp"
"C:\Users\user\OneDrive\바탕 화면\설계\설계 스튜디오\5학년\맵모델링\3사분면\N3L_F0010000.shp"
"C:\Users\user\OneDrive\바탕 화면\설계\설계 스튜디오\5학년\맵모델링\3사분면\N3L_F0030000.shp"
"C:\Users\user\OneDrive\바탕 화면\설계\설계 스튜디오\5학년\맵모델링\3사분면\N3L_F0040000.shp"
"C:\Users\user\OneDrive\바탕 화면\설계\설계 스튜디오\5학년\맵모델링\3사분면\N3L_G0030000.shp"
"C:\Users\user\OneDrive\바탕 화면\설계\설계 스튜디오\5학년\맵모델링\3사분면\N3L_H0010000.shp"
"C:\Users\user\OneDrive\바탕 화면\설계\설계 스튜디오\5학년\맵모델링\3사분면\N3P_A0131122.shp"
"C:\Users\user\OneDrive\바탕 화면\설계\설계 스튜디오\5학년\맵모델링\3사분면\N3P_C0340000.shp"
"C:\Users\user\OneDrive\바탕 화면\설계\설계 스튜디오\5학년\맵모델링\3사분면\N3P_C0380000.shp"
"C:\Users\user\OneDrive\바탕 화면\설계\설계 스튜디오\5학년\맵모델링\3사분면\N3P_E0042326.shp"
"C:\Users\user\OneDrive\바탕 화면\설계\설계 스튜디오\5학년\맵모델링\3사분면\N3P_F0020000.shp"
"C:\Users\user\OneDrive\바탕 화면\설계\설계 스튜디오\5학년\맵모델링\3사분면\N3P_H0020000.shp"
"C:\Users\user\OneDrive\바탕 화면\설계\설계 스튜디오\5학년\맵모델링\3사분면\N3P_H0040000.shp"
""")  # disabled
panel_19 = Panel(""""C:\Users\BaekInchan\Desktop\설계스튜디오9_졸업설계\맵모델링\압구정\N3A_A0010000.shp"
"C:\Users\BaekInchan\Desktop\설계스튜디오9_졸업설계\맵모델링\압구정\N3A_A0033320.shp"
"C:\Users\BaekInchan\Desktop\설계스튜디오9_졸업설계\맵모델링\압구정\N3A_A0053326.shp"
"C:\Users\BaekInchan\Desktop\설계스튜디오9_졸업설계\맵모델링\압구정\N3A_A0063321.shp"
"C:\Users\BaekInchan\Desktop\설계스튜디오9_졸업설계\맵모델링\압구정\N3A_A0070000.shp"
"C:\Users\BaekInchan\Desktop\설계스튜디오9_졸업설계\맵모델링\압구정\N3A_A0080000.shp"
"C:\Users\BaekInchan\Desktop\설계스튜디오9_졸업설계\맵모델링\압구정\N3A_A0090000.shp"
"C:\Users\BaekInchan\Desktop\설계스튜디오9_졸업설계\맵모델링\압구정\N3A_A0100000.shp"
"C:\Users\BaekInchan\Desktop\설계스튜디오9_졸업설계\맵모델링\압구정\N3A_A0110020.shp"
"C:\Users\BaekInchan\Desktop\설계스튜디오9_졸업설계\맵모델링\압구정\N3A_A0160024.shp"
"C:\Users\BaekInchan\Desktop\설계스튜디오9_졸업설계\맵모델링\압구정\N3A_A0191221.shp"
"C:\Users\BaekInchan\Desktop\설계스튜디오9_졸업설계\맵모델링\압구정\N3A_A0201222.shp"
"C:\Users\BaekInchan\Desktop\설계스튜디오9_졸업설계\맵모델링\압구정\N3A_B0010000.shp"
"C:\Users\BaekInchan\Desktop\설계스튜디오9_졸업설계\맵모델링\압구정\N3A_C0186115.shp"
"C:\Users\BaekInchan\Desktop\설계스튜디오9_졸업설계\맵모델링\압구정\N3A_C0390000.shp"
"C:\Users\BaekInchan\Desktop\설계스튜디오9_졸업설계\맵모델링\압구정\N3A_C0423365.shp"
"C:\Users\BaekInchan\Desktop\설계스튜디오9_졸업설계\맵모델링\압구정\N3A_C0430000.shp"
"C:\Users\BaekInchan\Desktop\설계스튜디오9_졸업설계\맵모델링\압구정\N3A_D0010000.shp"
"C:\Users\BaekInchan\Desktop\설계스튜디오9_졸업설계\맵모델링\압구정\N3A_E0010001.shp"
"C:\Users\BaekInchan\Desktop\설계스튜디오9_졸업설계\맵모델링\압구정\N3A_E0032111.shp"
"C:\Users\BaekInchan\Desktop\설계스튜디오9_졸업설계\맵모델링\압구정\N3A_E0052114.shp"
"C:\Users\BaekInchan\Desktop\설계스튜디오9_졸업설계\맵모델링\압구정\N3A_G0010000.shp"
"C:\Users\BaekInchan\Desktop\설계스튜디오9_졸업설계\맵모델링\압구정\N3A_G0020000.shp"
"C:\Users\BaekInchan\Desktop\설계스튜디오9_졸업설계\맵모델링\압구정\N3L_A0010000.shp"
"C:\Users\BaekInchan\Desktop\설계스튜디오9_졸업설계\맵모델링\압구정\N3L_A0020000.shp"
"C:\Users\BaekInchan\Desktop\설계스튜디오9_졸업설계\맵모델링\압구정\N3L_A0033330.shp"
"C:\Users\BaekInchan\Desktop\설계스튜디오9_졸업설계\맵모델링\압구정\N3L_A0123373.shp"
"C:\Users\BaekInchan\Desktop\설계스튜디오9_졸업설계\맵모델링\압구정\N3L_A0150000.shp"
"C:\Users\BaekInchan\Desktop\설계스튜디오9_졸업설계\맵모델링\압구정\N3L_A0171119.shp"
"C:\Users\BaekInchan\Desktop\설계스튜디오9_졸업설계\맵모델링\압구정\N3L_B0020000.shp"
"C:\Users\BaekInchan\Desktop\설계스튜디오9_졸업설계\맵모델링\압구정\N3L_C0050000.shp"
"C:\Users\BaekInchan\Desktop\설계스튜디오9_졸업설계\맵모델링\압구정\N3L_C0060000.shp"
"C:\Users\BaekInchan\Desktop\설계스튜디오9_졸업설계\맵모델링\압구정\N3L_C0070000.shp"
"C:\Users\BaekInchan\Desktop\설계스튜디오9_졸업설계\맵모델링\압구정\N3L_C0520000.shp"
"C:\Users\BaekInchan\Desktop\설계스튜디오9_졸업설계\맵모델링\압구정\N3L_E0020000.shp"
"C:\Users\BaekInchan\Desktop\설계스튜디오9_졸업설계\맵모델링\압구정\N3L_F0010000.shp"
"C:\Users\BaekInchan\Desktop\설계스튜디오9_졸업설계\맵모델링\압구정\N3L_F0030000.shp"
"C:\Users\BaekInchan\Desktop\설계스튜디오9_졸업설계\맵모델링\압구정\N3L_F0040000.shp"
"C:\Users\BaekInchan\Desktop\설계스튜디오9_졸업설계\맵모델링\압구정\N3L_G0030000.shp"
"C:\Users\BaekInchan\Desktop\설계스튜디오9_졸업설계\맵모델링\압구정\N3L_H0010000.shp"
"C:\Users\BaekInchan\Desktop\설계스튜디오9_졸업설계\맵모델링\압구정\N3P_A0131122.shp"
"C:\Users\BaekInchan\Desktop\설계스튜디오9_졸업설계\맵모델링\압구정\N3P_C0210000.shp"
"C:\Users\BaekInchan\Desktop\설계스튜디오9_졸업설계\맵모델링\압구정\N3P_C0380000.shp"
"C:\Users\BaekInchan\Desktop\설계스튜디오9_졸업설계\맵모델링\압구정\N3P_D0030000.shp"
"C:\Users\BaekInchan\Desktop\설계스튜디오9_졸업설계\맵모델링\압구정\N3P_E0042326.shp"
"C:\Users\BaekInchan\Desktop\설계스튜디오9_졸업설계\맵모델링\압구정\N3P_F0020000.shp"
"C:\Users\BaekInchan\Desktop\설계스튜디오9_졸업설계\맵모델링\압구정\N3P_H0020000.shp"
"C:\Users\BaekInchan\Desktop\설계스튜디오9_졸업설계\맵모델링\압구정\N3P_H0040000.shp"
"C:\Users\BaekInchan\Desktop\설계스튜디오9_졸업설계\맵모델링\압구정\N3P_H0059153.shp"
""")
panel_20 = Panel(""""C:\Users\BaekInchan\Desktop\설계스튜디오9_졸업설계\맵모델링\강남구청\(B010)수치지도_37705092_2022_00000597055733\N3P_H0040000.shp"
"C:\Users\BaekInchan\Desktop\설계스튜디오9_졸업설계\맵모델링\강남구청\(B010)수치지도_37705092_2022_00000597055733\N3A_A0010000.shp"
"C:\Users\BaekInchan\Desktop\설계스튜디오9_졸업설계\맵모델링\강남구청\(B010)수치지도_37705092_2022_00000597055733\N3A_A0033320.shp"
"C:\Users\BaekInchan\Desktop\설계스튜디오9_졸업설계\맵모델링\강남구청\(B010)수치지도_37705092_2022_00000597055733\N3A_A0053326.shp"
"C:\Users\BaekInchan\Desktop\설계스튜디오9_졸업설계\맵모델링\강남구청\(B010)수치지도_37705092_2022_00000597055733\N3A_A0080000.shp"
"C:\Users\BaekInchan\Desktop\설계스튜디오9_졸업설계\맵모델링\강남구청\(B010)수치지도_37705092_2022_00000597055733\N3A_B0010000.shp"
"C:\Users\BaekInchan\Desktop\설계스튜디오9_졸업설계\맵모델링\강남구청\(B010)수치지도_37705092_2022_00000597055733\N3A_C0186115.shp"
"C:\Users\BaekInchan\Desktop\설계스튜디오9_졸업설계\맵모델링\강남구청\(B010)수치지도_37705092_2022_00000597055733\N3A_C0305316.shp"
"C:\Users\BaekInchan\Desktop\설계스튜디오9_졸업설계\맵모델링\강남구청\(B010)수치지도_37705092_2022_00000597055733\N3A_C0390000.shp"
"C:\Users\BaekInchan\Desktop\설계스튜디오9_졸업설계\맵모델링\강남구청\(B010)수치지도_37705092_2022_00000597055733\N3A_C0423365.shp"
"C:\Users\BaekInchan\Desktop\설계스튜디오9_졸업설계\맵모델링\강남구청\(B010)수치지도_37705092_2022_00000597055733\N3A_C0430000.shp"
"C:\Users\BaekInchan\Desktop\설계스튜디오9_졸업설계\맵모델링\강남구청\(B010)수치지도_37705092_2022_00000597055733\N3A_G0010000.shp"
"C:\Users\BaekInchan\Desktop\설계스튜디오9_졸업설계\맵모델링\강남구청\(B010)수치지도_37705092_2022_00000597055733\N3L_A0010000.shp"
"C:\Users\BaekInchan\Desktop\설계스튜디오9_졸업설계\맵모델링\강남구청\(B010)수치지도_37705092_2022_00000597055733\N3L_A0020000.shp"
"C:\Users\BaekInchan\Desktop\설계스튜디오9_졸업설계\맵모델링\강남구청\(B010)수치지도_37705092_2022_00000597055733\N3L_A0033330.shp"
"C:\Users\BaekInchan\Desktop\설계스튜디오9_졸업설계\맵모델링\강남구청\(B010)수치지도_37705092_2022_00000597055733\N3L_B0020000.shp"
"C:\Users\BaekInchan\Desktop\설계스튜디오9_졸업설계\맵모델링\강남구청\(B010)수치지도_37705092_2022_00000597055733\N3L_C0070000.shp"
"C:\Users\BaekInchan\Desktop\설계스튜디오9_졸업설계\맵모델링\강남구청\(B010)수치지도_37705092_2022_00000597055733\N3L_C0520000.shp"
"C:\Users\BaekInchan\Desktop\설계스튜디오9_졸업설계\맵모델링\강남구청\(B010)수치지도_37705092_2022_00000597055733\N3L_E0020000.shp"
"C:\Users\BaekInchan\Desktop\설계스튜디오9_졸업설계\맵모델링\강남구청\(B010)수치지도_37705092_2022_00000597055733\N3L_F0010000.shp"
"C:\Users\BaekInchan\Desktop\설계스튜디오9_졸업설계\맵모델링\강남구청\(B010)수치지도_37705092_2022_00000597055733\N3L_F0040000.shp"
"C:\Users\BaekInchan\Desktop\설계스튜디오9_졸업설계\맵모델링\강남구청\(B010)수치지도_37705092_2022_00000597055733\N3L_G0030000.shp"
"C:\Users\BaekInchan\Desktop\설계스튜디오9_졸업설계\맵모델링\강남구청\(B010)수치지도_37705092_2022_00000597055733\N3L_H0010000.shp"
"C:\Users\BaekInchan\Desktop\설계스튜디오9_졸업설계\맵모델링\강남구청\(B010)수치지도_37705092_2022_00000597055733\N3P_A0131122.shp"
"C:\Users\BaekInchan\Desktop\설계스튜디오9_졸업설계\맵모델링\강남구청\(B010)수치지도_37705092_2022_00000597055733\N3P_C0285311.shp"
"C:\Users\BaekInchan\Desktop\설계스튜디오9_졸업설계\맵모델링\강남구청\(B010)수치지도_37705092_2022_00000597055733\N3P_C0310000.shp"
"C:\Users\BaekInchan\Desktop\설계스튜디오9_졸업설계\맵모델링\강남구청\(B010)수치지도_37705092_2022_00000597055733\N3P_C0380000.shp"
"C:\Users\BaekInchan\Desktop\설계스튜디오9_졸업설계\맵모델링\강남구청\(B010)수치지도_37705092_2022_00000597055733\N3P_F0020000.shp"
""")
panel_21 = Panel(""""C:\Users\BaekInchan\Desktop\설계스튜디오9_졸업설계\맵모델링\신사\N3P_H0059153.shp"
"C:\Users\BaekInchan\Desktop\설계스튜디오9_졸업설계\맵모델링\신사\N3A_A0010000.shp"
"C:\Users\BaekInchan\Desktop\설계스튜디오9_졸업설계\맵모델링\신사\N3A_A0033320.shp"
"C:\Users\BaekInchan\Desktop\설계스튜디오9_졸업설계\맵모델링\신사\N3A_A0053326.shp"
"C:\Users\BaekInchan\Desktop\설계스튜디오9_졸업설계\맵모델링\신사\N3A_A0063321.shp"
"C:\Users\BaekInchan\Desktop\설계스튜디오9_졸업설계\맵모델링\신사\N3A_A0070000.shp"
"C:\Users\BaekInchan\Desktop\설계스튜디오9_졸업설계\맵모델링\신사\N3A_A0080000.shp"
"C:\Users\BaekInchan\Desktop\설계스튜디오9_졸업설계\맵모델링\신사\N3A_A0090000.shp"
"C:\Users\BaekInchan\Desktop\설계스튜디오9_졸업설계\맵모델링\신사\N3A_A0100000.shp"
"C:\Users\BaekInchan\Desktop\설계스튜디오9_졸업설계\맵모델링\신사\N3A_A0110020.shp"
"C:\Users\BaekInchan\Desktop\설계스튜디오9_졸업설계\맵모델링\신사\N3A_A0160024.shp"
"C:\Users\BaekInchan\Desktop\설계스튜디오9_졸업설계\맵모델링\신사\N3A_A0191221.shp"
"C:\Users\BaekInchan\Desktop\설계스튜디오9_졸업설계\맵모델링\신사\N3A_A0201222.shp"
"C:\Users\BaekInchan\Desktop\설계스튜디오9_졸업설계\맵모델링\신사\N3A_B0010000.shp"
"C:\Users\BaekInchan\Desktop\설계스튜디오9_졸업설계\맵모델링\신사\N3A_C0186115.shp"
"C:\Users\BaekInchan\Desktop\설계스튜디오9_졸업설계\맵모델링\신사\N3A_C0390000.shp"
"C:\Users\BaekInchan\Desktop\설계스튜디오9_졸업설계\맵모델링\신사\N3A_C0423365.shp"
"C:\Users\BaekInchan\Desktop\설계스튜디오9_졸업설계\맵모델링\신사\N3A_C0430000.shp"
"C:\Users\BaekInchan\Desktop\설계스튜디오9_졸업설계\맵모델링\신사\N3A_D0010000.shp"
"C:\Users\BaekInchan\Desktop\설계스튜디오9_졸업설계\맵모델링\신사\N3A_E0010001.shp"
"C:\Users\BaekInchan\Desktop\설계스튜디오9_졸업설계\맵모델링\신사\N3A_E0032111.shp"
"C:\Users\BaekInchan\Desktop\설계스튜디오9_졸업설계\맵모델링\신사\N3A_E0052114.shp"
"C:\Users\BaekInchan\Desktop\설계스튜디오9_졸업설계\맵모델링\신사\N3A_G0010000.shp"
"C:\Users\BaekInchan\Desktop\설계스튜디오9_졸업설계\맵모델링\신사\N3A_G0020000.shp"
"C:\Users\BaekInchan\Desktop\설계스튜디오9_졸업설계\맵모델링\신사\N3L_A0010000.shp"
"C:\Users\BaekInchan\Desktop\설계스튜디오9_졸업설계\맵모델링\신사\N3L_A0020000.shp"
"C:\Users\BaekInchan\Desktop\설계스튜디오9_졸업설계\맵모델링\신사\N3L_A0033320.shp"
"C:\Users\BaekInchan\Desktop\설계스튜디오9_졸업설계\맵모델링\신사\N3L_A0123373.shp"
"C:\Users\BaekInchan\Desktop\설계스튜디오9_졸업설계\맵모델링\신사\N3L_A0150000.shp"
"C:\Users\BaekInchan\Desktop\설계스튜디오9_졸업설계\맵모델링\신사\N3L_A0171119.shp"
"C:\Users\BaekInchan\Desktop\설계스튜디오9_졸업설계\맵모델링\신사\N3L_B0020000.shp"
"C:\Users\BaekInchan\Desktop\설계스튜디오9_졸업설계\맵모델링\신사\N3L_C0050000.shp"
"C:\Users\BaekInchan\Desktop\설계스튜디오9_졸업설계\맵모델링\신사\N3L_C0060000.shp"
"C:\Users\BaekInchan\Desktop\설계스튜디오9_졸업설계\맵모델링\신사\N3L_C0520000.shp"
"C:\Users\BaekInchan\Desktop\설계스튜디오9_졸업설계\맵모델링\신사\N3L_E0020000.shp"
"C:\Users\BaekInchan\Desktop\설계스튜디오9_졸업설계\맵모델링\신사\N3L_F0010000.shp"
"C:\Users\BaekInchan\Desktop\설계스튜디오9_졸업설계\맵모델링\신사\N3L_F0030000.shp"
"C:\Users\BaekInchan\Desktop\설계스튜디오9_졸업설계\맵모델링\신사\N3L_F0040000.shp"
"C:\Users\BaekInchan\Desktop\설계스튜디오9_졸업설계\맵모델링\신사\N3L_G0030000.shp"
"C:\Users\BaekInchan\Desktop\설계스튜디오9_졸업설계\맵모델링\신사\N3L_H0010000.shp"
"C:\Users\BaekInchan\Desktop\설계스튜디오9_졸업설계\맵모델링\신사\N3P_A0131122.shp"
"C:\Users\BaekInchan\Desktop\설계스튜디오9_졸업설계\맵모델링\신사\N3P_C0380000.shp"
"C:\Users\BaekInchan\Desktop\설계스튜디오9_졸업설계\맵모델링\신사\N3P_E0042326.shp"
"C:\Users\BaekInchan\Desktop\설계스튜디오9_졸업설계\맵모델링\신사\N3P_F0020000.shp"
"C:\Users\BaekInchan\Desktop\설계스튜디오9_졸업설계\맵모델링\신사\N3P_H0020000.shp"
"C:\Users\BaekInchan\Desktop\설계스튜디오9_졸업설계\맵모델링\신사\N3P_H0040000.shp"
""")
panel_22 = Panel(""""C:\Users\BaekInchan\Desktop\설계스튜디오9_졸업설계\맵모델링\논현역\(B010)수치지도_37705091_2022_00000452529185\N3P_H0040000.shp"
"C:\Users\BaekInchan\Desktop\설계스튜디오9_졸업설계\맵모델링\논현역\(B010)수치지도_37705091_2022_00000452529185\N3A_A0010000.shp"
"C:\Users\BaekInchan\Desktop\설계스튜디오9_졸업설계\맵모델링\논현역\(B010)수치지도_37705091_2022_00000452529185\N3A_A0033320.shp"
"C:\Users\BaekInchan\Desktop\설계스튜디오9_졸업설계\맵모델링\논현역\(B010)수치지도_37705091_2022_00000452529185\N3A_A0053326.shp"
"C:\Users\BaekInchan\Desktop\설계스튜디오9_졸업설계\맵모델링\논현역\(B010)수치지도_37705091_2022_00000452529185\N3A_A0063321.shp"
"C:\Users\BaekInchan\Desktop\설계스튜디오9_졸업설계\맵모델링\논현역\(B010)수치지도_37705091_2022_00000452529185\N3A_A0070000.shp"
"C:\Users\BaekInchan\Desktop\설계스튜디오9_졸업설계\맵모델링\논현역\(B010)수치지도_37705091_2022_00000452529185\N3A_A0080000.shp"
"C:\Users\BaekInchan\Desktop\설계스튜디오9_졸업설계\맵모델링\논현역\(B010)수치지도_37705091_2022_00000452529185\N3A_A0090000.shp"
"C:\Users\BaekInchan\Desktop\설계스튜디오9_졸업설계\맵모델링\논현역\(B010)수치지도_37705091_2022_00000452529185\N3A_A0100000.shp"
"C:\Users\BaekInchan\Desktop\설계스튜디오9_졸업설계\맵모델링\논현역\(B010)수치지도_37705091_2022_00000452529185\N3A_A0160024.shp"
"C:\Users\BaekInchan\Desktop\설계스튜디오9_졸업설계\맵모델링\논현역\(B010)수치지도_37705091_2022_00000452529185\N3A_B0010000.shp"
"C:\Users\BaekInchan\Desktop\설계스튜디오9_졸업설계\맵모델링\논현역\(B010)수치지도_37705091_2022_00000452529185\N3A_C0186115.shp"
"C:\Users\BaekInchan\Desktop\설계스튜디오9_졸업설계\맵모델링\논현역\(B010)수치지도_37705091_2022_00000452529185\N3A_C0390000.shp"
"C:\Users\BaekInchan\Desktop\설계스튜디오9_졸업설계\맵모델링\논현역\(B010)수치지도_37705091_2022_00000452529185\N3A_C0423365.shp"
"C:\Users\BaekInchan\Desktop\설계스튜디오9_졸업설계\맵모델링\논현역\(B010)수치지도_37705091_2022_00000452529185\N3A_C0430000.shp"
"C:\Users\BaekInchan\Desktop\설계스튜디오9_졸업설계\맵모델링\논현역\(B010)수치지도_37705091_2022_00000452529185\N3A_D0010000.shp"
"C:\Users\BaekInchan\Desktop\설계스튜디오9_졸업설계\맵모델링\논현역\(B010)수치지도_37705091_2022_00000452529185\N3A_E0010001.shp"
"C:\Users\BaekInchan\Desktop\설계스튜디오9_졸업설계\맵모델링\논현역\(B010)수치지도_37705091_2022_00000452529185\N3A_E0032111.shp"
"C:\Users\BaekInchan\Desktop\설계스튜디오9_졸업설계\맵모델링\논현역\(B010)수치지도_37705091_2022_00000452529185\N3A_E0052114.shp"
"C:\Users\BaekInchan\Desktop\설계스튜디오9_졸업설계\맵모델링\논현역\(B010)수치지도_37705091_2022_00000452529185\N3A_G0010000.shp"
"C:\Users\BaekInchan\Desktop\설계스튜디오9_졸업설계\맵모델링\논현역\(B010)수치지도_37705091_2022_00000452529185\N3A_G0020000.shp"
"C:\Users\BaekInchan\Desktop\설계스튜디오9_졸업설계\맵모델링\논현역\(B010)수치지도_37705091_2022_00000452529185\N3L_A0010000.shp"
"C:\Users\BaekInchan\Desktop\설계스튜디오9_졸업설계\맵모델링\논현역\(B010)수치지도_37705091_2022_00000452529185\N3L_A0020000.shp"
"C:\Users\BaekInchan\Desktop\설계스튜디오9_졸업설계\맵모델링\논현역\(B010)수치지도_37705091_2022_00000452529185\N3L_A0033330.shp"
"C:\Users\BaekInchan\Desktop\설계스튜디오9_졸업설계\맵모델링\논현역\(B010)수치지도_37705091_2022_00000452529185\N3L_A0150000.shp"
"C:\Users\BaekInchan\Desktop\설계스튜디오9_졸업설계\맵모델링\논현역\(B010)수치지도_37705091_2022_00000452529185\N3L_A0171119.shp"
"C:\Users\BaekInchan\Desktop\설계스튜디오9_졸업설계\맵모델링\논현역\(B010)수치지도_37705091_2022_00000452529185\N3L_B0020000.shp"
"C:\Users\BaekInchan\Desktop\설계스튜디오9_졸업설계\맵모델링\논현역\(B010)수치지도_37705091_2022_00000452529185\N3L_C0050000.shp"
"C:\Users\BaekInchan\Desktop\설계스튜디오9_졸업설계\맵모델링\논현역\(B010)수치지도_37705091_2022_00000452529185\N3L_C0060000.shp"
"C:\Users\BaekInchan\Desktop\설계스튜디오9_졸업설계\맵모델링\논현역\(B010)수치지도_37705091_2022_00000452529185\N3L_C0070000.shp"
"C:\Users\BaekInchan\Desktop\설계스튜디오9_졸업설계\맵모델링\논현역\(B010)수치지도_37705091_2022_00000452529185\N3L_C0520000.shp"
"C:\Users\BaekInchan\Desktop\설계스튜디오9_졸업설계\맵모델링\논현역\(B010)수치지도_37705091_2022_00000452529185\N3L_E0020000.shp"
"C:\Users\BaekInchan\Desktop\설계스튜디오9_졸업설계\맵모델링\논현역\(B010)수치지도_37705091_2022_00000452529185\N3L_F0010000.shp"
"C:\Users\BaekInchan\Desktop\설계스튜디오9_졸업설계\맵모델링\논현역\(B010)수치지도_37705091_2022_00000452529185\N3L_F0030000.shp"
"C:\Users\BaekInchan\Desktop\설계스튜디오9_졸업설계\맵모델링\논현역\(B010)수치지도_37705091_2022_00000452529185\N3L_F0040000.shp"
"C:\Users\BaekInchan\Desktop\설계스튜디오9_졸업설계\맵모델링\논현역\(B010)수치지도_37705091_2022_00000452529185\N3L_G0030000.shp"
"C:\Users\BaekInchan\Desktop\설계스튜디오9_졸업설계\맵모델링\논현역\(B010)수치지도_37705091_2022_00000452529185\N3L_H0010000.shp"
"C:\Users\BaekInchan\Desktop\설계스튜디오9_졸업설계\맵모델링\논현역\(B010)수치지도_37705091_2022_00000452529185\N3P_A0131122.shp"
"C:\Users\BaekInchan\Desktop\설계스튜디오9_졸업설계\맵모델링\논현역\(B010)수치지도_37705091_2022_00000452529185\N3P_C0380000.shp"
"C:\Users\BaekInchan\Desktop\설계스튜디오9_졸업설계\맵모델링\논현역\(B010)수치지도_37705091_2022_00000452529185\N3P_D0030000.shp"
"C:\Users\BaekInchan\Desktop\설계스튜디오9_졸업설계\맵모델링\논현역\(B010)수치지도_37705091_2022_00000452529185\N3P_E0042326.shp"
"C:\Users\BaekInchan\Desktop\설계스튜디오9_졸업설계\맵모델링\논현역\(B010)수치지도_37705091_2022_00000452529185\N3P_F0020000.shp"
"C:\Users\BaekInchan\Desktop\설계스튜디오9_졸업설계\맵모델링\논현역\(B010)수치지도_37705091_2022_00000452529185\N3P_H0020000.shp"
""")
panel_23 = Panel(""""C:\Users\user\OneDrive\바탕 화면\설계\설계 스튜디오\5학년\맵모델링\4사분면\N1A_A0010000.shp"
"C:\Users\user\OneDrive\바탕 화면\설계\설계 스튜디오\5학년\맵모델링\4사분면\N1A_A0033320.shp"
"C:\Users\user\OneDrive\바탕 화면\설계\설계 스튜디오\5학년\맵모델링\4사분면\N1A_A0053326.shp"
"C:\Users\user\OneDrive\바탕 화면\설계\설계 스튜디오\5학년\맵모델링\4사분면\N1A_A0063321.shp"
"C:\Users\user\OneDrive\바탕 화면\설계\설계 스튜디오\5학년\맵모델링\4사분면\N1A_A0070000.shp"
"C:\Users\user\OneDrive\바탕 화면\설계\설계 스튜디오\5학년\맵모델링\4사분면\N1A_A0080000.shp"
"C:\Users\user\OneDrive\바탕 화면\설계\설계 스튜디오\5학년\맵모델링\4사분면\N1A_A0090000.shp"
"C:\Users\user\OneDrive\바탕 화면\설계\설계 스튜디오\5학년\맵모델링\4사분면\N1A_A0100000.shp"
"C:\Users\user\OneDrive\바탕 화면\설계\설계 스튜디오\5학년\맵모델링\4사분면\N1A_A0110020.shp"
"C:\Users\user\OneDrive\바탕 화면\설계\설계 스튜디오\5학년\맵모델링\4사분면\N1A_A0160024.shp"
"C:\Users\user\OneDrive\바탕 화면\설계\설계 스튜디오\5학년\맵모델링\4사분면\N1A_A0191221.shp"
"C:\Users\user\OneDrive\바탕 화면\설계\설계 스튜디오\5학년\맵모델링\4사분면\N1A_A0201222.shp"
"C:\Users\user\OneDrive\바탕 화면\설계\설계 스튜디오\5학년\맵모델링\4사분면\N1A_B0010000.shp"
"C:\Users\user\OneDrive\바탕 화면\설계\설계 스튜디오\5학년\맵모델링\4사분면\N1A_C0390000.shp"
"C:\Users\user\OneDrive\바탕 화면\설계\설계 스튜디오\5학년\맵모델링\4사분면\N1A_C0423365.shp"
"C:\Users\user\OneDrive\바탕 화면\설계\설계 스튜디오\5학년\맵모델링\4사분면\N1A_C0430000.shp"
"C:\Users\user\OneDrive\바탕 화면\설계\설계 스튜디오\5학년\맵모델링\4사분면\N1A_D0010000.shp"
"C:\Users\user\OneDrive\바탕 화면\설계\설계 스튜디오\5학년\맵모델링\4사분면\N1A_E0010001.shp"
"C:\Users\user\OneDrive\바탕 화면\설계\설계 스튜디오\5학년\맵모델링\4사분면\N1A_E0032111.shp"
"C:\Users\user\OneDrive\바탕 화면\설계\설계 스튜디오\5학년\맵모델링\4사분면\N1A_E0052114.shp"
"C:\Users\user\OneDrive\바탕 화면\설계\설계 스튜디오\5학년\맵모델링\4사분면\N1A_G0010000.shp"
"C:\Users\user\OneDrive\바탕 화면\설계\설계 스튜디오\5학년\맵모델링\4사분면\N1A_G0020000.shp"
"C:\Users\user\OneDrive\바탕 화면\설계\설계 스튜디오\5학년\맵모델링\4사분면\N1L_A0010000.shp"
"C:\Users\user\OneDrive\바탕 화면\설계\설계 스튜디오\5학년\맵모델링\4사분면\N1L_A0020000.shp"
"C:\Users\user\OneDrive\바탕 화면\설계\설계 스튜디오\5학년\맵모델링\4사분면\N1L_A0033330.shp"
"C:\Users\user\OneDrive\바탕 화면\설계\설계 스튜디오\5학년\맵모델링\4사분면\N1L_A0123373.shp"
"C:\Users\user\OneDrive\바탕 화면\설계\설계 스튜디오\5학년\맵모델링\4사분면\N1L_A0150000.shp"
"C:\Users\user\OneDrive\바탕 화면\설계\설계 스튜디오\5학년\맵모델링\4사분면\N1L_A0171119.shp"
"C:\Users\user\OneDrive\바탕 화면\설계\설계 스튜디오\5학년\맵모델링\4사분면\N1L_B0020000.shp"
"C:\Users\user\OneDrive\바탕 화면\설계\설계 스튜디오\5학년\맵모델링\4사분면\N1L_C0050000.shp"
"C:\Users\user\OneDrive\바탕 화면\설계\설계 스튜디오\5학년\맵모델링\4사분면\N1L_C0070000.shp"
"C:\Users\user\OneDrive\바탕 화면\설계\설계 스튜디오\5학년\맵모델링\4사분면\N1L_C0520000.shp"
"C:\Users\user\OneDrive\바탕 화면\설계\설계 스튜디오\5학년\맵모델링\4사분면\N1L_E0020000.shp"
"C:\Users\user\OneDrive\바탕 화면\설계\설계 스튜디오\5학년\맵모델링\4사분면\N1L_F0010000.shp"
"C:\Users\user\OneDrive\바탕 화면\설계\설계 스튜디오\5학년\맵모델링\4사분면\N1L_F0030000.shp"
"C:\Users\user\OneDrive\바탕 화면\설계\설계 스튜디오\5학년\맵모델링\4사분면\N1L_F0040000.shp"
"C:\Users\user\OneDrive\바탕 화면\설계\설계 스튜디오\5학년\맵모델링\4사분면\N1L_G0030000.shp"
"C:\Users\user\OneDrive\바탕 화면\설계\설계 스튜디오\5학년\맵모델링\4사분면\N1L_H0010000.shp"
"C:\Users\user\OneDrive\바탕 화면\설계\설계 스튜디오\5학년\맵모델링\4사분면\N1P_A0131122.shp"
"C:\Users\user\OneDrive\바탕 화면\설계\설계 스튜디오\5학년\맵모델링\4사분면\N1P_C0285311.shp"
"C:\Users\user\OneDrive\바탕 화면\설계\설계 스튜디오\5학년\맵모델링\4사분면\N1P_C0380000.shp"
"C:\Users\user\OneDrive\바탕 화면\설계\설계 스튜디오\5학년\맵모델링\4사분면\N1P_E0042326.shp"
"C:\Users\user\OneDrive\바탕 화면\설계\설계 스튜디오\5학년\맵모델링\4사분면\N1P_F0020000.shp"
"C:\Users\user\OneDrive\바탕 화면\설계\설계 스튜디오\5학년\맵모델링\4사분면\N1P_H0020000.shp"
"C:\Users\user\OneDrive\바탕 화면\설계\설계 스튜디오\5학년\맵모델링\4사분면\N1P_H0040000.shp"
""")  # disabled
panel_24 = Panel(""""C:\Users\user\OneDrive\바탕 화면\설계\설계 스튜디오\5학년\맵모델링\4사분면\N1A_A0010000.shp"
"C:\Users\user\OneDrive\바탕 화면\설계\설계 스튜디오\5학년\맵모델링\4사분면\N1A_A0033320.shp"
"C:\Users\user\OneDrive\바탕 화면\설계\설계 스튜디오\5학년\맵모델링\4사분면\N1A_A0053326.shp"
"C:\Users\user\OneDrive\바탕 화면\설계\설계 스튜디오\5학년\맵모델링\4사분면\N1A_A0063321.shp"
"C:\Users\user\OneDrive\바탕 화면\설계\설계 스튜디오\5학년\맵모델링\4사분면\N1A_A0070000.shp"
"C:\Users\user\OneDrive\바탕 화면\설계\설계 스튜디오\5학년\맵모델링\4사분면\N1A_A0080000.shp"
"C:\Users\user\OneDrive\바탕 화면\설계\설계 스튜디오\5학년\맵모델링\4사분면\N1A_A0090000.shp"
"C:\Users\user\OneDrive\바탕 화면\설계\설계 스튜디오\5학년\맵모델링\4사분면\N1A_A0100000.shp"
"C:\Users\user\OneDrive\바탕 화면\설계\설계 스튜디오\5학년\맵모델링\4사분면\N1A_A0110020.shp"
"C:\Users\user\OneDrive\바탕 화면\설계\설계 스튜디오\5학년\맵모델링\4사분면\N1A_A0160024.shp"
"C:\Users\user\OneDrive\바탕 화면\설계\설계 스튜디오\5학년\맵모델링\4사분면\N1A_A0191221.shp"
"C:\Users\user\OneDrive\바탕 화면\설계\설계 스튜디오\5학년\맵모델링\4사분면\N1A_A0201222.shp"
"C:\Users\user\OneDrive\바탕 화면\설계\설계 스튜디오\5학년\맵모델링\4사분면\N1A_B0010000.shp"
"C:\Users\user\OneDrive\바탕 화면\설계\설계 스튜디오\5학년\맵모델링\4사분면\N1A_C0390000.shp"
"C:\Users\user\OneDrive\바탕 화면\설계\설계 스튜디오\5학년\맵모델링\4사분면\N1A_C0423365.shp"
"C:\Users\user\OneDrive\바탕 화면\설계\설계 스튜디오\5학년\맵모델링\4사분면\N1A_C0430000.shp"
"C:\Users\user\OneDrive\바탕 화면\설계\설계 스튜디오\5학년\맵모델링\4사분면\N1A_D0010000.shp"
"C:\Users\user\OneDrive\바탕 화면\설계\설계 스튜디오\5학년\맵모델링\4사분면\N1A_E0010001.shp"
"C:\Users\user\OneDrive\바탕 화면\설계\설계 스튜디오\5학년\맵모델링\4사분면\N1A_E0032111.shp"
"C:\Users\user\OneDrive\바탕 화면\설계\설계 스튜디오\5학년\맵모델링\4사분면\N1A_E0052114.shp"
"C:\Users\user\OneDrive\바탕 화면\설계\설계 스튜디오\5학년\맵모델링\4사분면\N1A_G0010000.shp"
"C:\Users\user\OneDrive\바탕 화면\설계\설계 스튜디오\5학년\맵모델링\4사분면\N1A_G0020000.shp"
"C:\Users\user\OneDrive\바탕 화면\설계\설계 스튜디오\5학년\맵모델링\4사분면\N1L_A0010000.shp"
"C:\Users\user\OneDrive\바탕 화면\설계\설계 스튜디오\5학년\맵모델링\4사분면\N1L_A0020000.shp"
"C:\Users\user\OneDrive\바탕 화면\설계\설계 스튜디오\5학년\맵모델링\4사분면\N1L_A0033330.shp"
"C:\Users\user\OneDrive\바탕 화면\설계\설계 스튜디오\5학년\맵모델링\4사분면\N1L_A0123373.shp"
"C:\Users\user\OneDrive\바탕 화면\설계\설계 스튜디오\5학년\맵모델링\4사분면\N1L_A0150000.shp"
"C:\Users\user\OneDrive\바탕 화면\설계\설계 스튜디오\5학년\맵모델링\4사분면\N1L_A0171119.shp"
"C:\Users\user\OneDrive\바탕 화면\설계\설계 스튜디오\5학년\맵모델링\4사분면\N1L_B0020000.shp"
"C:\Users\user\OneDrive\바탕 화면\설계\설계 스튜디오\5학년\맵모델링\4사분면\N1L_C0050000.shp"
"C:\Users\user\OneDrive\바탕 화면\설계\설계 스튜디오\5학년\맵모델링\4사분면\N1L_C0070000.shp"
"C:\Users\user\OneDrive\바탕 화면\설계\설계 스튜디오\5학년\맵모델링\4사분면\N1L_C0520000.shp"
"C:\Users\user\OneDrive\바탕 화면\설계\설계 스튜디오\5학년\맵모델링\4사분면\N1L_E0020000.shp"
"C:\Users\user\OneDrive\바탕 화면\설계\설계 스튜디오\5학년\맵모델링\4사분면\N1L_F0010000.shp"
"C:\Users\user\OneDrive\바탕 화면\설계\설계 스튜디오\5학년\맵모델링\4사분면\N1L_F0030000.shp"
"C:\Users\user\OneDrive\바탕 화면\설계\설계 스튜디오\5학년\맵모델링\4사분면\N1L_F0040000.shp"
"C:\Users\user\OneDrive\바탕 화면\설계\설계 스튜디오\5학년\맵모델링\4사분면\N1L_G0030000.shp"
"C:\Users\user\OneDrive\바탕 화면\설계\설계 스튜디오\5학년\맵모델링\4사분면\N1L_H0010000.shp"
"C:\Users\user\OneDrive\바탕 화면\설계\설계 스튜디오\5학년\맵모델링\4사분면\N1P_A0131122.shp"
"C:\Users\user\OneDrive\바탕 화면\설계\설계 스튜디오\5학년\맵모델링\4사분면\N1P_C0285311.shp"
"C:\Users\user\OneDrive\바탕 화면\설계\설계 스튜디오\5학년\맵모델링\4사분면\N1P_C0380000.shp"
"C:\Users\user\OneDrive\바탕 화면\설계\설계 스튜디오\5학년\맵모델링\4사분면\N1P_E0042326.shp"
"C:\Users\user\OneDrive\바탕 화면\설계\설계 스튜디오\5학년\맵모델링\4사분면\N1P_F0020000.shp"
"C:\Users\user\OneDrive\바탕 화면\설계\설계 스튜디오\5학년\맵모델링\4사분면\N1P_H0020000.shp"
"C:\Users\user\OneDrive\바탕 화면\설계\설계 스튜디오\5학년\맵모델링\4사분면\N1P_H0040000.shp"
""")  # disabled
# 건물
panel_25 = Panel(""""C:\Users\BaekInchan\Desktop\설계스튜디오9_졸업설계\맵모델링\압구정\N3A_A0010000.shp"
"C:\Users\BaekInchan\Desktop\설계스튜디오9_졸업설계\맵모델링\압구정\N3A_A0033320.shp"
"C:\Users\BaekInchan\Desktop\설계스튜디오9_졸업설계\맵모델링\압구정\N3A_A0053326.shp"
"C:\Users\BaekInchan\Desktop\설계스튜디오9_졸업설계\맵모델링\압구정\N3A_A0063321.shp"
"C:\Users\BaekInchan\Desktop\설계스튜디오9_졸업설계\맵모델링\압구정\N3A_A0070000.shp"
"C:\Users\BaekInchan\Desktop\설계스튜디오9_졸업설계\맵모델링\압구정\N3A_A0080000.shp"
"C:\Users\BaekInchan\Desktop\설계스튜디오9_졸업설계\맵모델링\압구정\N3A_A0090000.shp"
"C:\Users\BaekInchan\Desktop\설계스튜디오9_졸업설계\맵모델링\압구정\N3A_A0100000.shp"
"C:\Users\BaekInchan\Desktop\설계스튜디오9_졸업설계\맵모델링\압구정\N3A_A0110020.shp"
"C:\Users\BaekInchan\Desktop\설계스튜디오9_졸업설계\맵모델링\압구정\N3A_A0160024.shp"
"C:\Users\BaekInchan\Desktop\설계스튜디오9_졸업설계\맵모델링\압구정\N3A_A0191221.shp"
"C:\Users\BaekInchan\Desktop\설계스튜디오9_졸업설계\맵모델링\압구정\N3A_A0201222.shp"
"C:\Users\BaekInchan\Desktop\설계스튜디오9_졸업설계\맵모델링\압구정\N3A_B0010000.shp"
"C:\Users\BaekInchan\Desktop\설계스튜디오9_졸업설계\맵모델링\압구정\N3A_C0186115.shp"
"C:\Users\BaekInchan\Desktop\설계스튜디오9_졸업설계\맵모델링\압구정\N3A_C0390000.shp"
"C:\Users\BaekInchan\Desktop\설계스튜디오9_졸업설계\맵모델링\압구정\N3A_C0423365.shp"
"C:\Users\BaekInchan\Desktop\설계스튜디오9_졸업설계\맵모델링\압구정\N3A_C0430000.shp"
"C:\Users\BaekInchan\Desktop\설계스튜디오9_졸업설계\맵모델링\압구정\N3A_D0010000.shp"
"C:\Users\BaekInchan\Desktop\설계스튜디오9_졸업설계\맵모델링\압구정\N3A_E0010001.shp"
"C:\Users\BaekInchan\Desktop\설계스튜디오9_졸업설계\맵모델링\압구정\N3A_E0032111.shp"
"C:\Users\BaekInchan\Desktop\설계스튜디오9_졸업설계\맵모델링\압구정\N3A_E0052114.shp"
"C:\Users\BaekInchan\Desktop\설계스튜디오9_졸업설계\맵모델링\압구정\N3A_G0010000.shp"
"C:\Users\BaekInchan\Desktop\설계스튜디오9_졸업설계\맵모델링\압구정\N3A_G0020000.shp"
"C:\Users\BaekInchan\Desktop\설계스튜디오9_졸업설계\맵모델링\압구정\N3L_A0010000.shp"
"C:\Users\BaekInchan\Desktop\설계스튜디오9_졸업설계\맵모델링\압구정\N3L_A0020000.shp"
"C:\Users\BaekInchan\Desktop\설계스튜디오9_졸업설계\맵모델링\압구정\N3L_A0033330.shp"
"C:\Users\BaekInchan\Desktop\설계스튜디오9_졸업설계\맵모델링\압구정\N3L_A0123373.shp"
"C:\Users\BaekInchan\Desktop\설계스튜디오9_졸업설계\맵모델링\압구정\N3L_A0150000.shp"
"C:\Users\BaekInchan\Desktop\설계스튜디오9_졸업설계\맵모델링\압구정\N3L_A0171119.shp"
"C:\Users\BaekInchan\Desktop\설계스튜디오9_졸업설계\맵모델링\압구정\N3L_B0020000.shp"
"C:\Users\BaekInchan\Desktop\설계스튜디오9_졸업설계\맵모델링\압구정\N3L_C0050000.shp"
"C:\Users\BaekInchan\Desktop\설계스튜디오9_졸업설계\맵모델링\압구정\N3L_C0060000.shp"
"C:\Users\BaekInchan\Desktop\설계스튜디오9_졸업설계\맵모델링\압구정\N3L_C0070000.shp"
"C:\Users\BaekInchan\Desktop\설계스튜디오9_졸업설계\맵모델링\압구정\N3L_C0520000.shp"
"C:\Users\BaekInchan\Desktop\설계스튜디오9_졸업설계\맵모델링\압구정\N3L_E0020000.shp"
"C:\Users\BaekInchan\Desktop\설계스튜디오9_졸업설계\맵모델링\압구정\N3L_F0010000.shp"
"C:\Users\BaekInchan\Desktop\설계스튜디오9_졸업설계\맵모델링\압구정\N3L_F0030000.shp"
"C:\Users\BaekInchan\Desktop\설계스튜디오9_졸업설계\맵모델링\압구정\N3L_F0040000.shp"
"C:\Users\BaekInchan\Desktop\설계스튜디오9_졸업설계\맵모델링\압구정\N3L_G0030000.shp"
"C:\Users\BaekInchan\Desktop\설계스튜디오9_졸업설계\맵모델링\압구정\N3L_H0010000.shp"
"C:\Users\BaekInchan\Desktop\설계스튜디오9_졸업설계\맵모델링\압구정\N3P_A0131122.shp"
"C:\Users\BaekInchan\Desktop\설계스튜디오9_졸업설계\맵모델링\압구정\N3P_C0210000.shp"
"C:\Users\BaekInchan\Desktop\설계스튜디오9_졸업설계\맵모델링\압구정\N3P_C0380000.shp"
"C:\Users\BaekInchan\Desktop\설계스튜디오9_졸업설계\맵모델링\압구정\N3P_D0030000.shp"
"C:\Users\BaekInchan\Desktop\설계스튜디오9_졸업설계\맵모델링\압구정\N3P_E0042326.shp"
"C:\Users\BaekInchan\Desktop\설계스튜디오9_졸업설계\맵모델링\압구정\N3P_F0020000.shp"
"C:\Users\BaekInchan\Desktop\설계스튜디오9_졸업설계\맵모델링\압구정\N3P_H0020000.shp"
"C:\Users\BaekInchan\Desktop\설계스튜디오9_졸업설계\맵모델링\압구정\N3P_H0040000.shp"
"C:\Users\BaekInchan\Desktop\설계스튜디오9_졸업설계\맵모델링\압구정\N3P_H0059153.shp"
""")  # disabled
panel_26 = Panel(""""C:\Users\BaekInchan\Desktop\설계스튜디오9_졸업설계\맵모델링\강남구청\(B010)수치지도_37705092_2022_00000597055733\N3P_H0040000.shp"
"C:\Users\BaekInchan\Desktop\설계스튜디오9_졸업설계\맵모델링\강남구청\(B010)수치지도_37705092_2022_00000597055733\N3A_A0010000.shp"
"C:\Users\BaekInchan\Desktop\설계스튜디오9_졸업설계\맵모델링\강남구청\(B010)수치지도_37705092_2022_00000597055733\N3A_A0033320.shp"
"C:\Users\BaekInchan\Desktop\설계스튜디오9_졸업설계\맵모델링\강남구청\(B010)수치지도_37705092_2022_00000597055733\N3A_A0053326.shp"
"C:\Users\BaekInchan\Desktop\설계스튜디오9_졸업설계\맵모델링\강남구청\(B010)수치지도_37705092_2022_00000597055733\N3A_A0080000.shp"
"C:\Users\BaekInchan\Desktop\설계스튜디오9_졸업설계\맵모델링\강남구청\(B010)수치지도_37705092_2022_00000597055733\N3A_B0010000.shp"
"C:\Users\BaekInchan\Desktop\설계스튜디오9_졸업설계\맵모델링\강남구청\(B010)수치지도_37705092_2022_00000597055733\N3A_C0186115.shp"
"C:\Users\BaekInchan\Desktop\설계스튜디오9_졸업설계\맵모델링\강남구청\(B010)수치지도_37705092_2022_00000597055733\N3A_C0305316.shp"
"C:\Users\BaekInchan\Desktop\설계스튜디오9_졸업설계\맵모델링\강남구청\(B010)수치지도_37705092_2022_00000597055733\N3A_C0390000.shp"
"C:\Users\BaekInchan\Desktop\설계스튜디오9_졸업설계\맵모델링\강남구청\(B010)수치지도_37705092_2022_00000597055733\N3A_C0423365.shp"
"C:\Users\BaekInchan\Desktop\설계스튜디오9_졸업설계\맵모델링\강남구청\(B010)수치지도_37705092_2022_00000597055733\N3A_C0430000.shp"
"C:\Users\BaekInchan\Desktop\설계스튜디오9_졸업설계\맵모델링\강남구청\(B010)수치지도_37705092_2022_00000597055733\N3A_G0010000.shp"
"C:\Users\BaekInchan\Desktop\설계스튜디오9_졸업설계\맵모델링\강남구청\(B010)수치지도_37705092_2022_00000597055733\N3L_A0010000.shp"
"C:\Users\BaekInchan\Desktop\설계스튜디오9_졸업설계\맵모델링\강남구청\(B010)수치지도_37705092_2022_00000597055733\N3L_A0020000.shp"
"C:\Users\BaekInchan\Desktop\설계스튜디오9_졸업설계\맵모델링\강남구청\(B010)수치지도_37705092_2022_00000597055733\N3L_A0033330.shp"
"C:\Users\BaekInchan\Desktop\설계스튜디오9_졸업설계\맵모델링\강남구청\(B010)수치지도_37705092_2022_00000597055733\N3L_B0020000.shp"
"C:\Users\BaekInchan\Desktop\설계스튜디오9_졸업설계\맵모델링\강남구청\(B010)수치지도_37705092_2022_00000597055733\N3L_C0070000.shp"
"C:\Users\BaekInchan\Desktop\설계스튜디오9_졸업설계\맵모델링\강남구청\(B010)수치지도_37705092_2022_00000597055733\N3L_C0520000.shp"
"C:\Users\BaekInchan\Desktop\설계스튜디오9_졸업설계\맵모델링\강남구청\(B010)수치지도_37705092_2022_00000597055733\N3L_E0020000.shp"
"C:\Users\BaekInchan\Desktop\설계스튜디오9_졸업설계\맵모델링\강남구청\(B010)수치지도_37705092_2022_00000597055733\N3L_F0010000.shp"
"C:\Users\BaekInchan\Desktop\설계스튜디오9_졸업설계\맵모델링\강남구청\(B010)수치지도_37705092_2022_00000597055733\N3L_F0040000.shp"
"C:\Users\BaekInchan\Desktop\설계스튜디오9_졸업설계\맵모델링\강남구청\(B010)수치지도_37705092_2022_00000597055733\N3L_G0030000.shp"
"C:\Users\BaekInchan\Desktop\설계스튜디오9_졸업설계\맵모델링\강남구청\(B010)수치지도_37705092_2022_00000597055733\N3L_H0010000.shp"
"C:\Users\BaekInchan\Desktop\설계스튜디오9_졸업설계\맵모델링\강남구청\(B010)수치지도_37705092_2022_00000597055733\N3P_A0131122.shp"
"C:\Users\BaekInchan\Desktop\설계스튜디오9_졸업설계\맵모델링\강남구청\(B010)수치지도_37705092_2022_00000597055733\N3P_C0285311.shp"
"C:\Users\BaekInchan\Desktop\설계스튜디오9_졸업설계\맵모델링\강남구청\(B010)수치지도_37705092_2022_00000597055733\N3P_C0310000.shp"
"C:\Users\BaekInchan\Desktop\설계스튜디오9_졸업설계\맵모델링\강남구청\(B010)수치지도_37705092_2022_00000597055733\N3P_C0380000.shp"
"C:\Users\BaekInchan\Desktop\설계스튜디오9_졸업설계\맵모델링\강남구청\(B010)수치지도_37705092_2022_00000597055733\N3P_F0020000.shp"
""")  # disabled
panel_27 = Panel(""""C:\Users\BaekInchan\Desktop\설계스튜디오9_졸업설계\맵모델링\신사\N3P_H0059153.shp"
"C:\Users\BaekInchan\Desktop\설계스튜디오9_졸업설계\맵모델링\신사\N3A_A0010000.shp"
"C:\Users\BaekInchan\Desktop\설계스튜디오9_졸업설계\맵모델링\신사\N3A_A0033320.shp"
"C:\Users\BaekInchan\Desktop\설계스튜디오9_졸업설계\맵모델링\신사\N3A_A0053326.shp"
"C:\Users\BaekInchan\Desktop\설계스튜디오9_졸업설계\맵모델링\신사\N3A_A0063321.shp"
"C:\Users\BaekInchan\Desktop\설계스튜디오9_졸업설계\맵모델링\신사\N3A_A0070000.shp"
"C:\Users\BaekInchan\Desktop\설계스튜디오9_졸업설계\맵모델링\신사\N3A_A0080000.shp"
"C:\Users\BaekInchan\Desktop\설계스튜디오9_졸업설계\맵모델링\신사\N3A_A0090000.shp"
"C:\Users\BaekInchan\Desktop\설계스튜디오9_졸업설계\맵모델링\신사\N3A_A0100000.shp"
"C:\Users\BaekInchan\Desktop\설계스튜디오9_졸업설계\맵모델링\신사\N3A_A0110020.shp"
"C:\Users\BaekInchan\Desktop\설계스튜디오9_졸업설계\맵모델링\신사\N3A_A0160024.shp"
"C:\Users\BaekInchan\Desktop\설계스튜디오9_졸업설계\맵모델링\신사\N3A_A0191221.shp"
"C:\Users\BaekInchan\Desktop\설계스튜디오9_졸업설계\맵모델링\신사\N3A_A0201222.shp"
"C:\Users\BaekInchan\Desktop\설계스튜디오9_졸업설계\맵모델링\신사\N3A_B0010000.shp"
"C:\Users\BaekInchan\Desktop\설계스튜디오9_졸업설계\맵모델링\신사\N3A_C0186115.shp"
"C:\Users\BaekInchan\Desktop\설계스튜디오9_졸업설계\맵모델링\신사\N3A_C0390000.shp"
"C:\Users\BaekInchan\Desktop\설계스튜디오9_졸업설계\맵모델링\신사\N3A_C0423365.shp"
"C:\Users\BaekInchan\Desktop\설계스튜디오9_졸업설계\맵모델링\신사\N3A_C0430000.shp"
"C:\Users\BaekInchan\Desktop\설계스튜디오9_졸업설계\맵모델링\신사\N3A_D0010000.shp"
"C:\Users\BaekInchan\Desktop\설계스튜디오9_졸업설계\맵모델링\신사\N3A_E0010001.shp"
"C:\Users\BaekInchan\Desktop\설계스튜디오9_졸업설계\맵모델링\신사\N3A_E0032111.shp"
"C:\Users\BaekInchan\Desktop\설계스튜디오9_졸업설계\맵모델링\신사\N3A_E0052114.shp"
"C:\Users\BaekInchan\Desktop\설계스튜디오9_졸업설계\맵모델링\신사\N3A_G0010000.shp"
"C:\Users\BaekInchan\Desktop\설계스튜디오9_졸업설계\맵모델링\신사\N3A_G0020000.shp"
"C:\Users\BaekInchan\Desktop\설계스튜디오9_졸업설계\맵모델링\신사\N3L_A0010000.shp"
"C:\Users\BaekInchan\Desktop\설계스튜디오9_졸업설계\맵모델링\신사\N3L_A0020000.shp"
"C:\Users\BaekInchan\Desktop\설계스튜디오9_졸업설계\맵모델링\신사\N3L_A0033320.shp"
"C:\Users\BaekInchan\Desktop\설계스튜디오9_졸업설계\맵모델링\신사\N3L_A0123373.shp"
"C:\Users\BaekInchan\Desktop\설계스튜디오9_졸업설계\맵모델링\신사\N3L_A0150000.shp"
"C:\Users\BaekInchan\Desktop\설계스튜디오9_졸업설계\맵모델링\신사\N3L_A0171119.shp"
"C:\Users\BaekInchan\Desktop\설계스튜디오9_졸업설계\맵모델링\신사\N3L_B0020000.shp"
"C:\Users\BaekInchan\Desktop\설계스튜디오9_졸업설계\맵모델링\신사\N3L_C0050000.shp"
"C:\Users\BaekInchan\Desktop\설계스튜디오9_졸업설계\맵모델링\신사\N3L_C0060000.shp"
"C:\Users\BaekInchan\Desktop\설계스튜디오9_졸업설계\맵모델링\신사\N3L_C0520000.shp"
"C:\Users\BaekInchan\Desktop\설계스튜디오9_졸업설계\맵모델링\신사\N3L_E0020000.shp"
"C:\Users\BaekInchan\Desktop\설계스튜디오9_졸업설계\맵모델링\신사\N3L_F0010000.shp"
"C:\Users\BaekInchan\Desktop\설계스튜디오9_졸업설계\맵모델링\신사\N3L_F0030000.shp"
"C:\Users\BaekInchan\Desktop\설계스튜디오9_졸업설계\맵모델링\신사\N3L_F0040000.shp"
"C:\Users\BaekInchan\Desktop\설계스튜디오9_졸업설계\맵모델링\신사\N3L_G0030000.shp"
"C:\Users\BaekInchan\Desktop\설계스튜디오9_졸업설계\맵모델링\신사\N3L_H0010000.shp"
"C:\Users\BaekInchan\Desktop\설계스튜디오9_졸업설계\맵모델링\신사\N3P_A0131122.shp"
"C:\Users\BaekInchan\Desktop\설계스튜디오9_졸업설계\맵모델링\신사\N3P_C0380000.shp"
"C:\Users\BaekInchan\Desktop\설계스튜디오9_졸업설계\맵모델링\신사\N3P_E0042326.shp"
"C:\Users\BaekInchan\Desktop\설계스튜디오9_졸업설계\맵모델링\신사\N3P_F0020000.shp"
"C:\Users\BaekInchan\Desktop\설계스튜디오9_졸업설계\맵모델링\신사\N3P_H0020000.shp"
"C:\Users\BaekInchan\Desktop\설계스튜디오9_졸업설계\맵모델링\신사\N3P_H0040000.shp"
""")  # disabled
panel_28 = Panel(""""C:\Users\BaekInchan\Desktop\설계스튜디오9_졸업설계\맵모델링\논현역\(B010)수치지도_37705091_2022_00000452529185\N3P_H0040000.shp"
"C:\Users\BaekInchan\Desktop\설계스튜디오9_졸업설계\맵모델링\논현역\(B010)수치지도_37705091_2022_00000452529185\N3A_A0010000.shp"
"C:\Users\BaekInchan\Desktop\설계스튜디오9_졸업설계\맵모델링\논현역\(B010)수치지도_37705091_2022_00000452529185\N3A_A0033320.shp"
"C:\Users\BaekInchan\Desktop\설계스튜디오9_졸업설계\맵모델링\논현역\(B010)수치지도_37705091_2022_00000452529185\N3A_A0053326.shp"
"C:\Users\BaekInchan\Desktop\설계스튜디오9_졸업설계\맵모델링\논현역\(B010)수치지도_37705091_2022_00000452529185\N3A_A0063321.shp"
"C:\Users\BaekInchan\Desktop\설계스튜디오9_졸업설계\맵모델링\논현역\(B010)수치지도_37705091_2022_00000452529185\N3A_A0070000.shp"
"C:\Users\BaekInchan\Desktop\설계스튜디오9_졸업설계\맵모델링\논현역\(B010)수치지도_37705091_2022_00000452529185\N3A_A0080000.shp"
"C:\Users\BaekInchan\Desktop\설계스튜디오9_졸업설계\맵모델링\논현역\(B010)수치지도_37705091_2022_00000452529185\N3A_A0090000.shp"
"C:\Users\BaekInchan\Desktop\설계스튜디오9_졸업설계\맵모델링\논현역\(B010)수치지도_37705091_2022_00000452529185\N3A_A0100000.shp"
"C:\Users\BaekInchan\Desktop\설계스튜디오9_졸업설계\맵모델링\논현역\(B010)수치지도_37705091_2022_00000452529185\N3A_A0160024.shp"
"C:\Users\BaekInchan\Desktop\설계스튜디오9_졸업설계\맵모델링\논현역\(B010)수치지도_37705091_2022_00000452529185\N3A_B0010000.shp"
"C:\Users\BaekInchan\Desktop\설계스튜디오9_졸업설계\맵모델링\논현역\(B010)수치지도_37705091_2022_00000452529185\N3A_C0186115.shp"
"C:\Users\BaekInchan\Desktop\설계스튜디오9_졸업설계\맵모델링\논현역\(B010)수치지도_37705091_2022_00000452529185\N3A_C0390000.shp"
"C:\Users\BaekInchan\Desktop\설계스튜디오9_졸업설계\맵모델링\논현역\(B010)수치지도_37705091_2022_00000452529185\N3A_C0423365.shp"
"C:\Users\BaekInchan\Desktop\설계스튜디오9_졸업설계\맵모델링\논현역\(B010)수치지도_37705091_2022_00000452529185\N3A_C0430000.shp"
"C:\Users\BaekInchan\Desktop\설계스튜디오9_졸업설계\맵모델링\논현역\(B010)수치지도_37705091_2022_00000452529185\N3A_D0010000.shp"
"C:\Users\BaekInchan\Desktop\설계스튜디오9_졸업설계\맵모델링\논현역\(B010)수치지도_37705091_2022_00000452529185\N3A_E0010001.shp"
"C:\Users\BaekInchan\Desktop\설계스튜디오9_졸업설계\맵모델링\논현역\(B010)수치지도_37705091_2022_00000452529185\N3A_E0032111.shp"
"C:\Users\BaekInchan\Desktop\설계스튜디오9_졸업설계\맵모델링\논현역\(B010)수치지도_37705091_2022_00000452529185\N3A_E0052114.shp"
"C:\Users\BaekInchan\Desktop\설계스튜디오9_졸업설계\맵모델링\논현역\(B010)수치지도_37705091_2022_00000452529185\N3A_G0010000.shp"
"C:\Users\BaekInchan\Desktop\설계스튜디오9_졸업설계\맵모델링\논현역\(B010)수치지도_37705091_2022_00000452529185\N3A_G0020000.shp"
"C:\Users\BaekInchan\Desktop\설계스튜디오9_졸업설계\맵모델링\논현역\(B010)수치지도_37705091_2022_00000452529185\N3L_A0010000.shp"
"C:\Users\BaekInchan\Desktop\설계스튜디오9_졸업설계\맵모델링\논현역\(B010)수치지도_37705091_2022_00000452529185\N3L_A0020000.shp"
"C:\Users\BaekInchan\Desktop\설계스튜디오9_졸업설계\맵모델링\논현역\(B010)수치지도_37705091_2022_00000452529185\N3L_A0033330.shp"
"C:\Users\BaekInchan\Desktop\설계스튜디오9_졸업설계\맵모델링\논현역\(B010)수치지도_37705091_2022_00000452529185\N3L_A0150000.shp"
"C:\Users\BaekInchan\Desktop\설계스튜디오9_졸업설계\맵모델링\논현역\(B010)수치지도_37705091_2022_00000452529185\N3L_A0171119.shp"
"C:\Users\BaekInchan\Desktop\설계스튜디오9_졸업설계\맵모델링\논현역\(B010)수치지도_37705091_2022_00000452529185\N3L_B0020000.shp"
"C:\Users\BaekInchan\Desktop\설계스튜디오9_졸업설계\맵모델링\논현역\(B010)수치지도_37705091_2022_00000452529185\N3L_C0050000.shp"
"C:\Users\BaekInchan\Desktop\설계스튜디오9_졸업설계\맵모델링\논현역\(B010)수치지도_37705091_2022_00000452529185\N3L_C0060000.shp"
"C:\Users\BaekInchan\Desktop\설계스튜디오9_졸업설계\맵모델링\논현역\(B010)수치지도_37705091_2022_00000452529185\N3L_C0070000.shp"
"C:\Users\BaekInchan\Desktop\설계스튜디오9_졸업설계\맵모델링\논현역\(B010)수치지도_37705091_2022_00000452529185\N3L_C0520000.shp"
"C:\Users\BaekInchan\Desktop\설계스튜디오9_졸업설계\맵모델링\논현역\(B010)수치지도_37705091_2022_00000452529185\N3L_E0020000.shp"
"C:\Users\BaekInchan\Desktop\설계스튜디오9_졸업설계\맵모델링\논현역\(B010)수치지도_37705091_2022_00000452529185\N3L_F0010000.shp"
"C:\Users\BaekInchan\Desktop\설계스튜디오9_졸업설계\맵모델링\논현역\(B010)수치지도_37705091_2022_00000452529185\N3L_F0030000.shp"
"C:\Users\BaekInchan\Desktop\설계스튜디오9_졸업설계\맵모델링\논현역\(B010)수치지도_37705091_2022_00000452529185\N3L_F0040000.shp"
"C:\Users\BaekInchan\Desktop\설계스튜디오9_졸업설계\맵모델링\논현역\(B010)수치지도_37705091_2022_00000452529185\N3L_G0030000.shp"
"C:\Users\BaekInchan\Desktop\설계스튜디오9_졸업설계\맵모델링\논현역\(B010)수치지도_37705091_2022_00000452529185\N3L_H0010000.shp"
"C:\Users\BaekInchan\Desktop\설계스튜디오9_졸업설계\맵모델링\논현역\(B010)수치지도_37705091_2022_00000452529185\N3P_A0131122.shp"
"C:\Users\BaekInchan\Desktop\설계스튜디오9_졸업설계\맵모델링\논현역\(B010)수치지도_37705091_2022_00000452529185\N3P_C0380000.shp"
"C:\Users\BaekInchan\Desktop\설계스튜디오9_졸업설계\맵모델링\논현역\(B010)수치지도_37705091_2022_00000452529185\N3P_D0030000.shp"
"C:\Users\BaekInchan\Desktop\설계스튜디오9_졸업설계\맵모델링\논현역\(B010)수치지도_37705091_2022_00000452529185\N3P_E0042326.shp"
"C:\Users\BaekInchan\Desktop\설계스튜디오9_졸업설계\맵모델링\논현역\(B010)수치지도_37705091_2022_00000452529185\N3P_F0020000.shp"
"C:\Users\BaekInchan\Desktop\설계스튜디오9_졸업설계\맵모델링\논현역\(B010)수치지도_37705091_2022_00000452529185\N3P_H0020000.shp"
""")  # disabled
# 지형
panel_29 = Panel(""""C:\Users\BaekInchan\Desktop\설계스튜디오9_졸업설계\맵모델링\압구정\N3A_A0010000.shp"
"C:\Users\BaekInchan\Desktop\설계스튜디오9_졸업설계\맵모델링\압구정\N3A_A0033320.shp"
"C:\Users\BaekInchan\Desktop\설계스튜디오9_졸업설계\맵모델링\압구정\N3A_A0053326.shp"
"C:\Users\BaekInchan\Desktop\설계스튜디오9_졸업설계\맵모델링\압구정\N3A_A0063321.shp"
"C:\Users\BaekInchan\Desktop\설계스튜디오9_졸업설계\맵모델링\압구정\N3A_A0070000.shp"
"C:\Users\BaekInchan\Desktop\설계스튜디오9_졸업설계\맵모델링\압구정\N3A_A0080000.shp"
"C:\Users\BaekInchan\Desktop\설계스튜디오9_졸업설계\맵모델링\압구정\N3A_A0090000.shp"
"C:\Users\BaekInchan\Desktop\설계스튜디오9_졸업설계\맵모델링\압구정\N3A_A0100000.shp"
"C:\Users\BaekInchan\Desktop\설계스튜디오9_졸업설계\맵모델링\압구정\N3A_A0110020.shp"
"C:\Users\BaekInchan\Desktop\설계스튜디오9_졸업설계\맵모델링\압구정\N3A_A0160024.shp"
"C:\Users\BaekInchan\Desktop\설계스튜디오9_졸업설계\맵모델링\압구정\N3A_A0191221.shp"
"C:\Users\BaekInchan\Desktop\설계스튜디오9_졸업설계\맵모델링\압구정\N3A_A0201222.shp"
"C:\Users\BaekInchan\Desktop\설계스튜디오9_졸업설계\맵모델링\압구정\N3A_B0010000.shp"
"C:\Users\BaekInchan\Desktop\설계스튜디오9_졸업설계\맵모델링\압구정\N3A_C0186115.shp"
"C:\Users\BaekInchan\Desktop\설계스튜디오9_졸업설계\맵모델링\압구정\N3A_C0390000.shp"
"C:\Users\BaekInchan\Desktop\설계스튜디오9_졸업설계\맵모델링\압구정\N3A_C0423365.shp"
"C:\Users\BaekInchan\Desktop\설계스튜디오9_졸업설계\맵모델링\압구정\N3A_C0430000.shp"
"C:\Users\BaekInchan\Desktop\설계스튜디오9_졸업설계\맵모델링\압구정\N3A_D0010000.shp"
"C:\Users\BaekInchan\Desktop\설계스튜디오9_졸업설계\맵모델링\압구정\N3A_E0010001.shp"
"C:\Users\BaekInchan\Desktop\설계스튜디오9_졸업설계\맵모델링\압구정\N3A_E0032111.shp"
"C:\Users\BaekInchan\Desktop\설계스튜디오9_졸업설계\맵모델링\압구정\N3A_E0052114.shp"
"C:\Users\BaekInchan\Desktop\설계스튜디오9_졸업설계\맵모델링\압구정\N3A_G0010000.shp"
"C:\Users\BaekInchan\Desktop\설계스튜디오9_졸업설계\맵모델링\압구정\N3A_G0020000.shp"
"C:\Users\BaekInchan\Desktop\설계스튜디오9_졸업설계\맵모델링\압구정\N3L_A0010000.shp"
"C:\Users\BaekInchan\Desktop\설계스튜디오9_졸업설계\맵모델링\압구정\N3L_A0020000.shp"
"C:\Users\BaekInchan\Desktop\설계스튜디오9_졸업설계\맵모델링\압구정\N3L_A0033330.shp"
"C:\Users\BaekInchan\Desktop\설계스튜디오9_졸업설계\맵모델링\압구정\N3L_A0123373.shp"
"C:\Users\BaekInchan\Desktop\설계스튜디오9_졸업설계\맵모델링\압구정\N3L_A0150000.shp"
"C:\Users\BaekInchan\Desktop\설계스튜디오9_졸업설계\맵모델링\압구정\N3L_A0171119.shp"
"C:\Users\BaekInchan\Desktop\설계스튜디오9_졸업설계\맵모델링\압구정\N3L_B0020000.shp"
"C:\Users\BaekInchan\Desktop\설계스튜디오9_졸업설계\맵모델링\압구정\N3L_C0050000.shp"
"C:\Users\BaekInchan\Desktop\설계스튜디오9_졸업설계\맵모델링\압구정\N3L_C0060000.shp"
"C:\Users\BaekInchan\Desktop\설계스튜디오9_졸업설계\맵모델링\압구정\N3L_C0070000.shp"
"C:\Users\BaekInchan\Desktop\설계스튜디오9_졸업설계\맵모델링\압구정\N3L_C0520000.shp"
"C:\Users\BaekInchan\Desktop\설계스튜디오9_졸업설계\맵모델링\압구정\N3L_E0020000.shp"
"C:\Users\BaekInchan\Desktop\설계스튜디오9_졸업설계\맵모델링\압구정\N3L_F0010000.shp"
"C:\Users\BaekInchan\Desktop\설계스튜디오9_졸업설계\맵모델링\압구정\N3L_F0030000.shp"
"C:\Users\BaekInchan\Desktop\설계스튜디오9_졸업설계\맵모델링\압구정\N3L_F0040000.shp"
"C:\Users\BaekInchan\Desktop\설계스튜디오9_졸업설계\맵모델링\압구정\N3L_G0030000.shp"
"C:\Users\BaekInchan\Desktop\설계스튜디오9_졸업설계\맵모델링\압구정\N3L_H0010000.shp"
"C:\Users\BaekInchan\Desktop\설계스튜디오9_졸업설계\맵모델링\압구정\N3P_A0131122.shp"
"C:\Users\BaekInchan\Desktop\설계스튜디오9_졸업설계\맵모델링\압구정\N3P_C0210000.shp"
"C:\Users\BaekInchan\Desktop\설계스튜디오9_졸업설계\맵모델링\압구정\N3P_C0380000.shp"
"C:\Users\BaekInchan\Desktop\설계스튜디오9_졸업설계\맵모델링\압구정\N3P_D0030000.shp"
"C:\Users\BaekInchan\Desktop\설계스튜디오9_졸업설계\맵모델링\압구정\N3P_E0042326.shp"
"C:\Users\BaekInchan\Desktop\설계스튜디오9_졸업설계\맵모델링\압구정\N3P_F0020000.shp"
"C:\Users\BaekInchan\Desktop\설계스튜디오9_졸업설계\맵모델링\압구정\N3P_H0020000.shp"
"C:\Users\BaekInchan\Desktop\설계스튜디오9_졸업설계\맵모델링\압구정\N3P_H0040000.shp"
"C:\Users\BaekInchan\Desktop\설계스튜디오9_졸업설계\맵모델링\압구정\N3P_H0059153.shp"
""")
panel_30 = Panel(""""C:\Users\BaekInchan\Desktop\설계스튜디오9_졸업설계\맵모델링\강남구청\(B010)수치지도_37705092_2022_00000597055733\N3P_H0040000.shp"
"C:\Users\BaekInchan\Desktop\설계스튜디오9_졸업설계\맵모델링\강남구청\(B010)수치지도_37705092_2022_00000597055733\N3A_A0010000.shp"
"C:\Users\BaekInchan\Desktop\설계스튜디오9_졸업설계\맵모델링\강남구청\(B010)수치지도_37705092_2022_00000597055733\N3A_A0033320.shp"
"C:\Users\BaekInchan\Desktop\설계스튜디오9_졸업설계\맵모델링\강남구청\(B010)수치지도_37705092_2022_00000597055733\N3A_A0053326.shp"
"C:\Users\BaekInchan\Desktop\설계스튜디오9_졸업설계\맵모델링\강남구청\(B010)수치지도_37705092_2022_00000597055733\N3A_A0080000.shp"
"C:\Users\BaekInchan\Desktop\설계스튜디오9_졸업설계\맵모델링\강남구청\(B010)수치지도_37705092_2022_00000597055733\N3A_B0010000.shp"
"C:\Users\BaekInchan\Desktop\설계스튜디오9_졸업설계\맵모델링\강남구청\(B010)수치지도_37705092_2022_00000597055733\N3A_C0186115.shp"
"C:\Users\BaekInchan\Desktop\설계스튜디오9_졸업설계\맵모델링\강남구청\(B010)수치지도_37705092_2022_00000597055733\N3A_C0305316.shp"
"C:\Users\BaekInchan\Desktop\설계스튜디오9_졸업설계\맵모델링\강남구청\(B010)수치지도_37705092_2022_00000597055733\N3A_C0390000.shp"
"C:\Users\BaekInchan\Desktop\설계스튜디오9_졸업설계\맵모델링\강남구청\(B010)수치지도_37705092_2022_00000597055733\N3A_C0423365.shp"
"C:\Users\BaekInchan\Desktop\설계스튜디오9_졸업설계\맵모델링\강남구청\(B010)수치지도_37705092_2022_00000597055733\N3A_C0430000.shp"
"C:\Users\BaekInchan\Desktop\설계스튜디오9_졸업설계\맵모델링\강남구청\(B010)수치지도_37705092_2022_00000597055733\N3A_G0010000.shp"
"C:\Users\BaekInchan\Desktop\설계스튜디오9_졸업설계\맵모델링\강남구청\(B010)수치지도_37705092_2022_00000597055733\N3L_A0010000.shp"
"C:\Users\BaekInchan\Desktop\설계스튜디오9_졸업설계\맵모델링\강남구청\(B010)수치지도_37705092_2022_00000597055733\N3L_A0020000.shp"
"C:\Users\BaekInchan\Desktop\설계스튜디오9_졸업설계\맵모델링\강남구청\(B010)수치지도_37705092_2022_00000597055733\N3L_A0033330.shp"
"C:\Users\BaekInchan\Desktop\설계스튜디오9_졸업설계\맵모델링\강남구청\(B010)수치지도_37705092_2022_00000597055733\N3L_B0020000.shp"
"C:\Users\BaekInchan\Desktop\설계스튜디오9_졸업설계\맵모델링\강남구청\(B010)수치지도_37705092_2022_00000597055733\N3L_C0070000.shp"
"C:\Users\BaekInchan\Desktop\설계스튜디오9_졸업설계\맵모델링\강남구청\(B010)수치지도_37705092_2022_00000597055733\N3L_C0520000.shp"
"C:\Users\BaekInchan\Desktop\설계스튜디오9_졸업설계\맵모델링\강남구청\(B010)수치지도_37705092_2022_00000597055733\N3L_E0020000.shp"
"C:\Users\BaekInchan\Desktop\설계스튜디오9_졸업설계\맵모델링\강남구청\(B010)수치지도_37705092_2022_00000597055733\N3L_F0010000.shp"
"C:\Users\BaekInchan\Desktop\설계스튜디오9_졸업설계\맵모델링\강남구청\(B010)수치지도_37705092_2022_00000597055733\N3L_F0040000.shp"
"C:\Users\BaekInchan\Desktop\설계스튜디오9_졸업설계\맵모델링\강남구청\(B010)수치지도_37705092_2022_00000597055733\N3L_G0030000.shp"
"C:\Users\BaekInchan\Desktop\설계스튜디오9_졸업설계\맵모델링\강남구청\(B010)수치지도_37705092_2022_00000597055733\N3L_H0010000.shp"
"C:\Users\BaekInchan\Desktop\설계스튜디오9_졸업설계\맵모델링\강남구청\(B010)수치지도_37705092_2022_00000597055733\N3P_A0131122.shp"
"C:\Users\BaekInchan\Desktop\설계스튜디오9_졸업설계\맵모델링\강남구청\(B010)수치지도_37705092_2022_00000597055733\N3P_C0285311.shp"
"C:\Users\BaekInchan\Desktop\설계스튜디오9_졸업설계\맵모델링\강남구청\(B010)수치지도_37705092_2022_00000597055733\N3P_C0310000.shp"
"C:\Users\BaekInchan\Desktop\설계스튜디오9_졸업설계\맵모델링\강남구청\(B010)수치지도_37705092_2022_00000597055733\N3P_C0380000.shp"
"C:\Users\BaekInchan\Desktop\설계스튜디오9_졸업설계\맵모델링\강남구청\(B010)수치지도_37705092_2022_00000597055733\N3P_F0020000.shp"
""")
panel_31 = Panel(""""C:\Users\BaekInchan\Desktop\설계스튜디오9_졸업설계\맵모델링\신사\N3P_H0059153.shp"
"C:\Users\BaekInchan\Desktop\설계스튜디오9_졸업설계\맵모델링\신사\N3A_A0010000.shp"
"C:\Users\BaekInchan\Desktop\설계스튜디오9_졸업설계\맵모델링\신사\N3A_A0033320.shp"
"C:\Users\BaekInchan\Desktop\설계스튜디오9_졸업설계\맵모델링\신사\N3A_A0053326.shp"
"C:\Users\BaekInchan\Desktop\설계스튜디오9_졸업설계\맵모델링\신사\N3A_A0063321.shp"
"C:\Users\BaekInchan\Desktop\설계스튜디오9_졸업설계\맵모델링\신사\N3A_A0070000.shp"
"C:\Users\BaekInchan\Desktop\설계스튜디오9_졸업설계\맵모델링\신사\N3A_A0080000.shp"
"C:\Users\BaekInchan\Desktop\설계스튜디오9_졸업설계\맵모델링\신사\N3A_A0090000.shp"
"C:\Users\BaekInchan\Desktop\설계스튜디오9_졸업설계\맵모델링\신사\N3A_A0100000.shp"
"C:\Users\BaekInchan\Desktop\설계스튜디오9_졸업설계\맵모델링\신사\N3A_A0110020.shp"
"C:\Users\BaekInchan\Desktop\설계스튜디오9_졸업설계\맵모델링\신사\N3A_A0160024.shp"
"C:\Users\BaekInchan\Desktop\설계스튜디오9_졸업설계\맵모델링\신사\N3A_A0191221.shp"
"C:\Users\BaekInchan\Desktop\설계스튜디오9_졸업설계\맵모델링\신사\N3A_A0201222.shp"
"C:\Users\BaekInchan\Desktop\설계스튜디오9_졸업설계\맵모델링\신사\N3A_B0010000.shp"
"C:\Users\BaekInchan\Desktop\설계스튜디오9_졸업설계\맵모델링\신사\N3A_C0186115.shp"
"C:\Users\BaekInchan\Desktop\설계스튜디오9_졸업설계\맵모델링\신사\N3A_C0390000.shp"
"C:\Users\BaekInchan\Desktop\설계스튜디오9_졸업설계\맵모델링\신사\N3A_C0423365.shp"
"C:\Users\BaekInchan\Desktop\설계스튜디오9_졸업설계\맵모델링\신사\N3A_C0430000.shp"
"C:\Users\BaekInchan\Desktop\설계스튜디오9_졸업설계\맵모델링\신사\N3A_D0010000.shp"
"C:\Users\BaekInchan\Desktop\설계스튜디오9_졸업설계\맵모델링\신사\N3A_E0010001.shp"
"C:\Users\BaekInchan\Desktop\설계스튜디오9_졸업설계\맵모델링\신사\N3A_E0032111.shp"
"C:\Users\BaekInchan\Desktop\설계스튜디오9_졸업설계\맵모델링\신사\N3A_E0052114.shp"
"C:\Users\BaekInchan\Desktop\설계스튜디오9_졸업설계\맵모델링\신사\N3A_G0010000.shp"
"C:\Users\BaekInchan\Desktop\설계스튜디오9_졸업설계\맵모델링\신사\N3A_G0020000.shp"
"C:\Users\BaekInchan\Desktop\설계스튜디오9_졸업설계\맵모델링\신사\N3L_A0010000.shp"
"C:\Users\BaekInchan\Desktop\설계스튜디오9_졸업설계\맵모델링\신사\N3L_A0020000.shp"
"C:\Users\BaekInchan\Desktop\설계스튜디오9_졸업설계\맵모델링\신사\N3L_A0033320.shp"
"C:\Users\BaekInchan\Desktop\설계스튜디오9_졸업설계\맵모델링\신사\N3L_A0123373.shp"
"C:\Users\BaekInchan\Desktop\설계스튜디오9_졸업설계\맵모델링\신사\N3L_A0150000.shp"
"C:\Users\BaekInchan\Desktop\설계스튜디오9_졸업설계\맵모델링\신사\N3L_A0171119.shp"
"C:\Users\BaekInchan\Desktop\설계스튜디오9_졸업설계\맵모델링\신사\N3L_B0020000.shp"
"C:\Users\BaekInchan\Desktop\설계스튜디오9_졸업설계\맵모델링\신사\N3L_C0050000.shp"
"C:\Users\BaekInchan\Desktop\설계스튜디오9_졸업설계\맵모델링\신사\N3L_C0060000.shp"
"C:\Users\BaekInchan\Desktop\설계스튜디오9_졸업설계\맵모델링\신사\N3L_C0520000.shp"
"C:\Users\BaekInchan\Desktop\설계스튜디오9_졸업설계\맵모델링\신사\N3L_E0020000.shp"
"C:\Users\BaekInchan\Desktop\설계스튜디오9_졸업설계\맵모델링\신사\N3L_F0010000.shp"
"C:\Users\BaekInchan\Desktop\설계스튜디오9_졸업설계\맵모델링\신사\N3L_F0030000.shp"
"C:\Users\BaekInchan\Desktop\설계스튜디오9_졸업설계\맵모델링\신사\N3L_F0040000.shp"
"C:\Users\BaekInchan\Desktop\설계스튜디오9_졸업설계\맵모델링\신사\N3L_G0030000.shp"
"C:\Users\BaekInchan\Desktop\설계스튜디오9_졸업설계\맵모델링\신사\N3L_H0010000.shp"
"C:\Users\BaekInchan\Desktop\설계스튜디오9_졸업설계\맵모델링\신사\N3P_A0131122.shp"
"C:\Users\BaekInchan\Desktop\설계스튜디오9_졸업설계\맵모델링\신사\N3P_C0380000.shp"
"C:\Users\BaekInchan\Desktop\설계스튜디오9_졸업설계\맵모델링\신사\N3P_E0042326.shp"
"C:\Users\BaekInchan\Desktop\설계스튜디오9_졸업설계\맵모델링\신사\N3P_F0020000.shp"
"C:\Users\BaekInchan\Desktop\설계스튜디오9_졸업설계\맵모델링\신사\N3P_H0020000.shp"
"C:\Users\BaekInchan\Desktop\설계스튜디오9_졸업설계\맵모델링\신사\N3P_H0040000.shp"
""")
panel_32 = Panel(""""C:\Users\BaekInchan\Desktop\설계스튜디오9_졸업설계\맵모델링\논현역\(B010)수치지도_37705091_2022_00000452529185\N3P_H0040000.shp"
"C:\Users\BaekInchan\Desktop\설계스튜디오9_졸업설계\맵모델링\논현역\(B010)수치지도_37705091_2022_00000452529185\N3A_A0010000.shp"
"C:\Users\BaekInchan\Desktop\설계스튜디오9_졸업설계\맵모델링\논현역\(B010)수치지도_37705091_2022_00000452529185\N3A_A0033320.shp"
"C:\Users\BaekInchan\Desktop\설계스튜디오9_졸업설계\맵모델링\논현역\(B010)수치지도_37705091_2022_00000452529185\N3A_A0053326.shp"
"C:\Users\BaekInchan\Desktop\설계스튜디오9_졸업설계\맵모델링\논현역\(B010)수치지도_37705091_2022_00000452529185\N3A_A0063321.shp"
"C:\Users\BaekInchan\Desktop\설계스튜디오9_졸업설계\맵모델링\논현역\(B010)수치지도_37705091_2022_00000452529185\N3A_A0070000.shp"
"C:\Users\BaekInchan\Desktop\설계스튜디오9_졸업설계\맵모델링\논현역\(B010)수치지도_37705091_2022_00000452529185\N3A_A0080000.shp"
"C:\Users\BaekInchan\Desktop\설계스튜디오9_졸업설계\맵모델링\논현역\(B010)수치지도_37705091_2022_00000452529185\N3A_A0090000.shp"
"C:\Users\BaekInchan\Desktop\설계스튜디오9_졸업설계\맵모델링\논현역\(B010)수치지도_37705091_2022_00000452529185\N3A_A0100000.shp"
"C:\Users\BaekInchan\Desktop\설계스튜디오9_졸업설계\맵모델링\논현역\(B010)수치지도_37705091_2022_00000452529185\N3A_A0160024.shp"
"C:\Users\BaekInchan\Desktop\설계스튜디오9_졸업설계\맵모델링\논현역\(B010)수치지도_37705091_2022_00000452529185\N3A_B0010000.shp"
"C:\Users\BaekInchan\Desktop\설계스튜디오9_졸업설계\맵모델링\논현역\(B010)수치지도_37705091_2022_00000452529185\N3A_C0186115.shp"
"C:\Users\BaekInchan\Desktop\설계스튜디오9_졸업설계\맵모델링\논현역\(B010)수치지도_37705091_2022_00000452529185\N3A_C0390000.shp"
"C:\Users\BaekInchan\Desktop\설계스튜디오9_졸업설계\맵모델링\논현역\(B010)수치지도_37705091_2022_00000452529185\N3A_C0423365.shp"
"C:\Users\BaekInchan\Desktop\설계스튜디오9_졸업설계\맵모델링\논현역\(B010)수치지도_37705091_2022_00000452529185\N3A_C0430000.shp"
"C:\Users\BaekInchan\Desktop\설계스튜디오9_졸업설계\맵모델링\논현역\(B010)수치지도_37705091_2022_00000452529185\N3A_D0010000.shp"
"C:\Users\BaekInchan\Desktop\설계스튜디오9_졸업설계\맵모델링\논현역\(B010)수치지도_37705091_2022_00000452529185\N3A_E0010001.shp"
"C:\Users\BaekInchan\Desktop\설계스튜디오9_졸업설계\맵모델링\논현역\(B010)수치지도_37705091_2022_00000452529185\N3A_E0032111.shp"
"C:\Users\BaekInchan\Desktop\설계스튜디오9_졸업설계\맵모델링\논현역\(B010)수치지도_37705091_2022_00000452529185\N3A_E0052114.shp"
"C:\Users\BaekInchan\Desktop\설계스튜디오9_졸업설계\맵모델링\논현역\(B010)수치지도_37705091_2022_00000452529185\N3A_G0010000.shp"
"C:\Users\BaekInchan\Desktop\설계스튜디오9_졸업설계\맵모델링\논현역\(B010)수치지도_37705091_2022_00000452529185\N3A_G0020000.shp"
"C:\Users\BaekInchan\Desktop\설계스튜디오9_졸업설계\맵모델링\논현역\(B010)수치지도_37705091_2022_00000452529185\N3L_A0010000.shp"
"C:\Users\BaekInchan\Desktop\설계스튜디오9_졸업설계\맵모델링\논현역\(B010)수치지도_37705091_2022_00000452529185\N3L_A0020000.shp"
"C:\Users\BaekInchan\Desktop\설계스튜디오9_졸업설계\맵모델링\논현역\(B010)수치지도_37705091_2022_00000452529185\N3L_A0033330.shp"
"C:\Users\BaekInchan\Desktop\설계스튜디오9_졸업설계\맵모델링\논현역\(B010)수치지도_37705091_2022_00000452529185\N3L_A0150000.shp"
"C:\Users\BaekInchan\Desktop\설계스튜디오9_졸업설계\맵모델링\논현역\(B010)수치지도_37705091_2022_00000452529185\N3L_A0171119.shp"
"C:\Users\BaekInchan\Desktop\설계스튜디오9_졸업설계\맵모델링\논현역\(B010)수치지도_37705091_2022_00000452529185\N3L_B0020000.shp"
"C:\Users\BaekInchan\Desktop\설계스튜디오9_졸업설계\맵모델링\논현역\(B010)수치지도_37705091_2022_00000452529185\N3L_C0050000.shp"
"C:\Users\BaekInchan\Desktop\설계스튜디오9_졸업설계\맵모델링\논현역\(B010)수치지도_37705091_2022_00000452529185\N3L_C0060000.shp"
"C:\Users\BaekInchan\Desktop\설계스튜디오9_졸업설계\맵모델링\논현역\(B010)수치지도_37705091_2022_00000452529185\N3L_C0070000.shp"
"C:\Users\BaekInchan\Desktop\설계스튜디오9_졸업설계\맵모델링\논현역\(B010)수치지도_37705091_2022_00000452529185\N3L_C0520000.shp"
"C:\Users\BaekInchan\Desktop\설계스튜디오9_졸업설계\맵모델링\논현역\(B010)수치지도_37705091_2022_00000452529185\N3L_E0020000.shp"
"C:\Users\BaekInchan\Desktop\설계스튜디오9_졸업설계\맵모델링\논현역\(B010)수치지도_37705091_2022_00000452529185\N3L_F0010000.shp"
"C:\Users\BaekInchan\Desktop\설계스튜디오9_졸업설계\맵모델링\논현역\(B010)수치지도_37705091_2022_00000452529185\N3L_F0030000.shp"
"C:\Users\BaekInchan\Desktop\설계스튜디오9_졸업설계\맵모델링\논현역\(B010)수치지도_37705091_2022_00000452529185\N3L_F0040000.shp"
"C:\Users\BaekInchan\Desktop\설계스튜디오9_졸업설계\맵모델링\논현역\(B010)수치지도_37705091_2022_00000452529185\N3L_G0030000.shp"
"C:\Users\BaekInchan\Desktop\설계스튜디오9_졸업설계\맵모델링\논현역\(B010)수치지도_37705091_2022_00000452529185\N3L_H0010000.shp"
"C:\Users\BaekInchan\Desktop\설계스튜디오9_졸업설계\맵모델링\논현역\(B010)수치지도_37705091_2022_00000452529185\N3P_A0131122.shp"
"C:\Users\BaekInchan\Desktop\설계스튜디오9_졸업설계\맵모델링\논현역\(B010)수치지도_37705091_2022_00000452529185\N3P_C0380000.shp"
"C:\Users\BaekInchan\Desktop\설계스튜디오9_졸업설계\맵모델링\논현역\(B010)수치지도_37705091_2022_00000452529185\N3P_D0030000.shp"
"C:\Users\BaekInchan\Desktop\설계스튜디오9_졸업설계\맵모델링\논현역\(B010)수치지도_37705091_2022_00000452529185\N3P_E0042326.shp"
"C:\Users\BaekInchan\Desktop\설계스튜디오9_졸업설계\맵모델링\논현역\(B010)수치지도_37705091_2022_00000452529185\N3P_F0020000.shp"
"C:\Users\BaekInchan\Desktop\설계스튜디오9_졸업설계\맵모델링\논현역\(B010)수치지도_37705091_2022_00000452529185\N3P_H0020000.shp"
""")
# 소화전
panel_33 = Panel("A0063321")  # disabled
# 공원
panel_34 = Panel("C0270000")  # disabled
panel_35 = Panel("E002")
# 인도
panel_36 = Panel("A0033320")
# 길
panel_37 = Panel("A0070000")
# 자동차 전용
panel_38 = Panel("A0020000")
panel_39 = Panel("B0010000")  # disabled
toggle = BooleanToggle(True)  # disabled
panel_40 = Panel("N3A_B0010000")  # disabled
toggle_2 = BooleanToggle(True)
toggle_3 = BooleanToggle(True)
toggle_4 = BooleanToggle(True)
toggle_5 = BooleanToggle(True)
python = GhPythonScript(x=panel_36, shapeFile=panel_3)  # -> out, a, ans; inputs shapeFile: list
# ---------- python: Python ----------
__author__ = "BaekInchan"
__version__ = "2024.03.23"

import rhinoscriptsyntax as rs


a = []

for i in shapeFile : 
    if(i[0] == '"') : i = i[1 :]
    if(i[-1] == '"') : i = i[:-1]
    #if(i.split("\\")[-1].split("_")[0][-1] == 'P') : continue; 
    a.append(i)

ans = ""

for i in a : 
    if x in i : 
        ans = i
        break
# ---------- end python ----------
python_2 = GhPythonScript(x=panel_36, shapeFile=panel_7)  # -> out, a, ans; inputs shapeFile: list; same code as python
python_3 = GhPythonScript(x=panel_36, shapeFile=panel_4)  # -> out, a, ans; inputs shapeFile: list; same code as python
python_4 = GhPythonScript(x=panel_36, shapeFile=panel_8)  # -> out, a, ans; inputs shapeFile: list; same code as python
toggle_6 = BooleanToggle(True)  # disabled
toggle_7 = BooleanToggle(True)
toggle_8 = BooleanToggle(True)
toggle_9 = BooleanToggle(True)  # disabled
toggle_10 = BooleanToggle(True)  # disabled
toggle_11 = BooleanToggle(True)  # disabled
toggle_12 = BooleanToggle(True)  # disabled
toggle_13 = BooleanToggle(True)
toggle_14 = BooleanToggle(True)
toggle_15 = BooleanToggle(True)
number_slider = Slider(10, range=0..10)
toggle_16 = BooleanToggle(True)
toggle_17 = BooleanToggle(True)
toggle_18 = BooleanToggle(True)
python_5 = GhPythonScript(x=panel_34, shapeFile=panel_13)  # -> out, a, ans; inputs shapeFile: list; disabled; same code as python
python_6 = GhPythonScript(x=panel_34, shapeFile=panel_14)  # -> out, a, ans; inputs shapeFile: list; disabled; same code as python
python_7 = GhPythonScript(x=panel_34, shapeFile=panel_17)  # -> out, a, ans; inputs shapeFile: list; disabled; same code as python
python_8 = GhPythonScript(x=panel_34, shapeFile=panel_23)  # -> out, a, ans; inputs shapeFile: list; disabled; same code as python
toggle_19 = BooleanToggle(True)  # disabled
toggle_20 = BooleanToggle(True)  # disabled
toggle_21 = BooleanToggle(True)  # disabled
python_9 = GhPythonScript(x="N3A_E0010001", shapeFile=panel_9)  # -> out, a, ans; inputs shapeFile: list; same code as python
python_10 = GhPythonScript(x="N3A_E0010001", shapeFile=panel_12)  # -> out, a, ans; inputs shapeFile: list; same code as python
python_11 = GhPythonScript(x="N3A_E0010001", shapeFile=panel_10)  # -> out, a, ans; inputs shapeFile: list; same code as python
python_12 = GhPythonScript(x="E0010001", shapeFile=panel_11)  # -> out, a, ans; inputs shapeFile: list; same code as python
python_13 = GhPythonScript(x=panel_38, shapeFile=panel)  # -> out, a, ans; inputs shapeFile: list; same code as python
python_14 = GhPythonScript(x=panel_38, shapeFile=panel_5)  # -> out, a, ans; inputs shapeFile: list; same code as python
python_15 = GhPythonScript(x=panel_38, shapeFile=panel_2)  # -> out, a, ans; inputs shapeFile: list; same code as python
python_16 = GhPythonScript(x=panel_38, shapeFile=panel_6)  # -> out, a, ans; inputs shapeFile: list; same code as python
number_slider_2 = Slider(0, range=0..100)  # disabled
number_slider_3 = Slider(0, range=0..100)  # disabled
number_slider_4 = Slider(0, range=0..100)  # disabled
python_17 = GhPythonScript(x=panel_33, shapeFile=panel_15)  # -> out, a, ans; inputs shapeFile: list; disabled; same code as python
python_18 = GhPythonScript(x=panel_33, shapeFile=panel_16)  # -> out, a, ans; inputs shapeFile: list; disabled; same code as python
python_19 = GhPythonScript(x=panel_33, shapeFile=panel_18)  # -> out, a, ans; inputs shapeFile: list; disabled; same code as python
python_20 = GhPythonScript(x=panel_33, shapeFile=panel_24)  # -> out, a, ans; inputs shapeFile: list; disabled; same code as python
number_slider_5 = Slider(0, range=0..100)  # disabled
number_slider_6 = Slider(0, range=0..100)  # disabled
number_slider_7 = Slider(0, range=0..100)  # disabled
python_21 = GhPythonScript(x=panel_40, shapeFile=panel_25)  # -> out, a, ans; inputs shapeFile: list; disabled; same code as python
toggle_22 = BooleanToggle(True)
number_slider_8 = Slider(5, range=0..100)  # disabled
toggle_23 = BooleanToggle(True)
toggle_24 = BooleanToggle(True)
toggle_25 = BooleanToggle(True)
python_22 = GhPythonScript(x="A0010000", shapeFile=panel_19)  # -> out, a, ans; inputs shapeFile: list; same code as python
python_23 = GhPythonScript(x="A0010000", shapeFile=panel_21)  # -> out, a, ans; inputs shapeFile: list; same code as python
python_24 = GhPythonScript(x="A0010000", shapeFile=panel_20)  # -> out, a, ans; inputs shapeFile: list; same code as python
python_25 = GhPythonScript(x="A0010000", shapeFile=panel_22)  # -> out, a, ans; inputs shapeFile: list; same code as python
python_26 = GhPythonScript(x=panel_40, shapeFile=panel_27)  # -> out, a, ans; inputs shapeFile: list; disabled; same code as python
number_slider_9 = Slider(0, range=0..10)  # disabled
number_slider_10 = Slider(0, range=0..10)  # disabled
python_27 = GhPythonScript(x=panel_40, shapeFile=panel_26)  # -> out, a, ans; inputs shapeFile: list; disabled; same code as python
python_28 = GhPythonScript(x=panel_39, shapeFile=panel_28)  # -> out, a, ans; inputs shapeFile: list; disabled; same code as python
imp_it = ImpIt(ShapefileShpPath=python.ans, Project2WGS84=False, TrueOrFalse=toggle_2)  # -> Shapes, Features
imp_it_2 = ImpIt(ShapefileShpPath=python_2.ans, Project2WGS84=False, TrueOrFalse=toggle_3)  # -> Shapes, Features
imp_it_3 = ImpIt(ShapefileShpPath=python_3.ans, Project2WGS84=False, TrueOrFalse=toggle_4)  # -> Shapes, Features
imp_it_4 = ImpIt(ShapefileShpPath=python_4.ans, Project2WGS84=False, TrueOrFalse=toggle_5)  # -> Shapes, Features
number_slider_11 = Slider(5, range=0..10)  # disabled
imp_it_5 = ImpIt(ShapefileShpPath=python_5.ans, Project2WGS84=False, TrueOrFalse=toggle_6)  # -> Shapes, Features; disabled
python_29 = GhPythonScript(x="F0010000", shapeFile=panel_32)  # -> out, a, ans; inputs shapeFile: list; same code as python
imp_it_6 = ImpIt(ShapefileShpPath=python_9.ans, Project2WGS84=False, TrueOrFalse=toggle_7)  # -> Shapes, Features
imp_it_7 = ImpIt(ShapefileShpPath=python_13.ans, Project2WGS84=False, TrueOrFalse=toggle_8)  # -> Shapes, Features
imp_it_8 = ImpIt(ShapefileShpPath=python_17.ans, Project2WGS84=False, TrueOrFalse=toggle_9)  # -> Shapes, Features; disabled
imp_it_9 = ImpIt(ShapefileShpPath=python_6.ans, Project2WGS84=False, TrueOrFalse=toggle_10)  # -> Shapes, Features; disabled
imp_it_10 = ImpIt(ShapefileShpPath=python_7.ans, Project2WGS84=False, TrueOrFalse=toggle_11)  # -> Shapes, Features; disabled
imp_it_11 = ImpIt(ShapefileShpPath=python_8.ans, Project2WGS84=False, TrueOrFalse=toggle_12)  # -> Shapes, Features; disabled
imp_it_12 = ImpIt(ShapefileShpPath=python_10.ans, Project2WGS84=False, TrueOrFalse=toggle_13)  # -> Shapes, Features
imp_it_13 = ImpIt(ShapefileShpPath=python_12.ans, Project2WGS84=False, TrueOrFalse=toggle_15)  # -> Shapes, Features
imp_it_14 = ImpIt(ShapefileShpPath=python_14.ans, Project2WGS84=False, TrueOrFalse=toggle_16)  # -> Shapes, Features
imp_it_15 = ImpIt(ShapefileShpPath=python_15.ans, Project2WGS84=False, TrueOrFalse=toggle_17)  # -> Shapes, Features
imp_it_16 = ImpIt(ShapefileShpPath=python_16.ans, Project2WGS84=False, TrueOrFalse=toggle_18)  # -> Shapes, Features
imp_it_17 = ImpIt(ShapefileShpPath=python_18.ans, Project2WGS84=False, TrueOrFalse=toggle_19)  # -> Shapes, Features; disabled
imp_it_18 = ImpIt(ShapefileShpPath=python_19.ans, Project2WGS84=False, TrueOrFalse=toggle_20)  # -> Shapes, Features; disabled
imp_it_19 = ImpIt(ShapefileShpPath=python_20.ans, Project2WGS84=False, TrueOrFalse=toggle_21)  # -> Shapes, Features; disabled
imp_it_20 = ImpIt(ShapefileShpPath=python_11.ans, Project2WGS84=False, TrueOrFalse=toggle_14)  # -> Shapes, Features
python_30 = GhPythonScript(x="F0010000", shapeFile=panel_29)  # -> out, a, ans; inputs shapeFile: list; same code as python
python_31 = GhPythonScript(x="F0010000", shapeFile=panel_31)  # -> out, a, ans; inputs shapeFile: list; same code as python
python_32 = GhPythonScript(x="F0010000", shapeFile=panel_30)  # -> out, a, ans; inputs shapeFile: list; same code as python
panel_41 = Panel(python_11.ans)
imp_it_21 = ImpIt(ShapefileShpPath=python_21.ans, Project2WGS84=False, TrueOrFalse=toggle)  # -> Shapes, Features; disabled
imp_it_22 = ImpIt(ShapefileShpPath=python_22.ans, Project2WGS84=False, TrueOrFalse=toggle_22)  # -> Shapes, Features
imp_it_23 = ImpIt(ShapefileShpPath=python_26.ans, Project2WGS84=False, TrueOrFalse=toggle)  # -> Shapes, Features; disabled
imp_it_24 = ImpIt(ShapefileShpPath=python_23.ans, Project2WGS84=False, TrueOrFalse=toggle_23)  # -> Shapes, Features
imp_it_25 = ImpIt(ShapefileShpPath=python_24.ans, Project2WGS84=False, TrueOrFalse=toggle_24)  # -> Shapes, Features
imp_it_26 = ImpIt(ShapefileShpPath=python_25.ans, Project2WGS84=False, TrueOrFalse=toggle_25)  # -> Shapes, Features
number_slider_12 = Slider(5, range=0..100)  # disabled
number_slider_13 = Slider(5, range=0..100)  # disabled
toggle_26 = BooleanToggle(True)
toggle_27 = BooleanToggle(True)
toggle_28 = BooleanToggle(True)
toggle_29 = BooleanToggle(True)
item = ListItem(List=imp_it.Features, Index=Slider(0, range=0..10), Wrap=True)
item_2 = ListItem(List=imp_it_2.Features, Index=Slider(0, range=0..100), Wrap=True)
item_3 = ListItem(List=imp_it_3.Features, Index=Slider(0, range=0..100), Wrap=True)
item_4 = ListItem(List=imp_it_4.Features, Index=Slider(0, range=0..100), Wrap=True)
item_5 = ListItem(List=imp_it_5.Features, Index=number_slider_9, Wrap=True)  # disabled
item_6 = ListItem(List=imp_it_9.Features, Index=number_slider_2, Wrap=True)  # disabled
item_7 = ListItem(List=imp_it_10.Features, Index=number_slider_3, Wrap=True)  # disabled
item_8 = ListItem(List=imp_it_11.Features, Index=number_slider_4, Wrap=True)  # disabled
item_9 = ListItem(List=imp_it_6.Features, Index=Slider(5, range=0..10), Wrap=True)
item_10 = ListItem(List=imp_it_7.Features, Index=number_slider, Wrap=True)
item_11 = ListItem(List=imp_it_8.Features, Index=number_slider_10, Wrap=True)  # disabled
item_12 = ListItem(List=imp_it_12.Features, Index=Slider(5, range=0..100), Wrap=True)
item_13 = ListItem(List=imp_it_20.Features, Index=Slider(0, range=0..100), Wrap=True)
item_14 = ListItem(List=imp_it_13.Features, Index=Slider(0, range=0..100), Wrap=True)
item_15 = ListItem(List=imp_it_14.Features, Index=number_slider, Wrap=True)
item_16 = ListItem(List=imp_it_15.Features, Index=number_slider, Wrap=True)
item_17 = ListItem(List=imp_it_16.Features, Index=number_slider, Wrap=True)
item_18 = ListItem(List=imp_it_17.Features, Index=number_slider_5, Wrap=True)  # disabled
item_19 = ListItem(List=imp_it_18.Features, Index=number_slider_6, Wrap=True)  # disabled
item_20 = ListItem(List=imp_it_19.Features, Index=number_slider_7, Wrap=True)  # disabled
panel_42 = Panel(imp_it.Features)
panel_43 = Panel(imp_it_5.Features)  # disabled
item_21 = ListItem(List=imp_it_21.Features, Index=number_slider_11, Wrap=True)  # disabled
item_22 = ListItem(List=imp_it_23.Features, Index=number_slider_8, Wrap=True)  # disabled
item_23 = ListItem(List=imp_it_22.Features, Index=Slider(5, range=0..10), Wrap=True)
panel_44 = Panel(imp_it_7.Features)
panel_45 = Panel(python_17.ans)  # disabled
panel_46 = Panel(imp_it_23.Features)  # disabled
item_24 = ListItem(List=imp_it_24.Features, Index=Slider(5, range=0..100), Wrap=True)
item_25 = ListItem(List=imp_it_25.Features, Index=Slider(5, range=0..100), Wrap=True)
item_26 = ListItem(List=imp_it_26.Features, Index=Slider(5, range=0..100), Wrap=True)
datavis_it = DataVisIt(Shapes=imp_it.Shapes, GetValueofFeature=item, TrueOrFalse=toggle_2)  # -> Polygon, Polyline, Point, AttValues
datavis_it_2 = DataVisIt(Shapes=imp_it_2.Shapes, GetValueofFeature=item_2, TrueOrFalse=toggle_3)  # -> Polygon, Polyline, Point, AttValues
datavis_it_3 = DataVisIt(Shapes=imp_it_3.Shapes, GetValueofFeature=item_3, TrueOrFalse=toggle_4)  # -> Polygon, Polyline, Point, AttValues
datavis_it_4 = DataVisIt(Shapes=imp_it_4.Shapes, GetValueofFeature=item_4, TrueOrFalse=toggle_5)  # -> Polygon, Polyline, Point, AttValues
panel_47 = Panel(python_29.ans)
datavis_it_5 = DataVisIt(Shapes=imp_it_5.Shapes, GetValueofFeature=item_5, TrueOrFalse=toggle_6)  # -> Polygon, Polyline, Point, AttValues; disabled
datavis_it_6 = DataVisIt(Shapes=imp_it_9.Shapes, GetValueofFeature=item_6, TrueOrFalse=toggle_10)  # -> Polygon, Polyline, Point, AttValues; disabled
datavis_it_7 = DataVisIt(Shapes=imp_it_10.Shapes, GetValueofFeature=item_7, TrueOrFalse=toggle_11)  # -> Polygon, Polyline, Point, AttValues; disabled
datavis_it_8 = DataVisIt(Shapes=imp_it_11.Shapes, GetValueofFeature=item_8, TrueOrFalse=toggle_12)  # -> Polygon, Polyline, Point, AttValues; disabled
datavis_it_9 = DataVisIt(Shapes=imp_it_6.Shapes, GetValueofFeature=item_9, TrueOrFalse=toggle_7)  # -> Polygon, Polyline, Point, AttValues
datavis_it_10 = DataVisIt(Shapes=imp_it_12.Shapes, GetValueofFeature=item_12, TrueOrFalse=toggle_13)  # -> Polygon, Polyline, Point, AttValues
datavis_it_11 = DataVisIt(Shapes=imp_it_20.Shapes, GetValueofFeature=item_13, TrueOrFalse=toggle_14)  # -> Polygon, Polyline, Point, AttValues
datavis_it_12 = DataVisIt(Shapes=imp_it_13.Shapes, GetValueofFeature=item_14, TrueOrFalse=toggle_15)  # -> Polygon, Polyline, Point, AttValues
datavis_it_13 = DataVisIt(Shapes=imp_it_7.Shapes, GetValueofFeature=item_10, TrueOrFalse=toggle_8)  # -> Polygon, Polyline, Point, AttValues
datavis_it_14 = DataVisIt(Shapes=imp_it_14.Shapes, GetValueofFeature=item_15, TrueOrFalse=toggle_16)  # -> Polygon, Polyline, Point, AttValues
datavis_it_15 = DataVisIt(Shapes=imp_it_15.Shapes, GetValueofFeature=item_16, TrueOrFalse=toggle_17)  # -> Polygon, Polyline, Point, AttValues
datavis_it_16 = DataVisIt(Shapes=imp_it_16.Shapes, GetValueofFeature=item_17, TrueOrFalse=toggle_18)  # -> Polygon, Polyline, Point, AttValues
datavis_it_17 = DataVisIt(Shapes=imp_it_8.Shapes, GetValueofFeature=item_11, TrueOrFalse=toggle_9)  # -> Polygon, Polyline, Point, AttValues; disabled
datavis_it_18 = DataVisIt(Shapes=imp_it_17.Shapes, GetValueofFeature=item_18, TrueOrFalse=toggle_19)  # -> Polygon, Polyline, Point, AttValues; disabled
datavis_it_19 = DataVisIt(Shapes=imp_it_18.Shapes, GetValueofFeature=item_19, TrueOrFalse=toggle_20)  # -> Polygon, Polyline, Point, AttValues; disabled
datavis_it_20 = DataVisIt(Shapes=imp_it_19.Shapes, GetValueofFeature=item_20, TrueOrFalse=toggle_21)  # -> Polygon, Polyline, Point, AttValues; disabled
panel_48 = Panel(imp_it_6.Features)
imp_it_27 = ImpIt(ShapefileShpPath=python_27.ans, Project2WGS84=False, TrueOrFalse=toggle)  # -> Shapes, Features; disabled
imp_it_28 = ImpIt(ShapefileShpPath=python_28.ans, Project2WGS84=False, TrueOrFalse=toggle)  # -> Shapes, Features; disabled
imp_it_29 = ImpIt(ShapefileShpPath=python_29.ans, Project2WGS84=False, TrueOrFalse=toggle_26)  # -> Shapes, Features
datavis_it_21 = DataVisIt(Shapes=imp_it_21.Shapes, GetValueofFeature=item_21, TrueOrFalse=toggle)  # -> Polygon, Polyline, Point, AttValues; disabled
datavis_it_22 = DataVisIt(Shapes=imp_it_23.Shapes, GetValueofFeature=item_22, TrueOrFalse=toggle)  # -> Polygon, Polyline, Point, AttValues; disabled
panel_49 = Panel(imp_it_22.Features)
datavis_it_23 = DataVisIt(Shapes=imp_it_22.Shapes, GetValueofFeature=item_23, TrueOrFalse=toggle_22)  # -> Polygon, Polyline, Point, AttValues
datavis_it_24 = DataVisIt(Shapes=imp_it_24.Shapes, GetValueofFeature=item_24, TrueOrFalse=toggle_23)  # -> Polygon, Polyline, Point, AttValues
datavis_it_25 = DataVisIt(Shapes=imp_it_25.Shapes, GetValueofFeature=item_25, TrueOrFalse=toggle_24)  # -> Polygon, Polyline, Point, AttValues
datavis_it_26 = DataVisIt(Shapes=imp_it_26.Shapes, GetValueofFeature=item_26, TrueOrFalse=toggle_25)  # -> Polygon, Polyline, Point, AttValues
imp_it_30 = ImpIt(ShapefileShpPath=python_30.ans, Project2WGS84=False, TrueOrFalse=toggle_27)  # -> Shapes, Features
imp_it_31 = ImpIt(ShapefileShpPath=python_31.ans, Project2WGS84=False, TrueOrFalse=toggle_28)  # -> Shapes, Features
imp_it_32 = ImpIt(ShapefileShpPath=python_32.ans, Project2WGS84=False, TrueOrFalse=toggle_29)  # -> Shapes, Features
panel_50 = Panel(datavis_it.AttValues)
panel_51 = Panel(datavis_it_5.AttValues)  # disabled
panel_52 = Panel(datavis_it_13.AttValues)
item_27 = ListItem(List=imp_it_27.Features, Index=number_slider_12, Wrap=True)  # disabled
item_28 = ListItem(List=imp_it_28.Features, Index=number_slider_13, Wrap=True)  # disabled
panel_53 = Panel(datavis_it_17.AttValues)  # disabled
item_29 = ListItem(List=imp_it_29.Features, Index=Slider(1, range=0..100), Wrap=True)
item_30 = ListItem(List=imp_it_30.Features, Index=Slider(1, range=0..10), Wrap=True)
item_31 = ListItem(List=imp_it_31.Features, Index=Slider(1, range=0..100), Wrap=True)
item_32 = ListItem(List=imp_it_32.Features, Index=Slider(1, range=0..100), Wrap=True)
datavis_it_27 = DataVisIt(Shapes=imp_it_27.Shapes, GetValueofFeature=item_27, TrueOrFalse=toggle)  # -> Polygon, Polyline, Point, AttValues; disabled
datavis_it_28 = DataVisIt(Shapes=imp_it_28.Shapes, GetValueofFeature=item_28, TrueOrFalse=toggle)  # -> Polygon, Polyline, Point, AttValues; disabled
crv = Curve(datavis_it.Polygon)
crv_2 = Curve(datavis_it_2.Polygon)
crv_3 = Curve(datavis_it_3.Polygon)
crv_4 = Curve(datavis_it_4.Polygon)
datavis_it_29 = DataVisIt(Shapes=imp_it_29.Shapes, GetValueofFeature=item_29, TrueOrFalse=toggle_26)  # -> Polygon, Polyline, Point, AttValues
crv_5 = Curve(datavis_it_21.Polygon)  # disabled
panel_54 = Panel(datavis_it_23.AttValues)
crv_6 = Curve(datavis_it_23.Polygon)
crv_7 = Curve(datavis_it_24.Polygon)
crv_8 = Curve(datavis_it_25.Polygon)
crv_9 = Curve(datavis_it_26.Polygon)
datavis_it_30 = DataVisIt(Shapes=imp_it_30.Shapes, GetValueofFeature=item_30, TrueOrFalse=toggle_27)  # -> Polygon, Polyline, Point, AttValues
datavis_it_31 = DataVisIt(Shapes=imp_it_31.Shapes, GetValueofFeature=item_31, TrueOrFalse=toggle_28)  # -> Polygon, Polyline, Point, AttValues
datavis_it_32 = DataVisIt(Shapes=imp_it_32.Shapes, GetValueofFeature=item_32, TrueOrFalse=toggle_29)  # -> Polygon, Polyline, Point, AttValues
crv_10 = Curve(datavis_it_15.Polyline)
tmatch = MatchText(Text=datavis_it_15.AttValues, RegEx="일반", Case=True)
crv_11 = Curve(datavis_it_16.Polyline)
tmatch_2 = MatchText(Text=datavis_it_16.AttValues, RegEx="일반", Case=True)
crv_12 = Curve(datavis_it_7.Polygon)  # disabled
crv_13 = Curve(datavis_it_8.Polygon)  # disabled
crv_14 = Curve(datavis_it_19.Polygon)  # disabled
crv_15 = Curve(datavis_it_20.Polygon)  # disabled
crv_16 = Curve(datavis_it_22.Polygon)  # disabled
number_slider_14 = Slider(4, range=0..10)  # disabled
crv_17 = Curve(datavis_it_11.Polygon)
crv_18 = Curve(datavis_it_9.Polygon)
crv_19 = Curve(datavis_it_10.Polygon)
crv_20 = Curve(datavis_it_12.Polygon)
crv_21 = Curve(datavis_it_13.Polyline)
tmatch_3 = MatchText(Text=datavis_it_13.AttValues, RegEx="일반", Case=True)
crv_22 = Curve(datavis_it_14.Polyline)
tmatch_4 = MatchText(Text=datavis_it_14.AttValues, RegEx="일반", Case=True)
crv_23 = Curve(datavis_it_5.Polygon)  # disabled
crv_24 = Curve(datavis_it_6.Polygon)  # disabled
crv_25 = Curve(datavis_it_17.Polygon)  # disabled
crv_26 = Curve(datavis_it_18.Polygon)  # disabled
cull = CullPattern(List=crv_10, CullPattern=invert(tmatch))
cull_2 = CullPattern(List=crv_11, CullPattern=invert(tmatch_2))
panel_55 = Panel(crv_18)
cull_3 = CullPattern(List=crv_21, CullPattern=invert(tmatch_3))
cull_4 = CullPattern(List=crv_22, CullPattern=invert(tmatch_4))
merge = Merge(Data1=crv_6, Data2=crv_7, Data3=crv_8, Data4=crv_9)  # -> flatten(Result)
Z = UnitZ(Factor=datavis_it_29.AttValues)
merge_2 = Merge(Data1=crv, Data2=crv_2, Data3=crv_3, Data4=crv_4)
Z_2 = UnitZ(Factor=datavis_it_30.AttValues)
Z_3 = UnitZ(Factor=datavis_it_31.AttValues)
Z_4 = UnitZ(Factor=datavis_it_32.AttValues)
boundary = BoundarySurfaces(Edges=crv_17)
boundary_2 = BoundarySurfaces(Edges=crv_18)
boundary_3 = BoundarySurfaces(Edges=crv_19)
boundary_4 = BoundarySurfaces(Edges=crv_20)
merge_3 = Merge(Data1=crv_23, Data2=crv_24, Data3=crv_12, Data4=crv_13)  # disabled
merge_4 = Merge(Data1=crv_25, Data2=crv_26, Data3=crv_14, Data4=crv_15)  # disabled
swatch = ColourSwatch(SwatchColor=RGB(173, 38, 38))  # disabled
crv_27 = Curve([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])
crv_28 = Curve([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])
move = Move(Geometry=datavis_it_29.Polyline, Motion=Z)  # -> flatten(Geometry), Transform
crv_29 = Curve(datavis_it_28.Polygon)  # disabled
runion = RegionUnion(Curves=merge)
move_2 = Move(Geometry=datavis_it_30.Polyline, Motion=Z_2)  # -> flatten(Geometry), Transform
move_3 = Move(Geometry=datavis_it_31.Polyline, Motion=Z_3)  # -> flatten(Geometry), Transform
move_4 = Move(Geometry=datavis_it_32.Polyline, Motion=Z_4)  # -> flatten(Geometry), Transform
Z_5 = UnitZ(Factor=datavis_it_21.AttValues)  # disabled
crv_30 = Curve(datavis_it_27.Polygon)  # disabled
panel_56 = Panel(cull)
panel_57 = Panel(cull_2)
Z_6 = UnitZ(Factor=datavis_it_22.AttValues)  # disabled
runion_2 = RegionUnion(Curves=merge_2)
panel_58 = Panel(cull_3)
panel_59 = Panel(cull_4)
runion_3 = RegionUnion(Curves=merge_3)  # disabled
runion_4 = RegionUnion(Curves=crv_27)
runion_5 = RegionUnion(Curves=crv_28)
redpline = Reduce(Polyline=runion, Tolerance=Slider(1, range=0..10))  # -> Polyline, Reduction
boundary_5 = BoundarySurfaces(Edges=crv_5)  # disabled
area = Area(Geometry=crv_5)  # -> Area, Centroid; disabled
srf = Surface(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)
runion_6 = RegionUnion(Curves=merge_4)  # disabled
crv_31 = Curve(move.Geometry)
boundary_6 = BoundarySurfaces(Edges=crv_16)  # disabled
area_2 = Area(Geometry=crv_16)  # -> Area, Centroid; disabled
multiplication = Multiplication(A=Z_6, B=number_slider_14)  # disabled
crv_32 = Curve(move_2.Geometry)
crv_33 = Curve(move_3.Geometry)
crv_34 = Curve(move_4.Geometry)
multiplication_2 = Multiplication(A=Z_5, B=number_slider_14)  # disabled
merge_5 = Merge(Data1=boundary_2, Data2=boundary_3, Data3=boundary_4, Data4=boundary)  # -> flatten(Result)
explode = Explode(Curve=runion_5, Recursive=True)  # -> Segments, Vertices
redpline_2 = Reduce(Polyline=runion_4, Tolerance=1)  # -> Polyline, Reduction
redpline_3 = Reduce(Polyline=runion_5, Tolerance=1)  # -> Polyline, Reduction
number_slider_15 = Slider(0.7, range=0..1)  # disabled
join = JoinCurves(Curves=redpline.Polyline, Preserve=False)
preview = CustomPreview(Geometry=runion_6, Material=swatch)  # disabled
Z_7 = UnitZ(Factor=1)  # disabled
crv_35 = Curve([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])
Z_8 = UnitZ(Factor=1)  # disabled
join_2 = JoinCurves(Curves=redpline_2.Polyline, Preserve=False)
join_3 = JoinCurves(Curves=redpline_3.Polyline, Preserve=False)
merge_6 = Merge(Data1=crv_32, Data2=crv_33, Data3=crv_34, Data4=crv_31)
Z_9 = UnitZ(Factor=datavis_it_28.AttValues)  # disabled
merge_7 = Merge(Data1=cull_3, Data2=cull_4, Data3=cull, Data4=cull_2)
Z_10 = UnitZ(Factor=datavis_it_27.AttValues)  # disabled
runion_7 = RegionUnion(Curves=merge_5)
boundary_7 = BoundarySurfaces(Edges=join_2)
runion_8 = RegionUnion(Curves=crv_35)
crv_36 = Curve(merge_6)
project = ProjectPoint(Point=area.Centroid, Direction=Z_7, Geometry=srf)  # -> Point, Index; disabled
boundary_8 = BoundarySurfaces(Edges=crv_29)  # disabled
area_3 = Area(Geometry=crv_29)  # -> Area, Centroid; disabled
boundary_9 = BoundarySurfaces(Edges=join_3)
project_2 = ProjectPoint(Point=area_2.Centroid, Direction=Z_8, Geometry=srf)  # -> Point, Index; disabled
multiplication_3 = Multiplication(A=Z_9, B=number_slider_14)  # disabled
boundary_10 = BoundarySurfaces(Edges=crv_30)  # disabled
area_4 = Area(Geometry=crv_30)  # -> Area, Centroid; disabled
multiplication_4 = Multiplication(A=Z_10, B=number_slider_14)  # disabled
bbox = BoundingBox(Content=crv_36, Plane=PlaneXY(0, 0, 0), UnionBox=True)  # -> Box, Box_2
redpline_4 = Reduce(Polyline=runion_8, Tolerance=1)  # -> Polyline, Reduction
null = NullItem(Item=project.Point)  # -> NullFlags, InvalidFlags, Description; disabled
null_2 = NullItem(Item=project_2.Point)  # -> NullFlags, InvalidFlags, Description; disabled
Z_11 = UnitZ(Factor=1)  # disabled
Z_12 = UnitZ(Factor=1)  # disabled
divlength = DivideLength(Curve=crv_36, Length=Slider(10, range=0..10))  # -> Points, Tangents, Parameters
debrep = DeconstructBrep(Brep=bbox.Box)  # -> Faces, Edges, Vertices
join_4 = JoinCurves(Curves=redpline_4.Polyline, Preserve=False)
cull_5 = CullPattern(List=boundary_5, CullPattern=invert(null.NullFlags))  # disabled
cull_6 = CullPattern(List=area.Centroid, CullPattern=invert(null.NullFlags))  # disabled
cull_7 = CullPattern(List=project.Point, CullPattern=invert(null.NullFlags))  # disabled
cull_8 = CullPattern(List=multiplication_2, CullPattern=invert(null.NullFlags))  # disabled
cull_9 = CullPattern(List=boundary_6, CullPattern=invert(null_2.NullFlags))  # disabled
cull_10 = CullPattern(List=area_2.Centroid, CullPattern=invert(null_2.NullFlags))  # disabled
cull_11 = CullPattern(List=project_2.Point, CullPattern=invert(null_2.NullFlags))  # disabled
cull_12 = CullPattern(List=multiplication, CullPattern=invert(null_2.NullFlags))  # disabled
project_3 = ProjectPoint(Point=area_3.Centroid, Direction=Z_11, Geometry=srf)  # -> Point, Index; disabled
area_5 = Area(Geometry=debrep.Faces)  # -> Area, Centroid
project_4 = ProjectPoint(Point=area_4.Centroid, Direction=Z_12, Geometry=srf)  # -> Point, Index; disabled
number_slider_16 = Slider(0.99, range=0..1)  # disabled
number_slider_17 = Slider(0.99, range=0..1)  # disabled
pdecon = Deconstruct(Point=area_5.Centroid)  # -> XComponent, YComponent, ZComponent
null_3 = NullItem(Item=project_3.Point)  # -> NullFlags, InvalidFlags, Description; disabled
null_4 = NullItem(Item=project_4.Point)  # -> NullFlags, InvalidFlags, Description; disabled
vec2pt = Vector2Pt(PointA=cull_6, PointB=cull_7, Unitize=False)  # -> Vector, Length; disabled
vec2pt_2 = Vector2Pt(PointA=cull_10, PointB=cull_11, Unitize=False)  # -> Vector, Length; disabled
sort = SortList(Keys=pdecon.ZComponent, ValuesA=debrep.Faces)  # -> Keys, reverse(ValuesA)
cull_13 = CullPattern(List=boundary_8, CullPattern=invert(null_3.NullFlags))  # disabled
cull_14 = CullPattern(List=area_3.Centroid, CullPattern=invert(null_3.NullFlags))  # disabled
cull_15 = CullPattern(List=project_3.Point, CullPattern=invert(null_3.NullFlags))  # disabled
cull_16 = CullPattern(List=multiplication_3, CullPattern=invert(null_3.NullFlags))  # disabled
cull_17 = CullPattern(List=boundary_10, CullPattern=invert(null_4.NullFlags))  # disabled
cull_18 = CullPattern(List=area_4.Centroid, CullPattern=invert(null_4.NullFlags))  # disabled
cull_19 = CullPattern(List=project_4.Point, CullPattern=invert(null_4.NullFlags))  # disabled
cull_20 = CullPattern(List=multiplication_4, CullPattern=invert(null_4.NullFlags))  # disabled
multiplication_5 = Multiplication(A=vec2pt.Vector, B=number_slider_16)  # disabled
multiplication_6 = Multiplication(A=vec2pt_2.Vector, B=number_slider_17)  # disabled
number_slider_18 = Slider(0.99, range=0..1)  # disabled
item_33 = ListItem(List=sort.ValuesA, Index=0, Wrap=True)
item_34 = ListItem(List=sort.ValuesA, Index="-1", Wrap=True)
Z_13 = UnitZ(Factor="-100")
number_slider_19 = Slider(0.99, range=0..1)  # disabled
move_5 = Move(Geometry=cull_5, Motion=multiplication_5)  # -> Geometry, Transform; disabled
disc = Discontinuity(Curve=item_33, Level=1)  # -> Points, Parameters
vec2pt_3 = Vector2Pt(PointA=cull_14, PointB=cull_15, Unitize=False)  # -> Vector, Length; disabled
move_6 = Move(Geometry=cull_9, Motion=multiplication_6)  # -> Geometry, Transform; disabled
vec2pt_4 = Vector2Pt(PointA=cull_18, PointB=cull_19, Unitize=False)  # -> Vector, Length; disabled
cp = ClosestPoint(Point=disc.Points, Cloud=flatten(divlength.Points))  # -> ClosestPoint, CPIndex, Distance
move_7 = Move(Geometry=item_34, Motion=Z_13)  # -> Geometry, Transform
panel_60 = Panel("-10")
neg = Negative(Value=Slider(10, range=0..100))
extr = Extrude(Base=move_5.Geometry, Direction=cull_8)  # disabled
multiplication_7 = Multiplication(A=vec2pt_3.Vector, B=number_slider_18)  # disabled
extr_2 = Extrude(Base=move_6.Geometry, Direction=cull_12)  # disabled
multiplication_8 = Multiplication(A=vec2pt_4.Vector, B=number_slider_19)  # disabled
xy = XYPlane(Origin=cp.ClosestPoint)
offset = OffsetCurve(Curve=move_7.Geometry, Distance=neg, Corners=1)
cap = CapHoles(Brep=extr)  # disabled
move_8 = Move(Geometry=cull_13, Motion=multiplication_7)  # -> Geometry, Transform; disabled
cap_2 = CapHoles(Brep=extr_2)  # disabled
move_9 = Move(Geometry=cull_17, Motion=multiplication_8)  # -> Geometry, Transform; disabled
srf_2 = Surface(offset)
project_5 = Project(Geometry=disc.Points, Plane=xy)  # -> Geometry, Transform
area_6 = Area(Geometry=srf_2)  # -> Area, Centroid
explode_2 = Explode(Curve=srf_2, Recursive=True)  # -> Segments, Vertices
extr_3 = Extrude(Base=move_8.Geometry, Direction=cull_16)  # disabled
extr_4 = Extrude(Base=move_9.Geometry, Direction=cull_20)  # disabled
len = Length(Curve=explode_2.Segments)
del = DelaunayMesh(Points=flatten([divlength.Points, project_5.Geometry]), Plane=PlaneXY(0, 0, 0))
xy_2 = XYPlane(Origin=area_6.Centroid)
cap_3 = CapHoles(Brep=extr_3)  # disabled
cap_4 = CapHoles(Brep=extr_4)  # disabled
cset = CreateSet(List=len)  # -> Set, Map
integer_division = IntegerDivision(A=cset.Set, B=Slider(50, range=0..1000))
item_35 = ListItem(List=integer_division, Index=0, Wrap=True)  # -> Item, Item1
sdivide = DivideSurface(Surface=srf_2, UCount=item_35.Item1, VCount=item_35.Item)  # -> Points, Normals, Parameters
Z_14 = UnitZ(Factor=1)
meshray = MeshRay(Mesh=del, Point=sdivide.Points, Direction=Z_14)  # -> Point, Hit
srfgrid = SurfaceFromPoints(Points=flatten(meshray.Point), UCount=expr("x + 1", item_35.Item1), Interpolate=False)
explode_3 = Explode(Curve=srfgrid, Recursive=True)  # -> Segments, Vertices
project_6 = Project(Geometry=explode_3.Segments, Plane=xy_2)  # -> Geometry, Transform
number_slider_20 = Slider(35000, range=0..100000)
merge_8 = Merge(Data1=graft(explode_3.Segments), Data2=graft(project_6.Geometry))
xy_3 = XYPlane(Origin=Point(0, 0, 0))
number_slider_21 = Slider(90000, range=0..100000)
loft = Loft(Curves=merge_8, Options={Adjust=False, Closed=False, LoftEnds=0, LoftSimp=0, LoftType=0, Rebuild=10, Refit=0.01})
number_slider_22 = Slider(17500, range=0..100000)
Z_15 = UnitZ(Factor="-30000")
cir = Circle(Plane=xy_3, Radius=number_slider_20)
number_slider_23 = Slider(42500, range=0..100000)
join_5 = BrepJoin(Breps=flatten([loft, srf_2, srfgrid]))  # -> Breps, Closed
extr_5 = Extrude(Base=cir, Direction=Z_15)
Z_16 = UnitZ(Factor=Slider(156538, range=0..1000000))
expression = Expression(x=number_slider_20, y=number_slider_23, Expression="63500 + x + y")
dom = ConstructDomain(DomainStart=expr("-x/2", number_slider_22), DomainEnd=expr("x / 2", number_slider_22))
dom_2 = ConstructDomain(DomainStart=expr("-x/2", number_slider_21), DomainEnd=expr("x / 2", number_slider_21))
move_10 = Move(Geometry=xy_3, Motion=Z_16)  # -> Geometry, Transform
polygon = Polygon(Plane=cir, Radius=number_slider_22, Segments="8", FilletRadius=0)  # -> Polygon, Length
expression_2 = Expression(x="8", Expression="2 * pi / x / 2")
rectangle = Rectangle(Plane=move_10.Geometry, XSize=dom, YSize=dom_2, Radius=0)  # -> Rectangle, Length
number_slider_24 = Slider(120000, range=0..1000000)
number_slider_25 = Slider(24000, range=0..100000)
number_slider_26 = Slider(17500, range=0..100000)
rotate = Rotate(Geometry=rectangle.Rectangle, Angle=expression_2, Plane=move_10.Geometry)  # -> Geometry, Transform
division = Division(A=number_slider_23, B=Slider(2, range=0..10))
Z_17 = UnitZ(Factor=expr("-x / sqrt(2)", number_slider_22))
expression_3 = Expression(x=number_slider_20, y=expression_2, Expression="x * Cos(y)")
planar = IsPlanar(Surface=rotate.Geometry, Interior=True)  # -> Planar, Plane
deplane = DeconstructPlane(Plane=planar.Plane)  # -> Origin, XAxis, YAxis, ZAxis
amp = Amplitude(Vector=deplane.YAxis, Amplitude=expression)
extr_6 = Extrude(Base=rotate.Geometry, Direction=expr("-x", Z_17))
dom_3 = ConstructDomain(DomainStart=expr("-x/2", number_slider_22), DomainEnd=expr("x / 2", number_slider_22))
dom_4 = ConstructDomain(DomainStart=expr("-x/2", number_slider_24), DomainEnd=expr("x / 2", number_slider_24))
move_11 = Move(Geometry=planar.Plane, Motion=Z_17)  # -> Geometry, Transform
dom_5 = ConstructDomain(DomainStart=expr("-x/2", expression_3), DomainEnd=expr("x / 2", expression_3))
dom_6 = ConstructDomain(DomainStart=expr("-x/2", number_slider_25), DomainEnd=expr("x / 2", number_slider_25))
move_12 = Move(Geometry=xy_3, Motion=amp)  # -> Geometry, Transform
rectangle_2 = Rectangle(Plane=move_11.Geometry, XSize=dom_3, YSize=dom_5, Radius=0)  # -> Rectangle, Length
move_13 = Move(Geometry=move_12.Geometry, Motion=Z_16)  # -> Geometry, Transform
cir_2 = Circle(Plane=move_12.Geometry, Radius=number_slider_23)
rectangle_3 = Rectangle(Plane=move_13.Geometry, XSize=dom_6, YSize=dom_4, Radius=0)  # -> Rectangle, Length
expression_4 = Expression(x=number_slider_23, y=expression_2, Expression="x * Cos(y)")
xy_4 = XYPlane(Origin=move_12.Geometry)
chamfer = Chamfer(Poly=rectangle_2.Rectangle, Chamfer=Slider(-2000, range=-5000..0))
merge_9 = Merge(Data1=polygon.Polygon, Data2=chamfer, Data3=rotate.Geometry)
rotate_2 = Rotate(Geometry=rectangle_3.Rectangle, Angle=expression_2, Plane=move_13.Geometry)  # -> Geometry, Transform
extr_7 = Extrude(Base=cir_2, Direction=Z_15)
Z_18 = UnitZ(Factor=expr("-x / sqrt(2)", number_slider_22))
planar_2 = IsPlanar(Surface=rotate_2.Geometry, Interior=True)  # -> Planar, Plane
polygon_2 = Polygon(Plane=xy_4, Radius=number_slider_25, Segments="8", FilletRadius=0)  # -> Polygon, Length
loft_2 = Loft(Curves=merge_9, Options={Adjust=True, Closed=False, LoftEnds=0, LoftSimp=0, LoftType=3, Rebuild=10, Refit=0.01})
join_6 = BrepJoin(Breps=[extr_6, loft_2])  # -> Breps, Closed
dom_7 = ConstructDomain(DomainStart=expr("-x/2", division), DomainEnd=expr("x / 2", division))
move_14 = Move(Geometry=planar_2.Plane, Motion=Z_18)  # -> Geometry, Transform
dom_8 = ConstructDomain(DomainStart=expr("-x/2", expression_4), DomainEnd=expr("x / 2", expression_4))
cap_5 = CapHoles(Brep=extr_5)
cap_6 = CapHoles(Brep=join_6.Breps)
rectangle_4 = Rectangle(Plane=move_14.Geometry, XSize=dom_7, YSize=dom_8, Radius=0)  # -> Rectangle, Length
merge_10 = Merge(Data1=cap_5, Data2=cap_6)
extr_8 = Extrude(Base=rotate_2.Geometry, Direction=expr("-x", Z_18))
move_15 = Move(Geometry=merge_10, Motion=expr("2 * x", amp))  # -> Geometry, Transform
chamfer_2 = Chamfer(Poly=rectangle_4.Rectangle, Chamfer=Slider(-2000, range=-5000..0))
merge_11 = Merge(Data1=rotate_2.Geometry, Data2=chamfer_2)  # -> flatten(Result)
merge_12 = Merge(Data1=chamfer_2, Data2=polygon_2.Polygon)  # -> flatten(Result)
loft_3 = Loft(Curves=merge_11, Options={Adjust=True, Closed=False, LoftEnds=0, LoftSimp=2, LoftType=3, Rebuild=10, Refit=0.01})
loft_4 = Loft(Curves=merge_12, Options={Adjust=True, Closed=False, LoftEnds=0, LoftSimp=2, LoftType=3, Rebuild=10, Refit=0.01})
join_7 = BrepJoin(Breps=[extr_8, loft_3, loft_4])  # -> Breps, Closed
cap_7 = CapHoles(Brep=extr_7)
cap_8 = CapHoles(Brep=join_7.Breps)
merge_13 = Merge(Data1=cap_7, Data2=cap_8)
entwine = Entwine(Branch00=merge_10, Branch01=merge_13, Branch02=move_15.Geometry, FlattenInputs=True)
