# Grasshopper definition orient_model_nonuniform.gh (Grasshopper 1.0.7)
# plug-ins: OpenNest, Bifocals, Weaverbird

crv = Curve()
brep = Brep(graft([<brep referenced from the Rhino model> x6]))
mesh = Mesh(graft([<mesh referenced from the Rhino model> x6]))
deconstruct_brep = DeconstructBrep(Brep=brep)  # -> Faces, Edges, Vertices
brep_2 = Brep([<brep referenced from the Rhino model> x6])
area = Area(Geometry=deconstruct_brep.Faces)  # -> Area, Centroid
debrep = DeconstructBrep(Brep=brep_2)  # -> Faces, Edges, Vertices
sort = SortList(Keys=area.Area, ValuesA=deconstruct_brep.Faces)  # -> Keys, ValuesA
pdecon = Deconstruct(Point=debrep.Vertices)  # -> XComponent, YComponent, ZComponent
item = ListItem(List=reverse(sort.ValuesA), Index=0, Wrap=True)
explode = Explode(Recursive=True)  # -> Segments, Vertices
sort_2 = SortList(Keys=pdecon.ZComponent, ValuesA=debrep.Vertices)  # -> Keys, ValuesA
crv_2 = Curve([<curve referenced from the Rhino model> x6])
planar = IsPlanar(Surface=item, Interior=True)  # -> Planar, Plane
partition = PartitionList(List=sort_2.ValuesA, Size=Slider(2, range=0..10))
flip = FlipCurve(Curve=crv_2)  # -> Curve, Flag
avr = Average(Input=partition)
eval = EvaluateCurve()  # -> Point, Tangent, Angle
eval_2 = EvaluateLength(Curve=flip.Curve, Length=Slider(0.7, range=0..1), Normalized=True)  # -> Point, Tangent, Parameter
pack = PackObjects(Geo=flatten(brep), Plane=flatten(planar.Plane), X=Slider(10, range=0..1000), Y=1, Tolerabce=Slider(5, range=0..10))  # -> Geo, Transformation
area_2 = Area(Geometry=brep)  # -> Area, flatten(Centroid)
pshift = ShiftPaths(Data=avr, Offset=-1)
number_slider = Slider(1, range=0..1)
crv_3 = Curve([<curve referenced from the Rhino model> x6])
area_3 = Area(Geometry=pack.Geo)  # -> Area, Centroid
intcrv = Interpolate(Vertices=pshift, Degree=3, Periodic=False, KnotStyle=1)  # -> Curve, Length, Domain
shatter = Shatter(Curve=flip.Curve, Parameters=eval_2.Parameter)
ln = Line(StartPoint=area_3.Centroid, EndPoint=area_2.Centroid)
planar_2 = Planar(Curve=intcrv.Curve)  # -> Planar, Plane, Deviation
item_2 = ListItem(List=shatter, Index=Slider(0, range=0..1), Wrap=True)
pframes = PerpFrames(Curve=intcrv.Curve, Count=10, Align=True)  # -> Frames, Parameters
item_3 = ListItem(List=ln, Index=0, Wrap=True)  # -> Item, Item1, Item2, Item3
item_4 = ListItem(List=shatter, Index=Slider(0, range=0..10), Wrap=True)
flip_2 = FlipCurve(Curve=item_2)  # -> Curve, Flag
offset = OffsetCurve(Curve=intcrv.Curve, Distance=Slider(5, range=0..10), Plane=planar_2.Plane, Corners=1)
shift = ShiftList(List=pframes.Frames, Shift=1, Wrap=invert(True))
pframes_2 = PerpFrames(Curve=flip_2.Curve, Count=10, Align=True)  # -> Frames, Parameters
cull_i = CullIndex(Indices="-1", Wrap=True)
merge = Merge(Data1=simplify(offset), Data2=simplify(intcrv.Curve))
short = ShortestList(ListA=pframes.Frames, ListB=shift, TrimMode=2)  # -> ListA, ListB
shift_2 = ShiftList(List=pframes_2.Frames, Shift=1, Wrap=invert(True))
deplane = DeconstructPlane(Plane=shift)  # -> Origin, XAxis, YAxis, ZAxis
merge_2 = Merge(Data1=graft(short.ListA), Data2=graft(short.ListB))
cull_i_2 = CullIndex(Indices="-1", Wrap=True)
loft = Loft(Curves=merge, Options={Adjust=False, Closed=False, LoftEnds=0, LoftSimp=0, LoftType=0, Rebuild=10, Refit=0.01})
short_2 = ShortestList(ListA=pframes_2.Frames, ListB=shift_2, TrimMode=2)  # -> ListA, ListB
edges = BrepEdges(Brep=loft)  # -> Naked, Interior, NonManifold
pt = Point(merge_2)
pt_2 = Point(pframes.Frames)
deplane_2 = DeconstructPlane(Plane=shift_2)  # -> Origin, XAxis, YAxis, ZAxis
merge_3 = Merge(Data1=graft(short_2.ListA), Data2=graft(short_2.ListB))
avr_2 = Average(Input=pt)
join = JoinCurves(Curves=edges.Naked, Preserve=False)
pt_3 = Point(merge_3)
pt_4 = Point(pframes_2.Frames)
pshift_2 = ShiftPaths(Data=avr_2, Offset=Slider(3, range=-5..5))
offset_2 = OffsetCurve(Curve=join, Distance=Slider(2, range=0..10), Plane=planar_2.Plane, Corners=1)
avr_3 = Average(Input=pt_3)
amp = Amplitude(Vector=deplane.XAxis, Amplitude=Slider(13, range=0..100))
boundary = BoundarySurfaces(Edges=offset_2)
merge_4 = Merge(Data1=simplify(join), Data2=simplify(offset_2))
crv_4 = Curve()
flip_3 = FlipMatrix(Data=pshift_2)
pshift_3 = ShiftPaths(Data=avr_3, Offset=Slider(3, range=-5..5))
rev = Reverse(Vector=amp)
extr = Extrude(Base=boundary)
amp_2 = Amplitude(Vector=deplane_2.XAxis, Amplitude=Slider(13, range=0..100))
loft_2 = Loft(Curves=merge_4, Options={Adjust=False, Closed=False, LoftEnds=0, LoftSimp=0, LoftType=0, Rebuild=10, Refit=0.01})
flip_4 = FlipMatrix(Data=pshift_3)
move = Move(Geometry=flip_3, Motion=rev)  # -> Geometry, Transform
rev_2 = Reverse(Vector=amp_2)
join_2 = BrepJoin(Breps=extr)  # -> Breps, Closed
panel = Panel(loft_2)
mesh_2 = MeshBrep(
    Brep=loft_2,
    Settings={GridMaxCount=0, GridMinCount=16, JaggedSeams=False, MaxEdgeLength=0, MinEdgeLength=0.0001, MinTolerance=0, Refine=True, RefineAngle=0, RelativeTolerance=0.65, SimplePlanes=True, Tolerance=0})
extr_2 = Extrude(Base=loft_2)
merge_5 = Merge(Data1=simplify(pt_2), Data2=simplify(move.Geometry))
move_2 = Move(Geometry=flip_4, Motion=rev_2)  # -> Geometry, Transform
sdiff = SolidDifference(BrepsA=join_2.Breps)
join_3 = BrepJoin(Breps=extr_2)  # -> Breps, Closed
wbthicken = WeaverbirdsMeshThicken(MeshCurves=mesh_2, Distance=Slider(2, range=0..10), OffsetType=0)
intcrv_2 = Interpolate(Vertices=move_2.Geometry, Degree=3, Periodic=False, KnotStyle=1)  # -> Curve, Length, Domain
flip_5 = FlipMatrix(Data=move_2.Geometry)
alongcrv = SortAlongCurve(Points=merge_5, Curve=intcrv.Curve)  # -> Points, Indices
merge_6 = Merge(Data1=simplify(pt_4), Data2=simplify(move_2.Geometry))
number_slider_2 = Slider(1, range=0..1)
intcrv_3 = Interpolate(Vertices=flip_5, Degree=3, Periodic=False, KnotStyle=1)  # -> Curve, Length, Domain
sdiff_2 = SolidDifference(BrepsA=join_3.Breps)
item_5 = ListItem(List=merge_5, Index=alongcrv.Indices, Wrap=True)
pipe = Pipe(Curve=intcrv_2.Curve, Radius=Slider(1, range=0..1), Caps=0)
alongcrv_2 = SortAlongCurve(Points=merge_6, Curve=graft(flip_2.Curve))  # -> Points, Indices
pipe_2 = Pipe(Curve=intcrv_3.Curve, Radius=Slider(0.5, range=0..1), Caps=0)
cap = CapHoles(Brep=pipe)
shift_3 = ShiftList(List=item_5, Shift=1, Wrap=invert(True))
item_6 = ListItem(List=merge_6, Index=alongcrv_2.Indices, Wrap=True)
cap_2 = CapHoles(Brep=pipe_2)
shift_4 = ShiftList(List=item_6, Shift=1, Wrap=invert(True))
short_3 = ShortestList(ListA=item_5, ListB=shift_3, TrimMode=2)  # -> ListA, ListB
merge_7 = Merge(Data1=simplify(graft(short_3.ListA)), Data2=simplify(graft(short_3.ListB)))
pline = PolyLine(Vertices=item_6, Closed=False)
short_4 = ShortestList(ListA=item_6, ListB=shift_4, TrimMode=2)  # -> ListA, ListB
item_7 = ListItem(List=merge_7, Index=0, Wrap=True)  # -> Item, Item1
merge_8 = Merge(Data1=simplify(graft(short_4.ListA)), Data2=simplify(graft(short_4.ListB)))
ln_2 = Line(StartPoint=item_7.Item, EndPoint=item_7.Item1)
item_8 = ListItem(List=merge_8, Index=0, Wrap=True)  # -> Item, Item1
number_slider_3 = Slider(1, range=0..10)
end = EndPoints(Curve=ln_2)  # -> Start, End
line = Line()
number_slider_4 = Slider(1.5, range=0..10)
number_slider_5 = Slider(0.5, range=0..10)
ln_3 = Line(StartPoint=item_8.Item, EndPoint=item_8.Item1)
number_slider_6 = Slider(3, range=0..10)
cir = Circle(Plane=end.Start, Radius=Slider(3, range=0..10))
planar_3 = Planar(Curve=pline)  # -> Planar, Plane, Deviation
end_2 = EndPoints(Curve=ln_3)  # -> Start, End
pshift_4 = ShiftPaths(Data=end_2.Start, Offset=-1)
pshift_5 = ShiftPaths(Data=end_2.End, Offset=-1)
pl_origin = PlaneOrigin(Base=planar_3.Plane, Origin=pshift_5)
neg = Negative(Value=number_slider_3)
pl_origin_2 = PlaneOrigin(Base=planar_3.Plane, Origin=pshift_4)
cir_2 = Circle(Plane=pl_origin_2, Radius=number_slider_4)
cir_3 = Circle(Plane=pl_origin, Radius=number_slider_4)
offset_3 = OffsetCurve(Curve=ln_3, Distance=[number_slider_3, neg], Plane=graft(pl_origin_2), Corners=1)
cir_4 = Circle(Plane=pl_origin_2, Radius=number_slider_5)
cir_5 = Circle(Plane=pl_origin, Radius=number_slider_5)
pshift_6 = ShiftPaths(Data=offset_3, Offset=-1)
loft_3 = Loft(Curves=pshift_6, Options={Adjust=False, Closed=False, LoftEnds=0, LoftSimp=0, LoftType=0, Rebuild=10, Refit=0.01})
merge_9 = Merge(Data1=cir_2, Data2=cir_3)
merge_10 = Merge(Data1=cir_5, Data2=cir_4)
crv_5 = Curve()
deplane_3 = DeconstructPlane(Plane=planar_3.Plane)  # -> Origin, XAxis, YAxis, ZAxis
number_slider_7 = Slider(2, range=0..10)
pshift_7 = ShiftPaths(Data=loft_3, Offset=-1)
boundary_2 = BoundarySurfaces(Edges=merge_9)
merge_11 = Merge(Data1=simplify(pshift_7), Data2=simplify(boundary_2))
amp_3 = Amplitude(Vector=deplane_3.ZAxis, Amplitude=number_slider_7)
Z = UnitZ(Factor=number_slider_7)
amp_4 = Amplitude(Vector=deplane_3.ZAxis, Amplitude=Slider(1, range=0..1))
amp_5 = Amplitude(Vector=deplane_3.ZAxis, Amplitude=Slider(2, range=0..10))
extr_3 = Extrude(Base=merge_11, Direction=amp_4)
neg_2 = Negative(Value=amp_3)
sunion = SolidUnion(Breps=extr_3)
extr_4 = Extrude(Base=merge_10, Direction=amp_3)
neg_3 = Negative(Value=amp_5)
boundary_3 = BoundarySurfaces(Edges=extr_3)
pshift_8 = ShiftPaths(Data=extr_4, Offset=-1)
dispatch = Dispatch(List=extr_3, DispatchPattern=[True, False])  # -> ListA, ListB
move_3 = Move(Geometry=dispatch.ListA, Motion=amp_4)  # -> Geometry, Transform
move_4 = Move(Geometry=dispatch.ListB, Motion=neg_3)  # -> Geometry, Transform
cap_3 = CapHoles(Brep=extr_4)
merge_12 = Merge(Data1=move_3.Geometry, Data2=move_4.Geometry)
sdiff_3 = SolidDifference(BrepsA=sunion, BrepsB=cap_3)
