# Grasshopper definition truss_structure.gh (Grasshopper 1.0.7)

srf = Surface(<surface referenced from the Rhino model>)
edges = BrepEdges(Brep=srf)  # -> Naked, Interior, NonManifold
join = JoinCurves(Curves=edges.Naked, Preserve=False)
Z = UnitZ(Factor=Slider(1500, range=0..10000))
extr = Extrude(Base=join, Direction=Z)
edges_2 = BrepEdges(Brep=extr)  # -> Naked, Interior, NonManifold
item = ListItem(List=edges_2.Naked, Index=Slider(12, range=0..100), Wrap=True)
number_slider = Slider(4000, range=0..10000)
item_2 = ListItem(List=edges_2.Naked, Index=Slider(12, range=0..100), Wrap=True)
divlength = DivideLength(Curve=item, Length=number_slider)  # -> Points, Tangents, Parameters
Z_2 = UnitZ(Factor=number_slider)
cir = Circle(Plane=divlength.Points, Radius=Slider(15, range=0..100))
neg = Negative(Value=Z_2)
pipe = Pipe(Curve=item_2, Radius=Slider(30, range=0..100), Caps=0)
extr_2 = Extrude(Base=cir, Direction=neg)
cap = CapHoles(Brep=pipe)
cap_2 = CapHoles(Brep=extr_2)
