# Grasshopper definition Arch_model.gh (Grasshopper 1.0.7)
# plug-ins: Kangaroo2 Components

number_slider = Slider(100, range=0..100)
xy = XYPlane(Origin=Point(0, 0, 0))

rectangle = Rectangle(Plane=xy, XSize=Slider(4, range=0..10), YSize=Slider(2, range=0..10), Radius=0)  # -> Rectangle, Length

X = UnitX(Factor=1)
number_slider_2 = Slider(100, range=0..100)
cir = Circle(Plane=PlaneXY(0, 0, 0), Radius=number_slider)
subtraction = Subtraction(B=15)
line = LineSDL(Start=xy, Direction=X, Length=Slider(320, range=0..1000))
hframes = HorizontalFrames(Curve=cir, Count=number_slider)  # -> Frames, Parameters
range = Range(Domain=Domain(0, 1), Steps=expr("x - 1", number_slider))
area = Area(Geometry=rectangle.Rectangle)  # -> Area, Centroid
planar = Planar(Curve=rectangle.Rectangle)  # -> Planar, Plane, Deviation
divide = DivideCurve(Curve=line, Count=number_slider_2, Kinks=False)  # -> Points, Tangents, Parameters
range_2 = Range(Domain=Domain(0, 1), Steps=number_slider_2)
deplane = DeconstructPlane(Plane=hframes.Frames)  # -> Origin, XAxis, YAxis, ZAxis
pt = Point(hframes.Frames)
graph = GraphMapper(range, x0=0, x1=1, y0=0, y1=1, container_name="Sine", Equation_px=[0, 0.1243523285], Equation_py=[0, 1])
graph_2 = GraphMapper(range_2, x0=0, x1=1, y0=0, y1=1, Ox=0.5, Oy=1, Px=0.9119170904, Py=0.3171806335, container_name="Parabola")
pl_origin = PlaneOrigin(Base=planar.Plane, Origin=area.Centroid)
fib = Fibonacci(SeedA=0, SeedB=1, Number=10)
dom = ConstructDomain(DomainStart=Slider(-15, range=-100..100), DomainEnd=Slider(15, range=0..100))
dom_2 = ConstructDomain(DomainStart=Slider(0, range=-100..100), DomainEnd=Slider(65, range=0..100))
bnd = Bounds(Numbers=graph)
bnd_2 = Bounds(Numbers=graph_2)
remap = RemapNumbers(Value=graph, Source=bnd, Target=dom)  # -> Mapped, Clipped
remap_2 = RemapNumbers(Value=graph_2, Source=bnd_2, Target=dom_2)  # -> Mapped, Clipped
number_slider_3 = Slider(0.05, range=0..1)
graph_3 = GraphMapper(range, x0=0, x1=1, y0=0, y1=1, container_name="Sine", Equation_px=[0, 0.1243523285], Equation_py=[0, 1])
amp = Amplitude(Vector=deplane.YAxis, Amplitude=remap.Mapped)
Z = UnitZ(Factor=remap_2.Mapped)
dom_3 = ConstructDomain(DomainStart=Slider(30, range=0..100), DomainEnd=Slider(20, range=0..100))
move = Move(Geometry=divide.Points, Motion=Z)  # -> Geometry, Transform
neg = Negative(Value=number_slider_3)
bnd_3 = Bounds(Numbers=graph_3)
move_2 = Move(Geometry=pt, Motion=amp)  # -> Geometry, Transform
addition = Addition(A=neg, B="1")
remap_3 = RemapNumbers(Value=graph_3, Source=bnd_3, Target=dom_3)  # -> Mapped, Clipped
intcrv = Interpolate(Vertices=move.Geometry, Degree=3, Periodic=False, KnotStyle=1)  # -> Curve, Length, Domain
merge = Merge(Data1=number_slider_3, Data2=addition)
end = EndPoints(Curve=intcrv.Curve)  # -> Start, End
Z_2 = UnitZ(Factor=remap_3.Mapped)
ln = Line(StartPoint=end.Start, EndPoint=end.End)
polygon = Polygon(Plane=PlaneXY(0, 0, 0), Radius=Slider(60, range=0..100), Segments=Slider(4, range=0..10), FilletRadius=0)  # -> Polygon, Length
move_3 = Move(Geometry=move_2.Geometry, Motion=Z_2)  # -> Geometry, Transform
rotax = RotateAxis(Geometry=intcrv.Curve, Angle=degrees(Slider(-12, range=-90..90)), Axis=ln)  # -> Geometry, Transform
disc = Discontinuity(Curve=polygon.Polygon, Level=1)  # -> Points, Parameters
intcrv_2 = Interpolate(Vertices=move_2.Geometry, Degree=3, Periodic=invert(False), KnotStyle=1)  # -> Curve, Length, Domain
item = ListItem(List=disc.Points, Index=0, Wrap=True)  # -> Item, Item1, Item2
cir_2 = Circle(Plane=disc.Points, Radius=Slider(15, range=0..100))
eval = EvaluateLength(Curve=reparameterize(rotax.Geometry), Length=merge, Normalized=True)  # -> Point, Tangent, Parameter
pframe = PerpFrame(Curve=reparameterize(rotax.Geometry), Parameter=merge)
merge_2 = Merge(Data1=item.Item, Data2=item.Item2)
merge_3 = Merge(Data1=cir_2, Data2=intcrv_2.Curve)
shatter = Shatter(Curve=reparameterize(rotax.Geometry), Parameters=eval.Parameter)
item_2 = ListItem(List=pframe, Index=0, Wrap=True)
boundary = BoundarySurfaces(Edges=merge_3)
qrsettings = QuadRemeshSettings(
    TargetCount=Slider(8941, range=0..10000),
    AdaptiveSize=0,
    AdaptiveCount=False,
    HardEdges=False,
    SeamEdges=0,
    Symmetry=0,
    GuideCurves=0)
orient = Orient(Geometry=rectangle.Rectangle, Source=pl_origin, Target=item_2)  # -> Geometry, Transform
qrmesh = QuadRemesh(Mesh=boundary, Settings=qrsettings)
item_3 = ListItem(List=shatter, Index="1", Wrap=True)
cull_i = CullIndex(List=shatter, Indices="1", Wrap=True)
panel = Panel("""0
1""")
pframes = PerpFrames(Curve=item_3, Count=Slider(60, range=0..100), Align=True)  # -> Frames, Parameters
clean = CombineClean(Meshes=flatten(qrmesh))
swp1 = Sweep1(Rail=item_3, Sections=orient.Geometry, Miter=1)
pframe_2 = PerpFrame(Curve=reparameterize(graft(cull_i)), Parameter=panel)
polygon_2 = Polygon(Plane=pframes.Frames, Radius=Slider(1.5, range=0..5), Segments=Slider(3, range=0..10), FilletRadius=0)  # -> Polygon, Length
pt_2 = Point(pframe_2)
unim = UnifyMesh(Mesh=clean)  # -> Result, Count
number_slider_4 = Slider(0, range=0..1)
pdecon = Deconstruct(Point=pt_2)  # -> XComponent, YComponent, ZComponent
sort = SortList(Keys=pdecon.ZComponent, ValuesA=pframe_2)  # -> Keys, ValuesA
rotate = Rotate(Geometry=polygon_2.Polygon, Angle="pi / 2", Plane=pframes.Frames)  # -> Geometry, Transform
nv = NakedVertices(Mesh=unim.Result)  # -> ClothedIndex, NakedIndex, ClothedPts, NakedPts
medges = MeshEdges(Mesh=unim.Result)  # -> NakedEdges, InteriorEdges, NonManifoldEdges
item_4 = ListItem(List=sort.ValuesA, Index=number_slider_4, Wrap=True)
pt_3 = Point(item_4)
facen = FaceNormals(Mesh=unim.Result)  # -> Centers, Normals
join = JoinCurves(Curves=medges.NakedEdges, Preserve=False)
avr = Average(Input=flatten(pt_3))
len = Length(Curve=join)
item_5 = ListItem(List=facen.Normals, Index=0, Wrap=True)
sort_2 = SortList(Keys=len, ValuesA=join)  # -> Keys, ValuesA
vec2pt = Vector2Pt(PointA=item_4, PointB=avr, Unitize=False)  # -> Vector, Length
devec = DeconstructVector(Vector=item_5)  # -> XComponent, YComponent, ZComponent
number_slider_5 = Slider(0.015, range=0..0.1)
deplane_2 = DeconstructPlane(Plane=item_4)  # -> Origin, XAxis, YAxis, ZAxis
cull_i_2 = CullIndex(List=sort_2.ValuesA, Indices="-1", Wrap=True)
larger = LargerThan(FirstNumber=devec.ZComponent, SecondNumber=Slider(0, range=0..100))  # -> LargerThan, OrEqualTo
crv_cp = CurveClosestPoint(Point=nv.NakedPts, Curve=graft(cull_i_2))  # -> Point, Parameter, Distance
pl = ConstructPlane(Origin=deplane_2.Origin, XAxis=vec2pt.Vector, YAxis=Vector(0, 1, 0))
int = Integer(crv_cp.Distance)
neg_2 = Negative(Value=number_slider_5)
replace = ReplaceItems(List=sort.ValuesA, Item=pl, Indices=number_slider_4, Wrap=False)

merge_4 = Merge(Data1=Slider(11, range=0..100), Data2=Slider(4, range=0..100))

cull = CullPattern(List=nv.NakedPts, CullPattern=invert(int))  # -> flatten(List)
filter = StreamFilter(Gate=larger.LargerThan, Stream0=neg_2, Stream1=number_slider_5)
index = ItemIndex(List=nv.NakedPts, Item=cull)
anchor = Anchor(Point=cull, Strength=10000)
cull_i_3 = CullIndex(List=nv.NakedPts, Indices=index, Wrap=True)
intcrv_3 = Interpolate(Vertices=move_3.Geometry, Degree=3, Periodic=invert(False), KnotStyle=1)  # -> Curve, Length, Domain
polygon_3 = Polygon(Plane=replace, Radius=merge_4, Segments=6, FilletRadius=0)  # -> Polygon, Length
crv_cp_2 = CurveClosestPoint(Point=cull_i_3, Curve=intcrv_3.Curve)  # -> Point, Parameter, Distance
loft = Loft(
    Curves=polygon_3.Polygon,
    Options={Adjust=False, Closed=False, LoftEnds=0, LoftSimp=0, LoftType=0, Rebuild=10, Refit=0.01})
pressure = Pressure(M=unim.Result, Strength=filter)
anchor_2 = Anchor(Point=cull_i_3, Target=crv_cp_2.Point, Strength=10000)
cap = CapHoles(Brep=swp1)
cap_2 = CapHoles(Brep=loft)
edgelengths = EdgeLengths(Mesh=unim.Result, LengthFactor=Slider(0, range=0..10), Strength=1)
sunion = SolidUnion(Breps=flatten([cap, cap_2]))
show = Show(G=unim.Result)
entwine = Entwine(Branch00=show, Branch01=[edgelengths, anchor_2, anchor, pressure], FlattenInputs=True)
solver = Solver(GoalObjects=entwine, Reset=Button(), Threshold=1e-15, Tolerance=0.0001, On=Toggle(True))  # -> I, V, O
bang = ExplodeTree(Data=solver.O)  # -> Branch0, Branch1
mesh = Mesh(bang.Branch0)
