# Grasshopper definition DongHo_structure.gh (Grasshopper 1.0.7)
# plug-ins: NGon

number_slider = Slider(150000, range=0..1000000)
number_slider_2 = Slider(60000, range=0..100000)
number_slider_3 = Slider(100000, range=0..100000)
number_slider_4 = Slider(35000, range=0..100000)
number_slider_5 = Slider(50000, range=0..100000)
xy = XYPlane(Origin=Point(0, 0, 0))
xy_2 = XYPlane(Origin=Point(0, 0, 0))
number_slider_6 = Slider(90000, range=0..100000)
number_slider_7 = Slider(90000, range=0..100000)
number_slider_8 = Slider(17500, range=0..100000)
number_slider_9 = Slider(26008, range=0..100000)
Z = UnitZ(Factor="-30000")
# typeC p18 - p20
xy_3 = XYPlane(Origin=Point(0, 0, 0))
crv = Curve(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)
# typeA p3 - p6, p14 - p16, p17
Z_2 = UnitZ(Factor="-30000")
dom = ConstructDomain(DomainStart=expr("- x / 2", number_slider_2), DomainEnd=expr("x / 2", number_slider_2))
dom_2 = ConstructDomain(DomainStart=expr("- x / 2", number_slider_3), DomainEnd=expr("x / 2", number_slider_3))
cir = Circle(Plane=xy, Radius=number_slider_4)
cir_2 = Circle(Plane=xy_2, Radius=number_slider_5)
number_slider_10 = Slider(42500, range=0..100000)
number_slider_11 = Slider(60000, range=0..100000)
number_slider_12 = Slider(163000, range=0..1000000)
# typeB p7 - p13
multiplication = Multiplication(A=number_slider, B=Slider(0.8, range=0..1))
divlength = DivideLength(Curve=crv, Length=Slider(80000, range=0..1000000))  # -> Points, Tangents, Parameters
len = Length(Curve=crv)
Z_3 = UnitZ(Factor=1)
crv_2 = Curve(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)
extr = Extrude(Base=cir, Direction=Z_2)
crv_3 = Curve(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)
rectangle = Rectangle(Plane=xy_3, XSize=dom, YSize=dom_2, Radius=Slider(30000, range=0..100000))  # -> Rectangle, Length
deplane = DeconstructPlane(Plane=xy_3)  # -> Origin, XAxis, YAxis, ZAxis
multiplication_2 = Multiplication(A=Slider(80001, range=0..1000000), B=Slider(6, range=0..10))
hframe = HorizontalFrame(Curve=crv, Parameter=divlength.Parameters)
Z_4 = UnitZ(Factor=Slider(150000, range=0..1000000))
Z_5 = UnitZ(Factor=number_slider)
rev = Reverse(Vector=Z_3)
flip = FlipCurve(Curve=crv_3)  # -> Curve, Flag
extr_2 = Extrude(Base=cir_2, Direction=Z)
Z_6 = UnitZ(Factor=multiplication)
srf = Surface(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)
divlength_2 = DivideLength(Curve=crv_2, Length=Slider(40000, range=0..1000000))  # -> Points, Tangents, Parameters
Z_7 = UnitZ(Factor=1)
merge = Merge(Data1=Slider(0, range=0..100), Data2=number_slider_12, Data3=Slider(220000, range=0..1000000), Data4=number_slider_12)
expression = Expression(x=number_slider_4, y=number_slider_10, Expression="63500 + x + y")
divlength_3 = DivideLength(Curve=flip.Curve, Length=multiplication_2)  # -> Points, Tangents, Parameters
dom_3 = ConstructDomain(DomainStart=expr("-x/2", number_slider_8), DomainEnd=expr("x / 2", number_slider_8))
dom_4 = ConstructDomain(DomainStart=expr("-x/2", number_slider_6), DomainEnd=expr("x / 2", number_slider_6))
dom_5 = ConstructDomain(DomainStart=expr("-x/2", number_slider_9), DomainEnd=expr("x / 2", number_slider_9))
dom_6 = ConstructDomain(DomainStart=expr("-x/2", number_slider_7), DomainEnd=expr("x / 2", number_slider_7))
move = Move(Geometry=xy, Motion=Z_4)  # -> Geometry, Transform
polygon = Polygon(Plane=cir, Radius=number_slider_8, Segments="8", FilletRadius=0)  # -> Polygon, Length
polygon_2 = Polygon(Plane=cir_2, Radius=Slider(27500, range=0..100000), Segments="8", FilletRadius=0)  # -> Polygon, Length
project = ProjectPoint(Point=hframe, Direction=rev, Geometry=srf)  # -> Point, Index
move_2 = Move(Geometry=xy_2, Motion=Z_6)  # -> Geometry, Transform
hframe_2 = HorizontalFrame(Curve=crv_2, Parameter=divlength_2.Parameters)
rev_2 = Reverse(Vector=Z_7)
expression_2 = Expression(x="8", Expression="2 * pi / x / 2")
expression_3 = Expression(x="8", Expression="2 * pi / x / 2")
srf_2 = Surface(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)
ma = MassAddition(Input=merge)  # -> Result, PartialResults
expression_4 = Expression(x=number_slider_5, y=number_slider_11, Expression="63500 + x + y")
shatter = Shatter(Curve=flip.Curve, Parameters=divlength_3.Parameters)
null = NullItem(Item=project.Point)  # -> NullFlags, InvalidFlags, Description
project_2 = ProjectPoint(Point=hframe_2, Direction=rev_2, Geometry=srf_2)  # -> Point, Index
rectangle_2 = Rectangle(Plane=move.Geometry, XSize=dom_3, YSize=dom_4, Radius=0)  # -> Rectangle, Length
rectangle_3 = Rectangle(Plane=move_2.Geometry, XSize=dom_5, YSize=dom_6, Radius=0)  # -> Rectangle, Length
amp = Amplitude(Vector=deplane.YAxis, Amplitude=ma.PartialResults)
number_slider_13 = Slider(24000, range=0..100000)
division = Division(A=number_slider_10, B=Slider(2, range=0..10))
number_slider_14 = Slider(17500, range=0..100000)
number_slider_15 = Slider(17500, range=0..100000)
move_3 = Move(Geometry=rectangle.Rectangle, Motion=amp)  # -> Geometry, Transform
number_slider_16 = Slider(120000, range=0..1000000)
Z_8 = UnitZ(Factor="-30000")
null_2 = NullItem(Item=project_2.Point)  # -> NullFlags, InvalidFlags, Description
number_slider_17 = Slider(30694, range=0..100000)
number_slider_18 = Slider(120000, range=0..1000000)
cull = CullPattern(List=hframe, CullPattern=invert(null.NullFlags))  # -> simplify(graft(List))
cull_2 = CullPattern(List=project.Point, CullPattern=invert(null.NullFlags))  # -> simplify(graft(List))
rotate = Rotate(Geometry=rectangle_2.Rectangle, Angle=expression_2, Plane=move.Geometry)  # -> Geometry, Transform
rotate_2 = Rotate(Geometry=rectangle_3.Rectangle, Angle=expression_3, Plane=move_2.Geometry)  # -> Geometry, Transform
number_slider_19 = Slider(30000, range=0..100000)
number_slider_20 = Slider(35000, range=0..100000)
number_slider_21 = Slider(50000, range=0..100000)
Z_9 = UnitZ(Factor=Slider(3000, range=0..10000))
division_2 = Division(A=number_slider_11, B=Slider(2, range=0..10))
Z_10 = UnitZ(Factor=expr("-x / sqrt(2)", number_slider_8))
expression_5 = Expression(x=number_slider_4, y=expression_2, Expression="x * Cos(y)")
extr_3 = Extrude(Base=move_3.Geometry, Direction=Z_8)
area = Area(Geometry=move_3.Geometry)  # -> Area, Centroid
cull_3 = CullPattern(List=hframe_2, CullPattern=invert(null_2.NullFlags))  # -> simplify(graft(List))
cull_4 = CullPattern(List=project_2.Point, CullPattern=invert(null_2.NullFlags))  # -> simplify(graft(List))
planar = IsPlanar(Surface=rotate.Geometry, Interior=True)  # -> Planar, Plane
deplane_2 = DeconstructPlane(Plane=planar.Plane)  # -> Origin, XAxis, YAxis, ZAxis
planar_2 = IsPlanar(Surface=rotate_2.Geometry, Interior=True)  # -> Planar, Plane
deplane_3 = DeconstructPlane(Plane=planar_2.Plane)  # -> Origin, XAxis, YAxis, ZAxis
move_4 = Move(Geometry=cull_2, Motion=Z_9)  # -> Geometry, Transform
cap = CapHoles(Brep=extr_3)
vec2pt = Vector2Pt(PointA=move_4.Geometry, PointB=cull, Unitize=False)  # -> Vector, Length
amp_2 = Amplitude(Vector=deplane_2.YAxis, Amplitude=expression)
amp_3 = Amplitude(Vector=deplane_3.YAxis, Amplitude=expression_4)
extr_4 = Extrude(Base=rotate.Geometry, Direction=expr("-x", Z_10))
dom_7 = ConstructDomain(DomainStart=expr("-x/2", number_slider_8), DomainEnd=expr("x / 2", number_slider_8))
dom_8 = ConstructDomain(DomainStart=expr("-x/2", number_slider_9), DomainEnd=expr("x / 2", number_slider_9))
dom_9 = ConstructDomain(DomainStart=expr("-x/2", number_slider_18), DomainEnd=expr("x / 2", number_slider_18))
dom_10 = ConstructDomain(DomainStart=expr("-x/2", number_slider_16), DomainEnd=expr("x / 2", number_slider_16))
move_5 = Move(Geometry=planar.Plane, Motion=Z_10)  # -> Geometry, Transform
dom_11 = ConstructDomain(DomainStart=expr("-x/2", expression_5), DomainEnd=expr("x / 2", expression_5))
dom_12 = ConstructDomain(DomainStart=expr("-x/2", number_slider_17), DomainEnd=expr("x / 2", number_slider_17))
vec2pt_2 = Vector2Pt(PointA=cull_4, PointB=cull_3, Unitize=False)  # -> Vector, Length
dom_13 = ConstructDomain(DomainStart=expr("- x / 2", number_slider_20), DomainEnd=expr("x / 2", number_slider_20))
dom_14 = ConstructDomain(DomainStart=expr("- x / 2", number_slider_21), DomainEnd=expr("x / 2", number_slider_21))
dom_15 = ConstructDomain(DomainStart=expr("-x/2", number_slider_13), DomainEnd=expr("x / 2", number_slider_13))
dom_16 = ConstructDomain(DomainStart=expr("-x/2", number_slider_19), DomainEnd=expr("x / 2", number_slider_19))
number_slider_22 = Slider(0.8, range=0..1)
move_6 = Move(Geometry=xy, Motion=amp_2)  # -> Geometry, Transform
move_7 = Move(Geometry=xy_2, Motion=amp_3)  # -> Geometry, Transform
vlen = VectorLength(Vector=vec2pt_2.Vector)
number_slider_23 = Slider(150000, range=0..1000000)
number_slider_24 = Slider(0.8, range=0..1)
vlen_2 = VectorLength(Vector=vec2pt.Vector)
number_slider_25 = Slider(1, range=0..10)
crv_4 = Curve(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)
crv_5 = Curve(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)
Z_11 = UnitZ(Factor=expr("-x / sqrt(2)", "17500"))
extr_5 = Extrude(Base=rotate_2.Geometry, Direction=expr("-x", Z_11))
move_8 = Move(Geometry=planar_2.Plane, Motion=Z_11)  # -> Geometry, Transform
rectangle_4 = Rectangle(Plane=move_5.Geometry, XSize=dom_7, YSize=dom_11, Radius=0)  # -> Rectangle, Length
move_9 = Move(Geometry=move_6.Geometry, Motion=Z_4)  # -> Geometry, Transform
rectangle_5 = Rectangle(Plane=move_8.Geometry, XSize=dom_8, YSize=dom_12, Radius=0)  # -> Rectangle, Length
move_10 = Move(Geometry=move_7.Geometry, Motion=Z_5)  # -> Geometry, Transform
rectangle_6 = Rectangle(Plane=move_10.Geometry, XSize=dom_16, YSize=dom_9, Radius=0)  # -> Rectangle, Length
cir_3 = Circle(Plane=move_6.Geometry, Radius=number_slider_10)
rectangle_7 = Rectangle(Plane=move_9.Geometry, XSize=dom_15, YSize=dom_10, Radius=0)  # -> Rectangle, Length
cir_4 = Circle(Plane=move_7.Geometry, Radius=number_slider_11)
rectangle_8 = Rectangle(Plane=area.Centroid, XSize=dom_13, YSize=dom_14, Radius=0)  # -> Rectangle, Length
divlength_4 = DivideLength(Curve=crv_4, Length=Slider(40000, range=0..1000000))  # -> Points, Tangents, Parameters
divlength_5 = DivideLength(Curve=crv_5, Length=Slider(40000, range=0..1000000))  # -> Points, Tangents, Parameters
number_slider_26 = Slider(34826, range=0..100000)
Z_12 = UnitZ(Factor=1)
Z_13 = UnitZ(Factor=1)
number_slider_27 = Slider(15000, range=0..1000000)
expression_6 = Expression(x=number_slider_10, y=expression_2, Expression="x * Cos(y)")
expression_7 = Expression(x=number_slider_22, Expression="1 - x")
crv_6 = Curve(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)
xy_4 = XYPlane(Origin=move_6.Geometry)
xy_5 = XYPlane(Origin=move_7.Geometry)
panel = Panel(vlen)
chamfer = Chamfer(Poly=rectangle_4.Rectangle, Chamfer=Slider(-2000, range=-5000..0))
merge_2 = Merge(Data1=polygon.Polygon, Data2=chamfer, Data3=rotate.Geometry)
chamfer_2 = Chamfer(Poly=rectangle_5.Rectangle, Chamfer=Slider(-2000, range=-5000..0))
merge_3 = Merge(Data1=polygon_2.Polygon, Data2=chamfer_2, Data3=rotate_2.Geometry)
rotate_3 = Rotate(Geometry=rectangle_7.Rectangle, Angle=expression_2, Plane=move_9.Geometry)  # -> Geometry, Transform
rotate_4 = Rotate(Geometry=rectangle_6.Rectangle, Angle=expression_3, Plane=move_10.Geometry)  # -> Geometry, Transform
extr_6 = Extrude(Base=cir_3, Direction=Z_2)
extr_7 = Extrude(Base=cir_4, Direction=Z)
hframe_3 = HorizontalFrame(Curve=crv_4, Parameter=divlength_4.Parameters)
hframe_4 = HorizontalFrame(Curve=crv_5, Parameter=divlength_5.Parameters)
rev_3 = Reverse(Vector=Z_12)
rev_4 = Reverse(Vector=Z_13)
multiplication_3 = Multiplication(A=number_slider_22, B=number_slider_23)
number_slider_28 = Slider(5000, range=0..100000)
srf_3 = Surface(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)
srf_4 = Surface(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)
Z_14 = UnitZ(Factor=expr("-x / sqrt(2)", "17500"))
Z_15 = UnitZ(Factor=expr("-x / sqrt(2)", number_slider_8))
xy_6 = XYPlane(Origin=move_4.Geometry)
divlength_6 = DivideLength(Curve=crv_6, Length=Slider(40000, range=0..1000000))  # -> Points, Tangents, Parameters
planar_3 = IsPlanar(Surface=rotate_3.Geometry, Interior=True)  # -> Planar, Plane
planar_4 = IsPlanar(Surface=rotate_4.Geometry, Interior=True)  # -> Planar, Plane
Z_16 = UnitZ(Factor=1)
dom_17 = ConstructDomain(DomainStart=expr("-x/2", division), DomainEnd=expr("x / 2", division))
multiplication_4 = Multiplication(A=expression_7, B=number_slider_23)
polygon_3 = Polygon(Plane=xy_4, Radius=number_slider_13, Segments="8", FilletRadius=0)  # -> Polygon, Length
polygon_4 = Polygon(Plane=xy_5, Radius=number_slider_19, Segments="8", FilletRadius=0)  # -> Polygon, Length
Z_17 = UnitZ(Factor=multiplication_3)
loft = Loft(Curves=merge_2, Options={Adjust=True, Closed=False, LoftEnds=0, LoftSimp=0, LoftType=3, Rebuild=10, Refit=0.01})
loft_2 = Loft(Curves=merge_3, Options={Adjust=True, Closed=False, LoftEnds=0, LoftSimp=0, LoftType=3, Rebuild=10, Refit=0.01})
project_3 = ProjectPoint(Point=hframe_3, Direction=rev_3, Geometry=srf_3)  # -> Point, Index
project_4 = ProjectPoint(Point=hframe_4, Direction=rev_4, Geometry=srf_4)  # -> Point, Index
number_slider_29 = Slider(9000, range=0..100000)
item = ListItem(List=flatten(vlen), Index=number_slider_25, Wrap=True)
number_slider_30 = Slider(2600, range=0..100000)
hframe_5 = HorizontalFrame(Curve=crv_6, Parameter=divlength_6.Parameters)
join = BrepJoin(Breps=[extr_4, loft])  # -> Breps, Closed
join_2 = BrepJoin(Breps=[extr_5, loft_2])  # -> Breps, Closed
dom_18 = ConstructDomain(DomainStart=expr("-x/2", division_2), DomainEnd=expr("x / 2", division_2))
rev_5 = Reverse(Vector=Z_16)
Z_18 = UnitZ(Factor="-10000")
move_11 = Move(Geometry=planar_3.Plane, Motion=Z_15)  # -> Geometry, Transform
move_12 = Move(Geometry=planar_4.Plane, Motion=Z_14)  # -> Geometry, Transform
srf_5 = Surface(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)
dom_19 = ConstructDomain(DomainStart=expr("-x/2", expression_6), DomainEnd=expr("x / 2", expression_6))
dom_20 = ConstructDomain(DomainStart=expr("-x/2", number_slider_26), DomainEnd=expr("x / 2", number_slider_26))
Z_19 = UnitZ(Factor=multiplication_4)
move_13 = Move(Geometry=rectangle_8.Rectangle, Motion=Z_17)  # -> Geometry, Transform
chamfer_3 = Chamfer(Poly=rectangle_8.Rectangle, Chamfer=Slider(-6000, range=-6000..0))  # -> graft(Curves)
number_slider_31 = Slider(10000, range=0..100000)
number_slider_32 = Slider(6000, range=0..100000)
null_3 = NullItem(Item=project_3.Point)  # -> NullFlags, InvalidFlags, Description
null_4 = NullItem(Item=project_4.Point)  # -> NullFlags, InvalidFlags, Description
cir_5 = Circle(Plane=xy_6, Radius=number_slider_28)
item_2 = ListItem(List=flatten(vlen), Index=number_slider_25, Wrap=True)
number_slider_33 = Slider(6000, range=0..100000)
item_3 = ListItem(List=flatten(cull_4), Index=number_slider_25, Wrap=True)
cap_2 = CapHoles(Brep=extr)
cap_3 = CapHoles(Brep=join.Breps)
cap_4 = CapHoles(Brep=extr_2)
cap_5 = CapHoles(Brep=join_2.Breps)
# typeB p7 - p13
multiplication_5 = Multiplication(A=vlen_2, B=Slider(0.8, range=0..1))
project_5 = ProjectPoint(Point=hframe_5, Direction=rev_5, Geometry=srf_5)  # -> Point, Index
disc = Discontinuity(Curve=chamfer_3, Level=1)  # -> Points, Parameters
cull_5 = CullPattern(List=hframe_3, CullPattern=invert(null_3.NullFlags))  # -> graft(List)
cull_6 = CullPattern(List=project_3.Point, CullPattern=invert(null_3.NullFlags))  # -> graft(List)
cull_7 = CullPattern(List=hframe_4, CullPattern=invert(null_4.NullFlags))  # -> graft(List)
cull_8 = CullPattern(List=project_4.Point, CullPattern=invert(null_4.NullFlags))  # -> graft(List)
disc_2 = Discontinuity(Curve=move_13.Geometry, Level=1)  # -> Points, Parameters
Z_20 = UnitZ(Factor=expr("x / sqrt(2)", Slider(17500, range=0..100000)))
panel_2 = Panel(item_2)
rectangle_9 = Rectangle(Plane=move_11.Geometry, XSize=dom_17, YSize=dom_19, Radius=0)  # -> Rectangle, Length
rectangle_10 = Rectangle(Plane=move_12.Geometry, XSize=dom_18, YSize=dom_20, Radius=0)  # -> Rectangle, Length
panel_3 = Panel(item_3)
Z_21 = UnitZ(Factor=Slider(3000, range=0..10000))
Z_22 = UnitZ(Factor=Slider(3000, range=0..10000))
null_5 = NullItem(Item=project_5.Point)  # -> NullFlags, InvalidFlags, Description
merge_4 = Merge(Data1=cap_2, Data2=cap_3)
merge_5 = Merge(Data1=cap_4, Data2=cap_5)
Z_23 = UnitZ(Factor=vlen_2)
merge_6 = Merge(Data1=graft(move_13.Geometry), Data2=chamfer_3)
cps = ClosestPoints(Point=disc_2.Points, Cloud=disc.Points, Count="2")  # -> ClosestPoint, CPIndex, Distance
extr_8 = Extrude(Base=cir_5, Direction=Z_18)
Z_24 = UnitZ(Factor=multiplication_5)
extr_9 = Extrude(Base=rotate_3.Geometry, Direction=expr("-x", Z_15))
extr_10 = Extrude(Base=rotate_4.Geometry, Direction=expr("-x", Z_14))
# typeC p18 - p20
xy_7 = XYPlane(Origin=item_3)
dom_21 = ConstructDomain(DomainStart=expr("- x / 2", number_slider_32), DomainEnd=expr("x / 2", number_slider_32))
dom_22 = ConstructDomain(DomainStart=expr("- x / 2", number_slider_31), DomainEnd=expr("x / 2", number_slider_31))
avr = Average(Input=disc_2.Points)
brep = Brep([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])
brep_2 = Brep([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])
number_slider_34 = Slider(16300, range=0..1000000)
cull_9 = CullPattern(List=hframe_5, CullPattern=invert(null_5.NullFlags))  # -> graft(List)
move_14 = Move(Geometry=graft(move_13.Geometry), Motion=Z_20)  # -> Geometry, Transform
dom_23 = ConstructDomain(DomainStart=expr("-x/2", number_slider_30), DomainEnd=expr("x / 2", number_slider_30))
dom_24 = ConstructDomain(DomainStart=expr("-x/2", number_slider_29), DomainEnd=expr("x / 2", number_slider_29))
polygon_5 = Polygon(Plane=cir_5, Radius=Slider(2500, range=0..100000), Segments="8", FilletRadius=0)  # -> Polygon, Length
move_15 = Move(Geometry=cull_6, Motion=Z_21)  # -> Geometry, Transform
vec2pt_3 = Vector2Pt(PointA=move_15.Geometry, PointB=cull_5, Unitize=False)  # -> Vector, Length
move_16 = Move(Geometry=cull_8, Motion=Z_22)  # -> Geometry, Transform
vec2pt_4 = Vector2Pt(PointA=move_16.Geometry, PointB=cull_7, Unitize=False)  # -> Vector, Length
brep_3 = Brep([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])
ln = Line(StartPoint=graft(disc_2.Points), EndPoint=cps.ClosestPoint)
move_17 = Move(Geometry=merge_4, Motion=expr("2 * x", amp_2))  # -> Geometry, Transform
move_18 = Move(Geometry=merge_5, Motion=expr("2 * x", amp_3))  # -> Geometry, Transform
move_19 = Move(Geometry=xy_6, Motion=Z_24)  # -> Geometry, Transform
expression_8 = Expression(x="8", Expression="2 * pi / x / 2")
chamfer_4 = Chamfer(Poly=rectangle_9.Rectangle, Chamfer=Slider(-2000, range=-5000..0))
chamfer_5 = Chamfer(Poly=rectangle_10.Rectangle, Chamfer=Slider(-2000, range=-5000..0))
cir_6 = Circle(Plane=avr, Radius=1)
debrep = DeconstructBrep(Brep=brep)  # -> Faces, Edges, Vertices
debrep_2 = DeconstructBrep(Brep=brep_2)  # -> Faces, Edges, Vertices
cull_10 = CullPattern(List=project_5.Point, CullPattern=invert(null_5.NullFlags))  # -> graft(List)
rectangle_11 = Rectangle(Plane=xy_7, XSize=dom_21, YSize=dom_22, Radius=Slider(3000, range=0..100000))  # -> Rectangle, Length
deplane_4 = DeconstructPlane(Plane=xy_7)  # -> Origin, XAxis, YAxis, ZAxis
expression_9 = Expression(x=number_slider_28, y=number_slider_33, Expression="6350 + x + y")
area_2 = Area(Geometry=flatten(move_14.Geometry))  # -> Area, Centroid
debrep_3 = DeconstructBrep(Brep=brep_3)  # -> Faces, Edges, Vertices
vec2pt_5 = Vector2Pt(PointA=cull_10, PointB=cull_9, Unitize=False)  # -> Vector, Length
pshift = ShiftPaths(Data=ln, Offset=-1)
number_slider_35 = Slider(100000, range=0..100000)
number_slider_36 = Slider(1000000, range=0..1000000)
rectangle_12 = Rectangle(Plane=move_19.Geometry, XSize=dom_23, YSize=dom_24, Radius=0)  # -> Rectangle, Length
area_3 = Area(Geometry=debrep.Faces)  # -> Area, Centroid
area_4 = Area(Geometry=debrep_2.Faces)  # -> Area, Centroid
pl_origin = PlaneOrigin(Base=cull_5, Origin=move_15.Geometry)
pl_origin_2 = PlaneOrigin(Base=cull_7, Origin=move_16.Geometry)
vlen_3 = VectorLength(Vector=vec2pt_3.Vector)
vlen_4 = VectorLength(Vector=vec2pt_4.Vector)
move_20 = Move(Geometry=move_14.Geometry, Motion=Z_19)  # -> Geometry, Transform
number_slider_37 = Slider(3500, range=0..100000)
number_slider_38 = Slider(3500, range=0..100000)
merge_7 = Merge(Data1=rotate_3.Geometry, Data2=chamfer_4)  # -> flatten(Result)
merge_8 = Merge(Data1=rotate_4.Geometry, Data2=chamfer_5)  # -> flatten(Result)
merge_9 = Merge(Data1=Slider(0, range=0..100), Data2=number_slider_34, Data3=Slider(22000, range=0..1000000), Data4=number_slider_34)
midpt = CurveMiddle(Curve=pshift)
number_slider_39 = Slider(17500, range=0..100000)
area_5 = Area(Geometry=debrep_3.Faces)  # -> Area, Centroid
merge_10 = Merge(Data1=chamfer_4, Data2=polygon_3.Polygon)  # -> flatten(Result)
merge_11 = Merge(Data1=chamfer_5, Data2=polygon_4.Polygon)  # -> flatten(Result)
shift = ShiftList(List=area_2.Centroid, Shift=1, Wrap=invert(True))
panel_4 = Panel(vlen_3)
panel_5 = Panel(vlen_4)
crv_7 = Curve(<curve referenced from the Rhino model>)
xy_8 = XYPlane(Origin=move_16.Geometry)
number_slider_40 = Slider(3000, range=0..100000)
number_slider_41 = Slider(12000, range=0..1000000)
crv_8 = Curve(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)
pdecon = Deconstruct(Point=area_3.Centroid)  # -> XComponent, YComponent, ZComponent
pdecon_2 = Deconstruct(Point=area_4.Centroid)  # -> XComponent, YComponent, ZComponent
rotate_5 = Rotate(Geometry=rectangle_12.Rectangle, Angle=expression_8, Plane=move_19.Geometry)  # -> Geometry, Transform
number_slider_42 = Slider(3000, range=0..100000)
planar_5 = Planar(Curve=move_20.Geometry)  # -> Planar, flatten(Plane), Deviation
number_slider_43 = Slider(9000, range=0..100000)
number_slider_44 = Slider(9000, range=0..100000)
number_slider_45 = Slider(1750, range=0..100000)
number_slider_46 = Slider(1750, range=0..100000)
alongcrv = SortAlongCurve(Points=midpt, Curve=cir_6)  # -> Points, Indices
ma_2 = MassAddition(Input=merge_9)  # -> Result, PartialResults
pdecon_3 = Deconstruct(Point=area_5.Centroid)  # -> XComponent, YComponent, ZComponent
pl_origin_3 = PlaneOrigin(Base=cull_9, Origin=cull_10)
flip_2 = FlipCurve(Curve=crv_8)  # -> Curve, Flag
vlen_5 = VectorLength(Vector=vec2pt_5.Vector)
short = ShortestList(ListA=area_2.Centroid, ListB=shift, TrimMode=2)  # -> ListA, ListB
number_slider_47 = Slider(3500, range=0..100000)
loft_3 = Loft(Curves=merge_7, Options={Adjust=True, Closed=False, LoftEnds=0, LoftSimp=2, LoftType=3, Rebuild=10, Refit=0.01})
loft_4 = Loft(Curves=merge_8, Options={Adjust=True, Closed=False, LoftEnds=0, LoftSimp=2, LoftType=3, Rebuild=10, Refit=0.01})
sort = SortList(Keys=pdecon.ZComponent, ValuesA=debrep.Faces)  # -> Keys, reverse(ValuesA)
sort_2 = SortList(Keys=pdecon_2.ZComponent, ValuesA=debrep_2.Faces)  # -> Keys, reverse(ValuesA)
division_3 = Division(A=number_slider_33, B=Slider(2, range=0..10))
reb = RebuildCurve(Curve=crv_7, Count=Slider(100, range=0..100), Tangents=False)
Z_25 = UnitZ(Factor="-10000")
Z_26 = UnitZ(Factor="-10000")
crv_9 = Curve([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])
crv_10 = Curve([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])
cir_7 = Circle(Plane=pl_origin, Radius=number_slider_37)
cir_8 = Circle(Plane=pl_origin_2, Radius=number_slider_38)
loft_5 = Loft(Curves=merge_10, Options={Adjust=True, Closed=False, LoftEnds=0, LoftSimp=2, LoftType=3, Rebuild=10, Refit=0.01})
loft_6 = Loft(Curves=merge_11, Options={Adjust=True, Closed=False, LoftEnds=0, LoftSimp=2, LoftType=3, Rebuild=10, Refit=0.01})
sort_3 = SortList(Keys=pdecon_3.ZComponent, ValuesA=debrep_3.Faces)  # -> Keys, reverse(ValuesA)
item_4 = ListItem(List=planar_5.Plane, Index=0, Wrap=True)
panel_6 = Panel(vlen_5)
item_5 = ListItem(List=pshift, Index=alongcrv.Indices, Wrap=True)
crv_11 = Curve([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])
xy_9 = XYPlane(Origin=cull_10)
planar_6 = IsPlanar(Surface=rotate_5.Geometry, Interior=True)  # -> Planar, Plane
deplane_5 = DeconstructPlane(Plane=planar_6.Plane)  # -> Origin, XAxis, YAxis, ZAxis
divlength_7 = DivideLength(Curve=flip_2.Curve, Length=Slider(940000, range=0..10000000))  # -> Points, Tangents, Parameters
amp_4 = Amplitude(Vector=deplane_4.YAxis, Amplitude=ma_2.PartialResults)
merge_12 = Merge(Data1=simplify(graft(short.ListA)), Data2=simplify(graft(short.ListB)))
number_slider_48 = Slider(4250, range=0..100000)
number_slider_49 = Slider(4250, range=0..100000)
join_3 = BrepJoin(Breps=[extr_9, loft_3, loft_5])  # -> Breps, Closed
join_4 = BrepJoin(Breps=[extr_10, loft_4, loft_6])  # -> Breps, Closed
item_6 = ListItem(List=sort.ValuesA, Index=0, Wrap=True)
number_slider_50 = Slider(1750, range=0..100000)
number_slider_51 = Slider(9000, range=0..100000)
move_21 = Move(Geometry=rectangle_11.Rectangle, Motion=amp_4)  # -> Geometry, Transform
Z_27 = UnitZ(Factor="-10000")
item_7 = ListItem(List=sort_2.ValuesA, Index=0, Wrap=True)
item_8 = ListItem(List=crv_9, Index=Slider(7, range=0..100), Wrap=True)
item_9 = ListItem(List=crv_10, Index=Slider(7, range=0..100), Wrap=True)
extr_11 = Extrude(Base=cir_7, Direction=Z_25)
extr_12 = Extrude(Base=cir_8, Direction=Z_26)
amp_5 = Amplitude(Vector=deplane_5.YAxis, Amplitude=expression_9)
number_slider_52 = Slider(15000, range=0..1000000)
item_10 = ListItem(List=sort_3.ValuesA, Index=0, Wrap=True)
disc_3 = Discontinuity(Curve=reb, Level=1)  # -> Points, Parameters
number_slider_53 = Slider(3500, range=0..100000)
number_slider_54 = Slider(5000, range=0..100000)
pframe = PerpFrame(Curve=flip_2.Curve, Parameter=divlength_7.Parameters)
dom_25 = ConstructDomain(DomainStart=expr("-x/2", number_slider_30), DomainEnd=expr("x / 2", number_slider_30))
dom_26 = ConstructDomain(DomainStart=expr("-x/2", number_slider_41), DomainEnd=expr("x / 2", number_slider_41))
Z_28 = UnitZ(Factor="-3000")
item_11 = ListItem(List=crv_11, Index=Slider(7, range=0..100), Wrap=True)
redpline = Reduce(Tolerance=1)  # -> Polyline, Reduction
shatter_2 = Shatter(Curve=flip_2.Curve, Parameters=divlength_7.Parameters)
cap_6 = CapHoles(Brep=extr_6)
cap_7 = CapHoles(Brep=join_3.Breps)
cap_8 = CapHoles(Brep=extr_7)
cap_9 = CapHoles(Brep=join_4.Breps)
dom_27 = ConstructDomain(DomainStart=expr("-x/2", number_slider_40), DomainEnd=expr("x / 2", number_slider_40))
cir_9 = Circle(Plane=pl_origin_3, Radius=number_slider_47)
item_12 = ListItem(List=flatten(item_6), Index=0, Wrap=True)
item_13 = ListItem(List=flatten(item_7), Index=0, Wrap=True)
loft_7 = Loft(Curves=item_5, Options={Adjust=True, Closed=True, LoftEnds=0, LoftSimp=0, LoftType=3, Rebuild=10, Refit=0.01})  # -> simplify(Loft)
boundary = BoundarySurfaces(Edges=merge_6)  # -> simplify(Surfaces)
expression_10 = Expression(x="8", Expression="2 * pi / x / 2")
Z_29 = UnitZ(Factor=vlen_3)
Z_30 = UnitZ(Factor=vlen_4)
planar_7 = IsPlanar(Surface=item_6, Interior=True)  # -> Planar, Plane
planar_8 = IsPlanar(Surface=item_7, Interior=True)  # -> Planar, Plane
item_14 = ListItem(List=merge_12, Index=0, Wrap=True)  # -> Item, Item1
Z_31 = UnitZ(Factor=Slider(2000, range=0..10000))
planar_9 = IsPlanar(Surface=item_8, Interior=True)  # -> Planar, Plane
planar_10 = IsPlanar(Surface=item_9, Interior=True)  # -> Planar, Plane
dom_28 = ConstructDomain(DomainStart=expr("-x/2", number_slider_42), DomainEnd=expr("x / 2", number_slider_42))
planar_11 = IsPlanar(Surface=item_10, Interior=True)  # -> Planar, Plane
number_slider_55 = Slider(4250, range=0..100000)
nurbs = NurbsCurve(Degree=3, Periodic=False)  # -> Curve, Length, Domain
pline = PolyLine(Vertices=disc_3.Points, Closed=False)
move_22 = Move(Geometry=xy_6, Motion=amp_5)  # -> Geometry, Transform
dom_29 = ConstructDomain(DomainStart=expr("-x/2", number_slider_43), DomainEnd=expr("x / 2", number_slider_43))
extr_13 = Extrude(Base=move_21.Geometry, Direction=Z_27)
area_6 = Area(Geometry=move_21.Geometry)  # -> Area, Centroid
planar_12 = IsPlanar(Surface=item_11, Interior=True)  # -> Planar, Plane
expression_11 = Expression(x=number_slider_37, y=number_slider_48, Expression="6350 + x + y")
expression_12 = Expression(x=number_slider_38, y=number_slider_49, Expression="6350 + x + y")
panel_7 = Panel(crv_9)
panel_8 = Panel(crv_10)
deplane_6 = DeconstructPlane(Plane=planar_7.Plane)  # -> Origin, XAxis, YAxis, ZAxis
deplane_7 = DeconstructPlane(Plane=planar_8.Plane)  # -> Origin, XAxis, YAxis, ZAxis
dom_30 = ConstructDomain(DomainStart=expr("-x/2", number_slider_46), DomainEnd=expr("x / 2", number_slider_46))
dom_31 = ConstructDomain(DomainStart=expr("-x/2", number_slider_44), DomainEnd=expr("x / 2", number_slider_44))
extr_14 = Extrude(Base=cir_9, Direction=Z_28)
intcrv = Interpolate(Degree=3, Periodic=False, KnotStyle=1)  # -> Curve, Length, Domain
move_23 = Move(Geometry=pl_origin_2, Motion=Z_30)  # -> Geometry, Transform
polygon_6 = Polygon(Plane=cir_8, Radius=number_slider_46, Segments="8", FilletRadius=0)  # -> Polygon, Length
move_24 = Move(Geometry=pl_origin, Motion=Z_29)  # -> Geometry, Transform
area_7 = Area(Geometry=item_12)  # -> Area, Centroid
merge_13 = Merge(Data1=cap_6, Data2=cap_7)
merge_14 = Merge(Data1=cap_8, Data2=cap_9)
panel_9 = Panel(crv_11)
area_8 = Area(Geometry=item_13)  # -> Area, Centroid
division_4 = Division(A=number_slider_48, B=Slider(2, range=0..10))
division_5 = Division(A=number_slider_49, B=Slider(2, range=0..10))
deplane_8 = DeconstructPlane(Plane=planar_9.Plane)  # -> Origin, XAxis, YAxis, ZAxis
deplane_9 = DeconstructPlane(Plane=planar_10.Plane)  # -> Origin, XAxis, YAxis, ZAxis
Z_32 = UnitZ(Factor=expr("-x / sqrt(2)", "1750"))
extr_15 = Extrude(Base=rotate_5.Geometry, Direction=expr("-x", Z_32))
move_25 = Move(Geometry=planar_6.Plane, Motion=Z_32)  # -> Geometry, Transform
deplane_10 = DeconstructPlane(Plane=planar_11.Plane)  # -> Origin, XAxis, YAxis, ZAxis
expression_13 = Expression(x="8", Expression="2 * pi / x / 2")
join_5 = BrepJoin(Breps=[boundary, loft_7])  # -> Breps, Closed
rectangle_13 = Rectangle(Plane=move_25.Geometry, XSize=dom_25, YSize=dom_27, Radius=0)  # -> Rectangle, Length
move_26 = Move(Geometry=move_22.Geometry, Motion=Z_23)  # -> Geometry, Transform
polygon_7 = Polygon(Plane=pl_origin, Radius=number_slider_45, Segments="8", FilletRadius=0)  # -> Polygon, Length
cap_10 = CapHoles(Brep=extr_13)
dist = Distance(PointA=item_14.Item, PointB=item_14.Item1)
rectangle_14 = Rectangle(Plane=move_26.Geometry, XSize=dom_28, YSize=dom_26, Radius=0)  # -> Rectangle, Length
eval = EvaluateCurve(Curve=reparameterize(pline), Parameter=Slider(1, range=0..1))  # -> Point, Tangent, Angle
dom_32 = ConstructDomain(DomainStart=expr("-x/2", number_slider_45), DomainEnd=expr("x / 2", number_slider_45))
deplane_11 = DeconstructPlane(Plane=planar_12.Plane)  # -> Origin, XAxis, YAxis, ZAxis
Z_33 = UnitZ(Factor=vlen_5)
cir_10 = Circle(Plane=move_22.Geometry, Radius=number_slider_33)
avr_2 = Average(Input=merge_12)
entwine = Entwine(Branch00=merge_4, Branch01=merge_13, Branch02=move_17.Geometry, FlattenInputs=True)
entwine_2 = Entwine(Branch00=merge_5, Branch01=merge_14, Branch02=move_18.Geometry, FlattenInputs=True)
neg = Negative(Value=deplane_8.YAxis)
neg_2 = Negative(Value=deplane_9.YAxis)
neg_3 = Negative(Value=deplane_6.XAxis)
neg_4 = Negative(Value=deplane_7.XAxis)
number_slider_56 = Slider(3500, range=0..100000)
pdecon_4 = Deconstruct(Point=area_7.Centroid)  # -> XComponent, YComponent, ZComponent
pdecon_5 = Deconstruct(Point=area_8.Centroid)  # -> XComponent, YComponent, ZComponent
expression_14 = Expression(x=number_slider_47, y=number_slider_55, Expression="6350 + x + y")
rectangle_15 = Rectangle(Plane=move_23.Geometry, XSize=dom_30, YSize=dom_31, Radius=0)  # -> Rectangle, Length
neg_5 = Negative(Value=deplane_11.YAxis)
number_slider_57 = Slider(12000, range=0..1000000)
number_slider_58 = Slider(12000, range=0..1000000)
neg_6 = Negative(Value=deplane_10.XAxis)
dom_33 = ConstructDomain(DomainStart=expr("- x / 2", number_slider_53), DomainEnd=expr("x / 2", number_slider_53))
dom_34 = ConstructDomain(DomainStart=expr("- x / 2", number_slider_54), DomainEnd=expr("x / 2", number_slider_54))
dom_35 = ConstructDomain(DomainStart=expr("-x/2", number_slider_50), DomainEnd=expr("x / 2", number_slider_50))
dom_36 = ConstructDomain(DomainStart=expr("-x/2", number_slider_51), DomainEnd=expr("x / 2", number_slider_51))
move_27 = Move(Geometry=pl_origin_3, Motion=Z_33)  # -> Geometry, Transform
polygon_8 = Polygon(Plane=cir_9, Radius=number_slider_50, Segments="8", FilletRadius=0)  # -> Polygon, Length
subtraction = Subtraction(A=Slider(100000, range=0..100000), B=dist)
move_28 = Move(Geometry=cap_10, Motion=Z_31)  # -> Geometry, Transform
rectangle_16 = Rectangle(Plane=move_24.Geometry, XSize=dom_32, YSize=dom_29, Radius=0)  # -> Rectangle, Length
division_6 = Division(A=number_slider_55, B=Slider(2, range=0..10))
xy_10 = XYPlane(Origin=move_22.Geometry)
number_slider_59 = Slider(0.8, range=0..1)
pl = ConstructPlane(Origin=deplane_8.Origin, XAxis=neg, YAxis=deplane_8.XAxis)
pl_2 = ConstructPlane(Origin=deplane_9.Origin, XAxis=neg_2, YAxis=deplane_9.XAxis)
expression_15 = Expression(x="8", Expression="2 * pi / x / 2")
chamfer_6 = Chamfer(Poly=rectangle_13.Rectangle, Chamfer=Slider(-200, range=-5000..0))
merge_15 = Merge(Data1=polygon_5.Polygon, Data2=chamfer_6, Data3=rotate_5.Geometry)
number_slider_60 = Slider(2400, range=0..100000)
number_slider_61 = Slider(2400, range=0..100000)
number_slider_62 = Slider(17500, range=0..100000)
number_slider_63 = Slider(17500, range=0..100000)
rotate_6 = Rotate(Geometry=rectangle_14.Rectangle, Angle=expression_8, Plane=move_26.Geometry)  # -> Geometry, Transform
extr_16 = Extrude(Base=cir_10, Direction=Z_18)
number_slider_64 = Slider(0.8, range=0..1)
pl_3 = ConstructPlane(Origin=deplane_6.Origin, XAxis=deplane_6.ZAxis, YAxis=neg_3)
pl_4 = ConstructPlane(Origin=deplane_7.Origin, XAxis=deplane_7.ZAxis, YAxis=neg_4)
pl_5 = ConstructPlane(Origin=deplane_11.Origin, XAxis=neg_5, YAxis=deplane_11.XAxis)
Z_34 = UnitZ(Factor=expr("-x / sqrt(2)", "1750"))
pl_6 = ConstructPlane(Origin=deplane_10.Origin, XAxis=deplane_10.ZAxis, YAxis=neg_6)
rotate_7 = Rotate(Geometry=rectangle_15.Rectangle, Angle=expression_13, Plane=move_23.Geometry)  # -> Geometry, Transform
subtraction_2 = Subtraction(A=pdecon_4.ZComponent, B=pdecon_5.ZComponent)
rotate_8 = Rotate(Geometry=rectangle_16.Rectangle, Angle=expression_10, Plane=move_24.Geometry)  # -> Geometry, Transform
dom_37 = ConstructDomain(DomainStart=expr("- x / 2", subtraction), DomainEnd=expr("x / 2", subtraction))
planar_13 = IsPlanar(Surface=rotate_6.Geometry, Interior=True)  # -> Planar, Plane
rectangle_17 = Rectangle(Plane=move_27.Geometry, XSize=dom_35, YSize=dom_36, Radius=0)  # -> Rectangle, Length
number_slider_65 = Slider(12000, range=0..1000000)
rectangle_18 = Rectangle(Plane=area_6.Centroid, XSize=dom_33, YSize=dom_34, Radius=0)  # -> Rectangle, Length
loft_8 = Loft(Curves=merge_15, Options={Adjust=True, Closed=False, LoftEnds=0, LoftSimp=0, LoftType=3, Rebuild=10, Refit=0.01})
polygon_9 = Polygon(Plane=xy_10, Radius=number_slider_42, Segments="8", FilletRadius=0)  # -> Polygon, Length
abs = Absolute()
multiplication_6 = Multiplication(A=Z_29, B=Slider(1, range=0..1))
multiplication_7 = Multiplication(A=Z_30, B=Slider(1, range=0..1))
Z_35 = UnitZ(Factor=expr("-x / sqrt(2)", number_slider_45))
expression_16 = Expression(x=number_slider_37, y=expression_10, Expression="x * Cos(y)")
Z_36 = UnitZ(Factor=expr("-x / sqrt(2)", number_slider_46))
expression_17 = Expression(x=number_slider_38, y=expression_13, Expression="x * Cos(y)")
number_slider_66 = Slider(2400, range=0..100000)
number_slider_67 = Slider(17500, range=0..100000)
join_6 = BrepJoin(Breps=[extr_15, loft_8])  # -> Breps, Closed
dom_38 = ConstructDomain(DomainStart=expr("-x/2", division_3), DomainEnd=expr("x / 2", division_3))
addition = Addition(A=subtraction_2, B=Slider(3000, range=0..10000))
move_29 = Move(Geometry=planar_13.Plane, Motion=Z_34)  # -> Geometry, Transform
planar_14 = IsPlanar(Surface=rotate_8.Geometry, Interior=True)  # -> Planar, Plane
deplane_12 = DeconstructPlane(Plane=planar_14.Plane)  # -> Origin, XAxis, YAxis, ZAxis
planar_15 = IsPlanar(Surface=rotate_7.Geometry, Interior=True)  # -> Planar, Plane
deplane_13 = DeconstructPlane(Plane=planar_15.Plane)  # -> Origin, XAxis, YAxis, ZAxis
panel_10 = Panel(subtraction_2)
rectangle_19 = Rectangle(Plane=avr_2, XSize=dom_13, YSize=dom_37, Radius=0)  # -> Rectangle, Length
dom_39 = ConstructDomain(DomainStart=expr("-x/2", number_slider_56), DomainEnd=expr("x / 2", number_slider_56))
expression_18 = Expression(x=number_slider_59, Expression="1 - x")
orient = Orient(Geometry=crv_9, Source=pl, Target=pl_3)  # -> Geometry, Transform
orient_2 = Orient(Geometry=crv_10, Source=pl_2, Target=pl_4)  # -> Geometry, Transform
rotate_9 = Rotate(Geometry=rectangle_17.Rectangle, Angle=expression_15, Plane=move_27.Geometry)  # -> Geometry, Transform
orient_3 = Orient(Geometry=crv_11, Source=pl_5, Target=pl_6)  # -> Geometry, Transform
multiplication_8 = Multiplication(A=number_slider_59, B=item_2)
xy_11 = XYPlane(Origin=cir_7)
amp_6 = Amplitude(Vector=deplane_12.YAxis, Amplitude=expression_11)
amp_7 = Amplitude(Vector=deplane_13.YAxis, Amplitude=expression_12)
cap_11 = CapHoles(Brep=extr_8)
cap_12 = CapHoles(Brep=join_6.Breps)
Z_37 = UnitZ(Factor=Slider(3000, range=0..10000))
Z_38 = UnitZ(Factor=addition)
extr_17 = Extrude(Base=rotate_8.Geometry, Direction=expr("-x", Z_35))
extr_18 = Extrude(Base=rotate_7.Geometry, Direction=expr("-x", Z_36))
dom_40 = ConstructDomain(DomainStart=expr("-x/2", number_slider_45), DomainEnd=expr("x / 2", number_slider_45))
dom_41 = ConstructDomain(DomainStart=expr("-x/2", number_slider_46), DomainEnd=expr("x / 2", number_slider_46))
dom_42 = ConstructDomain(DomainStart=expr("-x/2", number_slider_57), DomainEnd=expr("x / 2", number_slider_57))
dom_43 = ConstructDomain(DomainStart=expr("-x/2", number_slider_58), DomainEnd=expr("x / 2", number_slider_58))
multiplication_9 = Multiplication(A=Z_33, B=Slider(0.8, range=0..1))
move_30 = Move(Geometry=planar_14.Plane, Motion=Z_35)  # -> Geometry, Transform
move_31 = Move(Geometry=planar_15.Plane, Motion=Z_36)  # -> Geometry, Transform
Z_39 = UnitZ(Factor=Slider(3000, range=0..10000))
Z_40 = UnitZ(Factor=expr("-x / sqrt(2)", number_slider_50))
expression_19 = Expression(x=number_slider_47, y=expression_15, Expression="x * Cos(y)")
dom_44 = ConstructDomain(DomainStart=expr("-x/2", expression_16), DomainEnd=expr("x / 2", expression_16))
dom_45 = ConstructDomain(DomainStart=expr("-x/2", expression_17), DomainEnd=expr("x / 2", expression_17))
multiplication_10 = Multiplication(A=expression_18, B=item_2)
Z_41 = UnitZ(Factor=multiplication_8)
rectangle_20 = Rectangle(Plane=move_29.Geometry, XSize=dom_38, YSize=dom_39, Radius=0)  # -> Rectangle, Length
planar_16 = IsPlanar(Surface=rotate_9.Geometry, Interior=True)  # -> Planar, Plane
deplane_14 = DeconstructPlane(Plane=planar_16.Plane)  # -> Origin, XAxis, YAxis, ZAxis
merge_16 = Merge(Data1=move_13.Geometry, Data2=rectangle_19.Rectangle)
dom_46 = ConstructDomain(DomainStart=expr("-x/2", number_slider_60), DomainEnd=expr("x / 2", number_slider_60))
dom_47 = ConstructDomain(DomainStart=expr("-x/2", number_slider_61), DomainEnd=expr("x / 2", number_slider_61))
merge_17 = Merge(Data1=cap_11, Data2=cap_12)
move_32 = Move(Geometry=orient.Geometry, Motion=Z_37)  # -> Geometry, Transform
move_33 = Move(Geometry=orient_2.Geometry, Motion=Z_38)  # -> Geometry, Transform
move_34 = Move(Geometry=pl_origin, Motion=amp_6)  # -> Geometry, Transform
move_35 = Move(Geometry=pl_origin_2, Motion=amp_7)  # -> Geometry, Transform
move_36 = Move(Geometry=orient_3.Geometry, Motion=Z_39)  # -> Geometry, Transform
extr_19 = Extrude(Base=rotate_6.Geometry, Direction=expr("-x", Z_34))
Z_42 = UnitZ(Factor=multiplication_10)
chamfer_7 = Chamfer(Poly=rectangle_18.Rectangle, Chamfer=Slider(-600, range=-6000..0))  # -> graft(Curves)
amp_8 = Amplitude(Vector=deplane_14.YAxis, Amplitude=expression_14)
move_37 = Move(Geometry=rectangle_18.Rectangle, Motion=Z_41)  # -> Geometry, Transform
extr_20 = Extrude(Base=rotate_9.Geometry, Direction=expr("-x", Z_40))
dom_48 = ConstructDomain(DomainStart=expr("-x/2", number_slider_50), DomainEnd=expr("x / 2", number_slider_50))
dom_49 = ConstructDomain(DomainStart=expr("-x/2", number_slider_65), DomainEnd=expr("x / 2", number_slider_65))
move_38 = Move(Geometry=planar_16.Plane, Motion=Z_40)  # -> Geometry, Transform
rectangle_21 = Rectangle(Plane=move_30.Geometry, XSize=dom_40, YSize=dom_44, Radius=0)  # -> Rectangle, Length
move_39 = Move(Geometry=move_34.Geometry, Motion=multiplication_6)  # -> Geometry, Transform
rectangle_22 = Rectangle(Plane=move_31.Geometry, XSize=dom_41, YSize=dom_45, Radius=0)  # -> Rectangle, Length
move_40 = Move(Geometry=move_35.Geometry, Motion=multiplication_7)  # -> Geometry, Transform
dom_50 = ConstructDomain(DomainStart=expr("-x/2", expression_19), DomainEnd=expr("x / 2", expression_19))
explode = Explode(Curve=merge_16, Recursive=True)  # -> Segments, Vertices
rectangle_23 = Rectangle(Plane=move_39.Geometry, XSize=dom_46, YSize=dom_42, Radius=0)  # -> Rectangle, Length
cir_11 = Circle(Plane=move_35.Geometry, Radius=number_slider_49)
rectangle_24 = Rectangle(Plane=move_40.Geometry, XSize=dom_47, YSize=dom_43, Radius=0)  # -> Rectangle, Length
move_41 = Move(Geometry=merge_17, Motion=expr("2 * x", amp_5))  # -> Geometry, Transform
chamfer_8 = Chamfer(Poly=rectangle_20.Rectangle, Chamfer=Slider(-100, range=-5000..0))
disc_4 = Discontinuity(Curve=chamfer_7, Level=1)  # -> Points, Parameters
dom_51 = ConstructDomain(DomainStart=expr("-x/2", number_slider_66), DomainEnd=expr("x / 2", number_slider_66))
cir_12 = Circle(Plane=move_34.Geometry, Radius=number_slider_48)
disc_5 = Discontinuity(Curve=move_37.Geometry, Level=1)  # -> Points, Parameters
move_42 = Move(Geometry=pl_origin_3, Motion=amp_8)  # -> Geometry, Transform
item_15 = ListItem(List=move_32.Geometry, Index=Slider(9, range=0..100), Wrap=True)  # -> flatten(Item)
Z_43 = UnitZ(Factor=expr("x / sqrt(2)", Slider(1750, range=0..100000)))
item_16 = ListItem(List=move_33.Geometry, Index=0, Wrap=True)  # -> Item, Item1, Item2, Item3, Item4, Item5, Item6, Item7, Item8, Item9
len_2 = Length(Curve=explode.Segments)
expression_20 = Expression(x=number_slider_48, y=expression_10, Expression="x * Cos(y)")
expression_21 = Expression(x=number_slider_49, y=expression_13, Expression="x * Cos(y)")
dom_52 = ConstructDomain(DomainStart=expr("-x/2", division_4), DomainEnd=expr("x / 2", division_4))
dom_53 = ConstructDomain(DomainStart=expr("-x/2", division_5), DomainEnd=expr("x / 2", division_5))
item_17 = ListItem(List=move_36.Geometry, Index=Slider(7, range=0..100), Wrap=True)
xy_12 = XYPlane(Origin=move_35.Geometry)
number_slider_68 = Slider(78, range=0..100)
merge_18 = Merge(Data1=graft(move_37.Geometry), Data2=chamfer_7)
chamfer_9 = Chamfer(Poly=rectangle_21.Rectangle, Chamfer=Slider(-200, range=-5000..0))
merge_19 = Merge(Data1=polygon_7.Polygon, Data2=chamfer_9, Data3=rotate_8.Geometry)
rotate_10 = Rotate(Geometry=move_34.Geometry, Angle=expression_10, Plane=move_34.Geometry)  # -> Geometry, Transform
chamfer_10 = Chamfer(Poly=rectangle_22.Rectangle, Chamfer=Slider(-200, range=-5000..0))
merge_20 = Merge(Data1=polygon_6.Polygon, Data2=chamfer_10, Data3=rotate_7.Geometry)
rectangle_25 = Rectangle(Plane=move_38.Geometry, XSize=dom_48, YSize=dom_50, Radius=0)  # -> Rectangle, Length
move_43 = Move(Geometry=move_42.Geometry, Motion=multiplication_9)  # -> Geometry, Transform
rotate_11 = Rotate(Geometry=rectangle_23.Rectangle, Angle=expression_10, Plane=move_39.Geometry)  # -> Geometry, Transform
rotate_12 = Rotate(Geometry=rectangle_24.Rectangle, Angle=expression_13, Plane=move_40.Geometry)  # -> Geometry, Transform
extr_21 = Extrude(Base=cir_12, Direction=Z_25)
extr_22 = Extrude(Base=cir_11, Direction=Z_26)
cps_2 = ClosestPoints(Point=disc_5.Points, Cloud=disc_4.Points, Count="2")  # -> ClosestPoint, CPIndex, Distance
multiplication_11 = Multiplication(A=Z_29, B=Slider(0, range=0..1))
merge_21 = Merge(Data1=rotate_6.Geometry, Data2=chamfer_8)
rectangle_26 = Rectangle(Plane=move_43.Geometry, XSize=dom_51, YSize=dom_49, Radius=0)  # -> Rectangle, Length
avr_3 = Average(Input=disc_5.Points)
crv_12 = Curve(item_16.Item)
crv_13 = Curve(item_16.Item1)
crv_14 = Curve(item_16.Item4)
crv_15 = Curve(item_16.Item5)
crv_16 = Curve(item_16.Item6)
crv_17 = Curve(item_16.Item7)
crv_18 = Curve(item_16.Item8)
crv_19 = Curve(item_16.Item9)
Z_44 = UnitZ(Factor=expr("-x / sqrt(2)", number_slider_45))
Z_45 = UnitZ(Factor=expr("-x / sqrt(2)", number_slider_46))
sort_4 = SortList(Keys=len_2, ValuesA=explode.Segments)  # -> Keys, ValuesA
move_44 = Move(Geometry=graft(move_37.Geometry), Motion=Z_43)  # -> Geometry, Transform
cap_13 = CapHoles(Brep=extr_19)
merge_22 = Merge(Data1=chamfer_8, Data2=polygon_9.Polygon)
loft_9 = Loft(
    Curves=flatten(item_17),
    Options={Adjust=False, Closed=False, LoftEnds=0, LoftSimp=0, LoftType=0, Rebuild=10, Refit=0.01})
cir_13 = Circle(Plane=move_42.Geometry, Radius=number_slider_55)
planar_17 = IsPlanar(Surface=rotate_11.Geometry, Interior=True)  # -> Planar, Plane
planar_18 = IsPlanar(Surface=rotate_12.Geometry, Interior=True)  # -> Planar, Plane
polygon_10 = Polygon(Plane=xy_12, Radius=number_slider_61, Segments="8", FilletRadius=0)  # -> Polygon, Length
ln_2 = Line(StartPoint=graft(disc_5.Points), EndPoint=cps_2.ClosestPoint)
expression_22 = Expression(x=number_slider_55, y=expression_15, Expression="x * Cos(y)")
loft_10 = Loft(Curves=merge_19, Options={Adjust=True, Closed=False, LoftEnds=0, LoftSimp=0, LoftType=3, Rebuild=10, Refit=0.01})
loft_11 = Loft(Curves=merge_20, Options={Adjust=True, Closed=False, LoftEnds=0, LoftSimp=0, LoftType=3, Rebuild=10, Refit=0.01})
multiplication_12 = Multiplication(A=Z_30, B=Slider(0, range=0..1))
dom_54 = ConstructDomain(DomainStart=expr("-x/2", division_6), DomainEnd=expr("x / 2", division_6))
polygon_11 = Polygon(Plane=move_34.Geometry, Radius=number_slider_60, Segments="8", FilletRadius=0)  # -> Polygon, Length
cir_14 = Circle(Plane=avr_3, Radius=1)
chamfer_11 = Chamfer(Poly=rectangle_25.Rectangle, Chamfer=Slider(-200, range=-5000..0))
merge_23 = Merge(Data1=polygon_8.Polygon, Data2=chamfer_11, Data3=rotate_9.Geometry)
rotate_13 = Rotate(Geometry=rectangle_26.Rectangle, Angle=expression_15, Plane=move_43.Geometry)  # -> Geometry, Transform
extr_23 = Extrude(Base=cir_13, Direction=Z_28)
item_18 = ListItem(List=sort_4.ValuesA, Index=0, Wrap=True)  # -> Item, Item1
join_7 = BrepJoin(Breps=[extr_17, loft_10])  # -> Breps, Closed
join_8 = BrepJoin(Breps=[extr_18, loft_11])  # -> Breps, Closed
area_9 = Area(Geometry=flatten(move_44.Geometry))  # -> Area, Centroid
loft_12 = Loft(Curves=merge_21, Options={Adjust=True, Closed=False, LoftEnds=0, LoftSimp=2, LoftType=3, Rebuild=10, Refit=0.01})
move_45 = Move(Geometry=planar_17.Plane, Motion=Z_44)  # -> Geometry, Transform
move_46 = Move(Geometry=planar_18.Plane, Motion=Z_45)  # -> Geometry, Transform
dom_55 = ConstructDomain(DomainStart=expr("-x/2", expression_20), DomainEnd=expr("x / 2", expression_20))
dom_56 = ConstructDomain(DomainStart=expr("-x/2", expression_21), DomainEnd=expr("x / 2", expression_21))
pshift_2 = ShiftPaths(Data=ln_2, Offset=-1)
Z_46 = UnitZ(Factor=expr("-x / sqrt(2)", number_slider_50))
loft_13 = Loft(Curves=merge_22, Options={Adjust=True, Closed=False, LoftEnds=0, LoftSimp=2, LoftType=3, Rebuild=10, Refit=0.01})
planar_19 = IsPlanar(Surface=rotate_13.Geometry, Interior=True)  # -> Planar, Plane
move_47 = Move(Geometry=move_44.Geometry, Motion=Z_42)  # -> Geometry, Transform
debrep_4 = DeconstructBrep(Brep=cap_13)  # -> Faces, Edges, Vertices
cap_14 = CapHoles(Brep=extr_11)
cap_15 = CapHoles(Brep=join_7.Breps)
cap_16 = CapHoles(Brep=extr_12)
cap_17 = CapHoles(Brep=join_8.Breps)
merge_24 = Merge(Data1=item_18.Item, Data2=item_18.Item1)  # -> flatten(Result)
polygon_12 = Polygon(Plane=move_42.Geometry, Radius=number_slider_66, Segments="8", FilletRadius=0)  # -> Polygon, Length
loft_14 = Loft(Curves=merge_23, Options={Adjust=True, Closed=False, LoftEnds=0, LoftSimp=0, LoftType=3, Rebuild=10, Refit=0.01})
midpt_2 = CurveMiddle(Curve=pshift_2)
join_9 = BrepJoin(Breps=[extr_19, loft_12, loft_13])  # -> Breps, Closed
multiplication_13 = Multiplication(A=Z_33, B=Slider(0.2, range=0..1))
shift_2 = ShiftList(List=area_9.Centroid, Shift=1, Wrap=invert(True))
join_10 = BrepJoin(Breps=[extr_20, loft_14])  # -> Breps, Closed
rectangle_27 = Rectangle(Plane=move_45.Geometry, XSize=dom_52, YSize=dom_55, Radius=0)  # -> Rectangle, Length
rectangle_28 = Rectangle(Plane=move_46.Geometry, XSize=dom_53, YSize=dom_56, Radius=0)  # -> Rectangle, Length
move_48 = Move(Geometry=planar_19.Plane, Motion=Z_46)  # -> Geometry, Transform
dom_57 = ConstructDomain(DomainStart=expr("-x/2", expression_22), DomainEnd=expr("x / 2", expression_22))
planar_20 = Planar(Curve=move_47.Geometry)  # -> Planar, flatten(Plane), Deviation
alongcrv_2 = SortAlongCurve(Points=midpt_2, Curve=cir_14)  # -> Points, Indices
cap_18 = CapHoles(Brep=extr_16)
cap_19 = CapHoles(Brep=join_9.Breps)
item_19 = ListItem(List=debrep_4.Faces, Index=Slider(4, range=0..6), Wrap=True)
merge_25 = Merge(Data1=cap_14, Data2=cap_15)
merge_26 = Merge(Data1=cap_16, Data2=cap_17)
midpt_3 = CurveMiddle(Curve=merge_24)
extr_24 = Extrude(Base=rotate_11.Geometry, Direction=expr("-x", Z_44))
extr_25 = Extrude(Base=rotate_12.Geometry, Direction=expr("-x", Z_45))
short_2 = ShortestList(ListA=area_9.Centroid, ListB=shift_2, TrimMode=2)  # -> ListA, ListB
cap_20 = CapHoles(Brep=extr_14)
cap_21 = CapHoles(Brep=join_10.Breps)
pdecon_6 = Deconstruct(Point=midpt_3)  # -> XComponent, YComponent, ZComponent
item_20 = ListItem(List=planar_20.Plane, Index=0, Wrap=True)
item_21 = ListItem(List=pshift_2, Index=alongcrv_2.Indices, Wrap=True)
planar_21 = IsPlanar(Surface=item_19, Interior=True)  # -> Planar, Plane
crv_20 = Curve(flatten([<curve referenced from the Rhino model> x88]))
rectangle_29 = Rectangle(Plane=move_48.Geometry, XSize=dom_54, YSize=dom_57, Radius=0)  # -> Rectangle, Length
merge_27 = Merge(Data1=cap_18, Data2=cap_19)
merge_28 = Merge(Data1=simplify(graft(short_2.ListA)), Data2=simplify(graft(short_2.ListB)))
move_49 = Move(Geometry=merge_25, Motion=expr("2 * x", amp_6))  # -> Geometry, Transform
move_50 = Move(Geometry=merge_26, Motion=expr("2 * x", amp_7))  # -> Geometry, Transform
chamfer_12 = Chamfer(Poly=rectangle_27.Rectangle, Chamfer=Slider(-100, range=-5000..0))
chamfer_13 = Chamfer(Poly=rectangle_28.Rectangle, Chamfer=Slider(-200, range=-5000..0))
cap_22 = CapHoles(Brep=extr_24)
cap_23 = CapHoles(Brep=extr_25)
merge_29 = Merge(Data1=cap_20, Data2=cap_21)
extr_26 = Extrude(Base=rotate_13.Geometry, Direction=expr("-x", Z_46))
area_10 = Area(Geometry=crv_20)  # -> Area, Centroid
sort_5 = SortList(Keys=pdecon_6.YComponent, ValuesA=merge_24)  # -> Keys, ValuesA
loft_15 = Loft(Curves=item_21, Options={Adjust=True, Closed=True, LoftEnds=0, LoftSimp=0, LoftType=3, Rebuild=10, Refit=0.01})  # -> simplify(Loft)
boundary_2 = BoundarySurfaces(Edges=merge_18)  # -> simplify(Surfaces)
crv_21 = Curve(flatten([<curve referenced from the Rhino model> x44]))
item_22 = ListItem(List=merge_28, Index=0, Wrap=True)  # -> Item, Item1
move_51 = Move(Geometry=cap_22, Motion=multiplication_11)  # -> Geometry, Transform
move_52 = Move(Geometry=cap_23, Motion=multiplication_12)  # -> Geometry, Transform
crv_22 = Curve(flatten([<curve referenced from the Rhino model> x43]))
crv_23 = Curve(flatten([<curve referenced from the Rhino model> x43]))
crv_24 = Curve(flatten([<curve referenced from the Rhino model> x44]))
crv_25 = Curve(flatten([<curve referenced from the Rhino model> x44]))
merge_30 = Merge(Data1=rotate_11.Geometry, Data2=chamfer_12)
merge_31 = Merge(Data1=chamfer_12, Data2=polygon_11.Polygon)
merge_32 = Merge(Data1=rotate_12.Geometry, Data2=chamfer_13)
merge_33 = Merge(Data1=chamfer_13, Data2=polygon_10.Polygon)
move_53 = Move(Geometry=merge_29, Motion=expr("2 * x", amp_8))  # -> Geometry, Transform
cullpt = CullDuplicates(Points=area_10.Centroid, Tolerance=0.1, CullMode=1)  # -> Points, Indices, Valence
crv_26 = Curve(flatten([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, <curve referenced from the Rhino model>, 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, <curve referenced from the Rhino model>, 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]))
crv_27 = Curve(flatten([<curve referenced from the Rhino model> x44]))
merge_34 = Merge(Data1=merge_17, Data2=merge_27, Data3=move_41.Geometry)
chamfer_14 = Chamfer(Poly=rectangle_29.Rectangle, Chamfer=Slider(-200, range=-5000..0))
loft_16 = Loft(Curves=sort_5.ValuesA, Options={Adjust=True, Closed=False, LoftEnds=0, LoftSimp=0, LoftType=3, Rebuild=10, Refit=0.01})
# 인방_LEFT
area_11 = Area(Geometry=crv_21)  # -> Area, Centroid
# 방지턱_LEFT
area_12 = Area(Geometry=crv_22)  # -> Area, Centroid
# TRINGLE_LEFT
area_13 = Area(Geometry=crv_23)  # -> Area, Centroid
debrep_5 = DeconstructBrep(Brep=move_51.Geometry)  # -> Faces, Edges, Vertices
debrep_6 = DeconstructBrep(Brep=move_52.Geometry)  # -> Faces, Edges, Vertices
# GAGE_LEFT
area_14 = Area(Geometry=crv_24)  # -> Area, Centroid
# 지하철난간_LEFT
area_15 = Area(Geometry=crv_25)  # -> Area, Centroid
deplane_15 = DeconstructPlane(Plane=planar_21.Plane)  # -> Origin, XAxis, YAxis, ZAxis
join_11 = BrepJoin(Breps=[boundary_2, loft_15])  # -> Breps, Closed
item_23 = ListItem(List=crv_20, Index=cullpt.Indices, Wrap=True)
# BRIDGE_LEFT
area_16 = Area(Geometry=crv_26)  # -> Area, Centroid
# GAGE_LEFT
area_17 = Area(Geometry=crv_27)  # -> Area, Centroid
dist_2 = Distance(PointA=item_22.Item, PointB=item_22.Item1)
crv_28 = Curve(<curve referenced from the Rhino model>)
avr_4 = Average(Input=merge_28)
cullpt_2 = CullDuplicates(Points=area_11.Centroid, Tolerance=0.1, CullMode=1)  # -> Points, Indices, Valence
loft_17 = Loft(Curves=merge_30, Options={Adjust=True, Closed=False, LoftEnds=0, LoftSimp=2, LoftType=3, Rebuild=10, Refit=0.01})
loft_18 = Loft(Curves=merge_31, Options={Adjust=True, Closed=False, LoftEnds=0, LoftSimp=2, LoftType=3, Rebuild=10, Refit=0.01})
loft_19 = Loft(Curves=merge_32, Options={Adjust=True, Closed=False, LoftEnds=0, LoftSimp=2, LoftType=3, Rebuild=10, Refit=0.01})
loft_20 = Loft(Curves=merge_33, Options={Adjust=True, Closed=False, LoftEnds=0, LoftSimp=2, LoftType=3, Rebuild=10, Refit=0.01})
merge_35 = Merge(Data1=rotate_13.Geometry, Data2=chamfer_14)
merge_36 = Merge(Data1=chamfer_14, Data2=polygon_12.Polygon)
cullpt_3 = CullDuplicates(Points=area_12.Centroid, Tolerance=0.1, CullMode=1)  # -> Points, Indices, Valence
cullpt_4 = CullDuplicates(Points=area_13.Centroid, Tolerance=0.1, CullMode=1)  # -> Points, Indices, Valence
cullpt_5 = CullDuplicates(Points=area_14.Centroid, Tolerance=0.1, CullMode=1)  # -> Points, Indices, Valence
cullpt_6 = CullDuplicates(Points=area_15.Centroid, Tolerance=0.1, CullMode=1)  # -> Points, Indices, Valence
area_18 = Area(Geometry=item_23)  # -> Area, Centroid
cullpt_7 = CullDuplicates(Points=area_17.Centroid, Tolerance=0.1, CullMode=1)  # -> Points, Indices, Valence
edges = BrepEdges(Brep=loft_16)  # -> Naked, Interior, NonManifold
cullpt_8 = CullDuplicates(Points=area_16.Centroid, Tolerance=0.1, CullMode=1)  # -> Points, Indices, Valence
project_6 = Project(Geometry=loft_16, Plane=item_4)  # -> Geometry, Transform
rev_6 = Reverse(Vector=deplane_15.XAxis)
item_24 = ListItem(List=debrep_5.Faces, Index=Slider(4, range=0..6), Wrap=True)
item_25 = ListItem(List=debrep_6.Faces, Index=Slider(4, range=0..6), Wrap=True)
subtraction_3 = Subtraction(A=Slider(10000, range=0..100000), B=dist_2)
item_26 = ListItem(List=crv_21, Index=cullpt_2.Indices, Wrap=True)
join_12 = BrepJoin(Breps=[extr_24, loft_18, loft_17])  # -> Breps, Closed
join_13 = BrepJoin(Breps=[extr_25, loft_20, loft_19])  # -> Breps, Closed
item_27 = ListItem(List=crv_22, Index=cullpt_3.Indices, Wrap=True)
item_28 = ListItem(List=crv_23, Index=cullpt_4.Indices, Wrap=True)
item_29 = ListItem(List=crv_24, Index=cullpt_5.Indices, Wrap=True)
item_30 = ListItem(List=crv_25, Index=cullpt_6.Indices, Wrap=True)
alongcrv_3 = SortAlongCurve(Points=area_18.Centroid, Curve=crv_28)  # -> Points, Indices
pl_7 = ConstructPlane(Origin=planar_21.Plane, XAxis=deplane_15.YAxis, YAxis=rev_6)
item_31 = ListItem(List=crv_26, Index=cullpt_8.Indices, Wrap=True)
item_32 = ListItem(List=crv_27, Index=cullpt_7.Indices, Wrap=True)
runion = RegionUnion(Curves=project_6.Geometry)
crv_29 = Curve(edges.Naked)
planar_22 = IsPlanar(Surface=item_24, Interior=True)  # -> Planar, Plane
planar_23 = IsPlanar(Surface=item_25, Interior=True)  # -> Planar, Plane
item_33 = ListItem(List=item_26, Index=0, Wrap=True)
loft_21 = Loft(Curves=merge_35, Options={Adjust=True, Closed=False, LoftEnds=0, LoftSimp=2, LoftType=3, Rebuild=10, Refit=0.01})
loft_22 = Loft(Curves=merge_36, Options={Adjust=True, Closed=False, LoftEnds=0, LoftSimp=2, LoftType=3, Rebuild=10, Refit=0.01})
dom_58 = ConstructDomain(DomainStart=expr("- x / 2", subtraction_3), DomainEnd=expr("x / 2", subtraction_3))
item_34 = ListItem(List=item_27, Index=0, Wrap=True)
item_35 = ListItem(List=item_28, Index=0, Wrap=True)
item_36 = ListItem(List=item_29, Index=0, Wrap=True)
item_37 = ListItem(List=item_30, Index=0, Wrap=True)
orient_4 = Orient(Geometry=merge_34, Source=pl_7, Target=cull)  # -> Geometry, Transform
cap_24 = CapHoles(Brep=extr_21)
cap_25 = CapHoles(Brep=join_12.Breps)
cap_26 = CapHoles(Brep=extr_22)
cap_27 = CapHoles(Brep=join_13.Breps)
item_38 = ListItem(List=item_23, Index=alongcrv_3.Indices, Wrap=True)
item_39 = ListItem(List=item_31, Index=0, Wrap=True)
item_40 = ListItem(List=item_32, Index=0, Wrap=True)
join_14 = JoinCurves(Curves=crv_29, Preserve=False)
flip_3 = FlipCurve(Curve=item_26, Guide=item_33)  # -> Curve, Flag
flip_4 = FlipCurve(Curve=item_27, Guide=item_34)  # -> Curve, Flag
flip_5 = FlipCurve(Curve=item_28, Guide=item_35)  # -> Curve, Flag
flip_6 = FlipCurve(Curve=item_29, Guide=item_36)  # -> Curve, Flag
flip_7 = FlipCurve(Curve=item_30, Guide=item_37)  # -> Curve, Flag
join_15 = BrepJoin(Breps=[extr_26, loft_22, loft_21])  # -> Breps, Closed
loft_23 = Loft(
    Curves=flatten([runion, join_14]),
    Options={Adjust=True, Closed=False, LoftEnds=0, LoftSimp=0, LoftType=3, Rebuild=10, Refit=0.01})
flip_8 = FlipCurve(Curve=item_31, Guide=item_39)  # -> Curve, Flag
flip_9 = FlipCurve(Curve=item_32, Guide=item_40)  # -> Curve, Flag
partition = PartitionList(List=item_38, Size="2")
rectangle_30 = Rectangle(Plane=avr_4, XSize=dom_33, YSize=dom_58, Radius=0)  # -> Rectangle, Length
merge_37 = Merge(Data1=cap_24, Data2=cap_25)
merge_38 = Merge(Data1=cap_26, Data2=cap_27)
area_19 = Area(Geometry=flip_3.Curve)  # -> Area, Centroid
crv_30 = Curve(<curve referenced from the Rhino model>)
area_20 = Area(Geometry=flip_4.Curve)  # -> Area, Centroid
area_21 = Area(Geometry=flip_5.Curve)  # -> Area, Centroid
crv_31 = Curve(<curve referenced from the Rhino model>)
crv_32 = Curve(<curve referenced from the Rhino model>)
area_22 = Area(Geometry=flip_6.Curve)  # -> Area, Centroid
area_23 = Area(Geometry=flip_7.Curve)  # -> Area, Centroid
crv_33 = Curve(<curve referenced from the Rhino model>)
crv_34 = Curve(<curve referenced from the Rhino model>)
cap_28 = CapHoles(Brep=extr_23)
cap_29 = CapHoles(Brep=join_15.Breps)
join_16 = BrepJoin(Breps=flatten([project_6.Geometry, loft_23, loft_16]))  # -> Breps, Closed
area_24 = Area(Geometry=flip_8.Curve)  # -> Area, Centroid
area_25 = Area(Geometry=flip_9.Curve)  # -> Area, Centroid
crv_35 = Curve(<curve referenced from the Rhino model>)
crv_36 = Curve(<curve referenced from the Rhino model>)
area_26 = Area(Geometry=partition)  # -> Area, Centroid
merge_39 = Merge(Data1=merge_25, Data2=move_49.Geometry, Data3=merge_37)
merge_40 = Merge(Data1=merge_26, Data2=move_50.Geometry, Data3=merge_38)
alongcrv_4 = SortAlongCurve(Points=area_19.Centroid, Curve=crv_30)  # -> Points, Indices
alongcrv_5 = SortAlongCurve(Points=area_20.Centroid, Curve=crv_31)  # -> Points, Indices
alongcrv_6 = SortAlongCurve(Points=area_21.Centroid, Curve=crv_32)  # -> Points, Indices
alongcrv_7 = SortAlongCurve(Points=area_22.Centroid, Curve=crv_33)  # -> Points, Indices
alongcrv_8 = SortAlongCurve(Points=area_23.Centroid, Curve=crv_34)  # -> Points, Indices
alongcrv_9 = SortAlongCurve(Points=area_24.Centroid, Curve=crv_36)  # -> Points, Indices
alongcrv_10 = SortAlongCurve(Points=area_25.Centroid, Curve=crv_35)  # -> Points, Indices
deplane_16 = DeconstructPlane(Plane=planar_22.Plane)  # -> Origin, XAxis, YAxis, ZAxis
deplane_17 = DeconstructPlane(Plane=planar_23.Plane)  # -> Origin, XAxis, YAxis, ZAxis
merge_41 = Merge(Data1=move_37.Geometry, Data2=rectangle_30.Rectangle)
merge_42 = Merge(Data1=cap_28, Data2=cap_29)
pdecon_7 = Deconstruct(Point=area_26.Centroid)  # -> XComponent, YComponent, ZComponent
fmerge = MergeFaces(Brep=join_16.Breps)  # -> Breps, Before, After
item_41 = ListItem(List=flip_3.Curve, Index=alongcrv_4.Indices, Wrap=True)  # -> flatten(Item)
item_42 = ListItem(List=flip_4.Curve, Index=alongcrv_5.Indices, Wrap=True)  # -> graft(Item)
item_43 = ListItem(List=flip_5.Curve, Index=alongcrv_6.Indices, Wrap=True)  # -> graft(Item)
item_44 = ListItem(List=flip_6.Curve, Index=alongcrv_7.Indices, Wrap=True)  # -> graft(Item)
item_45 = ListItem(List=flip_7.Curve, Index=alongcrv_8.Indices, Wrap=True)  # -> flatten(Item)
rev_7 = Reverse(Vector=deplane_16.XAxis)
rev_8 = Reverse(Vector=deplane_17.XAxis)
item_46 = ListItem(List=flip_8.Curve, Index=alongcrv_9.Indices, Wrap=True)  # -> graft(Item)
item_47 = ListItem(List=flip_9.Curve, Index=alongcrv_10.Indices, Wrap=True)  # -> graft(Item)
sort_6 = SortList(Keys=pdecon_7.XComponent, ValuesA=partition)  # -> Keys, ValuesA
merge_43 = Merge(Data1=merge_29, Data2=move_53.Geometry, Data3=merge_42)
explode_2 = Explode(Curve=merge_41, Recursive=True)  # -> Segments, Vertices
pl_8 = ConstructPlane(Origin=planar_22.Plane, XAxis=deplane_16.YAxis, YAxis=rev_7)
pl_9 = ConstructPlane(Origin=planar_23.Plane, XAxis=deplane_17.YAxis, YAxis=rev_8)
item_48 = ListItem(List=sort_6.ValuesA, Index=0, Wrap=True)  # -> flatten(Item), flatten(Item1)
shift_3 = ShiftList(List=item_41, Shift=1, Wrap=invert(True))
shift_4 = ShiftList(List=item_45, Shift=1, Wrap=invert(True))
planar_24 = IsPlanar(Surface=item_42, Interior=True)  # -> Planar, Plane
boundary_3 = BoundarySurfaces(Edges=item_42)
planar_25 = IsPlanar(Surface=item_43, Interior=True)  # -> Planar, Plane
boundary_4 = BoundarySurfaces(Edges=item_43)
orient_5 = Orient(Geometry=merge_39, Source=pl_8, Target=cull_5)  # -> Geometry, Transform
orient_6 = Orient(Geometry=merge_40, Source=pl_9, Target=cull_7)  # -> Geometry, Transform
planar_26 = IsPlanar(Surface=item_44, Interior=True)  # -> Planar, Plane
boundary_5 = BoundarySurfaces(Edges=item_44)
len_3 = Length(Curve=explode_2.Segments)
merge_44 = Merge(Data1=fmerge.Breps, Data2=join_5.Breps, Data3=cap)  # -> flatten(Result)
planar_27 = IsPlanar(Surface=item_46, Interior=True)  # -> Planar, Plane
boundary_6 = BoundarySurfaces(Edges=item_46)
planar_28 = IsPlanar(Surface=item_47, Interior=True)  # -> Planar, Plane
boundary_7 = BoundarySurfaces(Edges=item_47)
bbox = BoundingBox(Content=item_42, Plane=planar_24.Plane)  # -> Box, Box_2
bbox_2 = BoundingBox(Content=item_43, Plane=planar_25.Plane)  # -> Box, Box_2
bbox_3 = BoundingBox(Content=item_44, Plane=planar_26.Plane)  # -> Box, Box_2
short_3 = ShortestList(ListA=item_41, ListB=shift_3, TrimMode=2)  # -> ListA, ListB
short_4 = ShortestList(ListA=item_45, ListB=shift_4, TrimMode=2)  # -> ListA, ListB
bbox_4 = BoundingBox(Content=item_46, Plane=planar_27.Plane)  # -> Box, Box_2
bbox_5 = BoundingBox(Content=item_47, Plane=planar_28.Plane)  # -> Box, Box_2
sort_7 = SortList(Keys=len_3, ValuesA=explode_2.Segments)  # -> Keys, ValuesA
rec = Rectangle(bbox.Box)
rec_2 = Rectangle(bbox_2.Box)
shift_5 = ShiftList(List=item_48.Item, Shift=1, Wrap=invert(True))
rec_3 = Rectangle(bbox_3.Box)
merge_45 = Merge(Data1=graft(short_3.ListA), Data2=graft(short_3.ListB))
merge_46 = Merge(Data1=graft(short_4.ListA), Data2=graft(short_4.ListB))
shift_6 = ShiftList(List=item_48.Item1, Shift=1, Wrap=invert(True))
rec_4 = Rectangle(bbox_4.Box)
rec_5 = Rectangle(bbox_5.Box)
item_49 = ListItem(List=sort_7.ValuesA, Index=0, Wrap=True)  # -> Item, Item1
srf_6 = Surface(flatten(rec))
srf_7 = Surface(flatten(rec_2))
srf_8 = Surface(flatten(rec_3))
srf_9 = Surface(flatten(rec_4))
srf_10 = Surface(flatten(rec_5))
short_5 = ShortestList(ListA=item_48.Item, ListB=shift_5, TrimMode=2)  # -> ListA, ListB
item_50 = ListItem(List=merge_45, Index=0, Wrap=True)  # -> Item, Item1
item_51 = ListItem(List=merge_46, Index=0, Wrap=True)  # -> Item, Item1
short_6 = ShortestList(ListA=item_48.Item1, ListB=shift_6, TrimMode=2)  # -> ListA, ListB
shift_7 = ShiftList(List=srf_6, Shift=1, Wrap=invert(True))
shift_8 = ShiftList(List=srf_7, Shift=1, Wrap=invert(True))
shift_9 = ShiftList(List=srf_8, Shift=1, Wrap=invert(True))
merge_47 = Merge(Data1=item_49.Item, Data2=item_49.Item1)  # -> flatten(Result)
loft_24 = Loft(Curves=srf_9, Options={Adjust=True, Closed=False, LoftEnds=0, LoftSimp=0, LoftType=3, Rebuild=10, Refit=0.01})
shift_10 = ShiftList(List=srf_9, Shift=1, Wrap=invert(True))
shift_11 = ShiftList(List=srf_10, Shift=1, Wrap=invert(True))
merge_48 = Merge(Data1=graft(short_5.ListA), Data2=graft(short_5.ListB))
merge_49 = Merge(Data1=graft(short_6.ListA), Data2=graft(short_6.ListB))
rulesrf = RuledSurface(CurveA=item_50.Item, CurveB=item_50.Item1)
rulesrf_2 = RuledSurface(CurveA=item_51.Item, CurveB=item_51.Item1)
cap_30 = CapHoles(Brep=loft_24)
short_7 = ShortestList(ListA=srf_6, ListB=shift_7, TrimMode=2)  # -> ListA, ListB
short_8 = ShortestList(ListA=srf_7, ListB=shift_8, TrimMode=2)  # -> ListA, ListB
midpt_4 = CurveMiddle(Curve=merge_47)
short_9 = ShortestList(ListA=srf_8, ListB=shift_9, TrimMode=2)  # -> ListA, ListB
short_10 = ShortestList(ListA=srf_9, ListB=shift_10, TrimMode=2)  # -> ListA, ListB
short_11 = ShortestList(ListA=srf_10, ListB=shift_11, TrimMode=2)  # -> ListA, ListB
join_17 = BrepJoin(Breps=flatten(rulesrf))  # -> Breps, Closed
join_18 = BrepJoin(Breps=flatten(rulesrf_2))  # -> Breps, Closed
item_52 = ListItem(List=merge_48, Index=0, Wrap=True)  # -> Item, Item1
item_53 = ListItem(List=merge_49, Index=0, Wrap=True)  # -> Item, Item1
merge_50 = Merge(Data1=graft(short_7.ListA), Data2=graft(short_7.ListB))
merge_51 = Merge(Data1=graft(short_8.ListA), Data2=graft(short_8.ListB))
merge_52 = Merge(Data1=graft(short_9.ListA), Data2=graft(short_9.ListB))
pdecon_8 = Deconstruct(Point=midpt_4)  # -> XComponent, YComponent, ZComponent
merge_53 = Merge(Data1=graft(short_10.ListA), Data2=graft(short_10.ListB))
merge_54 = Merge(Data1=graft(short_11.ListA), Data2=graft(short_11.ListB))
cap_31 = CapHoles(Brep=join_17.Breps)
cap_32 = CapHoles(Brep=join_18.Breps)
rulesrf_3 = RuledSurface(CurveA=item_52.Item, CurveB=item_52.Item1)
rulesrf_4 = RuledSurface(CurveA=item_53.Item, CurveB=item_53.Item1)
item_54 = ListItem(List=merge_50, Index=0, Wrap=True)  # -> Item, Item1
item_55 = ListItem(List=merge_51, Index=0, Wrap=True)  # -> Item, Item1
item_56 = ListItem(List=merge_52, Index=0, Wrap=True)  # -> Item, Item1
item_57 = ListItem(List=merge_53, Index=0, Wrap=True)  # -> Item, Item1
item_58 = ListItem(List=merge_54, Index=0, Wrap=True)  # -> Item, Item1
sort_8 = SortList(Keys=pdecon_8.YComponent, ValuesA=merge_47)  # -> Keys, ValuesA
join_19 = BrepJoin(Breps=flatten(rulesrf_3))  # -> Breps, Closed
join_20 = BrepJoin(Breps=flatten(rulesrf_4))  # -> Breps, Closed
rulesrf_5 = RuledSurface(CurveA=item_54.Item, CurveB=item_54.Item1)
rulesrf_6 = RuledSurface(CurveA=item_55.Item, CurveB=item_55.Item1)
rulesrf_7 = RuledSurface(CurveA=item_56.Item, CurveB=item_56.Item1)
rulesrf_8 = RuledSurface(CurveA=item_57.Item, CurveB=item_57.Item1)
rulesrf_9 = RuledSurface(CurveA=item_58.Item, CurveB=item_58.Item1)
loft_25 = Loft(Curves=sort_8.ValuesA, Options={Adjust=True, Closed=False, LoftEnds=0, LoftSimp=0, LoftType=3, Rebuild=10, Refit=0.01})
cap_33 = CapHoles(Brep=join_19.Breps)
panel_11 = Panel(cap_32)
cap_34 = CapHoles(Brep=join_20.Breps)
join_21 = BrepJoin(Breps=flatten(rulesrf_5))  # -> Breps, Closed
join_22 = BrepJoin(Breps=flatten(rulesrf_6))  # -> Breps, Closed
join_23 = BrepJoin(Breps=flatten(rulesrf_7))  # -> Breps, Closed
join_24 = BrepJoin(Breps=flatten(rulesrf_8))  # -> Breps, Closed
join_25 = BrepJoin(Breps=flatten(rulesrf_9))  # -> Breps, Closed
crv_37 = Curve(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)
cap_35 = CapHoles(Brep=join_21.Breps)
cap_36 = CapHoles(Brep=join_22.Breps)
edges_2 = BrepEdges(Brep=loft_25)  # -> Naked, Interior, NonManifold
cap_37 = CapHoles(Brep=join_23.Breps)
project_7 = Project(Geometry=loft_25, Plane=item_20)  # -> Geometry, Transform
cap_38 = CapHoles(Brep=join_24.Breps)
cap_39 = CapHoles(Brep=join_25.Breps)
divlength_8 = DivideLength(Curve=crv_37, Length=Slider(40000, range=0..1000000))  # -> Points, Tangents, Parameters
Z_47 = UnitZ(Factor=1)
panel_12 = Panel(cap_31)
runion_2 = RegionUnion(Curves=project_7.Geometry)
crv_38 = Curve(edges_2.Naked)
panel_13 = Panel(cap_35)
panel_14 = Panel(cap_36)
panel_15 = Panel(cap_37)
panel_16 = Panel(cap_38)
panel_17 = Panel(cap_39)
hframe_6 = HorizontalFrame(Curve=crv_37, Parameter=divlength_8.Parameters)
rev_9 = Reverse(Vector=Z_47)
srf_11 = Surface(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)
join_26 = JoinCurves(Curves=crv_38, Preserve=False)
loft_26 = Loft(
    Curves=flatten([runion_2, join_26]),
    Options={Adjust=True, Closed=False, LoftEnds=0, LoftSimp=0, LoftType=3, Rebuild=10, Refit=0.01})
project_8 = ProjectPoint(Point=hframe_6, Direction=rev_9, Geometry=srf_11)  # -> Point, Index
join_27 = BrepJoin(Breps=flatten([project_7.Geometry, loft_26, loft_25]))  # -> Breps, Closed
null_6 = NullItem(Item=project_8.Point)  # -> NullFlags, InvalidFlags, Description
cull_11 = CullPattern(List=hframe_6, CullPattern=invert(null_6.NullFlags))  # -> graft(List)
cull_12 = CullPattern(List=project_8.Point, CullPattern=invert(null_6.NullFlags))  # -> graft(List)
fmerge_2 = MergeFaces(Brep=join_27.Breps)  # -> Breps, Before, After
Z_48 = UnitZ(Factor=Slider(3000, range=0..10000))
debrep_7 = DeconstructBrep(Brep=fmerge_2.Breps)  # -> Faces, Edges, Vertices
move_54 = Move(Geometry=cull_12, Motion=Z_48)  # -> Geometry, Transform
vec2pt_6 = Vector2Pt(PointA=move_54.Geometry, PointB=cull_11, Unitize=False)  # -> Vector, Length
merge_55 = Merge(Data1=fmerge_2.Breps, Data2=join_11.Breps, Data3=move_28.Geometry)  # -> flatten(Result)
item_59 = ListItem(List=debrep_7.Faces, Index=Slider(16, range=0..100), Wrap=True)
pl_origin_4 = PlaneOrigin(Base=cull_11, Origin=move_54.Geometry)
vlen_6 = VectorLength(Vector=vec2pt_6.Vector)
number_slider_69 = Slider(3500, range=0..100000)
planar_29 = IsPlanar(Surface=item_59, Interior=True)  # -> Planar, Plane
panel_18 = Panel(vlen_6)
number_slider_70 = Slider(9000, range=0..100000)
number_slider_71 = Slider(1750, range=0..100000)
deplane_18 = DeconstructPlane(Plane=planar_29.Plane)  # -> Origin, XAxis, YAxis, ZAxis
Z_49 = UnitZ(Factor="-10000")
cir_15 = Circle(Plane=pl_origin_4, Radius=number_slider_69)
rev_10 = Reverse(Vector=deplane_18.XAxis)
number_slider_72 = Slider(4250, range=0..100000)
pl_10 = ConstructPlane(Origin=planar_29.Plane, XAxis=deplane_18.YAxis, YAxis=deplane_18.XAxis)
extr_27 = Extrude(Base=cir_15, Direction=Z_49)
expression_23 = Expression(x="8", Expression="2 * pi / x / 2")
Z_50 = UnitZ(Factor=vlen_6)
orient_7 = Orient(Geometry=merge_55, Source=pl_10, Target=cull_3)  # -> Geometry, Transform
dom_59 = ConstructDomain(DomainStart=expr("-x/2", number_slider_70), DomainEnd=expr("x / 2", number_slider_70))
expression_24 = Expression(x=number_slider_69, y=number_slider_72, Expression="6350 + x + y")
move_55 = Move(Geometry=pl_origin_4, Motion=Z_50)  # -> Geometry, Transform
division_7 = Division(A=number_slider_72, B=Slider(2, range=0..10))
polygon_13 = Polygon(Plane=pl_origin_4, Radius=number_slider_71, Segments="8", FilletRadius=0)  # -> Polygon, Length
dom_60 = ConstructDomain(DomainStart=expr("-x/2", number_slider_71), DomainEnd=expr("x / 2", number_slider_71))
number_slider_73 = Slider(12000, range=0..1000000)
rectangle_31 = Rectangle(Plane=move_55.Geometry, XSize=dom_60, YSize=dom_59, Radius=0)  # -> Rectangle, Length
number_slider_74 = Slider(2400, range=0..100000)
number_slider_75 = Slider(17500, range=0..100000)
rotate_14 = Rotate(Geometry=rectangle_31.Rectangle, Angle=expression_23, Plane=move_55.Geometry)  # -> Geometry, Transform
multiplication_14 = Multiplication(A=Z_50, B=Slider(1, range=0..1))
Z_51 = UnitZ(Factor=expr("-x / sqrt(2)", number_slider_71))
expression_25 = Expression(x=number_slider_69, y=expression_23, Expression="x * Cos(y)")
planar_30 = IsPlanar(Surface=rotate_14.Geometry, Interior=True)  # -> Planar, Plane
deplane_19 = DeconstructPlane(Plane=planar_30.Plane)  # -> Origin, XAxis, YAxis, ZAxis
xy_13 = XYPlane(Origin=cir_15)
brep_4 = Brep([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])
brep_5 = Brep([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])
amp_9 = Amplitude(Vector=deplane_19.YAxis, Amplitude=expression_24)
extr_28 = Extrude(Base=rotate_14.Geometry, Direction=expr("-x", Z_51))
brep_6 = Brep([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])
dom_61 = ConstructDomain(DomainStart=expr("-x/2", number_slider_71), DomainEnd=expr("x / 2", number_slider_71))
dom_62 = ConstructDomain(DomainStart=expr("-x/2", number_slider_73), DomainEnd=expr("x / 2", number_slider_73))
move_56 = Move(Geometry=planar_30.Plane, Motion=Z_51)  # -> Geometry, Transform
dom_63 = ConstructDomain(DomainStart=expr("-x/2", expression_25), DomainEnd=expr("x / 2", expression_25))
debrep_8 = DeconstructBrep(Brep=brep_4)  # -> Faces, Edges, Vertices
debrep_9 = DeconstructBrep(Brep=brep_5)  # -> Faces, Edges, Vertices
dom_64 = ConstructDomain(DomainStart=expr("-x/2", number_slider_74), DomainEnd=expr("x / 2", number_slider_74))
debrep_10 = DeconstructBrep(Brep=brep_6)  # -> Faces, Edges, Vertices
move_57 = Move(Geometry=pl_origin_4, Motion=amp_9)  # -> Geometry, Transform
area_27 = Area(Geometry=debrep_8.Faces)  # -> Area, Centroid
area_28 = Area(Geometry=debrep_9.Faces)  # -> Area, Centroid
rectangle_32 = Rectangle(Plane=move_56.Geometry, XSize=dom_61, YSize=dom_63, Radius=0)  # -> Rectangle, Length
move_58 = Move(Geometry=move_57.Geometry, Motion=multiplication_14)  # -> Geometry, Transform
area_29 = Area(Geometry=debrep_10.Faces)  # -> Area, Centroid
rectangle_33 = Rectangle(Plane=move_58.Geometry, XSize=dom_64, YSize=dom_62, Radius=0)  # -> Rectangle, Length
pdecon_9 = Deconstruct(Point=area_27.Centroid)  # -> XComponent, YComponent, ZComponent
pdecon_10 = Deconstruct(Point=area_28.Centroid)  # -> XComponent, YComponent, ZComponent
cir_16 = Circle(Plane=move_57.Geometry, Radius=number_slider_72)
pdecon_11 = Deconstruct(Point=area_29.Centroid)  # -> XComponent, YComponent, ZComponent
expression_26 = Expression(x=number_slider_72, y=expression_23, Expression="x * Cos(y)")
dom_65 = ConstructDomain(DomainStart=expr("-x/2", division_7), DomainEnd=expr("x / 2", division_7))
sort_9 = SortList(Keys=pdecon_9.ZComponent, ValuesA=debrep_8.Faces)  # -> Keys, reverse(ValuesA)
sort_10 = SortList(Keys=pdecon_10.ZComponent, ValuesA=debrep_9.Faces)  # -> Keys, reverse(ValuesA)
chamfer_15 = Chamfer(Poly=rectangle_32.Rectangle, Chamfer=Slider(-200, range=-5000..0))
merge_56 = Merge(Data1=polygon_13.Polygon, Data2=chamfer_15, Data3=rotate_14.Geometry)
rotate_15 = Rotate(Geometry=move_57.Geometry, Angle=expression_23, Plane=move_57.Geometry)  # -> Geometry, Transform
rotate_16 = Rotate(Geometry=rectangle_33.Rectangle, Angle=expression_23, Plane=move_58.Geometry)  # -> Geometry, Transform
extr_29 = Extrude(Base=cir_16, Direction=Z_49)
crv_39 = Curve([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])
crv_40 = Curve([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])
sort_11 = SortList(Keys=pdecon_11.ZComponent, ValuesA=debrep_10.Faces)  # -> Keys, reverse(ValuesA)
multiplication_15 = Multiplication(A=Z_50, B=Slider(0, range=0..1))
crv_41 = Curve([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])
Z_52 = UnitZ(Factor=expr("-x / sqrt(2)", number_slider_71))
item_60 = ListItem(List=sort_9.ValuesA, Index=0, Wrap=True)
planar_31 = IsPlanar(Surface=rotate_16.Geometry, Interior=True)  # -> Planar, Plane
item_61 = ListItem(List=sort_10.ValuesA, Index=0, Wrap=True)
item_62 = ListItem(List=crv_39, Index=Slider(7, range=0..100), Wrap=True)
item_63 = ListItem(List=crv_40, Index=Slider(7, range=0..100), Wrap=True)
loft_27 = Loft(Curves=merge_56, Options={Adjust=True, Closed=False, LoftEnds=0, LoftSimp=0, LoftType=3, Rebuild=10, Refit=0.01})
item_64 = ListItem(List=sort_11.ValuesA, Index=0, Wrap=True)
polygon_14 = Polygon(Plane=move_57.Geometry, Radius=number_slider_74, Segments="8", FilletRadius=0)  # -> Polygon, Length
item_65 = ListItem(List=crv_41, Index=Slider(7, range=0..100), Wrap=True)
join_28 = BrepJoin(Breps=[extr_28, loft_27])  # -> Breps, Closed
item_66 = ListItem(List=flatten(item_60), Index=0, Wrap=True)
item_67 = ListItem(List=flatten(item_61), Index=0, Wrap=True)
move_59 = Move(Geometry=planar_31.Plane, Motion=Z_52)  # -> Geometry, Transform
planar_32 = IsPlanar(Surface=item_60, Interior=True)  # -> Planar, Plane
planar_33 = IsPlanar(Surface=item_61, Interior=True)  # -> Planar, Plane
dom_66 = ConstructDomain(DomainStart=expr("-x/2", expression_26), DomainEnd=expr("x / 2", expression_26))
planar_34 = IsPlanar(Surface=item_62, Interior=True)  # -> Planar, Plane
planar_35 = IsPlanar(Surface=item_63, Interior=True)  # -> Planar, Plane
planar_36 = IsPlanar(Surface=item_64, Interior=True)  # -> Planar, Plane
planar_37 = IsPlanar(Surface=item_65, Interior=True)  # -> Planar, Plane
panel_19 = Panel(crv_39)
deplane_20 = DeconstructPlane(Plane=planar_32.Plane)  # -> Origin, XAxis, YAxis, ZAxis
panel_20 = Panel(crv_40)
cap_40 = CapHoles(Brep=extr_27)
cap_41 = CapHoles(Brep=join_28.Breps)
deplane_21 = DeconstructPlane(Plane=planar_33.Plane)  # -> Origin, XAxis, YAxis, ZAxis
area_30 = Area(Geometry=item_66)  # -> Area, Centroid
panel_21 = Panel(crv_41)
area_31 = Area(Geometry=item_67)  # -> Area, Centroid
deplane_22 = DeconstructPlane(Plane=planar_34.Plane)  # -> Origin, XAxis, YAxis, ZAxis
deplane_23 = DeconstructPlane(Plane=planar_35.Plane)  # -> Origin, XAxis, YAxis, ZAxis
deplane_24 = DeconstructPlane(Plane=planar_36.Plane)  # -> Origin, XAxis, YAxis, ZAxis
rectangle_34 = Rectangle(Plane=move_59.Geometry, XSize=dom_65, YSize=dom_66, Radius=0)  # -> Rectangle, Length
deplane_25 = DeconstructPlane(Plane=planar_37.Plane)  # -> Origin, XAxis, YAxis, ZAxis
merge_57 = Merge(Data1=cap_40, Data2=cap_41)
neg_7 = Negative(Value=deplane_22.YAxis)
neg_8 = Negative(Value=deplane_21.XAxis)
extr_30 = Extrude(Base=rotate_16.Geometry, Direction=expr("-x", Z_52))
neg_9 = Negative(Value=deplane_23.YAxis)
pdecon_12 = Deconstruct(Point=area_30.Centroid)  # -> XComponent, YComponent, ZComponent
pdecon_13 = Deconstruct(Point=area_31.Centroid)  # -> XComponent, YComponent, ZComponent
neg_10 = Negative(Value=deplane_25.YAxis)
pl_11 = ConstructPlane(Origin=deplane_20.Origin, XAxis=deplane_20.ZAxis, YAxis=deplane_20.XAxis)
pl_12 = ConstructPlane(Origin=deplane_22.Origin, XAxis=neg_7, YAxis=deplane_22.XAxis)
pl_13 = ConstructPlane(Origin=deplane_23.Origin, XAxis=neg_9, YAxis=deplane_23.XAxis)
pl_14 = ConstructPlane(Origin=deplane_21.Origin, XAxis=deplane_21.ZAxis, YAxis=deplane_21.XAxis)
pl_15 = ConstructPlane(Origin=deplane_25.Origin, XAxis=neg_10, YAxis=deplane_25.XAxis)
move_60 = Move(Geometry=merge_57, Motion=expr("2 * x", amp_9))  # -> Geometry, Transform
chamfer_16 = Chamfer(Poly=rectangle_34.Rectangle, Chamfer=Slider(-100, range=-5000..0))
cap_42 = CapHoles(Brep=extr_30)
pl_16 = ConstructPlane(Origin=deplane_24.Origin, XAxis=deplane_24.ZAxis, YAxis=deplane_24.XAxis)
subtraction_4 = Subtraction(A=pdecon_12.ZComponent, B=pdecon_13.ZComponent)
abs_2 = Absolute()
move_61 = Move(Geometry=cap_42, Motion=multiplication_15)  # -> Geometry, Transform
addition_2 = Addition(A=subtraction_4, B=Slider(3000, range=0..10000))
merge_58 = Merge(Data1=rotate_16.Geometry, Data2=chamfer_16)
merge_59 = Merge(Data1=chamfer_16, Data2=polygon_14.Polygon)
panel_22 = Panel(subtraction_4)
orient_8 = Orient(Geometry=crv_39, Source=pl_12, Target=pl_11)  # -> Geometry, Transform
orient_9 = Orient(Geometry=crv_40, Source=pl_13, Target=pl_14)  # -> Geometry, Transform
orient_10 = Orient(Geometry=crv_41, Source=pl_15, Target=pl_16)  # -> Geometry, Transform
debrep_11 = DeconstructBrep(Brep=move_61.Geometry)  # -> Faces, Edges, Vertices
Z_53 = UnitZ(Factor=Slider(3000, range=0..10000))
Z_54 = UnitZ(Factor=addition_2)
Z_55 = UnitZ(Factor=Slider(3000, range=0..10000))
loft_28 = Loft(Curves=merge_58, Options={Adjust=True, Closed=False, LoftEnds=0, LoftSimp=2, LoftType=3, Rebuild=10, Refit=0.01})
loft_29 = Loft(Curves=merge_59, Options={Adjust=True, Closed=False, LoftEnds=0, LoftSimp=2, LoftType=3, Rebuild=10, Refit=0.01})
item_68 = ListItem(List=debrep_11.Faces, Index=Slider(4, range=0..6), Wrap=True)
move_62 = Move(Geometry=orient_8.Geometry, Motion=Z_53)  # -> Geometry, Transform
move_63 = Move(Geometry=orient_9.Geometry, Motion=Z_54)  # -> Geometry, Transform
move_64 = Move(Geometry=orient_10.Geometry, Motion=Z_55)  # -> Geometry, Transform
join_29 = BrepJoin(Breps=[extr_30, loft_29, loft_28])  # -> Breps, Closed
planar_38 = IsPlanar(Surface=item_68, Interior=True)  # -> Planar, Plane
cap_43 = CapHoles(Brep=extr_29)
cap_44 = CapHoles(Brep=join_29.Breps)
item_69 = ListItem(List=move_63.Geometry, Index=0, Wrap=True)  # -> Item, Item1, Item2, Item3, Item4, Item5, Item6, Item7, Item8, Item9
item_70 = ListItem(List=move_62.Geometry, Index=0, Wrap=True)  # -> Item, Item1, Item2, Item3, Item4, Item5, Item6, Item7, Item8, Item9
item_71 = ListItem(List=move_64.Geometry, Index=Slider(7, range=0..100), Wrap=True)
item_72 = ListItem(List=move_64.Geometry, Index=0, Wrap=True)  # -> Item, Item1, Item2, Item3, Item4, Item5, Item6, Item7, Item8, Item9
merge_60 = Merge(Data1=cap_43, Data2=cap_44)
crv_42 = Curve(item_69.Item)
crv_43 = Curve(item_69.Item1)
crv_44 = Curve(item_69.Item4)
crv_45 = Curve(item_69.Item5)
crv_46 = Curve(item_69.Item6)
crv_47 = Curve(item_69.Item7)
crv_48 = Curve(item_69.Item8)
crv_49 = Curve(item_69.Item9)
crv_50 = Curve(item_70.Item)
crv_51 = Curve(item_70.Item1)
crv_52 = Curve(item_70.Item4)
crv_53 = Curve(item_70.Item5)
crv_54 = Curve(item_70.Item6)
crv_55 = Curve(item_70.Item7)
crv_56 = Curve(item_70.Item8)
crv_57 = Curve(item_70.Item9)
loft_30 = Loft(
    Curves=flatten(item_71),
    Options={Adjust=False, Closed=False, LoftEnds=0, LoftSimp=0, LoftType=0, Rebuild=10, Refit=0.01})
crv_58 = Curve(item_72.Item)
crv_59 = Curve(item_72.Item1)
crv_60 = Curve(item_72.Item4)
crv_61 = Curve(item_72.Item5)
crv_62 = Curve(item_72.Item6)
crv_63 = Curve(item_72.Item7)
crv_64 = Curve(item_72.Item8)
crv_65 = Curve(item_72.Item9)
merge_61 = Merge(Data1=merge_57, Data2=move_60.Geometry, Data3=merge_60)
deplane_26 = DeconstructPlane(Plane=planar_38.Plane)  # -> Origin, XAxis, YAxis, ZAxis
rev_11 = Reverse(Vector=deplane_26.XAxis)
pl_17 = ConstructPlane(Origin=planar_38.Plane, XAxis=deplane_26.YAxis, YAxis=rev_11)
orient_11 = Orient(Geometry=merge_61, Source=pl_17, Target=cull_11)  # -> Geometry, Transform
crv_66 = Curve(flatten([<curve referenced from the Rhino model> x47]))
crv_67 = Curve(flatten([<curve referenced from the Rhino model> x91]))
area_32 = Area(Geometry=crv_67)  # -> Area, Centroid
disc_6 = Discontinuity(Curve=crv_66, Level=1)  # -> Points, Parameters
crv_68 = Curve(flatten([<curve referenced from the Rhino model> x44]))
crv_69 = Curve(flatten([<curve referenced from the Rhino model> x44]))
crv_70 = Curve(flatten([<curve referenced from the Rhino model> x43]))
crv_71 = Curve(flatten([<curve referenced from the Rhino model> x44]))
crv_72 = Curve(flatten([<curve referenced from the Rhino model> x44]))
# 방지턱_LEFT
pline_2 = PolyLine(Vertices=disc_6.Points, Closed=invert(False))  # -> flatten(Polyline)
cullpt_9 = CullDuplicates(Points=area_32.Centroid, Tolerance=0.1, CullMode=1)  # -> Points, Indices, Valence
crv_73 = Curve(flatten([<curve referenced from the Rhino model> x44]))
crv_74 = Curve(flatten([<curve referenced from the Rhino model> x44]))
avr_5 = Average(Input=disc_6.Points)  # -> flatten(ArithmeticMean)
# 인방_LEFT
area_33 = Area(Geometry=crv_68)  # -> Area, Centroid
area_34 = Area(Geometry=crv_69)  # -> Area, Centroid
# TRINGLE_LEFT
area_35 = Area(Geometry=crv_70)  # -> Area, Centroid
# GAGE_right
area_36 = Area(Geometry=crv_71)  # -> Area, Centroid
# 지하철난간_LEFT
area_37 = Area(Geometry=crv_72)  # -> Area, Centroid
item_73 = ListItem(List=crv_67, Index=cullpt_9.Indices, Wrap=True)
# BRIDGE_LEFT
area_38 = Area(Geometry=crv_73)  # -> Area, Centroid
# GAGE_RIGHT
area_39 = Area(Geometry=crv_74)  # -> Area, Centroid
cls = Closed(Curve=pline_2)  # -> Closed, Periodic
# 지하철난간_LEFT
cset = CreateSet(List=cls.Closed)  # -> Set, Map
crv_75 = Curve(<curve referenced from the Rhino model>)
cullpt_10 = CullDuplicates(Points=area_33.Centroid, Tolerance=0.1, CullMode=1)  # -> Points, Indices, Valence
cullpt_11 = CullDuplicates(Points=area_34.Centroid, Tolerance=0.1, CullMode=1)  # -> Points, Indices, Valence
cullpt_12 = CullDuplicates(Points=area_35.Centroid, Tolerance=0.1, CullMode=1)  # -> Points, Indices, Valence
cullpt_13 = CullDuplicates(Points=area_36.Centroid, Tolerance=0.1, CullMode=1)  # -> Points, Indices, Valence
cullpt_14 = CullDuplicates(Points=area_37.Centroid, Tolerance=0.1, CullMode=1)  # -> Points, Indices, Valence
area_40 = Area(Geometry=item_73)  # -> Area, Centroid
cullpt_15 = CullDuplicates(Points=area_39.Centroid, Tolerance=0.1, CullMode=1)  # -> Points, Indices, Valence
cullpt_16 = CullDuplicates(Points=avr_5, Tolerance=0.1, CullMode=1)  # -> Points, Indices, Valence
cullpt_17 = CullDuplicates(Points=area_38.Centroid, Tolerance=0.1, CullMode=1)  # -> Points, Indices, Valence
item_74 = ListItem(List=crv_68, Index=cullpt_10.Indices, Wrap=True)
area_41 = Area(Geometry=pline_2)  # -> Area, Centroid
item_75 = ListItem(List=pline_2, Index=cullpt_16.Indices, Wrap=True)
item_76 = ListItem(List=crv_69, Index=cullpt_11.Indices, Wrap=True)
item_77 = ListItem(List=crv_70, Index=cullpt_12.Indices, Wrap=True)
item_78 = ListItem(List=crv_71, Index=cullpt_13.Indices, Wrap=True)
item_79 = ListItem(List=crv_72, Index=cullpt_14.Indices, Wrap=True)
alongcrv_11 = SortAlongCurve(Points=area_40.Centroid, Curve=crv_75)  # -> Points, Indices
item_80 = ListItem(List=crv_73, Index=cullpt_17.Indices, Wrap=True)
item_81 = ListItem(List=crv_74, Index=cullpt_15.Indices, Wrap=True)
item_82 = ListItem(List=item_74, Index=0, Wrap=True)
item_83 = ListItem(List=item_75, Index=0, Wrap=True)
item_84 = ListItem(List=item_76, Index=0, Wrap=True)
item_85 = ListItem(List=item_77, Index=0, Wrap=True)
item_86 = ListItem(List=item_78, Index=0, Wrap=True)
item_87 = ListItem(List=item_79, Index=0, Wrap=True)
item_88 = ListItem(List=item_73, Index=alongcrv_11.Indices, Wrap=True)
item_89 = ListItem(List=item_80, Index=0, Wrap=True)
item_90 = ListItem(List=item_81, Index=0, Wrap=True)
flip_10 = FlipCurve(Curve=item_74, Guide=item_82)  # -> Curve, Flag
panel_23 = Panel(cls.Closed)
flip_11 = FlipCurve(Curve=item_75, Guide=item_83)  # -> Curve, Flag
flip_12 = FlipCurve(Curve=item_76, Guide=item_84)  # -> Curve, Flag
flip_13 = FlipCurve(Curve=item_77, Guide=item_85)  # -> Curve, Flag
flip_14 = FlipCurve(Curve=item_78, Guide=item_86)  # -> Curve, Flag
flip_15 = FlipCurve(Curve=item_79, Guide=item_87)  # -> Curve, Flag
flip_16 = FlipCurve(Curve=item_80, Guide=item_89)  # -> Curve, Flag
flip_17 = FlipCurve(Curve=item_81, Guide=item_90)  # -> Curve, Flag
partition_2 = PartitionList(List=item_88, Size="2")
area_42 = Area(Geometry=flip_10.Curve)  # -> Area, Centroid
crv_76 = Curve(<curve referenced from the Rhino model>)
area_43 = Area(Geometry=flip_11.Curve)  # -> Area, Centroid
area_44 = Area(Geometry=flip_12.Curve)  # -> Area, Centroid
area_45 = Area(Geometry=flip_13.Curve)  # -> Area, Centroid
crv_77 = Curve(<curve referenced from the Rhino model>)
crv_78 = Curve(<curve referenced from the Rhino model>)
crv_79 = Curve(<curve referenced from the Rhino model>)
area_46 = Area(Geometry=flip_14.Curve)  # -> Area, Centroid
area_47 = Area(Geometry=flip_15.Curve)  # -> Area, Centroid
crv_80 = Curve(<curve referenced from the Rhino model>)
crv_81 = Curve(<curve referenced from the Rhino model>)
area_48 = Area(Geometry=flip_16.Curve)  # -> Area, Centroid
area_49 = Area(Geometry=flip_17.Curve)  # -> Area, Centroid
crv_82 = Curve(<curve referenced from the Rhino model>)
crv_83 = Curve(<curve referenced from the Rhino model>)
area_50 = Area(Geometry=partition_2)  # -> Area, Centroid
alongcrv_12 = SortAlongCurve(Points=area_42.Centroid, Curve=crv_76)  # -> Points, Indices
alongcrv_13 = SortAlongCurve(Points=area_43.Centroid, Curve=crv_77)  # -> Points, Indices
alongcrv_14 = SortAlongCurve(Points=area_44.Centroid, Curve=crv_78)  # -> Points, Indices
alongcrv_15 = SortAlongCurve(Points=area_45.Centroid, Curve=crv_79)  # -> Points, Indices
alongcrv_16 = SortAlongCurve(Points=area_46.Centroid, Curve=crv_80)  # -> Points, Indices
alongcrv_17 = SortAlongCurve(Points=area_47.Centroid, Curve=crv_81)  # -> Points, Indices
alongcrv_18 = SortAlongCurve(Points=area_48.Centroid, Curve=crv_82)  # -> Points, Indices
alongcrv_19 = SortAlongCurve(Points=area_49.Centroid, Curve=crv_83)  # -> Points, Indices
pdecon_14 = Deconstruct(Point=area_50.Centroid)  # -> XComponent, YComponent, ZComponent
item_91 = ListItem(List=flip_10.Curve, Index=alongcrv_12.Indices, Wrap=True)  # -> flatten(Item)
item_92 = ListItem(List=flip_11.Curve, Index=alongcrv_13.Indices, Wrap=True)  # -> flatten(Item)
item_93 = ListItem(List=flip_12.Curve, Index=alongcrv_14.Indices, Wrap=True)  # -> graft(Item)
item_94 = ListItem(List=flip_13.Curve, Index=alongcrv_15.Indices, Wrap=True)  # -> graft(Item)
item_95 = ListItem(List=flip_14.Curve, Index=alongcrv_16.Indices, Wrap=True)  # -> graft(Item)
item_96 = ListItem(List=flip_15.Curve, Index=alongcrv_17.Indices, Wrap=True)  # -> flatten(Item)
item_97 = ListItem(List=flip_16.Curve, Index=alongcrv_18.Indices, Wrap=True)  # -> graft(Item)
item_98 = ListItem(List=flip_17.Curve, Index=alongcrv_19.Indices, Wrap=True)  # -> graft(Item)
sort_12 = SortList(Keys=pdecon_14.XComponent, ValuesA=partition_2)  # -> Keys, ValuesA
item_99 = ListItem(List=sort_12.ValuesA, Index=0, Wrap=True)  # -> flatten(Item), flatten(Item1)
shift_12 = ShiftList(List=item_92, Shift=1, Wrap=invert(True))
shift_13 = ShiftList(List=item_91, Shift=1, Wrap=invert(True))
shift_14 = ShiftList(List=item_96, Shift=1, Wrap=invert(True))
planar_39 = IsPlanar(Surface=item_93, Interior=True)  # -> Planar, Plane
boundary_8 = BoundarySurfaces(Edges=item_93)
planar_40 = IsPlanar(Surface=item_94, Interior=True)  # -> Planar, Plane
boundary_9 = BoundarySurfaces(Edges=item_94)
planar_41 = IsPlanar(Surface=item_95, Interior=True)  # -> Planar, Plane
planar_42 = IsPlanar(Surface=item_97, Interior=True)  # -> Planar, Plane
planar_43 = IsPlanar(Surface=item_98, Interior=True)  # -> Planar, Plane
bbox_6 = BoundingBox(Content=item_93, Plane=planar_39.Plane)  # -> Box, Box_2
bbox_7 = BoundingBox(Content=item_94, Plane=planar_40.Plane)  # -> Box, Box_2
bbox_8 = BoundingBox(Content=item_95, Plane=planar_41.Plane)  # -> Box, Box_2
short_12 = ShortestList(ListA=item_92, ListB=shift_12, TrimMode=2)  # -> ListA, ListB
short_13 = ShortestList(ListA=item_91, ListB=shift_13, TrimMode=2)  # -> ListA, ListB
short_14 = ShortestList(ListA=item_96, ListB=shift_14, TrimMode=2)  # -> ListA, ListB
bbox_9 = BoundingBox(Content=item_97, Plane=planar_42.Plane)  # -> Box, Box_2
bbox_10 = BoundingBox(Content=item_98, Plane=planar_43.Plane)  # -> Box, Box_2
rec_6 = Rectangle(bbox_6.Box)
rec_7 = Rectangle(bbox_7.Box)
shift_15 = ShiftList(List=item_99.Item, Shift=1, Wrap=invert(True))
rec_8 = Rectangle(bbox_8.Box)
merge_62 = Merge(Data1=graft(short_12.ListA), Data2=graft(short_12.ListB))
merge_63 = Merge(Data1=graft(short_13.ListA), Data2=graft(short_13.ListB))
merge_64 = Merge(Data1=graft(short_14.ListA), Data2=graft(short_14.ListB))
shift_16 = ShiftList(List=item_99.Item1, Shift=1, Wrap=invert(True))
rec_9 = Rectangle(bbox_9.Box)
rec_10 = Rectangle(bbox_10.Box)
srf_12 = Surface(flatten(rec_6))
srf_13 = Surface(flatten(rec_7))
srf_14 = Surface(flatten(rec_8))
srf_15 = Surface(flatten(rec_9))
srf_16 = Surface(flatten(rec_10))
short_15 = ShortestList(ListA=item_99.Item, ListB=shift_15, TrimMode=2)  # -> ListA, ListB
item_100 = ListItem(List=merge_62, Index=0, Wrap=True)  # -> Item, Item1
item_101 = ListItem(List=merge_63, Index=0, Wrap=True)  # -> Item, Item1
item_102 = ListItem(List=merge_64, Index=0, Wrap=True)  # -> Item, Item1
short_16 = ShortestList(ListA=item_99.Item1, ListB=shift_16, TrimMode=2)  # -> ListA, ListB
shift_17 = ShiftList(List=srf_12, Shift=1, Wrap=invert(True))
shift_18 = ShiftList(List=srf_13, Shift=1, Wrap=invert(True))
shift_19 = ShiftList(List=srf_14, Shift=1, Wrap=invert(True))
shift_20 = ShiftList(List=srf_15, Shift=1, Wrap=invert(True))
shift_21 = ShiftList(List=srf_16, Shift=1, Wrap=invert(True))
merge_65 = Merge(Data1=graft(short_15.ListA), Data2=graft(short_15.ListB))
merge_66 = Merge(Data1=graft(short_16.ListA), Data2=graft(short_16.ListB))
rulesrf_10 = RuledSurface(CurveA=item_100.Item, CurveB=item_100.Item1)
rulesrf_11 = RuledSurface(CurveA=item_101.Item, CurveB=item_101.Item1)
rulesrf_12 = RuledSurface(CurveA=item_102.Item, CurveB=item_102.Item1)
short_17 = ShortestList(ListA=srf_12, ListB=shift_17, TrimMode=2)  # -> ListA, ListB
short_18 = ShortestList(ListA=srf_13, ListB=shift_18, TrimMode=2)  # -> ListA, ListB
short_19 = ShortestList(ListA=srf_14, ListB=shift_19, TrimMode=2)  # -> ListA, ListB
short_20 = ShortestList(ListA=srf_15, ListB=shift_20, TrimMode=2)  # -> ListA, ListB
short_21 = ShortestList(ListA=srf_16, ListB=shift_21, TrimMode=2)  # -> ListA, ListB
join_30 = BrepJoin(Breps=flatten(rulesrf_10))  # -> Breps, Closed
join_31 = BrepJoin(Breps=flatten(rulesrf_11))  # -> Breps, Closed
join_32 = BrepJoin(Breps=flatten(rulesrf_12))  # -> Breps, Closed
item_103 = ListItem(List=merge_65, Index=0, Wrap=True)  # -> Item, Item1
item_104 = ListItem(List=merge_66, Index=0, Wrap=True)  # -> Item, Item1
merge_67 = Merge(Data1=graft(short_17.ListA), Data2=graft(short_17.ListB))
merge_68 = Merge(Data1=graft(short_18.ListA), Data2=graft(short_18.ListB))
merge_69 = Merge(Data1=graft(short_19.ListA), Data2=graft(short_19.ListB))
merge_70 = Merge(Data1=graft(short_20.ListA), Data2=graft(short_20.ListB))
merge_71 = Merge(Data1=graft(short_21.ListA), Data2=graft(short_21.ListB))
cap_45 = CapHoles(Brep=join_30.Breps)
cap_46 = CapHoles(Brep=join_31.Breps)
cap_47 = CapHoles(Brep=join_32.Breps)
rulesrf_13 = RuledSurface(CurveA=item_103.Item, CurveB=item_103.Item1)
rulesrf_14 = RuledSurface(CurveA=item_104.Item, CurveB=item_104.Item1)
item_105 = ListItem(List=merge_67, Index=0, Wrap=True)  # -> Item, Item1
item_106 = ListItem(List=merge_68, Index=0, Wrap=True)  # -> Item, Item1
item_107 = ListItem(List=merge_69, Index=0, Wrap=True)  # -> Item, Item1
item_108 = ListItem(List=merge_70, Index=0, Wrap=True)  # -> Item, Item1
item_109 = ListItem(List=merge_71, Index=0, Wrap=True)  # -> Item, Item1
join_33 = BrepJoin(Breps=flatten(rulesrf_13))  # -> Breps, Closed
join_34 = BrepJoin(Breps=flatten(rulesrf_14))  # -> Breps, Closed
rulesrf_15 = RuledSurface(CurveA=item_105.Item, CurveB=item_105.Item1)
rulesrf_16 = RuledSurface(CurveA=item_106.Item, CurveB=item_106.Item1)
rulesrf_17 = RuledSurface(CurveA=item_107.Item, CurveB=item_107.Item1)
rulesrf_18 = RuledSurface(CurveA=item_108.Item, CurveB=item_108.Item1)
rulesrf_19 = RuledSurface(CurveA=item_109.Item, CurveB=item_109.Item1)
panel_24 = Panel(cap_45)
cap_48 = CapHoles(Brep=join_33.Breps)
panel_25 = Panel(cap_47)
cap_49 = CapHoles(Brep=join_34.Breps)
join_35 = BrepJoin(Breps=flatten(rulesrf_15))  # -> Breps, Closed
join_36 = BrepJoin(Breps=flatten(rulesrf_16))  # -> Breps, Closed
join_37 = BrepJoin(Breps=flatten(rulesrf_17))  # -> Breps, Closed
join_38 = BrepJoin(Breps=flatten(rulesrf_18))  # -> Breps, Closed
join_39 = BrepJoin(Breps=flatten(rulesrf_19))  # -> Breps, Closed
cap_50 = CapHoles(Brep=join_35.Breps)
cap_51 = CapHoles(Brep=join_36.Breps)
cap_52 = CapHoles(Brep=join_37.Breps)
cap_53 = CapHoles(Brep=join_38.Breps)
cap_54 = CapHoles(Brep=join_39.Breps)
panel_26 = Panel(cap_46)
panel_27 = Panel(cap_50)
panel_28 = Panel(cap_51)
panel_29 = Panel(cap_52)
panel_30 = Panel(cap_54)
panel_31 = Panel(cap_53)

cap_55 = CapHoles(Brep=extr_26)

move_65 = Move(Geometry=cap_55, Motion=multiplication_13)  # -> Geometry, Transform

debrep_12 = DeconstructBrep(Brep=move_65.Geometry)  # -> Faces, Edges, Vertices
item_110 = ListItem(List=debrep_12.Faces, Index=Slider(4, range=0..6), Wrap=True)

planar_44 = IsPlanar(Surface=item_110, Interior=True)  # -> Planar, Plane
deplane_27 = DeconstructPlane(Plane=planar_44.Plane)  # -> Origin, XAxis, YAxis, ZAxis
rev_12 = Reverse(Vector=deplane_27.XAxis)
pl_18 = ConstructPlane(Origin=planar_44.Plane, XAxis=deplane_27.YAxis, YAxis=rev_12)

orient_12 = Orient(Geometry=merge_43, Source=pl_18, Target=cull_9)  # -> Geometry, Transform
