# Grasshopper definition DongHo_train_rail.gh (Grasshopper 1.0.7)

crv = Curve(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)
crv_2 = Curve(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)
crv_3 = Curve(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)
crv_4 = Curve(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)
brep = Brep([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])
brep_2 = Brep([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])
debrep = DeconstructBrep(Brep=brep)  # -> Faces, Edges, Vertices
merge = Merge(Data1=crv, Data2=crv_2, Data3=crv_3, Data4=crv_4)
area = Area(Geometry=debrep.Faces)  # -> Area, Centroid
item = ListItem(List=merge, Index=0, Wrap=True)
crv_5 = Curve(<curve referenced from the Rhino model>)
crv_6 = Curve(<curve referenced from the Rhino model>)
crv_7 = Curve(<curve referenced from the Rhino model>)
crv_8 = Curve(<curve referenced from the Rhino model>)
pdecon = Deconstruct(Point=area.Centroid)  # -> XComponent, YComponent, ZComponent
flip = FlipCurve(Curve=crv_5, Guide=crv_6)  # -> Curve, Flag
flip_2 = FlipCurve(Curve=crv_7, Guide=crv_8)  # -> Curve, Flag
flip_3 = FlipCurve(Curve=merge, Guide=item)  # -> Curve, Flag
sort = SortList(Keys=pdecon.ZComponent, ValuesA=debrep.Faces)  # -> Keys, reverse(ValuesA)
project = Project(Geometry=flip_3.Curve, Plane=PlaneXY(0, 0, 0))  # -> Geometry, Transform
crv_9 = Curve([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])
merge_2 = Merge(Data1=flip.Curve, Data2=crv_6)  # -> graft(Result)
merge_3 = Merge(Data1=flip_2.Curve, Data2=crv_8)  # -> graft(Result)
rulesrf = RuledSurface(CurveA=flip_2.Curve, CurveB=crv_8)
item_2 = ListItem(List=sort.ValuesA, Index=0, Wrap=True)
divlength = DivideLength(Curve=project.Geometry, Length=Slider(10000, range=0..10000))  # -> Points, Tangents, Parameters
item_3 = ListItem(List=crv_9, Index=Slider(63, range=0..100), Wrap=True)
item_4 = ListItem(List=crv_9, Index=Slider(62, range=0..100), Wrap=True)
divlength_2 = DivideLength(Curve=merge_2, Length=Slider(40000, range=0..100000))  # -> Points, Tangents, Parameters
divlength_3 = DivideLength(Curve=merge_3, Length=Slider(40000, range=0..100000))  # -> Points, Tangents, Parameters
intcrv = Interpolate(Vertices=divlength.Points, Degree=3, Periodic=False, KnotStyle=1)  # -> Curve, Length, Domain
planar = IsPlanar(Surface=item_2, Interior=True)  # -> Planar, Plane
area_2 = Area(Geometry=item_3)  # -> Area, Centroid
area_3 = Area(Geometry=item_4)  # -> Area, Centroid
pshift = ShiftPaths(Data=divlength_2.Points, Offset=-1)
pshift_2 = ShiftPaths(Data=divlength_3.Points, Offset=-1)
planar_2 = IsPlanar(Surface=item_4, Interior=True)  # -> Planar, Plane
item_5 = ListItem(List=flatten(intcrv.Curve), Index=0, Wrap=True)  # -> Item, Item1, Item2, Item3
deplane = DeconstructPlane(Plane=planar.Plane)  # -> Origin, XAxis, YAxis, ZAxis
avr = Average(Input=[area_2.Centroid, area_3.Centroid])
flip_4 = FlipMatrix(Data=pshift)
flip_5 = FlipMatrix(Data=pshift_2)
neg = Negative(Value=deplane.XAxis)
tweencrv = TweenCurve(CurveA=item_5.Item, CurveB=item_5.Item1, Factor=0.5, BlendType=0)
avr_2 = Average(Input=flip_4)
avr_3 = Average(Input=flip_5)
tweencrv_2 = TweenCurve(CurveA=item_5.Item2, CurveB=item_5.Item3, Factor=0.5, BlendType=0)
crv_10 = Curve(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)
pl_origin = PlaneOrigin(Base=planar_2.Plane, Origin=avr)
crv_11 = Curve(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)
pl = ConstructPlane(Origin=deplane.Origin, XAxis=deplane.ZAxis, YAxis=neg)
X = UnitX(Factor=1)
Y = UnitY(Factor=1)
eval = EvaluateCurve(Curve=reparameterize(tweencrv), Parameter=Slider(0, range=0..1))  # -> Point, Tangent, Angle
cull_i = CullIndex(List=flatten(avr_2), Indices="-1", Wrap=True)
cull_i_2 = CullIndex(List=flatten(avr_3), Indices="-1", Wrap=True)
eval_2 = EvaluateCurve(Curve=reparameterize(tweencrv_2), Parameter=Slider(0, range=0..1))  # -> Point, Tangent, Angle
disc = Discontinuity(Curve=crv_10, Level=1)  # -> Points, Parameters
disc_2 = Discontinuity(Curve=crv_11, Level=1)  # -> Points, Parameters
align = AlignPlane(Plane=pl, Direction=X)  # -> Plane, Angle
avr_4 = Average(Input=disc.Points)
pline = PolyLine(Vertices=cull_i, Closed=False)
Z = UnitZ(Factor=Slider(-2000, range=-2000..0))
pl_2 = ConstructPlane(Origin=eval.Point, XAxis=eval.Tangent, YAxis=Vector(0, 1, 0))
planar_3 = Planar(Curve=crv_10)  # -> Planar, Plane, Deviation
avr_5 = Average(Input=disc_2.Points)
pl_3 = ConstructPlane(Origin=eval_2.Point, XAxis=eval_2.Tangent, YAxis=Vector(0, 1, 0))
planar_4 = Planar(Curve=crv_11)  # -> Planar, Plane, Deviation
orient = Orient(Geometry=crv_9, Source=pl_origin, Target=align.Plane)  # -> Geometry, Transform
eval_3 = EvaluateCurve(Curve=reparameterize(pline), Parameter=Slider(0, range=0..1))  # -> Point, Tangent, Angle
deplane_2 = DeconstructPlane(Plane=pl_2)  # -> Origin, XAxis, YAxis, ZAxis
Z_2 = UnitZ(Factor=1)
deplane_3 = DeconstructPlane(Plane=pl_3)  # -> Origin, XAxis, YAxis, ZAxis
Z_3 = UnitZ(Factor=Slider(200, range=0..10000))
move = Move(Geometry=pline, Motion=Z)  # -> Geometry, Transform
divlength_4 = DivideLength(Curve=tweencrv, Length=Slider(40000, range=0..100000))  # -> Points, Tangents, Parameters
pl_origin_2 = PlaneOrigin(Base=planar_3.Plane, Origin=avr_4)
divlength_5 = DivideLength(Curve=tweencrv_2, Length=Slider(40000, range=0..100000))  # -> Points, Tangents, Parameters
pl_origin_3 = PlaneOrigin(Base=planar_4.Plane, Origin=avr_5)
pl_4 = ConstructPlane(Origin=deplane_2.Origin, XAxis=deplane_2.ZAxis, YAxis=deplane_2.YAxis)
pl_5 = ConstructPlane(Origin=deplane_3.Origin, XAxis=deplane_3.ZAxis, YAxis=deplane_3.YAxis)
move_2 = Move(Geometry=orient.Geometry, Motion=Z_3)  # -> Geometry, Transform
rot3d = Rotate3D(Geometry=eval_3.Tangent, Angle=1.570796327, Center=eval_3.Point, Axis=Z_2)  # -> Geometry, Transform
Z_4 = UnitZ(Factor="-1000")
cir = Circle(Plane=divlength_4.Points, Radius=Slider(2000, range=0..10000))
ln = Line()
Z_5 = UnitZ(Factor="-1000")
cir_2 = Circle(Plane=divlength_5.Points, Radius=Slider(2000, range=0..10000))
flip_6 = FlipMatrix(Data=move_2.Geometry)
orient_2 = Orient(Geometry=crv_10, Source=pl_origin_2, Target=pl_4)  # -> Geometry, Transform
line = LineSDL(Start=eval_3.Point, Direction=rot3d.Geometry, Length=Slider(4000, range=0..10000))
orient_3 = Orient(Geometry=crv_11, Source=pl_origin_3, Target=pl_5)  # -> Geometry, Transform
move_3 = Move(Geometry=cir, Motion=Z_4)  # -> Geometry, Transform
item_6 = ListItem(List=move_2.Geometry, Index=0, Wrap=True)  # -> Item, Item1, Item2, Item3, Item4, Item5, Item6, Item7
move_4 = Move(Geometry=cir_2, Motion=Z_5)  # -> Geometry, Transform
Z_6 = UnitZ(Factor=Slider(12000, range=0..100000))
Z_7 = UnitZ(Factor=Slider(12000, range=0..100000))
swp1 = Sweep1(Rail=tweencrv, Sections=orient_2.Geometry, Miter=1)
swp1_2 = Sweep1(Rail=tweencrv_2, Sections=orient_3.Geometry, Miter=1)
rev = Reverse(Vector=Z_6)
rev_2 = Reverse(Vector=Z_7)
panel = Panel(flip_6)
extr = Extrude(Base=move_3.Geometry, Direction=rev)
cap = CapHoles(Brep=swp1)
crv_12 = Curve(flip_6)
extr_2 = Extrude(Base=move_4.Geometry, Direction=rev_2)
cap_2 = CapHoles(Brep=swp1_2)
area_4 = Area(Geometry=crv_12)  # -> Area, Centroid
cap_3 = CapHoles(Brep=extr)
cap_4 = CapHoles(Brep=extr_2)
cullpt = CullDuplicates(Points=area_4.Centroid, Tolerance=0.1, CullMode=1)  # -> Points, Indices, Valence
merge_4 = Merge(Data1=cap, Data2=cap_3)
merge_5 = Merge(Data1=cap_2, Data2=cap_4)
item_7 = ListItem(List=crv_12, Index=cullpt.Indices, Wrap=True)
item_8 = ListItem(List=item_7, Index=0, Wrap=True)
flip_7 = FlipCurve(Curve=item_7, Guide=item_8)  # -> Curve, Flag
crv_13 = Curve(<curve referenced from the Rhino model>)
area_5 = Area(Geometry=flip_7.Curve)  # -> Area, Centroid
alongcrv = SortAlongCurve(Points=area_5.Centroid, Curve=crv_13)  # -> Points, Indices
item_9 = ListItem(List=flip_7.Curve, Index=alongcrv.Indices, Wrap=True)
shift = ShiftList(List=item_9, Shift=1, Wrap=invert(True))
short = ShortestList(ListA=item_9, ListB=shift, TrimMode=2)  # -> ListA, ListB
merge_6 = Merge(Data1=graft(short.ListA), Data2=graft(short.ListB))
item_10 = ListItem(List=merge_6, Index=0, Wrap=True)  # -> Item, Item1
rulesrf_2 = RuledSurface(CurveA=item_10.Item, CurveB=item_10.Item1)
join = BrepJoin(Breps=flatten(rulesrf_2))  # -> Breps, Closed
cap_5 = CapHoles(Brep=join.Breps)
