# Grasshopper definition DongHo_truss.gh (Grasshopper 1.0.7)

crv = Curve(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)
number_slider = Slider(12500, range=0..100000)
crv_2 = Curve(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)
number_slider_2 = Slider(500, range=0..1000)
pt = Point([Point(-2405381.669, 1432654.063, 134149.3872), Point(-2409189.156, 1439484.84, 134313.8784), Point(-2412996.56, 1446315.466, 134486.3464), Point(-2416803.592, 1453145.427, 134689.9066), Point(-2420608.65, 1459971.845, 135008.3777), Point(-2424395.824, 1466766.18, 135797.276)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])
lnpt = LinePt()
lng = ListLength(List=pt)
planar = Planar(Curve=crv)  # -> Planar, Plane, Deviation
disc = Discontinuity(Curve=crv, Level=1)  # -> Points, Parameters
eval = EvaluateCurve(Curve=reparameterize(crv), Parameter="0")  # -> Point, Tangent, Angle
dom = ConstructDomain(DomainStart=expr("-x / 2", number_slider_2), DomainEnd=expr("x / 2", number_slider_2))
integer_division = IntegerDivision(A=lng, B=Slider(2, range=0..10))
crv_3 = Curve(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)
panel = Panel("""0
-1""")
shatter = Shatter(Curve=crv, Parameters=disc.Parameters)
deplane = DeconstructPlane(Plane=planar.Plane)  # -> Origin, XAxis, YAxis, ZAxis
pl = PlaneNormal(Origin=eval.Point, ZAxis=eval.Tangent)
crv_4 = Curve(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)
partition = PartitionList(List=pt, Size=integer_division)
pt_2 = Point([Point(-2628807.135, 1847351.763, 135926.8242), Point(-2624999.151, 1840520.095, 136032.289), Point(-2621191.222, 1833688.527, 136145.7316), Point(-2617383.55, 1826857.419, 136290.2714), Point(-2613577.431, 1820029.097, 136549.7493), Point(-2609787.465, 1813229.754, 137279.9183)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])
number_slider_3 = Slider(0, range=0..100)
cull_i = CullIndex(List=shatter, Indices=panel, Wrap=True)
align = AlignPlane(Plane=pl, Direction=deplane.ZAxis)  # -> Plane, Angle
shift = ShiftList(List=pt_2, Shift=1, Wrap=invert(True))
alongcrv = SortAlongCurve(Points=partition, Curve=crv_3)  # -> Points, Indices
Z = UnitZ(Factor=1)
division = Division(A=number_slider, B="2")
pt_3 = Point([Point(-2405381.669, 1432654.063, 134149.3872), Point(-2409189.156, 1439484.84, 134313.8784), Point(-2412996.56, 1446315.466, 134486.3464), Point(-2416803.592, 1453145.427, 134689.9066), Point(-2420608.65, 1459971.845, 135008.3777), Point(-2424395.824, 1466766.18, 135797.276)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])
divide = DivideCurve(Curve=cull_i, Count=Slider(10, range=0..100), Kinks=False)  # -> flatten(Points), flatten(Tangents), Parameters
rev = Reverse(Vector=Z)
item = ListItem(List=partition, Index=alongcrv.Indices, Wrap=True)
amp = Amplitude(Vector=deplane.ZAxis, Amplitude=division)
rectangle = Rectangle(Plane=align.Plane, XSize=dom, YSize=dom, Radius=0)  # -> Rectangle, Length
amp_2 = Amplitude(Vector=deplane.ZAxis, Amplitude=number_slider)
short = ShortestList(ListA=pt_2, ListB=shift, TrimMode=2)  # -> ListA, ListB
sort = SortList()  # -> Keys, ValuesA
partition_2 = PartitionList(List=item, Size="2")
rev_2 = Reverse(Vector=amp_2)
rev_3 = Reverse(Vector=amp)
tstat = TreeStatistics(Tree=item)  # -> Paths, Length, Count
number_slider_4 = Slider(500, range=0..1000)
merge = Merge(Data1=graft(short.ListA), Data2=graft(short.ListB))
srf = Surface(<surface referenced from the Rhino model>)
cullpt = CullDuplicates(Points=divide.Points, Tolerance=0.1, CullMode=1)  # -> Points, Indices, Valence
swp1 = Sweep1(Rail=crv, Sections=rectangle.Rectangle, Miter=1)
pl_origin = PlaneOrigin(Base=planar.Plane, Origin=cullpt.Points)
crv_5 = Curve(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)
merge_2 = Merge(Data1=rev_2, Data2=rev_3)
dispatch = Dispatch(List=tstat.Paths, DispatchPattern=[True, False])  # -> ListA, ListB
planar_2 = IsPlanar(Surface=srf, Interior=True)  # -> Planar, Plane
sort_2 = SortList()  # -> Keys, ValuesA
deplane_2 = DeconstructPlane(Plane=pl_origin)  # -> Origin, XAxis, YAxis, ZAxis
cir = Circle(Plane=pl_origin, Radius=Slider(1000, range=0..1000))
avr = Average(Input=merge)
move = Move(Geometry=crv, Motion=merge_2)  # -> Geometry, Transform
project = Project(Geometry=cullpt.Points, Plane=planar_2.Plane)  # -> Geometry, Transform
alongcrv_2 = SortAlongCurve(Points=pt_3, Curve=crv_5)  # -> Points, Indices
branch = TreeBranch(Tree=item, Path=dispatch.ListA, MaintainPaths=True)
branch_2 = TreeBranch(Tree=item, Path=dispatch.ListB, MaintainPaths=True)
dom_2 = ConstructDomain(DomainStart=expr("-x / 2", number_slider_4), DomainEnd=expr("x / 2", number_slider_4))
pln = Plane([Plane(origin=(-2399922.47, 1435697.03, 134149.3872), x=(-0.4867680657, 0.8732803824, 0.02093379959), y=(0.0101921386, -0.01828508343, 0.999780864)), Plane(origin=(-2403729.958, 1442527.807, 134313.8784), x=(-0.4867645136, 0.8732740097, 0.02127938496), y=(0.01036039539, -0.01858694251, 0.9997735683)), Plane(origin=(-2407537.361, 1449358.434, 134486.3464), x=(-0.4867431975, 0.8732357678, 0.02324550498), y=(0.0113176496, -0.02030429288, 0.9997297867)), Plane(origin=(-2411344.394, 1456188.395, 134689.9066), x=(-0.4866521582, 0.8730724398, 0.03023560376), y=(0.01472095225, -0.02640994698, 0.9995427996)), Plane(origin=(-2415149.451, 1463014.812, 135008.3777), x=(-0.4860644397, 0.8720180505, 0.05767044272), y=(0.02807828281, -0.05037350491, 0.998335675)), Plane(origin=(-2418936.626, 1469809.147, 135797.276), x=(-0.4807710077, 0.8625214326, 0.1578480801), y=(0.07685224571, -0.1378758453, 0.9874634087))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])
item_2 = ListItem(List=move.Geometry, Index=0, Wrap=True)  # -> Item, Item1
item_3 = ListItem(List=pt_3, Index=alongcrv_2.Indices, Wrap=True)
amp_3 = Amplitude(Vector=deplane_2.ZAxis, Amplitude=Slider(250, range=0..1000))
number_slider_5 = Slider(500, range=0..1000)
shift_2 = ShiftList(List=project.Geometry, Shift=1, Wrap=invert(True))
merge_3 = Merge(Data1=graft(cullpt.Points), Data2=graft(project.Geometry))
number_slider_6 = Slider(500, range=0..1000)
pline = PolyLine(Vertices=project.Geometry, Closed=False)
pl_origin_2 = PlaneOrigin(Base=pln, Origin=branch)
pl_origin_3 = PlaneOrigin(Base=pln, Origin=branch_2)
rev_4 = Reverse(Vector=amp_3)
short_2 = ShortestList(ListA=cullpt.Points, ListB=shift_2, TrimMode=2)  # -> ListA, ListB
eval_2 = EvaluateCurve(Curve=reparameterize(pline), Parameter="0")  # -> Point, Tangent, Angle
item_4 = ListItem(List=merge_3, Index=0, Wrap=True)  # -> Item, Item1
Z_2 = UnitZ(Factor=1)
item_5 = ListItem(List=divide.Tangents, Index=cullpt.Indices, Wrap=True)
partition_3 = PartitionList(List=item_3, Size="2")
merge_4 = Merge(Data1=graft(rev_4), Data2=graft(amp_3))
number_slider_7 = Slider(500, range=0..1000)
rectangle_2 = Rectangle(Plane=pl_origin_2, XSize=dom_2, YSize=dom_2, Radius=0)  # -> Rectangle, Length
rectangle_3 = Rectangle(Plane=pl_origin_3, XSize=dom_2, YSize=dom_2, Radius=0)  # -> Rectangle, Length
cps = ClosestPoints(Point=partition_3, Cloud=flatten(avr), Count=Slider(2, range=0..10))  # -> ClosestPoint, CPIndex, Distance
cap = CapHoles(Brep=swp1)
merge_5 = Merge(Data1=graft(short_2.ListA), Data2=graft(short_2.ListB))
dom_3 = ConstructDomain(DomainStart=expr("-x / 2", number_slider_6), DomainEnd=expr("x / 2", number_slider_6))
pl_2 = PlaneNormal(Origin=eval_2.Point, ZAxis=eval_2.Tangent)
pl_origin_4 = PlaneOrigin(Base=planar_2.Plane, Origin=item_4.Item)
ln = Line(StartPoint=item_4.Item, EndPoint=item_4.Item1)
shift_3 = ShiftList(List=rectangle_2.Rectangle, Shift=1, Wrap=invert(True))
flip = FlipMatrix(Data=merge_4)
pl_3 = ConstructPlane(Origin=cullpt.Points, XAxis=item_5, YAxis=Z_2)
dom_4 = ConstructDomain(DomainStart=expr("-x / 2", number_slider_5), DomainEnd=expr("x / 2", number_slider_5))
neg = Negative(Value=number_slider_5)
rectangle_4 = Rectangle(Plane=pl_origin_4, XSize=dom_3, YSize=dom_3, Radius=0)  # -> Rectangle, Length
item_6 = ListItem(List=merge_5, Index=0, Wrap=True)  # -> Item, Item1
shift_4 = ShiftList(List=rectangle_3.Rectangle, Shift=1, Wrap=invert(True))
deplane_3 = DeconstructPlane(Plane=pl_2)  # -> Origin, XAxis, YAxis, ZAxis
pl_origin_5 = PlaneOrigin(Base=graft(pl_3), Origin=graft(partition_3))
ln_2 = Line(StartPoint=graft(partition_3), EndPoint=cps.ClosestPoint)
short_3 = ShortestList(ListA=rectangle_2.Rectangle, ListB=shift_4, TrimMode=2)  # -> ListA, ListB
short_4 = ShortestList(ListA=rectangle_3.Rectangle, ListB=shift_3, TrimMode=2)  # -> ListA, ListB
extr = Extrude(Base=cir, Direction=flip)  # -> flatten(Extrusion)
dom_5 = ConstructDomain(DomainStart=expr("-x / 2", number_slider_7), DomainEnd=expr("x / 2", number_slider_7))
swp1_2 = Sweep1(Rail=ln, Sections=rectangle_4.Rectangle, Miter=1)
pl_4 = ConstructPlane(Origin=deplane_3.Origin, XAxis=Vector(1, 0, 0), YAxis=Vector(0, 1, 0))
rectangle_5 = Rectangle(Plane=pl_2, XSize=dom_4, YSize=neg, Radius=0)  # -> Rectangle, Length
ln_3 = Line(StartPoint=item_6.Item, EndPoint=item_6.Item1)
merge_6 = Merge(Data1=graft(short_3.ListA), Data2=graft(short_3.ListB))
merge_7 = Merge(Data1=graft(short_4.ListA), Data2=graft(short_4.ListB))
cap_2 = CapHoles(Brep=extr)
pshift = ShiftPaths(Data=ln_2, Offset=-1)
swp1_3 = Sweep1(Rail=pline, Sections=rectangle_5.Rectangle, Miter=1)
sunion = SolidUnion(Breps=cap_2)  # -> graft(Result)
loft = Loft(Curves=merge_6, Options={Adjust=False, Closed=False, LoftEnds=0, LoftSimp=0, LoftType=3, Rebuild=10, Refit=0.01})
loft_2 = Loft(Curves=merge_7, Options={Adjust=False, Closed=False, LoftEnds=0, LoftSimp=0, LoftType=0, Rebuild=10, Refit=0.01})
rectangle_6 = Rectangle(Plane=pl_origin_4, XSize=dom_5, YSize=dom_5, Radius=0)  # -> Rectangle, Length
item_7 = ListItem(Index=0, Wrap=True)
sdiff = SolidDifference(BrepsA=sunion, BrepsB=cap)
swp1_4 = Sweep1(Rail=ln_2, Sections=rectangle_2.Rectangle, Miter=1)
swp1_5 = Sweep1(Rail=ln_3, Sections=rectangle_6.Rectangle, Miter=1)
cap_3 = CapHoles(Brep=loft)
cap_4 = CapHoles(Brep=loft_2)
debrep = DeconstructBrep(Brep=sdiff)  # -> Faces, Edges, Vertices
cap_5 = CapHoles(Brep=swp1_4)
avr_2 = Average(Input=debrep.Vertices)
sunion_2 = SolidUnion(Breps=flatten([cap_3, cap_4]))
pshift_2 = ShiftPaths(Data=avr_2, Offset=-1)
sunion_3 = SolidUnion(Breps=cap_5)
pdecon = Deconstruct(Point=pshift_2)  # -> XComponent, YComponent, ZComponent
sort_3 = SortList(Keys=pdecon.ZComponent, ValuesA=sdiff)  # -> Keys, ValuesA
item_8 = ListItem(List=sort_3.ValuesA, Index=0, Wrap=True)
merge_8 = Merge(Data1=swp1_2, Data2=swp1_5, Data3=swp1_3, Data4=item_8)  # -> flatten(Result)
cap_6 = CapHoles(Brep=merge_8)
sunion_4 = SolidUnion(Breps=cap_6)
