# Grasshopper definition typeA.gh (Grasshopper 1.0.7)
# plug-ins: NGon

number_slider = Slider(150000, range=0..1000000)
number_slider_2 = Slider(60000, range=0..100000)
number_slider_3 = Slider(100000, range=0..100000)
number_slider_4 = Slider(35000, range=0..100000)
number_slider_5 = Slider(50000, range=0..100000)
xy = XYPlane(Origin=Point(0, 0, 0))
xy_2 = XYPlane(Origin=Point(0, 0, 0))
number_slider_6 = Slider(90000, range=0..100000)
number_slider_7 = Slider(90000, range=0..100000)
number_slider_8 = Slider(17500, range=0..100000)
number_slider_9 = Slider(26008, range=0..100000)
Z = UnitZ(Factor="-30000")
# typeC p18 - p20
xy_3 = XYPlane(Origin=Point(0, 0, 0))
# typeA p3 - p6, p14 - p16, p17
Z_2 = UnitZ(Factor="-30000")
dom = ConstructDomain(DomainStart=expr("- x / 2", number_slider_2), DomainEnd=expr("x / 2", number_slider_2))
dom_2 = ConstructDomain(DomainStart=expr("- x / 2", number_slider_3), DomainEnd=expr("x / 2", number_slider_3))
cir = Circle(Plane=xy, Radius=number_slider_4)
cir_2 = Circle(Plane=xy_2, Radius=number_slider_5)
number_slider_10 = Slider(42500, range=0..100000)
number_slider_11 = Slider(60000, range=0..100000)
number_slider_12 = Slider(163000, range=0..1000000)
# typeB p7 - p13
multiplication = Multiplication(A=number_slider, B=Slider(0.8, range=0..1))
extr = Extrude(Base=cir, Direction=Z_2)
rectangle = Rectangle(Plane=xy_3, XSize=dom, YSize=dom_2, Radius=Slider(30000, range=0..100000))  # -> Rectangle, Length
deplane = DeconstructPlane(Plane=xy_3)  # -> Origin, XAxis, YAxis, ZAxis
Z_3 = UnitZ(Factor=Slider(150000, range=0..1000000))
Z_4 = UnitZ(Factor=number_slider)
extr_2 = Extrude(Base=cir_2, Direction=Z)
Z_5 = UnitZ(Factor=multiplication)
merge = Merge(Data1=Slider(0, range=0..100), Data2=number_slider_12, Data3=Slider(220000, range=0..1000000), Data4=number_slider_12)
expression = Expression(x=number_slider_4, y=number_slider_10, Expression="63500 + x + y")
dom_3 = ConstructDomain(DomainStart=expr("-x/2", number_slider_8), DomainEnd=expr("x / 2", number_slider_8))
dom_4 = ConstructDomain(DomainStart=expr("-x/2", number_slider_6), DomainEnd=expr("x / 2", number_slider_6))
dom_5 = ConstructDomain(DomainStart=expr("-x/2", number_slider_9), DomainEnd=expr("x / 2", number_slider_9))
dom_6 = ConstructDomain(DomainStart=expr("-x/2", number_slider_7), DomainEnd=expr("x / 2", number_slider_7))
move = Move(Geometry=xy, Motion=Z_3)  # -> Geometry, Transform
polygon = Polygon(Plane=cir, Radius=number_slider_8, Segments="8", FilletRadius=0)  # -> Polygon, Length
polygon_2 = Polygon(Plane=cir_2, Radius=Slider(27500, range=0..100000), Segments="8", FilletRadius=0)  # -> Polygon, Length
move_2 = Move(Geometry=xy_2, Motion=Z_5)  # -> Geometry, Transform
expression_2 = Expression(x="8", Expression="2 * pi / x / 2")
expression_3 = Expression(x="8", Expression="2 * pi / x / 2")
ma = MassAddition(Input=merge)  # -> Result, PartialResults
expression_4 = Expression(x=number_slider_5, y=number_slider_11, Expression="63500 + x + y")
rectangle_2 = Rectangle(Plane=move.Geometry, XSize=dom_3, YSize=dom_4, Radius=0)  # -> Rectangle, Length
rectangle_3 = Rectangle(Plane=move_2.Geometry, XSize=dom_5, YSize=dom_6, Radius=0)  # -> Rectangle, Length
number_slider_13 = Slider(120000, range=0..1000000)
amp = Amplitude(Vector=deplane.YAxis, Amplitude=ma.PartialResults)
number_slider_14 = Slider(24000, range=0..100000)
number_slider_15 = Slider(17500, range=0..100000)
number_slider_16 = Slider(17500, range=0..100000)
move_3 = Move(Geometry=rectangle.Rectangle, Motion=amp)  # -> Geometry, Transform
Z_6 = UnitZ(Factor="-30000")
number_slider_17 = Slider(30694, range=0..100000)
number_slider_18 = Slider(120000, range=0..1000000)
rotate = Rotate(Geometry=rectangle_2.Rectangle, Angle=expression_2, Plane=move.Geometry)  # -> Geometry, Transform
rotate_2 = Rotate(Geometry=rectangle_3.Rectangle, Angle=expression_3, Plane=move_2.Geometry)  # -> Geometry, Transform
number_slider_19 = Slider(30000, range=0..100000)
number_slider_20 = Slider(35000, range=0..100000)
number_slider_21 = Slider(50000, range=0..100000)
division = Division(A=number_slider_10, B=Slider(2, range=0..10))
division_2 = Division(A=number_slider_11, B=Slider(2, range=0..10))
Z_7 = UnitZ(Factor=expr("-x / sqrt(2)", number_slider_8))
expression_5 = Expression(x=number_slider_4, y=expression_2, Expression="x * Cos(y)")
extr_3 = Extrude(Base=move_3.Geometry, Direction=Z_6)
area = Area(Geometry=move_3.Geometry)  # -> Area, Centroid
planar = IsPlanar(Surface=rotate.Geometry, Interior=True)  # -> Planar, Plane
deplane_2 = DeconstructPlane(Plane=planar.Plane)  # -> Origin, XAxis, YAxis, ZAxis
planar_2 = IsPlanar(Surface=rotate_2.Geometry, Interior=True)  # -> Planar, Plane
deplane_3 = DeconstructPlane(Plane=planar_2.Plane)  # -> Origin, XAxis, YAxis, ZAxis
cap = CapHoles(Brep=extr_3)
amp_2 = Amplitude(Vector=deplane_2.YAxis, Amplitude=expression)
amp_3 = Amplitude(Vector=deplane_3.YAxis, Amplitude=expression_4)
extr_4 = Extrude(Base=rotate.Geometry, Direction=expr("-x", Z_7))
dom_7 = ConstructDomain(DomainStart=expr("-x/2", number_slider_8), DomainEnd=expr("x / 2", number_slider_8))
dom_8 = ConstructDomain(DomainStart=expr("-x/2", number_slider_9), DomainEnd=expr("x / 2", number_slider_9))
dom_9 = ConstructDomain(DomainStart=expr("-x/2", number_slider_18), DomainEnd=expr("x / 2", number_slider_18))
dom_10 = ConstructDomain(DomainStart=expr("-x/2", number_slider_13), DomainEnd=expr("x / 2", number_slider_13))
move_4 = Move(Geometry=planar.Plane, Motion=Z_7)  # -> Geometry, Transform
dom_11 = ConstructDomain(DomainStart=expr("-x/2", expression_5), DomainEnd=expr("x / 2", expression_5))
dom_12 = ConstructDomain(DomainStart=expr("-x/2", number_slider_17), DomainEnd=expr("x / 2", number_slider_17))
dom_13 = ConstructDomain(DomainStart=expr("- x / 2", number_slider_20), DomainEnd=expr("x / 2", number_slider_20))
dom_14 = ConstructDomain(DomainStart=expr("- x / 2", number_slider_21), DomainEnd=expr("x / 2", number_slider_21))
dom_15 = ConstructDomain(DomainStart=expr("-x/2", number_slider_14), DomainEnd=expr("x / 2", number_slider_14))
dom_16 = ConstructDomain(DomainStart=expr("-x/2", number_slider_19), DomainEnd=expr("x / 2", number_slider_19))
number_slider_22 = Slider(0.8, range=0..1)
move_5 = Move(Geometry=xy, Motion=amp_2)  # -> Geometry, Transform
move_6 = Move(Geometry=xy_2, Motion=amp_3)  # -> Geometry, Transform
number_slider_23 = Slider(150000, range=0..1000000)
number_slider_24 = Slider(0.8, range=0..1)
Z_8 = UnitZ(Factor=expr("-x / sqrt(2)", "17500"))
extr_5 = Extrude(Base=rotate_2.Geometry, Direction=expr("-x", Z_8))
move_7 = Move(Geometry=planar_2.Plane, Motion=Z_8)  # -> Geometry, Transform
rectangle_4 = Rectangle(Plane=move_4.Geometry, XSize=dom_7, YSize=dom_11, Radius=0)  # -> Rectangle, Length
move_8 = Move(Geometry=move_5.Geometry, Motion=Z_3)  # -> Geometry, Transform
rectangle_5 = Rectangle(Plane=move_7.Geometry, XSize=dom_8, YSize=dom_12, Radius=0)  # -> Rectangle, Length
move_9 = Move(Geometry=move_6.Geometry, Motion=Z_4)  # -> Geometry, Transform
rectangle_6 = Rectangle(Plane=move_9.Geometry, XSize=dom_16, YSize=dom_9, Radius=0)  # -> Rectangle, Length
cir_3 = Circle(Plane=move_5.Geometry, Radius=number_slider_10)
rectangle_7 = Rectangle(Plane=move_8.Geometry, XSize=dom_15, YSize=dom_10, Radius=0)  # -> Rectangle, Length
cir_4 = Circle(Plane=move_6.Geometry, Radius=number_slider_11)
rectangle_8 = Rectangle(Plane=area.Centroid, XSize=dom_13, YSize=dom_14, Radius=0)  # -> Rectangle, Length
number_slider_25 = Slider(34826, range=0..100000)
expression_6 = Expression(x=number_slider_10, y=expression_2, Expression="x * Cos(y)")
expression_7 = Expression(x=number_slider_22, Expression="1 - x")
xy_4 = XYPlane(Origin=move_5.Geometry)
xy_5 = XYPlane(Origin=move_6.Geometry)
chamfer = Chamfer(Poly=rectangle_4.Rectangle, Chamfer=Slider(-2000, range=-5000..0))
merge_2 = Merge(Data1=polygon.Polygon, Data2=chamfer, Data3=rotate.Geometry)
chamfer_2 = Chamfer(Poly=rectangle_5.Rectangle, Chamfer=Slider(-2000, range=-5000..0))
merge_3 = Merge(Data1=polygon_2.Polygon, Data2=chamfer_2, Data3=rotate_2.Geometry)
rotate_3 = Rotate(Geometry=rectangle_7.Rectangle, Angle=expression_2, Plane=move_8.Geometry)  # -> Geometry, Transform
rotate_4 = Rotate(Geometry=rectangle_6.Rectangle, Angle=expression_3, Plane=move_9.Geometry)  # -> Geometry, Transform
extr_6 = Extrude(Base=cir_3, Direction=Z_2)
extr_7 = Extrude(Base=cir_4, Direction=Z)
multiplication_2 = Multiplication(A=number_slider_22, B=number_slider_23)
Z_9 = UnitZ(Factor=expr("-x / sqrt(2)", "17500"))
Z_10 = UnitZ(Factor=expr("-x / sqrt(2)", number_slider_8))
planar_3 = IsPlanar(Surface=rotate_3.Geometry, Interior=True)  # -> Planar, Plane
planar_4 = IsPlanar(Surface=rotate_4.Geometry, Interior=True)  # -> Planar, Plane
multiplication_3 = Multiplication(A=expression_7, B=number_slider_23)
polygon_3 = Polygon(Plane=xy_4, Radius=number_slider_14, Segments="8", FilletRadius=0)  # -> Polygon, Length
polygon_4 = Polygon(Plane=xy_5, Radius=number_slider_19, Segments="8", FilletRadius=0)  # -> Polygon, Length
Z_11 = UnitZ(Factor=multiplication_2)
loft = Loft(Curves=merge_2, Options={Adjust=True, Closed=False, LoftEnds=0, LoftSimp=0, LoftType=3, Rebuild=10, Refit=0.01})
loft_2 = Loft(Curves=merge_3, Options={Adjust=True, Closed=False, LoftEnds=0, LoftSimp=0, LoftType=3, Rebuild=10, Refit=0.01})
join = BrepJoin(Breps=[extr_4, loft])  # -> Breps, Closed
join_2 = BrepJoin(Breps=[extr_5, loft_2])  # -> Breps, Closed
dom_17 = ConstructDomain(DomainStart=expr("-x/2", division), DomainEnd=expr("x / 2", division))
dom_18 = ConstructDomain(DomainStart=expr("-x/2", division_2), DomainEnd=expr("x / 2", division_2))
move_10 = Move(Geometry=planar_3.Plane, Motion=Z_10)  # -> Geometry, Transform
move_11 = Move(Geometry=planar_4.Plane, Motion=Z_9)  # -> Geometry, Transform
dom_19 = ConstructDomain(DomainStart=expr("-x/2", expression_6), DomainEnd=expr("x / 2", expression_6))
dom_20 = ConstructDomain(DomainStart=expr("-x/2", number_slider_25), DomainEnd=expr("x / 2", number_slider_25))
Z_12 = UnitZ(Factor=multiplication_3)
move_12 = Move(Geometry=rectangle_8.Rectangle, Motion=Z_11)  # -> Geometry, Transform
chamfer_3 = Chamfer(Poly=rectangle_8.Rectangle, Chamfer=Slider(-6000, range=-6000..0))  # -> graft(Curves)
cap_2 = CapHoles(Brep=extr)
cap_3 = CapHoles(Brep=join.Breps)
cap_4 = CapHoles(Brep=extr_2)
cap_5 = CapHoles(Brep=join_2.Breps)
disc = Discontinuity(Curve=chamfer_3, Level=1)  # -> Points, Parameters
disc_2 = Discontinuity(Curve=move_12.Geometry, Level=1)  # -> Points, Parameters
Z_13 = UnitZ(Factor=expr("x / sqrt(2)", Slider(17500, range=0..100000)))
rectangle_9 = Rectangle(Plane=move_10.Geometry, XSize=dom_17, YSize=dom_19, Radius=0)  # -> Rectangle, Length
rectangle_10 = Rectangle(Plane=move_11.Geometry, XSize=dom_18, YSize=dom_20, Radius=0)  # -> Rectangle, Length
merge_4 = Merge(Data1=cap_2, Data2=cap_3)
merge_5 = Merge(Data1=cap_4, Data2=cap_5)
merge_6 = Merge(Data1=graft(move_12.Geometry), Data2=chamfer_3)
cps = ClosestPoints(Point=disc_2.Points, Cloud=disc.Points, Count="2")  # -> ClosestPoint, CPIndex, Distance
extr_8 = Extrude(Base=rotate_3.Geometry, Direction=expr("-x", Z_10))
extr_9 = Extrude(Base=rotate_4.Geometry, Direction=expr("-x", Z_9))
avr = Average(Input=disc_2.Points)
move_13 = Move(Geometry=graft(move_12.Geometry), Motion=Z_13)  # -> Geometry, Transform
ln = Line(StartPoint=graft(disc_2.Points), EndPoint=cps.ClosestPoint)
move_14 = Move(Geometry=merge_4, Motion=expr("2 * x", amp_2))  # -> Geometry, Transform
move_15 = Move(Geometry=merge_5, Motion=expr("2 * x", amp_3))  # -> Geometry, Transform
chamfer_4 = Chamfer(Poly=rectangle_9.Rectangle, Chamfer=Slider(-2000, range=-5000..0))
chamfer_5 = Chamfer(Poly=rectangle_10.Rectangle, Chamfer=Slider(-2000, range=-5000..0))
cir_5 = Circle(Plane=avr, Radius=1)
area_2 = Area(Geometry=flatten(move_13.Geometry))  # -> Area, Centroid
pshift = ShiftPaths(Data=ln, Offset=-1)
move_16 = Move(Geometry=move_13.Geometry, Motion=Z_12)  # -> Geometry, Transform
merge_7 = Merge(Data1=rotate_3.Geometry, Data2=chamfer_4)  # -> flatten(Result)
merge_8 = Merge(Data1=rotate_4.Geometry, Data2=chamfer_5)  # -> flatten(Result)
midpt = CurveMiddle(Curve=pshift)
merge_9 = Merge(Data1=chamfer_4, Data2=polygon_3.Polygon)  # -> flatten(Result)
merge_10 = Merge(Data1=chamfer_5, Data2=polygon_4.Polygon)  # -> flatten(Result)
shift = ShiftList(List=area_2.Centroid, Shift=1, Wrap=invert(True))
planar_5 = Planar(Curve=move_16.Geometry)  # -> Planar, flatten(Plane), Deviation
alongcrv = SortAlongCurve(Points=midpt, Curve=cir_5)  # -> Points, Indices
short = ShortestList(ListA=area_2.Centroid, ListB=shift, TrimMode=2)  # -> ListA, ListB
loft_3 = Loft(Curves=merge_7, Options={Adjust=True, Closed=False, LoftEnds=0, LoftSimp=2, LoftType=3, Rebuild=10, Refit=0.01})
loft_4 = Loft(Curves=merge_8, Options={Adjust=True, Closed=False, LoftEnds=0, LoftSimp=2, LoftType=3, Rebuild=10, Refit=0.01})
loft_5 = Loft(Curves=merge_9, Options={Adjust=True, Closed=False, LoftEnds=0, LoftSimp=2, LoftType=3, Rebuild=10, Refit=0.01})
loft_6 = Loft(Curves=merge_10, Options={Adjust=True, Closed=False, LoftEnds=0, LoftSimp=2, LoftType=3, Rebuild=10, Refit=0.01})
item = ListItem(List=planar_5.Plane, Index=0, Wrap=True)
item_2 = ListItem(List=pshift, Index=alongcrv.Indices, Wrap=True)
merge_11 = Merge(Data1=simplify(graft(short.ListA)), Data2=simplify(graft(short.ListB)))
join_3 = BrepJoin(Breps=[extr_8, loft_3, loft_5])  # -> Breps, Closed
join_4 = BrepJoin(Breps=[extr_9, loft_4, loft_6])  # -> Breps, Closed
cap_6 = CapHoles(Brep=extr_6)
cap_7 = CapHoles(Brep=join_3.Breps)
cap_8 = CapHoles(Brep=extr_7)
cap_9 = CapHoles(Brep=join_4.Breps)
loft_7 = Loft(Curves=item_2, Options={Adjust=True, Closed=True, LoftEnds=0, LoftSimp=0, LoftType=3, Rebuild=10, Refit=0.01})  # -> simplify(Loft)
boundary = BoundarySurfaces(Edges=merge_6)  # -> simplify(Surfaces)
item_3 = ListItem(List=merge_11, Index=0, Wrap=True)  # -> Item, Item1
merge_12 = Merge(Data1=cap_6, Data2=cap_7)
merge_13 = Merge(Data1=cap_8, Data2=cap_9)
join_5 = BrepJoin(Breps=[boundary, loft_7])  # -> Breps, Closed
dist = Distance(PointA=item_3.Item, PointB=item_3.Item1)
avr_2 = Average(Input=merge_11)
entwine = Entwine(Branch00=merge_4, Branch01=merge_12, Branch02=move_14.Geometry, FlattenInputs=True)
entwine_2 = Entwine(Branch00=merge_5, Branch01=merge_13, Branch02=move_15.Geometry, FlattenInputs=True)
subtraction = Subtraction(A=Slider(100000, range=0..100000), B=dist)
dom_21 = ConstructDomain(DomainStart=expr("- x / 2", subtraction), DomainEnd=expr("x / 2", subtraction))
rectangle_11 = Rectangle(Plane=avr_2, XSize=dom_13, YSize=dom_21, Radius=0)  # -> Rectangle, Length
merge_14 = Merge(Data1=move_12.Geometry, Data2=rectangle_11.Rectangle)
explode = Explode(Curve=merge_14, Recursive=True)  # -> Segments, Vertices
len = Length(Curve=explode.Segments)
sort = SortList(Keys=len, ValuesA=explode.Segments)  # -> Keys, ValuesA
item_4 = ListItem(List=sort.ValuesA, Index=0, Wrap=True)  # -> Item, Item1
merge_15 = Merge(Data1=item_4.Item, Data2=item_4.Item1)  # -> flatten(Result)
midpt_2 = CurveMiddle(Curve=merge_15)
pdecon = Deconstruct(Point=midpt_2)  # -> XComponent, YComponent, ZComponent
sort_2 = SortList(Keys=pdecon.YComponent, ValuesA=merge_15)  # -> Keys, ValuesA
loft_8 = Loft(Curves=sort_2.ValuesA, Options={Adjust=True, Closed=False, LoftEnds=0, LoftSimp=0, LoftType=3, Rebuild=10, Refit=0.01})
edges = BrepEdges(Brep=loft_8)  # -> Naked, Interior, NonManifold
project = Project(Geometry=loft_8, Plane=item)  # -> Geometry, Transform
runion = RegionUnion(Curves=project.Geometry)
crv = Curve(edges.Naked)
join_6 = JoinCurves(Curves=crv, Preserve=False)
loft_9 = Loft(
    Curves=flatten([runion, join_6]),
    Options={Adjust=True, Closed=False, LoftEnds=0, LoftSimp=0, LoftType=3, Rebuild=10, Refit=0.01})
join_7 = BrepJoin(Breps=flatten([project.Geometry, loft_9, loft_8]))  # -> Breps, Closed
fmerge = MergeFaces(Brep=join_7.Breps)  # -> Breps, Before, After
merge_16 = Merge(Data1=fmerge.Breps, Data2=join_5.Breps, Data3=cap)  # -> flatten(Result)
