# Grasshopper definition 동호트러스.gh (Grasshopper 1.0.7)
# plug-ins: LunchBox, Weaverbird, MeshEdit Components, Kangaroo2 Components

number_slider = Slider(15, range=0..100)
number_slider_2 = Slider(80, range=0..1000)
number_slider_3 = Slider(12, range=0..1000)
number_slider_4 = Slider(160, range=0..1000)
rectangle = Rectangle(Plane=PlaneXY(0, 0, 0), XSize=Slider(320, range=0..1000), YSize=Slider(14, range=0..1000), Radius=0)  # -> Rectangle, Length
srf = Surface(rectangle.Rectangle)
brep = Brep([<brep referenced from the Rhino model> x36])
number_slider_5 = Slider(8, range=0..10)
divide = DivideDomain²(Domain=srf, UCount=Slider(2, range=0..100), VCount=Slider(1, range=0..1))
panel = Panel("""0
1""")
debrep = DeconstructBrep(Brep=brep)  # -> Faces, Edges, Vertices
crv = Curve(<curve referenced from the Rhino model>)
subsrf = Isotrim(Surface=srf, Domain=divide)
number_slider_6 = Slider(5, range=0..10)
pframe = PerpFrame(Curve=reparameterize(graft(crv)), Parameter=panel)
tmatch = MatchText(Text=debrep.Faces, RegEx="Untrim", Case=True)
brep_2 = Brep(simplify(flatten([<brep referenced from the Rhino model> x2])))
panel_2 = Panel(debrep.Faces)
disc = Discontinuity(Curve=subsrf, Level=1)  # -> Points, Parameters
merge = Merge(Data1=Slider(5, range=0..10))  # -> graft(Result)
cull = CullPattern(List=debrep.Faces, CullPattern=reverse(tmatch))
pt = Point(flatten(disc.Points))
graft = GraftTree(Tree=brep_2, IncludeEmptyLists=True, IncludeNullItems=True)
polygon = Polygon(Plane=pframe, Radius=merge, Segments=6, FilletRadius=0)  # -> Polygon, Length
cullpt = CullDuplicates(Points=pt, Tolerance=0.1, CullMode=1)  # -> Points, Indices, Valence
area = Area(Geometry=graft(polygon.Polygon))  # -> Area, Centroid
area_2 = Area(Geometry=cull)  # -> Area, Centroid
pt_2 = Point(flatten(cullpt.Points))
merge_2 = Merge(Data1=Slider(2, range=0..2), Data2=Slider(1.2, range=0..2))  # -> graft(Result)
pdecon = Deconstruct(Point=pt_2)  # -> XComponent, YComponent, ZComponent
lng = ListLength(List=pt_2)
pt_3 = Point(area_2.Centroid)
srf_2 = Surface(<surface referenced from the Rhino model>)
scale = Scale(Geometry=graft(polygon.Polygon), Center=area.Centroid, Factor=merge_2)  # -> Geometry, Transform
sort = SortList(Keys=pdecon.YComponent, ValuesA=pt_2)  # -> Keys, ValuesA
loft = Loft(
    Curves=flatten(scale.Geometry),
    Options={Adjust=False, Closed=False, LoftEnds=0, LoftSimp=0, LoftType=0, Rebuild=10, Refit=0.01})
loft_2 = Loft(Curves=loft, Options={Adjust=False, Closed=False, LoftEnds=0, LoftSimp=0, LoftType=0, Rebuild=10, Refit=0.01})
splitmul = SplitBrepMultiple(Brep=graft, Cutters=flatten(loft))
splitmul_2 = SplitBrepMultiple(Brep=loft, Cutters=flatten(graft))
item = ListItem(List=splitmul, Index=0, Wrap=True)
item_2 = ListItem(List=splitmul_2, Index=Slider(1, range=0..10), Wrap=True)
area_3 = Area(Geometry=srf_2)  # -> Area, Centroid
partition = PartitionList(List=sort.ValuesA, Size=expr("x / 2", lng))
item_3 = ListItem(List=flatten(item), Index=0, Wrap=True)
lng_2 = ListLength(List=pt_3)
join = BrepJoin(Breps=flatten([item_3, item_2]))  # -> Breps, Closed
panel_3 = Panel(area_3.Area)
integer_division = IntegerDivision(A=lng_2, B=Slider(2, range=0..10))
pdecon_2 = Deconstruct(Point=partition)  # -> XComponent, YComponent, ZComponent
crv_2 = Curve(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)
sort_2 = SortList(Keys=pdecon_2.XComponent, ValuesA=partition)  # -> Keys, ValuesA
partition_2 = PartitionList(List=pt_3, Size=integer_division)
qrsettings = QuadRemeshSettings(
    TargetCount=Slider(6000, range=0..10000),
    AdaptiveSize=0,
    AdaptiveCount=False,
    HardEdges=False,
    SeamEdges=0,
    Symmetry=0,
    GuideCurves=0)
number_slider_7 = Slider(0, range=0..100)
alongcrv = SortAlongCurve(Points=partition_2, Curve=crv_2)  # -> Points, Indices
shift = ShiftList(List=sort_2.ValuesA, Shift=1, Wrap=invert(True))
qrmesh = QuadRemesh(Mesh=join.Breps, Settings=qrsettings)
item_4 = ListItem(List=partition_2, Index=alongcrv.Indices, Wrap=True)
explode = MeshExplode(Mesh=qrmesh, Interpolate=False)
short = ShortestList(ListA=sort_2.ValuesA, ListB=shift, TrimMode=2)  # -> ListA, ListB
partition_3 = PartitionList(List=item_4, Size="2")
number_slider_8 = Slider(0, range=0..100)
tstat = TreeStatistics(Tree=item_4)  # -> Paths, Length, Count
number_slider_9 = Slider(500, range=0..1000)
merge_3 = Merge(Data1=simplify(graft(short.ListA)), Data2=simplify(graft(short.ListB)))
area_4 = Area(Geometry=explode)  # -> Area, Centroid
flatten = FlattenTree(Tree=item_2, Path="{0}")
dispatch = Dispatch(List=tstat.Paths, DispatchPattern=[True, False])  # -> ListA, ListB
sort_3 = SortList()  # -> Keys, ValuesA
pull = PullPoint(Point=area_4.Centroid, Geometry=flatten, ClosestOnly=True)  # -> ClosestPoint, Distance
Z = UnitZ(Factor=Slider(0, range=0..10))
avr = Average(Input=merge_3)
branch = TreeBranch(Tree=item_4, Path=dispatch.ListA, MaintainPaths=True)
branch_2 = TreeBranch(Tree=item_4, Path=dispatch.ListB, MaintainPaths=True)
dom = ConstructDomain(DomainStart=expr("-x / 2", number_slider_9), DomainEnd=expr("x / 2", number_slider_9))
pln = Plane([Plane(origin=(-2399922.47, 1435697.03, 134149.3872), x=(-0.4867680657, 0.8732803824, 0.02093379959), y=(0.0101921386, -0.01828508343, 0.999780864)), Plane(origin=(-2403729.958, 1442527.807, 134313.8784), x=(-0.4867645136, 0.8732740097, 0.02127938496), y=(0.01036039539, -0.01858694251, 0.9997735683)), Plane(origin=(-2407537.361, 1449358.434, 134486.3464), x=(-0.4867431975, 0.8732357678, 0.02324550498), y=(0.0113176496, -0.02030429288, 0.9997297867)), Plane(origin=(-2411344.394, 1456188.395, 134689.9066), x=(-0.4866521582, 0.8730724398, 0.03023560376), y=(0.01472095225, -0.02640994698, 0.9995427996)), Plane(origin=(-2415149.451, 1463014.812, 135008.3777), x=(-0.4860644397, 0.8720180505, 0.05767044272), y=(0.02807828281, -0.05037350491, 0.998335675)), Plane(origin=(-2418936.626, 1469809.147, 135797.276), x=(-0.4807710077, 0.8625214326, 0.1578480801), y=(0.07685224571, -0.1378758453, 0.9874634087))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])
move = Move(Geometry=avr, Motion=Z)  # -> Geometry, Transform
smaller = SmallerThan(FirstNumber=pull.Distance, SecondNumber=Slider(4, range=0..100))  # -> SmallerThan, OrEqualTo
pl_origin = PlaneOrigin(Base=pln, Origin=branch)
pl_origin_2 = PlaneOrigin(Base=pln, Origin=branch_2)
merge_4 = Merge(Data1=merge_3, Data2=move.Geometry)
cull_2 = CullPattern(List=explode, CullPattern=invert(smaller.SmallerThan))
cull_3 = CullPattern(List=explode, CullPattern=smaller.SmallerThan)
rectangle_2 = Rectangle(Plane=pl_origin, XSize=dom, YSize=dom, Radius=0)  # -> Rectangle, Length
rectangle_3 = Rectangle(Plane=pl_origin_2, XSize=dom, YSize=dom, Radius=0)  # -> Rectangle, Length
pdecon_3 = Deconstruct(Point=merge_4)  # -> XComponent, YComponent, ZComponent
demesh = DeconstructMesh(Mesh=cull_2)  # -> Vertices, Faces, Colours, Normals
shift_2 = ShiftList(List=rectangle_2.Rectangle, Shift=1, Wrap=invert(True))
sort_4 = SortList(Keys=pdecon_3.XComponent, ValuesA=merge_4)  # -> Keys, ValuesA
wbjoin = WeaverbirdsJoinMeshesAndWeld(Mesh=cull_3, Weld=invert(False))
shift_3 = ShiftList(List=rectangle_3.Rectangle, Shift=1, Wrap=invert(True))
xy = XYPlane(Origin=Point(0, 0, 0))
Z_2 = UnitZ(Factor=Slider(10, range=0..100))
deface = DeconstructFace(Face=demesh.Faces)  # -> CornerA, CornerB, CornerC, CornerD
short_2 = ShortestList(ListA=rectangle_2.Rectangle, ListB=shift_3, TrimMode=2)  # -> ListA, ListB
short_3 = ShortestList(ListA=rectangle_3.Rectangle, ListB=shift_2, TrimMode=2)  # -> ListA, ListB
intcrv = Interpolate(Vertices=sort_4.ValuesA, Degree=3, Periodic=False, KnotStyle=1)  # -> Curve, Length, Domain
move_2 = Move(Geometry=xy, Motion=Z_2)  # -> Geometry, Transform
wblaplace = WeaverbirdsLaplacianSmoothing(MeshCurves=wbjoin, Level=Slider(3, range=0..100), SmoothNakedEdges="0", Thin=1)
merge_5 = Merge(Data1=graft(short_2.ListA), Data2=graft(short_2.ListB))
merge_6 = Merge(Data1=graft(short_3.ListA), Data2=graft(short_3.ListB))
pshift = ShiftPaths(Data=intcrv.Curve, Offset=-1)
item_5 = ListItem(List=demesh.Vertices, Index=deface.CornerA, Wrap=True)
item_6 = ListItem(List=demesh.Vertices, Index=deface.CornerB, Wrap=True)
item_7 = ListItem(List=demesh.Vertices, Index=deface.CornerC, Wrap=True)
item_8 = ListItem(List=demesh.Vertices, Index=deface.CornerD, Wrap=True)
loft_3 = Loft(Curves=merge_5, Options={Adjust=False, Closed=False, LoftEnds=0, LoftSimp=0, LoftType=3, Rebuild=10, Refit=0.01})
loft_4 = Loft(Curves=merge_6, Options={Adjust=False, Closed=False, LoftEnds=0, LoftSimp=0, LoftType=0, Rebuild=10, Refit=0.01})
project = Project(Geometry=pshift, Plane=move_2.Geometry)  # -> Geometry, Transform
wbjoin_2 = WeaverbirdsJoinMeshesAndWeld(Mesh=[cull_2, wblaplace], Weld=invert(False))
srf4pt = _4PointSurface(CornerA=item_5, CornerB=item_6, CornerC=item_7, CornerD=item_8)
cap = CapHoles(Brep=loft_3)
cap_2 = CapHoles(Brep=loft_4)
merge_7 = Merge(Data1=graft(project.Geometry), Data2=graft(pshift))
merge_8 = Merge(Data1=project.Geometry, Data2=pshift)
number_slider_10 = Slider(1, range=0..100)
number_slider_11 = Slider(8, range=0..100)
number_slider_12 = Slider(16, range=0..100)
join_2 = BrepJoin(Breps=flatten(srf4pt))  # -> Breps, Closed
pshift_2 = ShiftPaths(Data=merge_7, Offset=-1)
sunion = SolidUnion(Breps=flatten([cap, cap_2]))
mesh = Mesh(wblaplace)
loft_5 = Loft(Curves=merge_7, Options={Adjust=False, Closed=False, LoftEnds=0, LoftSimp=0, LoftType=0, Rebuild=10, Refit=0.01})
flip = FlipMatrix(Data=merge_8)
join_3 = JoinCurves(Curves=pshift_2, Preserve=False)
triremesh = TriRemesh(Geometry=mesh, Length=Slider(4, range=0..100), Iterations=25)  # -> Triangulation, Dual, Creases
loft_6 = Loft(Curves=flip, Options={Adjust=False, Closed=False, LoftEnds=0, LoftSimp=0, LoftType=0, Rebuild=10, Refit=0.01})
divide_2 = DivideDomain²(Domain=loft_5, UCount=number_slider_10, VCount=number_slider_12)
number_slider_13 = Slider(0.5, range=0..10)
gridbraced1d = BracedGrid1DStructure(Surface=loft_5, UDivisions=number_slider_10, VDivisions=number_slider_12)  # -> PrimaryLines, BraceLines, StructureNodes
subsrf_2 = Isotrim(Surface=loft_5, Domain=divide_2)
number_slider_14 = Slider(0.05, range=0..1)
gridbraced2d = BracedGrid2DStructure(Surface=loft_6, UDivisions=number_slider_10, VDivisions=number_slider_12)  # -> PrimaryLines, BraceLines, StructureNodes
partition_4 = PartitionList(List=subsrf_2, Size=expr("x / 2", number_slider_12))
xz = XZPlane(Origin=gridbraced1d.StructureNodes)
wblaplace_2 = WeaverbirdsLaplacianSmoothing(MeshCurves=triremesh.Dual, Level=Slider(7, range=0..10), SmoothNakedEdges="0", Thin=1)
crv_3 = Curve(gridbraced1d.PrimaryLines)
tstat_2 = TreeStatistics(Tree=partition_4)  # -> Paths, Length, Count
crv_4 = Curve(gridbraced2d.BraceLines)
dispatch_2 = Dispatch(List=tstat_2.Paths, DispatchPattern=[True, False])  # -> ListA, ListB
wbcarpet = WeaverbirdsSierpinskiCarpet(MeshPolylines=wblaplace_2, Distance=number_slider_14, InsetType="1")
wbwindow = WeaverbirdsMeshWindow(MeshPolylines=wblaplace_2, Distance=number_slider_14, InsetType="1")
branch_3 = TreeBranch(Tree=partition_4, Path=dispatch_2.ListA, MaintainPaths=False)
branch_4 = TreeBranch(Tree=partition_4, Path=dispatch_2.ListB, MaintainPaths=False)
disc_2 = Discontinuity(Curve=branch_3, Level=1)  # -> Points, Parameters
disc_3 = Discontinuity(Curve=branch_4, Level=1)  # -> Points, Parameters
item_9 = ListItem(List=disc_2.Points, Index=0, Wrap=True)  # -> Item, Item1, Item2, Item3
item_10 = ListItem(List=disc_3.Points, Index=0, Wrap=True)  # -> Item, Item1, Item2, Item3
ln = Line(StartPoint=item_9.Item, EndPoint=item_9.Item2)
ln_2 = Line(StartPoint=item_10.Item1, EndPoint=item_10.Item3)
merge_9 = Merge(Data2=gridbraced2d.PrimaryLines)  # -> flatten(Result)
merge_10 = Merge(Data1=ln, Data2=ln_2, Data3=crv_3)  # -> flatten(Result)
panel_4 = Panel("""0
1""")
pframe_2 = PerpFrame(Curve=reparameterize(graft(merge_9)), Parameter=panel_4)
Z_3 = UnitZ(Factor=1)
pframe_3 = PerpFrame(Curve=reparameterize(graft(merge_10)), Parameter=panel_4)
number_slider_15 = Slider(0.6, range=0..1)
align = AlignPlane(Plane=pframe_2, Direction=Z_3)  # -> Plane, Angle
number_slider_16 = Slider(0.2, range=0..1)
rotate = Rotate(Geometry=pframe_3, Angle=".25 * pi", Plane=pframe_3)  # -> Geometry, Transform
pt_4 = Point(flatten(xz))
rotate_2 = Rotate(Geometry=align.Plane, Angle=".25 * pi", Plane=align.Plane)  # -> Geometry, Transform
expression = Expression(x=number_slider_15, Expression="sin(0.25 * pi) * x")
polygon_2 = Polygon(Plane=rotate.Geometry, Radius=number_slider_15, Segments=Slider(4, range=0..10), FilletRadius=0)  # -> Polygon, Length
cullpt_2 = CullDuplicates(Points=pt_4, Tolerance=0.1, CullMode=1)  # -> Points, Indices, Valence
xz_2 = XZPlane(Origin=cullpt_2.Points)
cir = Circle(Plane=rotate_2.Geometry, Radius=expression)
loft_7 = Loft(
    Curves=polygon_2.Polygon,
    Options={Adjust=False, Closed=False, LoftEnds=0, LoftSimp=0, LoftType=0, Rebuild=10, Refit=0.01})  # -> flatten(Loft)
loft_8 = Loft(Curves=cir, Options={Adjust=False, Closed=False, LoftEnds=0, LoftSimp=0, LoftType=0, Rebuild=10, Refit=0.01})  # -> flatten(Loft)
cir_2 = Circle(Plane=xz_2, Radius=expression)
Y = UnitY(Factor=expression)
cap_3 = CapHoles(Brep=loft_7)
neg = Negative(Value=Y)
cap_4 = CapHoles(Brep=loft_8)
merge_11 = Merge(Data1=Y, Data2=neg)
extr = Extrude(Base=flatten(cir_2), Direction=graft(merge_11))
join_4 = BrepJoin(Breps=flatten(extr))  # -> Breps, Closed
cap_5 = CapHoles(Brep=join_4.Breps)
merge_12 = Merge(Data1=cap_3, Data2=cap_5)  # -> flatten(Result)
sunion_2 = SolidUnion(Breps=flatten(merge_12))
sunion_3 = SolidUnion(Breps=flatten(cap_4))
