# Grasshopper definition FGM_WCLP.gh (Grasshopper 1.0.7)
# plug-ins: atit

panel = Panel(""""C:\Users\BaekInchan\Desktop\설계스튜디오9_졸업설계\맵모델링\신사\N3P_H0059153.shp"
"C:\Users\BaekInchan\Desktop\설계스튜디오9_졸업설계\맵모델링\신사\N3A_A0010000.shp"
"C:\Users\BaekInchan\Desktop\설계스튜디오9_졸업설계\맵모델링\신사\N3A_A0033320.shp"
"C:\Users\BaekInchan\Desktop\설계스튜디오9_졸업설계\맵모델링\신사\N3A_A0053326.shp"
"C:\Users\BaekInchan\Desktop\설계스튜디오9_졸업설계\맵모델링\신사\N3A_A0063321.shp"
"C:\Users\BaekInchan\Desktop\설계스튜디오9_졸업설계\맵모델링\신사\N3A_A0070000.shp"
"C:\Users\BaekInchan\Desktop\설계스튜디오9_졸업설계\맵모델링\신사\N3A_A0080000.shp"
"C:\Users\BaekInchan\Desktop\설계스튜디오9_졸업설계\맵모델링\신사\N3A_A0090000.shp"
"C:\Users\BaekInchan\Desktop\설계스튜디오9_졸업설계\맵모델링\신사\N3A_A0100000.shp"
"C:\Users\BaekInchan\Desktop\설계스튜디오9_졸업설계\맵모델링\신사\N3A_A0110020.shp"
"C:\Users\BaekInchan\Desktop\설계스튜디오9_졸업설계\맵모델링\신사\N3A_A0160024.shp"
"C:\Users\BaekInchan\Desktop\설계스튜디오9_졸업설계\맵모델링\신사\N3A_A0191221.shp"
"C:\Users\BaekInchan\Desktop\설계스튜디오9_졸업설계\맵모델링\신사\N3A_A0201222.shp"
"C:\Users\BaekInchan\Desktop\설계스튜디오9_졸업설계\맵모델링\신사\N3A_B0010000.shp"
"C:\Users\BaekInchan\Desktop\설계스튜디오9_졸업설계\맵모델링\신사\N3A_C0186115.shp"
"C:\Users\BaekInchan\Desktop\설계스튜디오9_졸업설계\맵모델링\신사\N3A_C0390000.shp"
"C:\Users\BaekInchan\Desktop\설계스튜디오9_졸업설계\맵모델링\신사\N3A_C0423365.shp"
"C:\Users\BaekInchan\Desktop\설계스튜디오9_졸업설계\맵모델링\신사\N3A_C0430000.shp"
"C:\Users\BaekInchan\Desktop\설계스튜디오9_졸업설계\맵모델링\신사\N3A_D0010000.shp"
"C:\Users\BaekInchan\Desktop\설계스튜디오9_졸업설계\맵모델링\신사\N3A_E0010001.shp"
"C:\Users\BaekInchan\Desktop\설계스튜디오9_졸업설계\맵모델링\신사\N3A_E0032111.shp"
"C:\Users\BaekInchan\Desktop\설계스튜디오9_졸업설계\맵모델링\신사\N3A_E0052114.shp"
"C:\Users\BaekInchan\Desktop\설계스튜디오9_졸업설계\맵모델링\신사\N3A_G0010000.shp"
"C:\Users\BaekInchan\Desktop\설계스튜디오9_졸업설계\맵모델링\신사\N3A_G0020000.shp"
"C:\Users\BaekInchan\Desktop\설계스튜디오9_졸업설계\맵모델링\신사\N3L_A0010000.shp"
"C:\Users\BaekInchan\Desktop\설계스튜디오9_졸업설계\맵모델링\신사\N3L_A0020000.shp"
"C:\Users\BaekInchan\Desktop\설계스튜디오9_졸업설계\맵모델링\신사\N3L_A0033320.shp"
"C:\Users\BaekInchan\Desktop\설계스튜디오9_졸업설계\맵모델링\신사\N3L_A0123373.shp"
"C:\Users\BaekInchan\Desktop\설계스튜디오9_졸업설계\맵모델링\신사\N3L_A0150000.shp"
"C:\Users\BaekInchan\Desktop\설계스튜디오9_졸업설계\맵모델링\신사\N3L_A0171119.shp"
"C:\Users\BaekInchan\Desktop\설계스튜디오9_졸업설계\맵모델링\신사\N3L_B0020000.shp"
"C:\Users\BaekInchan\Desktop\설계스튜디오9_졸업설계\맵모델링\신사\N3L_C0050000.shp"
"C:\Users\BaekInchan\Desktop\설계스튜디오9_졸업설계\맵모델링\신사\N3L_C0060000.shp"
"C:\Users\BaekInchan\Desktop\설계스튜디오9_졸업설계\맵모델링\신사\N3L_C0520000.shp"
"C:\Users\BaekInchan\Desktop\설계스튜디오9_졸업설계\맵모델링\신사\N3L_E0020000.shp"
"C:\Users\BaekInchan\Desktop\설계스튜디오9_졸업설계\맵모델링\신사\N3L_F0010000.shp"
"C:\Users\BaekInchan\Desktop\설계스튜디오9_졸업설계\맵모델링\신사\N3L_F0030000.shp"
"C:\Users\BaekInchan\Desktop\설계스튜디오9_졸업설계\맵모델링\신사\N3L_F0040000.shp"
"C:\Users\BaekInchan\Desktop\설계스튜디오9_졸업설계\맵모델링\신사\N3L_G0030000.shp"
"C:\Users\BaekInchan\Desktop\설계스튜디오9_졸업설계\맵모델링\신사\N3L_H0010000.shp"
"C:\Users\BaekInchan\Desktop\설계스튜디오9_졸업설계\맵모델링\신사\N3P_A0131122.shp"
"C:\Users\BaekInchan\Desktop\설계스튜디오9_졸업설계\맵모델링\신사\N3P_C0380000.shp"
"C:\Users\BaekInchan\Desktop\설계스튜디오9_졸업설계\맵모델링\신사\N3P_E0042326.shp"
"C:\Users\BaekInchan\Desktop\설계스튜디오9_졸업설계\맵모델링\신사\N3P_F0020000.shp"
"C:\Users\BaekInchan\Desktop\설계스튜디오9_졸업설계\맵모델링\신사\N3P_H0020000.shp"
"C:\Users\BaekInchan\Desktop\설계스튜디오9_졸업설계\맵모델링\신사\N3P_H0040000.shp"
""")
panel_2 = Panel(""""C:\Users\BaekInchan\Desktop\설계스튜디오9_졸업설계\맵모델링\압구정\N3A_A0010000.shp"
"C:\Users\BaekInchan\Desktop\설계스튜디오9_졸업설계\맵모델링\압구정\N3A_A0033320.shp"
"C:\Users\BaekInchan\Desktop\설계스튜디오9_졸업설계\맵모델링\압구정\N3A_A0053326.shp"
"C:\Users\BaekInchan\Desktop\설계스튜디오9_졸업설계\맵모델링\압구정\N3A_A0063321.shp"
"C:\Users\BaekInchan\Desktop\설계스튜디오9_졸업설계\맵모델링\압구정\N3A_A0070000.shp"
"C:\Users\BaekInchan\Desktop\설계스튜디오9_졸업설계\맵모델링\압구정\N3A_A0080000.shp"
"C:\Users\BaekInchan\Desktop\설계스튜디오9_졸업설계\맵모델링\압구정\N3A_A0090000.shp"
"C:\Users\BaekInchan\Desktop\설계스튜디오9_졸업설계\맵모델링\압구정\N3A_A0100000.shp"
"C:\Users\BaekInchan\Desktop\설계스튜디오9_졸업설계\맵모델링\압구정\N3A_A0110020.shp"
"C:\Users\BaekInchan\Desktop\설계스튜디오9_졸업설계\맵모델링\압구정\N3A_A0160024.shp"
"C:\Users\BaekInchan\Desktop\설계스튜디오9_졸업설계\맵모델링\압구정\N3A_A0191221.shp"
"C:\Users\BaekInchan\Desktop\설계스튜디오9_졸업설계\맵모델링\압구정\N3A_A0201222.shp"
"C:\Users\BaekInchan\Desktop\설계스튜디오9_졸업설계\맵모델링\압구정\N3A_B0010000.shp"
"C:\Users\BaekInchan\Desktop\설계스튜디오9_졸업설계\맵모델링\압구정\N3A_C0186115.shp"
"C:\Users\BaekInchan\Desktop\설계스튜디오9_졸업설계\맵모델링\압구정\N3A_C0390000.shp"
"C:\Users\BaekInchan\Desktop\설계스튜디오9_졸업설계\맵모델링\압구정\N3A_C0423365.shp"
"C:\Users\BaekInchan\Desktop\설계스튜디오9_졸업설계\맵모델링\압구정\N3A_C0430000.shp"
"C:\Users\BaekInchan\Desktop\설계스튜디오9_졸업설계\맵모델링\압구정\N3A_D0010000.shp"
"C:\Users\BaekInchan\Desktop\설계스튜디오9_졸업설계\맵모델링\압구정\N3A_E0010001.shp"
"C:\Users\BaekInchan\Desktop\설계스튜디오9_졸업설계\맵모델링\압구정\N3A_E0032111.shp"
"C:\Users\BaekInchan\Desktop\설계스튜디오9_졸업설계\맵모델링\압구정\N3A_E0052114.shp"
"C:\Users\BaekInchan\Desktop\설계스튜디오9_졸업설계\맵모델링\압구정\N3A_G0010000.shp"
"C:\Users\BaekInchan\Desktop\설계스튜디오9_졸업설계\맵모델링\압구정\N3A_G0020000.shp"
"C:\Users\BaekInchan\Desktop\설계스튜디오9_졸업설계\맵모델링\압구정\N3L_A0010000.shp"
"C:\Users\BaekInchan\Desktop\설계스튜디오9_졸업설계\맵모델링\압구정\N3L_A0020000.shp"
"C:\Users\BaekInchan\Desktop\설계스튜디오9_졸업설계\맵모델링\압구정\N3L_A0033330.shp"
"C:\Users\BaekInchan\Desktop\설계스튜디오9_졸업설계\맵모델링\압구정\N3L_A0123373.shp"
"C:\Users\BaekInchan\Desktop\설계스튜디오9_졸업설계\맵모델링\압구정\N3L_A0150000.shp"
"C:\Users\BaekInchan\Desktop\설계스튜디오9_졸업설계\맵모델링\압구정\N3L_A0171119.shp"
"C:\Users\BaekInchan\Desktop\설계스튜디오9_졸업설계\맵모델링\압구정\N3L_B0020000.shp"
"C:\Users\BaekInchan\Desktop\설계스튜디오9_졸업설계\맵모델링\압구정\N3L_C0050000.shp"
"C:\Users\BaekInchan\Desktop\설계스튜디오9_졸업설계\맵모델링\압구정\N3L_C0060000.shp"
"C:\Users\BaekInchan\Desktop\설계스튜디오9_졸업설계\맵모델링\압구정\N3L_C0070000.shp"
"C:\Users\BaekInchan\Desktop\설계스튜디오9_졸업설계\맵모델링\압구정\N3L_C0520000.shp"
"C:\Users\BaekInchan\Desktop\설계스튜디오9_졸업설계\맵모델링\압구정\N3L_E0020000.shp"
"C:\Users\BaekInchan\Desktop\설계스튜디오9_졸업설계\맵모델링\압구정\N3L_F0010000.shp"
"C:\Users\BaekInchan\Desktop\설계스튜디오9_졸업설계\맵모델링\압구정\N3L_F0030000.shp"
"C:\Users\BaekInchan\Desktop\설계스튜디오9_졸업설계\맵모델링\압구정\N3L_F0040000.shp"
"C:\Users\BaekInchan\Desktop\설계스튜디오9_졸업설계\맵모델링\압구정\N3L_G0030000.shp"
"C:\Users\BaekInchan\Desktop\설계스튜디오9_졸업설계\맵모델링\압구정\N3L_H0010000.shp"
"C:\Users\BaekInchan\Desktop\설계스튜디오9_졸업설계\맵모델링\압구정\N3P_A0131122.shp"
"C:\Users\BaekInchan\Desktop\설계스튜디오9_졸업설계\맵모델링\압구정\N3P_C0210000.shp"
"C:\Users\BaekInchan\Desktop\설계스튜디오9_졸업설계\맵모델링\압구정\N3P_C0380000.shp"
"C:\Users\BaekInchan\Desktop\설계스튜디오9_졸업설계\맵모델링\압구정\N3P_D0030000.shp"
"C:\Users\BaekInchan\Desktop\설계스튜디오9_졸업설계\맵모델링\압구정\N3P_E0042326.shp"
"C:\Users\BaekInchan\Desktop\설계스튜디오9_졸업설계\맵모델링\압구정\N3P_F0020000.shp"
"C:\Users\BaekInchan\Desktop\설계스튜디오9_졸업설계\맵모델링\압구정\N3P_H0020000.shp"
"C:\Users\BaekInchan\Desktop\설계스튜디오9_졸업설계\맵모델링\압구정\N3P_H0040000.shp"
"C:\Users\BaekInchan\Desktop\설계스튜디오9_졸업설계\맵모델링\압구정\N3P_H0059153.shp"
""")
panel_3 = Panel(""""C:\Users\BaekInchan\Desktop\설계스튜디오9_졸업설계\맵모델링\강남구청\(B010)수치지도_37705092_2022_00000597055733\N3P_H0040000.shp"
"C:\Users\BaekInchan\Desktop\설계스튜디오9_졸업설계\맵모델링\강남구청\(B010)수치지도_37705092_2022_00000597055733\N3A_A0010000.shp"
"C:\Users\BaekInchan\Desktop\설계스튜디오9_졸업설계\맵모델링\강남구청\(B010)수치지도_37705092_2022_00000597055733\N3A_A0033320.shp"
"C:\Users\BaekInchan\Desktop\설계스튜디오9_졸업설계\맵모델링\강남구청\(B010)수치지도_37705092_2022_00000597055733\N3A_A0053326.shp"
"C:\Users\BaekInchan\Desktop\설계스튜디오9_졸업설계\맵모델링\강남구청\(B010)수치지도_37705092_2022_00000597055733\N3A_A0080000.shp"
"C:\Users\BaekInchan\Desktop\설계스튜디오9_졸업설계\맵모델링\강남구청\(B010)수치지도_37705092_2022_00000597055733\N3A_B0010000.shp"
"C:\Users\BaekInchan\Desktop\설계스튜디오9_졸업설계\맵모델링\강남구청\(B010)수치지도_37705092_2022_00000597055733\N3A_C0186115.shp"
"C:\Users\BaekInchan\Desktop\설계스튜디오9_졸업설계\맵모델링\강남구청\(B010)수치지도_37705092_2022_00000597055733\N3A_C0305316.shp"
"C:\Users\BaekInchan\Desktop\설계스튜디오9_졸업설계\맵모델링\강남구청\(B010)수치지도_37705092_2022_00000597055733\N3A_C0390000.shp"
"C:\Users\BaekInchan\Desktop\설계스튜디오9_졸업설계\맵모델링\강남구청\(B010)수치지도_37705092_2022_00000597055733\N3A_C0423365.shp"
"C:\Users\BaekInchan\Desktop\설계스튜디오9_졸업설계\맵모델링\강남구청\(B010)수치지도_37705092_2022_00000597055733\N3A_C0430000.shp"
"C:\Users\BaekInchan\Desktop\설계스튜디오9_졸업설계\맵모델링\강남구청\(B010)수치지도_37705092_2022_00000597055733\N3A_G0010000.shp"
"C:\Users\BaekInchan\Desktop\설계스튜디오9_졸업설계\맵모델링\강남구청\(B010)수치지도_37705092_2022_00000597055733\N3L_A0010000.shp"
"C:\Users\BaekInchan\Desktop\설계스튜디오9_졸업설계\맵모델링\강남구청\(B010)수치지도_37705092_2022_00000597055733\N3L_A0020000.shp"
"C:\Users\BaekInchan\Desktop\설계스튜디오9_졸업설계\맵모델링\강남구청\(B010)수치지도_37705092_2022_00000597055733\N3L_A0033330.shp"
"C:\Users\BaekInchan\Desktop\설계스튜디오9_졸업설계\맵모델링\강남구청\(B010)수치지도_37705092_2022_00000597055733\N3L_B0020000.shp"
"C:\Users\BaekInchan\Desktop\설계스튜디오9_졸업설계\맵모델링\강남구청\(B010)수치지도_37705092_2022_00000597055733\N3L_C0070000.shp"
"C:\Users\BaekInchan\Desktop\설계스튜디오9_졸업설계\맵모델링\강남구청\(B010)수치지도_37705092_2022_00000597055733\N3L_C0520000.shp"
"C:\Users\BaekInchan\Desktop\설계스튜디오9_졸업설계\맵모델링\강남구청\(B010)수치지도_37705092_2022_00000597055733\N3L_E0020000.shp"
"C:\Users\BaekInchan\Desktop\설계스튜디오9_졸업설계\맵모델링\강남구청\(B010)수치지도_37705092_2022_00000597055733\N3L_F0010000.shp"
"C:\Users\BaekInchan\Desktop\설계스튜디오9_졸업설계\맵모델링\강남구청\(B010)수치지도_37705092_2022_00000597055733\N3L_F0040000.shp"
"C:\Users\BaekInchan\Desktop\설계스튜디오9_졸업설계\맵모델링\강남구청\(B010)수치지도_37705092_2022_00000597055733\N3L_G0030000.shp"
"C:\Users\BaekInchan\Desktop\설계스튜디오9_졸업설계\맵모델링\강남구청\(B010)수치지도_37705092_2022_00000597055733\N3L_H0010000.shp"
"C:\Users\BaekInchan\Desktop\설계스튜디오9_졸업설계\맵모델링\강남구청\(B010)수치지도_37705092_2022_00000597055733\N3P_A0131122.shp"
"C:\Users\BaekInchan\Desktop\설계스튜디오9_졸업설계\맵모델링\강남구청\(B010)수치지도_37705092_2022_00000597055733\N3P_C0285311.shp"
"C:\Users\BaekInchan\Desktop\설계스튜디오9_졸업설계\맵모델링\강남구청\(B010)수치지도_37705092_2022_00000597055733\N3P_C0310000.shp"
"C:\Users\BaekInchan\Desktop\설계스튜디오9_졸업설계\맵모델링\강남구청\(B010)수치지도_37705092_2022_00000597055733\N3P_C0380000.shp"
"C:\Users\BaekInchan\Desktop\설계스튜디오9_졸업설계\맵모델링\강남구청\(B010)수치지도_37705092_2022_00000597055733\N3P_F0020000.shp"
""")
panel_4 = Panel(""""C:\Users\BaekInchan\Desktop\설계스튜디오9_졸업설계\맵모델링\신사\N3P_H0059153.shp"
"C:\Users\BaekInchan\Desktop\설계스튜디오9_졸업설계\맵모델링\신사\N3A_A0010000.shp"
"C:\Users\BaekInchan\Desktop\설계스튜디오9_졸업설계\맵모델링\신사\N3A_A0033320.shp"
"C:\Users\BaekInchan\Desktop\설계스튜디오9_졸업설계\맵모델링\신사\N3A_A0053326.shp"
"C:\Users\BaekInchan\Desktop\설계스튜디오9_졸업설계\맵모델링\신사\N3A_A0063321.shp"
"C:\Users\BaekInchan\Desktop\설계스튜디오9_졸업설계\맵모델링\신사\N3A_A0070000.shp"
"C:\Users\BaekInchan\Desktop\설계스튜디오9_졸업설계\맵모델링\신사\N3A_A0080000.shp"
"C:\Users\BaekInchan\Desktop\설계스튜디오9_졸업설계\맵모델링\신사\N3A_A0090000.shp"
"C:\Users\BaekInchan\Desktop\설계스튜디오9_졸업설계\맵모델링\신사\N3A_A0100000.shp"
"C:\Users\BaekInchan\Desktop\설계스튜디오9_졸업설계\맵모델링\신사\N3A_A0110020.shp"
"C:\Users\BaekInchan\Desktop\설계스튜디오9_졸업설계\맵모델링\신사\N3A_A0160024.shp"
"C:\Users\BaekInchan\Desktop\설계스튜디오9_졸업설계\맵모델링\신사\N3A_A0191221.shp"
"C:\Users\BaekInchan\Desktop\설계스튜디오9_졸업설계\맵모델링\신사\N3A_A0201222.shp"
"C:\Users\BaekInchan\Desktop\설계스튜디오9_졸업설계\맵모델링\신사\N3A_B0010000.shp"
"C:\Users\BaekInchan\Desktop\설계스튜디오9_졸업설계\맵모델링\신사\N3A_C0186115.shp"
"C:\Users\BaekInchan\Desktop\설계스튜디오9_졸업설계\맵모델링\신사\N3A_C0390000.shp"
"C:\Users\BaekInchan\Desktop\설계스튜디오9_졸업설계\맵모델링\신사\N3A_C0423365.shp"
"C:\Users\BaekInchan\Desktop\설계스튜디오9_졸업설계\맵모델링\신사\N3A_C0430000.shp"
"C:\Users\BaekInchan\Desktop\설계스튜디오9_졸업설계\맵모델링\신사\N3A_D0010000.shp"
"C:\Users\BaekInchan\Desktop\설계스튜디오9_졸업설계\맵모델링\신사\N3A_E0010001.shp"
"C:\Users\BaekInchan\Desktop\설계스튜디오9_졸업설계\맵모델링\신사\N3A_E0032111.shp"
"C:\Users\BaekInchan\Desktop\설계스튜디오9_졸업설계\맵모델링\신사\N3A_E0052114.shp"
"C:\Users\BaekInchan\Desktop\설계스튜디오9_졸업설계\맵모델링\신사\N3A_G0010000.shp"
"C:\Users\BaekInchan\Desktop\설계스튜디오9_졸업설계\맵모델링\신사\N3A_G0020000.shp"
"C:\Users\BaekInchan\Desktop\설계스튜디오9_졸업설계\맵모델링\신사\N3L_A0010000.shp"
"C:\Users\BaekInchan\Desktop\설계스튜디오9_졸업설계\맵모델링\신사\N3L_A0020000.shp"
"C:\Users\BaekInchan\Desktop\설계스튜디오9_졸업설계\맵모델링\신사\N3L_A0033320.shp"
"C:\Users\BaekInchan\Desktop\설계스튜디오9_졸업설계\맵모델링\신사\N3L_A0123373.shp"
"C:\Users\BaekInchan\Desktop\설계스튜디오9_졸업설계\맵모델링\신사\N3L_A0150000.shp"
"C:\Users\BaekInchan\Desktop\설계스튜디오9_졸업설계\맵모델링\신사\N3L_A0171119.shp"
"C:\Users\BaekInchan\Desktop\설계스튜디오9_졸업설계\맵모델링\신사\N3L_B0020000.shp"
"C:\Users\BaekInchan\Desktop\설계스튜디오9_졸업설계\맵모델링\신사\N3L_C0050000.shp"
"C:\Users\BaekInchan\Desktop\설계스튜디오9_졸업설계\맵모델링\신사\N3L_C0060000.shp"
"C:\Users\BaekInchan\Desktop\설계스튜디오9_졸업설계\맵모델링\신사\N3L_C0520000.shp"
"C:\Users\BaekInchan\Desktop\설계스튜디오9_졸업설계\맵모델링\신사\N3L_E0020000.shp"
"C:\Users\BaekInchan\Desktop\설계스튜디오9_졸업설계\맵모델링\신사\N3L_F0010000.shp"
"C:\Users\BaekInchan\Desktop\설계스튜디오9_졸업설계\맵모델링\신사\N3L_F0030000.shp"
"C:\Users\BaekInchan\Desktop\설계스튜디오9_졸업설계\맵모델링\신사\N3L_F0040000.shp"
"C:\Users\BaekInchan\Desktop\설계스튜디오9_졸업설계\맵모델링\신사\N3L_G0030000.shp"
"C:\Users\BaekInchan\Desktop\설계스튜디오9_졸업설계\맵모델링\신사\N3L_H0010000.shp"
"C:\Users\BaekInchan\Desktop\설계스튜디오9_졸업설계\맵모델링\신사\N3P_A0131122.shp"
"C:\Users\BaekInchan\Desktop\설계스튜디오9_졸업설계\맵모델링\신사\N3P_C0380000.shp"
"C:\Users\BaekInchan\Desktop\설계스튜디오9_졸업설계\맵모델링\신사\N3P_E0042326.shp"
"C:\Users\BaekInchan\Desktop\설계스튜디오9_졸업설계\맵모델링\신사\N3P_F0020000.shp"
"C:\Users\BaekInchan\Desktop\설계스튜디오9_졸업설계\맵모델링\신사\N3P_H0020000.shp"
"C:\Users\BaekInchan\Desktop\설계스튜디오9_졸업설계\맵모델링\신사\N3P_H0040000.shp"
""")
panel_5 = Panel(""""C:\Users\BaekInchan\Desktop\설계스튜디오9_졸업설계\맵모델링\논현역\(B010)수치지도_37705091_2022_00000452529185\N3P_H0040000.shp"
"C:\Users\BaekInchan\Desktop\설계스튜디오9_졸업설계\맵모델링\논현역\(B010)수치지도_37705091_2022_00000452529185\N3A_A0010000.shp"
"C:\Users\BaekInchan\Desktop\설계스튜디오9_졸업설계\맵모델링\논현역\(B010)수치지도_37705091_2022_00000452529185\N3A_A0033320.shp"
"C:\Users\BaekInchan\Desktop\설계스튜디오9_졸업설계\맵모델링\논현역\(B010)수치지도_37705091_2022_00000452529185\N3A_A0053326.shp"
"C:\Users\BaekInchan\Desktop\설계스튜디오9_졸업설계\맵모델링\논현역\(B010)수치지도_37705091_2022_00000452529185\N3A_A0063321.shp"
"C:\Users\BaekInchan\Desktop\설계스튜디오9_졸업설계\맵모델링\논현역\(B010)수치지도_37705091_2022_00000452529185\N3A_A0070000.shp"
"C:\Users\BaekInchan\Desktop\설계스튜디오9_졸업설계\맵모델링\논현역\(B010)수치지도_37705091_2022_00000452529185\N3A_A0080000.shp"
"C:\Users\BaekInchan\Desktop\설계스튜디오9_졸업설계\맵모델링\논현역\(B010)수치지도_37705091_2022_00000452529185\N3A_A0090000.shp"
"C:\Users\BaekInchan\Desktop\설계스튜디오9_졸업설계\맵모델링\논현역\(B010)수치지도_37705091_2022_00000452529185\N3A_A0100000.shp"
"C:\Users\BaekInchan\Desktop\설계스튜디오9_졸업설계\맵모델링\논현역\(B010)수치지도_37705091_2022_00000452529185\N3A_A0160024.shp"
"C:\Users\BaekInchan\Desktop\설계스튜디오9_졸업설계\맵모델링\논현역\(B010)수치지도_37705091_2022_00000452529185\N3A_B0010000.shp"
"C:\Users\BaekInchan\Desktop\설계스튜디오9_졸업설계\맵모델링\논현역\(B010)수치지도_37705091_2022_00000452529185\N3A_C0186115.shp"
"C:\Users\BaekInchan\Desktop\설계스튜디오9_졸업설계\맵모델링\논현역\(B010)수치지도_37705091_2022_00000452529185\N3A_C0390000.shp"
"C:\Users\BaekInchan\Desktop\설계스튜디오9_졸업설계\맵모델링\논현역\(B010)수치지도_37705091_2022_00000452529185\N3A_C0423365.shp"
"C:\Users\BaekInchan\Desktop\설계스튜디오9_졸업설계\맵모델링\논현역\(B010)수치지도_37705091_2022_00000452529185\N3A_C0430000.shp"
"C:\Users\BaekInchan\Desktop\설계스튜디오9_졸업설계\맵모델링\논현역\(B010)수치지도_37705091_2022_00000452529185\N3A_D0010000.shp"
"C:\Users\BaekInchan\Desktop\설계스튜디오9_졸업설계\맵모델링\논현역\(B010)수치지도_37705091_2022_00000452529185\N3A_E0010001.shp"
"C:\Users\BaekInchan\Desktop\설계스튜디오9_졸업설계\맵모델링\논현역\(B010)수치지도_37705091_2022_00000452529185\N3A_E0032111.shp"
"C:\Users\BaekInchan\Desktop\설계스튜디오9_졸업설계\맵모델링\논현역\(B010)수치지도_37705091_2022_00000452529185\N3A_E0052114.shp"
"C:\Users\BaekInchan\Desktop\설계스튜디오9_졸업설계\맵모델링\논현역\(B010)수치지도_37705091_2022_00000452529185\N3A_G0010000.shp"
"C:\Users\BaekInchan\Desktop\설계스튜디오9_졸업설계\맵모델링\논현역\(B010)수치지도_37705091_2022_00000452529185\N3A_G0020000.shp"
"C:\Users\BaekInchan\Desktop\설계스튜디오9_졸업설계\맵모델링\논현역\(B010)수치지도_37705091_2022_00000452529185\N3L_A0010000.shp"
"C:\Users\BaekInchan\Desktop\설계스튜디오9_졸업설계\맵모델링\논현역\(B010)수치지도_37705091_2022_00000452529185\N3L_A0020000.shp"
"C:\Users\BaekInchan\Desktop\설계스튜디오9_졸업설계\맵모델링\논현역\(B010)수치지도_37705091_2022_00000452529185\N3L_A0033330.shp"
"C:\Users\BaekInchan\Desktop\설계스튜디오9_졸업설계\맵모델링\논현역\(B010)수치지도_37705091_2022_00000452529185\N3L_A0150000.shp"
"C:\Users\BaekInchan\Desktop\설계스튜디오9_졸업설계\맵모델링\논현역\(B010)수치지도_37705091_2022_00000452529185\N3L_A0171119.shp"
"C:\Users\BaekInchan\Desktop\설계스튜디오9_졸업설계\맵모델링\논현역\(B010)수치지도_37705091_2022_00000452529185\N3L_B0020000.shp"
"C:\Users\BaekInchan\Desktop\설계스튜디오9_졸업설계\맵모델링\논현역\(B010)수치지도_37705091_2022_00000452529185\N3L_C0050000.shp"
"C:\Users\BaekInchan\Desktop\설계스튜디오9_졸업설계\맵모델링\논현역\(B010)수치지도_37705091_2022_00000452529185\N3L_C0060000.shp"
"C:\Users\BaekInchan\Desktop\설계스튜디오9_졸업설계\맵모델링\논현역\(B010)수치지도_37705091_2022_00000452529185\N3L_C0070000.shp"
"C:\Users\BaekInchan\Desktop\설계스튜디오9_졸업설계\맵모델링\논현역\(B010)수치지도_37705091_2022_00000452529185\N3L_C0520000.shp"
"C:\Users\BaekInchan\Desktop\설계스튜디오9_졸업설계\맵모델링\논현역\(B010)수치지도_37705091_2022_00000452529185\N3L_E0020000.shp"
"C:\Users\BaekInchan\Desktop\설계스튜디오9_졸업설계\맵모델링\논현역\(B010)수치지도_37705091_2022_00000452529185\N3L_F0010000.shp"
"C:\Users\BaekInchan\Desktop\설계스튜디오9_졸업설계\맵모델링\논현역\(B010)수치지도_37705091_2022_00000452529185\N3L_F0030000.shp"
"C:\Users\BaekInchan\Desktop\설계스튜디오9_졸업설계\맵모델링\논현역\(B010)수치지도_37705091_2022_00000452529185\N3L_F0040000.shp"
"C:\Users\BaekInchan\Desktop\설계스튜디오9_졸업설계\맵모델링\논현역\(B010)수치지도_37705091_2022_00000452529185\N3L_G0030000.shp"
"C:\Users\BaekInchan\Desktop\설계스튜디오9_졸업설계\맵모델링\논현역\(B010)수치지도_37705091_2022_00000452529185\N3L_H0010000.shp"
"C:\Users\BaekInchan\Desktop\설계스튜디오9_졸업설계\맵모델링\논현역\(B010)수치지도_37705091_2022_00000452529185\N3P_A0131122.shp"
"C:\Users\BaekInchan\Desktop\설계스튜디오9_졸업설계\맵모델링\논현역\(B010)수치지도_37705091_2022_00000452529185\N3P_C0380000.shp"
"C:\Users\BaekInchan\Desktop\설계스튜디오9_졸업설계\맵모델링\논현역\(B010)수치지도_37705091_2022_00000452529185\N3P_D0030000.shp"
"C:\Users\BaekInchan\Desktop\설계스튜디오9_졸업설계\맵모델링\논현역\(B010)수치지도_37705091_2022_00000452529185\N3P_E0042326.shp"
"C:\Users\BaekInchan\Desktop\설계스튜디오9_졸업설계\맵모델링\논현역\(B010)수치지도_37705091_2022_00000452529185\N3P_F0020000.shp"
"C:\Users\BaekInchan\Desktop\설계스튜디오9_졸업설계\맵모델링\논현역\(B010)수치지도_37705091_2022_00000452529185\N3P_H0020000.shp"
""")
# 길
panel_6 = Panel("A0070000")  # disabled
toggle = BooleanToggle(True)
python = GhPythonScript(x="N3A_B0010000", shapeFile=panel)  # -> out, a, ans; inputs shapeFile: list
# ---------- python: Python ----------
__author__ = "BaekInchan"
__version__ = "2024.03.23"

import rhinoscriptsyntax as rs


a = []

for i in shapeFile : 
    if(i[0] == '"') : i = i[1 :]
    if(i[-1] == '"') : i = i[:-1]
    #if(i.split("\\")[-1].split("_")[0][-1] == 'P') : continue; 
    a.append(i)

ans = ""

for i in a : 
    if x in i : 
        ans = i
        break
# ---------- end python ----------
toggle_2 = BooleanToggle(True)
toggle_3 = BooleanToggle(True)
toggle_4 = BooleanToggle(True)
toggle_5 = BooleanToggle(True)
python_2 = GhPythonScript(x="A0010000", shapeFile=panel_2)  # -> out, a, ans; inputs shapeFile: list; same code as python
python_3 = GhPythonScript(x="A0010000", shapeFile=panel_4)  # -> out, a, ans; inputs shapeFile: list; same code as python
python_4 = GhPythonScript(x="A0010000", shapeFile=panel_3)  # -> out, a, ans; inputs shapeFile: list; same code as python
python_5 = GhPythonScript(x="A0010000", shapeFile=panel_5)  # -> out, a, ans; inputs shapeFile: list; same code as python
imp_it = ImpIt(ShapefileShpPath=python.ans, Project2WGS84=False, TrueOrFalse=toggle)  # -> Shapes, Features
imp_it_2 = ImpIt(ShapefileShpPath=python_2.ans, Project2WGS84=False, TrueOrFalse=toggle_2)  # -> Shapes, Features
imp_it_3 = ImpIt(ShapefileShpPath=python_3.ans, Project2WGS84=False, TrueOrFalse=toggle_3)  # -> Shapes, Features
imp_it_4 = ImpIt(ShapefileShpPath=python_4.ans, Project2WGS84=False, TrueOrFalse=toggle_4)  # -> Shapes, Features
imp_it_5 = ImpIt(ShapefileShpPath=python_5.ans, Project2WGS84=False, TrueOrFalse=toggle_5)  # -> Shapes, Features
item = ListItem(List=imp_it.Features, Index=Slider(3, range=0..10), Wrap=True)
item_2 = ListItem(List=imp_it_2.Features, Index=Slider(5, range=0..10), Wrap=True)
item_3 = ListItem(List=imp_it_3.Features, Index=Slider(5, range=0..100), Wrap=True)
item_4 = ListItem(List=imp_it_4.Features, Index=Slider(5, range=0..100), Wrap=True)
item_5 = ListItem(List=imp_it_5.Features, Index=Slider(5, range=0..100), Wrap=True)
datavis_it = DataVisIt(Shapes=imp_it.Shapes, GetValueofFeature=item, TrueOrFalse=toggle)  # -> Polygon, Polyline, Point, AttValues
panel_7 = Panel(imp_it_2.Features)
datavis_it_2 = DataVisIt(Shapes=imp_it_2.Shapes, GetValueofFeature=item_2, TrueOrFalse=toggle_2)  # -> Polygon, Polyline, Point, AttValues
datavis_it_3 = DataVisIt(Shapes=imp_it_3.Shapes, GetValueofFeature=item_3, TrueOrFalse=toggle_3)  # -> Polygon, Polyline, Point, AttValues
datavis_it_4 = DataVisIt(Shapes=imp_it_4.Shapes, GetValueofFeature=item_4, TrueOrFalse=toggle_4)  # -> Polygon, Polyline, Point, AttValues
datavis_it_5 = DataVisIt(Shapes=imp_it_5.Shapes, GetValueofFeature=item_5, TrueOrFalse=toggle_5)  # -> Polygon, Polyline, Point, AttValues
panel_8 = Panel("""W
C
L
P""")
item_6 = ListItem(List=datavis_it.Polygon, Index=0, Wrap=True)  # -> flatten(Item)
python_6 = GhPythonScript(x=datavis_it.AttValues)  # -> out, a; inputs x: list
# ---------- python_6: Python ----------
__author__ = "BaekInchan"
__version__ = "2024.04.05"

P = ["교육연구시설", "종교시설", "운동시설", "문화및집회시설", "노유자(노인및어린이)시설"]
C = ["근린생활시설", "판매시설"]
L = ["주택", "숙박시설"]
W = ["자동차관련시설", "기타시설", "공장", "운수시설", "업무시설", "위험물저장및처리시설", "분뇨및쓰레기처리시설", "의료시설"]

import rhinoscriptsyntax as rs

dict = {}

for i in P : 
    dict[i] = 'P'
for i in C : 
    dict[i] = 'C'
for i in L : 
    dict[i] = 'L'
for i in W : 
    dict[i] = 'W'

a = []
cnt = 0
for i in x : 
    if i in dict : a.append(dict[i])
    else : 
        a.append(NULL)
# ---------- end python_6 ----------
panel_9 = Panel(datavis_it_2.AttValues)
crv = Curve(datavis_it_2.Polygon)
crv_2 = Curve(datavis_it_3.Polygon)
crv_3 = Curve(datavis_it_4.Polygon)
crv_4 = Curve(datavis_it_5.Polygon)
mindex = MemberIndex(Set=flatten(python_6.a), Member=panel_8)  # -> Index, Count
merge = Merge(Data1=crv, Data2=crv_2, Data3=crv_3, Data4=crv_4)  # -> flatten(Result)
item_7 = ListItem(List=item_6, Index=mindex.Index, Wrap=True)
crv_5 = Curve([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])
crv_6 = Curve([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])
runion = RegionUnion(Curves=merge)
runion_2 = RegionUnion(Curves=crv_5)
runion_3 = RegionUnion(Curves=crv_6)
tstat = TreeStatistics(Tree=item_7)  # -> Paths, Length, Count
redpline = Reduce(Polyline=runion, Tolerance=Slider(1, range=0..10))  # -> Polyline, Reduction
explode = Explode(Curve=runion_3, Recursive=True)  # -> Segments, Vertices
redpline_2 = Reduce(Polyline=runion_2, Tolerance=1)  # -> Polyline, Reduction
redpline_3 = Reduce(Polyline=runion_3, Tolerance=1)  # -> Polyline, Reduction
item_8 = ListItem(List=tstat.Paths, Index=0, Wrap=True)  # -> Item, Item1, Item2, Item3
join = JoinCurves(Curves=redpline.Polyline, Preserve=False)
crv_7 = Curve([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])
join_2 = JoinCurves(Curves=redpline_2.Polyline, Preserve=False)
join_3 = JoinCurves(Curves=redpline_3.Polyline, Preserve=False)
boundary = BoundarySurfaces(Edges=join_2)
runion_4 = RegionUnion(Curves=crv_7)
boundary_2 = BoundarySurfaces(Edges=join_3)
branch = TreeBranch(Tree=item_7, Path=item_8.Item3, MaintainPaths=True)
branch_2 = TreeBranch(Tree=item_7, Path=item_8.Item, MaintainPaths=True)
branch_3 = TreeBranch(Tree=item_7, Path=item_8.Item1, MaintainPaths=True)
branch_4 = TreeBranch(Tree=item_7, Path=item_8.Item2, MaintainPaths=True)
redpline_4 = Reduce(Polyline=runion_4, Tolerance=1)  # -> Polyline, Reduction
crv_8 = Curve(branch_2)
crv_9 = Curve(branch)
crv_10 = Curve(branch_3)
crv_11 = Curve(branch_4)
join_4 = JoinCurves(Curves=redpline_4.Polyline, Preserve=False)
preview = CustomPreview(Geometry=crv_9, Material=ColourSwatch(SwatchColor=RGB(52, 39, 242)))
preview_2 = CustomPreview(Geometry=crv_8, Material=ColourSwatch(SwatchColor=RGB(188, 39, 242)))
preview_3 = CustomPreview(Geometry=crv_10, Material=ColourSwatch(SwatchColor=RGB(229, 242, 39)))
preview_4 = CustomPreview(Geometry=crv_11, Material=ColourSwatch(SwatchColor=RGB(242, 39, 39)))
