# Grasshopper definition arrow.gh (Grasshopper 1.0.7)

number_slider = Slider(4728, range=0..10000)
brep = Brep(<brep referenced from the Rhino model>)
crv = Curve(<curve referenced from the Rhino model>)
divlength = DivideLength(Length=Slider(10000, range=0..10000))  # -> Points, Tangents, Parameters
debrep = DeconstructBrep(Brep=brep)  # -> Faces, Edges, Vertices
intcrv = Interpolate(Vertices=divlength.Points, Degree=3, Periodic=False, KnotStyle=1)  # -> Curve, Length, Domain
fit = FitCurve(Curve=crv)
number_slider_2 = Slider(4, range=0..10)
number_slider_3 = Slider(0.06, range=0..1)
number_slider_4 = Slider(2, range=0..10)
number_slider_5 = Slider(0, range=0..1000)
pgroups = PointGroups(Points=debrep.Vertices, Distance=Slider(5000, range=0..10000))  # -> Groups, Indices
number_slider_6 = Slider(0.01, range=0..0.01)
number_slider_7 = Slider(2, range=0..10)
number_slider_8 = Slider(4, range=0..10)
number_slider_9 = Slider(0.01, range=0..0.01)
panel = Panel("""0
1""")
crv_2 = Curve(<curve referenced from the Rhino model>)
panel_2 = Panel("""0
1""")
avr = Average(Input=pgroups.Groups)
panel_3 = Panel("0")
panel_4 = Panel("1")
crv_3 = Curve(<curve referenced from the Rhino model>)
crv_4 = Curve(<curve referenced from the Rhino model>)
neg = Negative(Value=number_slider_2)
number_slider_10 = Slider(4000, range=0..10000)
xy = XYPlane(Origin=Point(0, 0, 0))
neg_2 = Negative(Value=number_slider_3)
number_slider_11 = Slider(8000, range=0..10000)
neg_3 = Negative(Value=number_slider_8)
neg_4 = Negative(Value=number_slider_7)
number_slider_12 = Slider(2000, range=0..10000)
eval = EvaluateCurve(Curve=reparameterize(crv_2), Parameter=panel)  # -> Point, Tangent, Angle
offset = OffsetCurve(Curve=crv_2, Distance=[number_slider_2, neg], Corners=1)
eval_2 = EvaluateCurve(Curve=reparameterize(crv), Parameter=panel_2)  # -> Point, Tangent, Angle
offset_2 = OffsetCurve(Curve=crv, Distance=[number_slider_3, neg_2], Plane=xy, Corners=1)
eval_3 = EvaluateCurve(Curve=reparameterize(crv_3), Parameter="0")  # -> Point, Tangent, Angle
eval_4 = EvaluateCurve(Curve=reparameterize(crv_4), Parameter="1")  # -> Point, Tangent, Angle
offset_3 = OffsetCurve(Curve=crv_3, Distance=[number_slider_8, neg_3], Corners=1)
offset_4 = OffsetCurve(Curve=crv_4, Distance=[number_slider_7, neg_4], Corners=1)
item = ListItem(List=eval.Tangent, Index=0, Wrap=True)  # -> Item, Item1
item_2 = ListItem(List=eval_2.Tangent, Index=0, Wrap=True)  # -> Item, Item1
xy_2 = XYPlane(Origin=eval.Point)
xy_3 = XYPlane(Origin=eval_2.Point)
rev = Reverse(Vector=eval_3.Tangent)
rev_2 = Reverse(Vector=item.Item)
xy_4 = XYPlane(Origin=eval_3.Point)
xy_5 = XYPlane(Origin=eval_4.Point)
rev_3 = Reverse(Vector=item_2.Item)
merge = Merge(Data1=rev_2, Data2=item.Item1)
merge_2 = Merge(Data1=rev_3, Data2=item_2.Item1)
align = AlignPlane(Plane=xy_2, Direction=merge)  # -> Plane, Angle
align_2 = AlignPlane(Plane=xy_3, Direction=merge_2)  # -> Plane, Angle
align_3 = AlignPlane(Plane=xy_4, Direction=rev)  # -> Plane, Angle
align_4 = AlignPlane(Plane=xy_5, Direction=eval_4.Tangent)  # -> Plane, Angle
polygon = Polygon(Plane=align.Plane, Radius=Slider(12, range=0..100), Segments=Slider(3, range=0..10), FilletRadius=0)  # -> Polygon, Length
polygon_2 = Polygon(Plane=align_2.Plane, Radius=Slider(0.21, range=0..1), Segments=Slider(3, range=0..10), FilletRadius=0)  # -> Polygon, Length
polygon_3 = Polygon(Plane=align_3.Plane, Radius=Slider(12, range=0..100), Segments=Slider(3, range=0..10), FilletRadius=0)  # -> Polygon, Length
polygon_4 = Polygon(Plane=align_4.Plane, Radius=Slider(5, range=0..100), Segments=Slider(3, range=0..10), FilletRadius=0)  # -> Polygon, Length
loft = Loft(Curves=flatten(offset), Options={Adjust=False, Closed=False, LoftEnds=0, LoftSimp=0, LoftType=0, Rebuild=10, Refit=0.01})
boundary = BoundarySurfaces(Edges=flatten(polygon.Polygon))
loft_2 = Loft(
    Curves=flatten(offset_2),
    Options={Adjust=False, Closed=False, LoftEnds=0, LoftSimp=0, LoftType=0, Rebuild=10, Refit=0.01})
boundary_2 = BoundarySurfaces(Edges=flatten(polygon_2.Polygon))
loft_3 = Loft(
    Curves=flatten(offset_3),
    Options={Adjust=False, Closed=False, LoftEnds=0, LoftSimp=0, LoftType=0, Rebuild=10, Refit=0.01})
loft_4 = Loft(
    Curves=flatten(offset_4),
    Options={Adjust=False, Closed=False, LoftEnds=0, LoftSimp=0, LoftType=0, Rebuild=10, Refit=0.01})
boundary_3 = BoundarySurfaces(Edges=flatten(polygon_3.Polygon))
boundary_4 = BoundarySurfaces(Edges=flatten(polygon_4.Polygon))
runion = RegionUnion(Curves=flatten([boundary, loft]))
runion_2 = RegionUnion(Curves=flatten([boundary_2, loft_2]))
runion_3 = RegionUnion(Curves=flatten([boundary_3, loft_3]))
runion_4 = RegionUnion(Curves=flatten([boundary_4, loft_4]))
crv_5 = Curve(runion)
crv_6 = Curve(runion_2)
boundary_5 = BoundarySurfaces(Edges=flatten(crv_6))
crv_7 = Curve(runion_3)
crv_8 = Curve(runion_4)
pt = Point(<point referenced from the Rhino model>)
xy_6 = XYPlane(Origin=Point(0, 0, 0))
number_slider_13 = Slider(11000, range=0..100000)
pl_origin = PlaneOrigin(Base=xy_6, Origin=pt)
cone = Cone(Base=pl_origin, Radius=Slider(38586, range=0..100000), Length=Slider(361552, range=0..1000000))  # -> Cone, Tip
cap = CapHoles(Brep=cone.Cone)
