# Grasshopper definition closest curve circle diameter.gh (Grasshopper 1.0.7)

number_slider = Slider(10, range=0..10)
cir = Circle(Plane=PlaneXY(0, 0, 0), Radius=Slider(3, range=0..10))
rectangle = Rectangle(Plane=PlaneXY(0, 0, 0), XSize=number_slider, YSize=number_slider, Radius=0)  # -> Rectangle, Length
arrrec = RectangularArray(Geometry=cir, Cell=rectangle.Rectangle, XCount=Slider(22, range=0..100), YCount=Slider(12, range=0..100))  # -> Geometry, Transform
area = Area(Geometry=arrrec.Geometry)  # -> Area, Centroid
crv = Curve(<curve referenced from the Rhino model>)
boundary = BoundarySurfaces(Edges=arrrec.Geometry)
crv_cp = CurveClosestPoint(Point=area.Centroid, Curve=crv)  # -> Point, Parameter, Distance
bnd = Bounds(Numbers=crv_cp.Distance)
dom = ConstructDomain(DomainStart=Slider(5, range=0..10), DomainEnd=Slider(1, range=0..10))
preview = CustomPreview(Geometry=boundary, Material=ColourSwatch(SwatchColor=RGB(117, 144, 217)))
remap = RemapNumbers(Value=crv_cp.Distance, Source=bnd, Target=dom)  # -> Mapped, Clipped
cir_2 = Circle(Plane=area.Centroid, Radius=remap.Mapped)
bnd_2 = Bounds(Numbers=remap.Mapped)
dedomain = DeconstructDomain(Domain=bnd_2)  # -> Start, End
boundary_2 = BoundarySurfaces(Edges=cir_2)
gradient = Gradient(
    LowerLimit=dedomain.Start,
    UpperLimit=dedomain.End,
    Parameter=remap.Mapped,
    stops=[0: RGB(255, 130, 160), 0: RGB(56, 129, 233), 1: RGB(220, 0, 40)])
preview_2 = CustomPreview(Geometry=boundary_2, Material=gradient)
