# Grasshopper definition closest curve circle diameter_3D.gh (Grasshopper 1.0.7)

number_slider = Slider(60, range=0..100)
crv = Curve(<curve referenced from the Rhino model>)
range = Range(Domain=Domain(0, 1), Steps=number_slider)
divide = DivideCurve(Curve=crv, Count=number_slider, Kinks=False)  # -> Points, Tangents, Parameters
graph = GraphMapper(range, x0=0, x1=1, y0=0, y1=1, container_name="Sine", Equation_px=[0, 0.1989131272], Equation_py=[0, 0.9869561791])
bnd = Bounds(Numbers=graph)
dom = ConstructDomain(DomainStart=Slider(-25, range=-50..50), DomainEnd=Slider(29, range=-50..50))
remap = RemapNumbers(Value=graph, Source=Domain(0, 1), Target=dom)  # -> Mapped, Clipped
Y = UnitY(Factor=remap.Mapped)
move = Move(Geometry=divide.Points, Motion=Y)  # -> Geometry, Transform
graph_2 = GraphMapper(range, x0=0, x1=1, y0=0, y1=1, container_name="Gaussian", factor=0.2, mean=0.5, sdev=0.1)
bnd_2 = Bounds(Numbers=graph_2)
dom_2 = ConstructDomain(DomainStart=Slider(40, range=-50..50), DomainEnd=Slider(-25, range=-50..50))
crv_2 = Curve(<curve referenced from the Rhino model>)
remap_2 = RemapNumbers(Value=graph_2, Source=Domain(0, 1), Target=dom_2)  # -> Mapped, Clipped
crv_3 = Curve(<curve referenced from the Rhino model>)
Z = UnitZ(Factor=remap_2.Mapped)
move_2 = Move(Geometry=move.Geometry, Motion=Z)  # -> Geometry, Transform
xz = XZPlane(Origin="0, 0, 9")
number_slider_2 = Slider(22, range=0..100)
number_slider_3 = Slider(12, range=0..100)
number_slider_4 = Slider(45, range=0..100)
number_slider_5 = Slider(15, range=0..100)
divide_2 = DivideCurve(Curve=crv_2, Count=Slider(60, range=0..100), Kinks=False)  # -> Points, Tangents, Parameters
cir = Circle(Plane=PlaneXY(0, 0, 0), Radius=Slider(3, range=0..10))
rectangle = Rectangle(Plane=PlaneXY(0, 0, 0), XSize=Slider(11, range=0..100), YSize=Slider(15, range=0..100), Radius=0)  # -> Rectangle, Length
cir_2 = Circle(Plane=xz, Radius=Slider(3, range=0..10))
rectangle_2 = Rectangle(Plane=xz, XSize=Slider(11, range=0..100), YSize=Slider(15, range=0..100), Radius=0)  # -> Rectangle, Length
Z_2 = UnitZ(Factor=1)
intcrv = Interpolate(Vertices=move_2.Geometry, Degree=3, Periodic=False, KnotStyle=1)  # -> Curve, Length, Domain
Y_2 = UnitY(Factor=1)
arrrec = RectangularArray(Geometry=cir, Cell=rectangle.Rectangle, XCount=number_slider_4, YCount=number_slider_5)  # -> Geometry, Transform
arrrec_2 = RectangularArray(Geometry=cir_2, Cell=rectangle_2.Rectangle, XCount=number_slider_4, YCount=number_slider_5)  # -> Geometry, Transform
xy = XYPlane(Origin=Point(0, 0, 0))
rev = Reverse(Vector=Y_2)
rev_2 = Reverse(Vector=Z_2)
crv_4 = Curve(crv_2)
area = Area(Geometry=arrrec.Geometry)  # -> Area, Centroid
project = Project(Geometry=crv_4, Plane=xy)  # -> Geometry, Transform
xz_2 = XZPlane(Origin=Point(0, 0, 0))
project_2 = ProjectPoint(Point=move_2.Geometry, Direction=rev_2, Geometry=project.Geometry)  # -> Point, Index
boundary = BoundarySurfaces(Edges=arrrec.Geometry)
crv_cp = CurveClosestPoint(Point=area.Centroid, Curve=project.Geometry)  # -> Point, Parameter, Distance
crv_5 = Curve(crv_2)
area_2 = Area(Geometry=arrrec_2.Geometry)  # -> Area, Centroid
dom_3 = ConstructDomain(DomainStart=Slider(5, range=0..10), DomainEnd=Slider(1, range=0..10))
project_3 = Project(Geometry=crv_5, Plane=xz_2)  # -> Geometry, Transform
project_4 = ProjectPoint(Point=move_2.Geometry, Direction=rev, Geometry=project_3.Geometry)  # -> Point, Index
xy_2 = XYPlane(Origin=Point(0, 0, 0))
bnd_3 = Bounds(Numbers=crv_cp.Distance)
ln = Line(StartPoint=move_2.Geometry, EndPoint=project_4.Point)
ln_2 = Line(StartPoint=move_2.Geometry, EndPoint=project_2.Point)
boundary_2 = BoundarySurfaces(Edges=arrrec_2.Geometry)
crv_cp_2 = CurveClosestPoint(Point=area_2.Centroid, Curve=project_3.Geometry)  # -> Point, Parameter, Distance
preview = CustomPreview(Geometry=boundary, Material=ColourSwatch(SwatchColor=RGB(117, 144, 217)))
remap_3 = RemapNumbers(Value=crv_cp.Distance, Source=bnd_3, Target=dom_3)  # -> Mapped, Clipped
bnd_4 = Bounds(Numbers=crv_cp_2.Distance)
dom_4 = ConstructDomain(DomainStart=Slider(5, range=0..10), DomainEnd=Slider(1, range=0..10))
merge = Merge(Data1=ln, Data2=ln_2)
pl_origin = PlaneOrigin(Base=xz_2, Origin=area_2.Centroid)
bnd_5 = Bounds(Numbers=remap_3.Mapped)
cir_3 = Circle(Plane=area.Centroid, Radius=remap_3.Mapped)
preview_2 = CustomPreview(Geometry=boundary_2, Material=ColourSwatch(SwatchColor=RGB(117, 144, 217)))
remap_4 = RemapNumbers(Value=crv_cp_2.Distance, Source=bnd_4, Target=dom_4)  # -> Mapped, Clipped
dedomain = DeconstructDomain(Domain=bnd_5)  # -> Start, End
cir_4 = Circle(Plane=pl_origin, Radius=remap_4.Mapped)
bnd_6 = Bounds(Numbers=remap_4.Mapped)
boundary_3 = BoundarySurfaces(Edges=cir_3)
gradient = Gradient(
    LowerLimit=dedomain.Start,
    UpperLimit=dedomain.End,
    Parameter=remap_3.Mapped,
    stops=[0: RGB(255, 255, 255), 1: RGB(128, 128, 255), 1: RGB(128, 128, 128), 1: RGB(198, 77, 33)])
dedomain_2 = DeconstructDomain(Domain=bnd_6)  # -> Start, End
gradient_2 = Gradient(
    LowerLimit=dedomain_2.Start,
    UpperLimit=dedomain_2.End,
    Parameter=remap_4.Mapped,
    stops=[0: RGB(255, 255, 255), 1: RGB(128, 128, 255), 1: RGB(128, 128, 128), 1: RGB(198, 77, 33)])
boundary_4 = BoundarySurfaces(Edges=cir_4)
preview_3 = CustomPreview(Geometry=boundary_3, Material=gradient)
preview_4 = CustomPreview(Geometry=boundary_4, Material=gradient_2)
