# Grasshopper definition people_random_arrangement.gh (Grasshopper 1.0.7)

brep = Brep([<brep referenced from the Rhino model> x11])
debrep = DeconstructBrep(Brep=brep)  # -> Faces, Edges, Vertices
area = Area(Geometry=debrep.Faces)  # -> Area, Centroid
pdecon = Deconstruct(Point=area.Centroid)  # -> XComponent, YComponent, ZComponent
sort = SortList(Keys=pdecon.ZComponent, ValuesA=debrep.Faces)  # -> Keys, reverse(ValuesA)
item = ListItem(List=sort.ValuesA, Index=0, Wrap=True)
edges = BrepEdges(Brep=item)  # -> Naked, Interior, NonManifold
join = JoinCurves(Curves=edges.Naked, Preserve=False)
len = Length(Curve=join)
sort_2 = SortList(Keys=len, ValuesA=join)  # -> Keys, ValuesA
Z = UnitZ(Factor=Slider(1200, range=0..10000))
item_2 = ListItem(List=sort_2.ValuesA, Index=0, Wrap=True)
extr = Extrude(Base=item_2, Direction=Z)
crv = Curve(item_2)
move = Move(Geometry=item_2, Motion=Z)  # -> Geometry, Transform
join_2 = JoinCurves(Curves=flatten(crv), Preserve=False)
number_slider = Slider(1.1, range=0..10)
random = Random(Range="1 to 2", Number=Slider(10, range=0..10), Seed=2)
area_2 = Area(Geometry=join_2)  # -> Area, Centroid
divlength = DivideLength(Curve=item_2, Length=Slider(2000, range=0..10000))  # -> Points, Tangents, Parameters
pipe = Pipe(Curve=move.Geometry, Radius=Slider(40, range=0..100), Caps=0)
scale = Scale(Geometry=join_2, Center=area_2.Centroid, Factor=random)  # -> Geometry, Transform
number_slider_2 = Slider(62, range=0..1000)
cir = Circle(Plane=divlength.Points, Radius=Slider(20, range=0..100))
move_2 = Move(Geometry=cir, Motion=Z)  # -> Geometry, Transform
extr_2 = Extrude(Base=cir, Direction=Z)
divlength_2 = DivideLength(Curve=scale.Geometry, Length=Slider(2000, range=0..10000))  # -> flatten(Points), Tangents, Parameters
cap = CapHoles(Brep=extr_2)
multiplication = Multiplication(A=number_slider_2, B=Slider(272, range=0..1000))
lng = ListLength(List=divlength_2.Points)
mesh = Mesh(<mesh referenced from the Rhino model>)
random_2 = Random(Range=lng, Number=Slider(8, range=0..100), Seed=multiplication)
bbox = BoundingBox(Content=mesh, Plane=PlaneXY(0, 0, 0))  # -> Box, Box_2
int = Integer(random_2)
debrep_2 = DeconstructBrep(Brep=bbox.Box)  # -> Faces, Edges, Vertices
item_3 = ListItem(List=divlength_2.Points, Index=int, Wrap=True)
area_3 = Area(Geometry=debrep_2.Faces)  # -> Area, Centroid
pdecon_2 = Deconstruct(Point=area_3.Centroid)  # -> XComponent, YComponent, ZComponent
sort_3 = SortList(Keys=pdecon_2.ZComponent, ValuesA=debrep_2.Faces)  # -> Keys, ValuesA
item_4 = ListItem(List=sort_3.ValuesA, Index=0, Wrap=True)
area_4 = Area(Geometry=item_4)  # -> Area, Centroid
vec2pt = Vector2Pt(PointA=area_4.Centroid, PointB=item_3, Unitize=False)  # -> Vector, Length
move_3 = Move(Geometry=mesh, Motion=vec2pt.Vector)  # -> Geometry, Transform
xy = XYPlane(Origin=Point(0, 0, 0))
move_4 = Move(Geometry=area_4.Centroid, Motion=vec2pt.Vector)  # -> Geometry, Transform
pl_origin = PlaneOrigin(Base=xy, Origin=move_4.Geometry)
lng_2 = ListLength(List=move_3.Geometry)
random_3 = Random(Range="0 to 360", Number=lng_2, Seed=number_slider_2)
rotate = Rotate(Geometry=move_3.Geometry, Angle=random_3, Plane=pl_origin)  # -> Geometry, Transform
